vi "angle_mirr_azi.gvi"   [LabVIEW Communications System Design Suite 2.0.1]
inputs:
  "angle_in (deg)": f64
  "error_in": error
outputs:
  "angle_out (deg)": f64
  "error_out": error
diagram:
  Quotient And Remainder(x=$"angle_in (deg)", y=360) -> (x-y*floor(x/y)=w1)
  Is Greater Or Equal(x=w1, y=90) -> w2
  Is Less Or Equal(x=w1, y=270) -> w3
  Logical And(w2, w3) -> w4
  Is Greater(x=w1, y=270) -> w5
  Is Less(x=w1, y=360) -> w6
  Logical And(w5, w6) -> w7
  case (w4) {
    frame False, Default {
      # QI or QII
      case (w7) {
        frame False, Default {
          # Q1
          w8 = w1
        }
        frame True {
          # QII
          Subtract(x=w1, y=360) -> w8
        }
      }
    }
    frame True {
      # Q-III or IV
      Subtract(x=180, y=w1) -> w8
    }
  }
  $"angle_out (deg)" <- w8
  # NOTES:
  #
  # -- VI to wrap AOA, AOD to [0, 360] deg.
  # -- angles are also mirrored to be on the broadside of the antenna panel.
  $error_out <- $error_in
