vi "angle_mirr_azi_1D.gvi"   [LabVIEW Communications System Design Suite 2.0.1]
inputs:
  "angle_in (deg)": f64[]
  "error_in": error
outputs:
  "angle_out (deg)": f64[]
  "error_out": error
diagram:
  Quotient And Remainder(x=$"angle_in (deg)", y=360) -> (x-y*floor(x/y)=w1)
  Is Greater Or Equal(x=w1, y=90) -> w2
  Is Less Or Equal(x=w1, y=270) -> w3
  Logical And(w2, w3) -> w4
  Is Greater(x=w1, y=270) -> w5
  Is Less(x=w1, y=360) -> w6
  Logical And(w5, w6) -> w7
  for {
    w8 = each element of w4
    w9 = each element of w7
    w10 = each element of w1
    case (w8) {
      frame False, Default {
        # QI or QII
        case (w9) {
          frame False, Default {
            # Q1
            w12 = w10
          }
          frame True {
            # QII
            Subtract(x=w10, y=360) -> w12
          }
        }
      }
      frame True {
        # Q-III or IV
        Subtract(x=180, y=w10) -> w12
      }
    }
    append w12 to w11
  }
  $"angle_out (deg)" <- w11
  # NOTES:
  #
  # -- VI to wrap AOA, AOD to [0, 360] deg.
  # -- angles are also mirrored to be on the broadside of the antenna panel.
  $error_out <- $error_in
