vi "angle_mirr_azi_2D.gvi"   [LabVIEW Communications System Design Suite 2.0.1]
inputs:
  "angle_in (deg)": f64[][]
  "error_in": error
outputs:
  "angle_out (deg)": f64[][]
  "error_out": error
diagram:
  Quotient And Remainder(x=$"angle_in (deg)", y=360) -> (x-y*floor(x/y)=w1)
  Is Greater Or Equal(x=w1, y=90) -> w2
  Is Less Or Equal(x=w1, y=270) -> w3
  Logical And(w2, w3) -> w4
  Is Greater(x=w1, y=270) -> w5
  Is Less(x=w1, y=360) -> w6
  Logical And(w5, w6) -> w7
  for {
    w8 = each element of w4
    w9 = each element of w7
    w10 = each element of w1
    for {
      w12 = each element of w8
      w13 = each element of w9
      w14 = each element of w10
      case (w12) {
        frame False, Default {
          # QI or QII
          case (w13) {
            frame False, Default {
              # Q1
              w16 = w14
            }
            frame True {
              # QII
              Subtract(x=w14, y=360) -> w16
            }
          }
        }
        frame True {
          # Q-III or IV
          Subtract(x=180, y=w14) -> w16
        }
      }
      append w16 to w15
    }
    append w15 to w11
  }
  $"angle_out (deg)" <- w11
  # NOTES:
  #
  # -- VI to wrap AOA, AOD to [0, 360] deg.
  # -- angles are also mirrored to be on the broadside of the antenna panel.
  $error_out <- $error_in
