vi "angle_mirr_zen.gvi"   [LabVIEW Communications System Design Suite 2.0.1]
inputs:
  "angle_in (deg)": f64
  "error_in": error
outputs:
  "angle_out (deg)": f64
  "error_out": error
diagram:
  Quotient And Remainder(x=$"angle_in (deg)", y=360) -> (x-y*floor(x/y)=w1)
  Subtract(x=360, y=w1) -> w2
  Is Greater(x=w1, y=180) -> w3
  Select(s=w3, t=w2, f=w1) -> w4
  $"angle_out (deg)" <- w4
  # NOTES:
  #
  # -- VI to wrap ZOA, ZOD to [0, 360] deg.
  # -- angles are also mirrored to be on the broadside of the antenna panel.
  Is Less(x=w1, y=0) -> w5
  call "Build Error Cluster.gvi"(code=1, description="Invalid Zenith angle.\\n Zenith angles must be positive.", error in=$error_in) -> (error out=w6)
  Select(s=w5, t=w6, f=$error_in) -> w7
  $error_out <- w7
