vi "angle_mirr_zen_1D.gvi"   [LabVIEW Communications System Design Suite 2.0.1]
inputs:
  "angle_in (deg)": f64[]
  "error_in": error
outputs:
  "angle_out (deg)": f64[]
  "error_out": error
diagram:
  for {
    w1 = each element of $"angle_in (deg)"
    Quotient And Remainder(x=w1, y=360) -> (x-y*floor(x/y)=w3)
    Subtract(x=360, y=w3) -> w4
    Is Greater(x=w3, y=180) -> w5
    Select(s=w5, t=w4, f=w3) -> w6
    append w6 to w2
  }
  $"angle_out (deg)" <- w2
  # NOTES:
  #
  # -- VI to wrap ZOA, ZOD to [0, 360] deg.
  # -- angles are also mirrored to be on the broadside of the antenna panel.
  $error_out <- $error_in
