vi "angle_mirr_zen_2D.gvi"   [LabVIEW Communications System Design Suite 2.0.1]
inputs:
  "angle_in (deg)": f64[][]
  "error_in": error
outputs:
  "angle_out (deg)": f64[][]
  "error_out": error
diagram:
  for {
    w1 = each element of $"angle_in (deg)"
    for {
      w3 = each element of w1
      Quotient And Remainder(x=w3, y=360) -> (x-y*floor(x/y)=w5)
      Subtract(x=360, y=w5) -> w6
      Is Greater(x=w5, y=180) -> w7
      Select(s=w7, t=w6, f=w5) -> w8
      append w8 to w4
    }
    append w4 to w2
  }
  $"angle_out (deg)" <- w2
  # NOTES:
  #
  # -- VI to wrap ZOA, ZOD to [0, 360] deg.
  # -- angles are also mirrored to be on the broadside of the antenna panel.
  $error_out <- $error_in
