vi "angle_wrap_1D.gvi"   [LabVIEW Communications System Design Suite 2.0.1]
inputs:
  "angle": f64[]
outputs:
  "wrapped angle": f64[]
diagram:
  Quotient And Remainder(x=$angle, y=360) -> (x-y*floor(x/y)=w1)
  Subtract(x=360, y=w1) -> w2
  Is Greater Or Equal(x=w1, y=180) -> w3
  Is Less Or Equal(x=w1, y=360) -> w4
  Logical And(w3, w4) -> w5
  # NOTES:
  #
  # VI to wrap AOA, AOD, ZOA, ZOD to [0, 360] deg.
  # Angles are also mirrored to be on the braodside of the antenna panel.
  for {
    w6 = each element of w5
    w7 = each element of w2
    w8 = each element of w1
    Select(s=w6, t=w7, f=w8) -> w10
    append w10 to w9
  }
  $"wrapped angle" <- w9
