vi "apply_PL.gvi"   [LabVIEW Communications System Design Suite 2.0.1]
inputs:
  "UP_lnk_in": "UP_lnk.gtype" = {"Scenario LOS-NLOS"="UMi - Street Canyon (LOS)", "d_2D (m)"=50, "f_C (Hz)"=28, "phi_LOS,AOA"=24, "phi_LOS,AOD"=57, "theta_LOS,ZOA"=31, "theta_LOS,ZOD"=45, "d_rx,u"=[0, 0, 0], "d_tx,s"=[0, 0, 0]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}
  "LSP_in": "LSP.gtype"
  "SSP_in": "SSP.gtype"
  "error_in": error
outputs:
  "UP_lnk_out": "UP_lnk.gtype"
  "error out": error
  "SSP_out": "SSP.gtype"
  "LSP_out": "LSP.gtype"
types:
  T1 = cluster{"SF": f64, "K": f64, "DS": f64, "ASD": f64, "ASA": f64, "ZSD": f64, "ZSA": f64, "mu_XPR_dB": f64}
  T2 = cluster{"mu_SF_dB": f64, "sig_SF_dB": f64, "mu_K_dB": f64, "sig_K_dB": f64, "mu_lgDS": f64, "sig_lgDS": f64, "mu_lgASD": f64, "sig_lgASD": f64, "mu_lgASA": f64, "sig_lgASA": f64, "mu_lgZSD": f64, "sig_lgZSD": f64, "mu_lgZSA": f64, "sig_lgZSA": f64, "mu_XPR_dB": f64, "sig_XPR_dB": f64}
  "LSP.gtype" = cluster{"LSP": T1, "LSP_mu_sig": T2, "PL_dB": f64, "mu_PL_dB": f64, "LSP_map_LOS": f64[][][], "LSP_map_NLOS": f64[][][]}
  "SSP.gtype" = cluster{"N": i32, "M": i32, "tau_n": f64[], "tau_n,i": f64[], "P_n": f64[], "P_ray": f64[][], "phi_n_AOA": f64[], "phi_n,m,AOA": f64[][], "theta_n_ZOA": f64[], "theta_n,m,ZOA": f64[][], "phi_n_AOD": f64[], "phi_n,m,AOD": f64[][], "theta_n_ZOD": f64[], "theta_n,m,ZOD": f64[][], "phi_theta_n,m,cpl": f64[][][], "XPR": f64[][], "Phi_n,m,theta,theta": f64[][], "Phi_n,m,theta,phi": f64[][], "Phi_n,m,phi,theta": f64[][], "Phi_n,m,phi, phi": f64[][], "H_u,s,n,NLOS": c128[], "H_u,s,n,i,NLOS": c128[], "H_u,s,NLOS": c128, "H_u,s,1,LOS": c128, "H_u,s": c128, "H": c128[][], "H_u,s,n": c128[][][]}
  T3 = enum{"UMi - Street Canyon (LOS)", "UMi - Street Canyon (NLOS)"}
  T4 = cluster{"X_BS (m)": f64, "Y_BS (m)": f64, "h_BS (m)": f64, "Omega_BS,alpha": f64, "Omega_BS,beta": f64, "Omega_BS,gamma": f64, "zeta_tx": f64, "M,tx": i32, "N,tx": i32, "M_g,tx": i32, "N_g,tx": i32, "s": i32}
  T5 = cluster{"h_UT (m)": f64, "v": f64, "phi_v": f64, "theta_v": f64, "t": f64, "Omega_UT,alpha": f64, "Omega_UT,beta": f64, "Omega_UT,gamma": f64, "zeta_rx": f64, "Y_UT (m)": f64, "X_UT (m)": f64, "N,rx": i32, "M,rx": i32, "N_g,rx": i32, "M_g,rx": i32, "u": i32}
  "UP_lnk.gtype" = cluster{"Scenario LOS-NLOS": T3, "d_2D (m)": f64, "d_3D (m)": f64, "f_C (Hz)": f64, "lambda_0": f64, "phi_LOS,AOA": f64, "phi_LOS,AOD": f64, "theta_LOS,ZOA": f64, "theta_LOS,ZOD": f64, "BS": T4, "d_V_tx": f64, "d_H,tx": f64, "d_V_rx": f64, "d_H,rx": f64, "d_g,V,tx": f64, "d_g,H,tx": f64, "d_g,V,rx": f64, "d_g,H,rx": f64, "d_rx,u": f64[3], "d_tx,s": f64[3], "UT": T5}
diagram:
  $UP_lnk_out <- $UP_lnk_in
  Property Node(instance in=$SSP_in) -> ("H_u,s,n,NLOS"=w1, "H_u,s,n,i,NLOS"=w2, "H_u,s,NLOS"=w3, "H_u,s,1,LOS"=w4, "H_u,s"=w5, "H"=w6, "H_u,s,n"=w7, instance out=w8)
  Property Node(instance in=$LSP_in) -> ("PL_dB"=w9, instance out=w10)
  Multiply(w9, 0.1) -> w11
  Power Of 10(x=w11) -> w12
  Divide(x=w1, y=w12) -> w13
  Divide(x=w2, y=w12) -> w14
  Divide(x=w3, y=w12) -> w15
  Divide(x=w4, y=w12) -> w16
  Divide(x=w5, y=w12) -> w17
  Divide(x=w6, y=w12) -> w18
  Divide(x=w7, y=w12) -> w19
  Property Node(instance in=w8, "H_u,s,n,NLOS"=w13, "H_u,s,n,i,NLOS"=w14, "H_u,s,NLOS"=w15, "H_u,s,1,LOS"=w16, "H_u,s"=w17, "H"=w18, "H_u,s,n"=w19) -> (instance out=w20)
  $SSP_out <- w20
  $LSP_out <- w10
  Is Equal To 0(x=w12) -> w21
  call "Build Error Cluster.gvi"(code=2, description="Pathloss value is zero.", error in=$error_in) -> (error out=w22)
  Select(s=w21, t=w22, f=$error_in) -> w23
  $"error out" <- w23
