vi "azi_plotter.gvi"   [LabVIEW Communications System Design Suite 2.0.1]
inputs:
  "LOS angle (deg)": f64
  "cluster angle (rad)": f64[] = [4.70865550732, 8.70489644232, -9.21039051424, 11.5949043709, -2.08963648874]
outputs:
  "AOA": T1[]
types:
  T1 = cluster{"Element 1": c128[], "Element 2": c128[]}
diagram:
  call "calc_polar_coord.gvi"(angle (rad)=$"cluster angle (rad)") -> (polar coordinates=w1)
  Build Cluster(w1, w1) -> w2
  call "angle_mirr_azi.gvi"(angle_in (deg)=$"LOS angle (deg)") -> (angle_out (deg)=w3)
  Subtract(x=w3, y=180) -> w4
  for (N = 1) {
    append w4 to w5
  }
  call "conv_deg_to_rad_1D.gvi"(angle (deg)=w5) -> (angle (rad)=w6)
  Multiply(0+1i, w6) -> w7
  Exponential(x=w7) -> w8
  Build Cluster(w8, w8) -> w9
  Build Array(w2, w9) -> w10
  $AOA <- w10
