vi "beamtracking.gvi"   [LabVIEW Communications System Design Suite 2.0.1]
inputs:
  "UP_lnk_in": "UP_lnk.gtype"
  "error_in": error
  "SSP_in": "SSP.gtype"
  "LSP_in": "LSP.gtype"
outputs:
  "LSP_out": "LSP.gtype"
  "UP_lnk_out": "UP_lnk.gtype"
  "error_out": error
  "SSP_out": "SSP.gtype"
types:
  T1 = enum{"Pedestrian", "Cyclist", "City Motorist", "Freeway Motorist", "Train"}
  T2 = cluster{"Type": enum{"SB", "NSB"}, "Class (for NSB)": T1, "Location (X,Y,Z)": i32[], "Attenuation": f64, "Cl. No.": i32, "t": f64}
  T3 = cluster{"Blocker Info": T2[][], "No. of Blocked Cl. at time t": i32}
  T4 = cluster{"Cl. Attn. (ray aggr.)": f64, "No. of Blocked Rays": i32, "Ray Blocker Array": "blk_inf_ry_B.gtype"[], "Cl. No.": i32}
  "blk_inf_cl_B.gtype" = cluster{"Cluster Blocker Array": T4[], "No. of Blocked Cl. at time t": i32}
  "SSP.gtype" = cluster{"N": i32, "M": i32, "tau_n": f64[], "tau_n,i": f64[], "min(tau'_n)": f64, "P_n": f64[], "P_n,pre_blk": f64[], "P_n,m": f64[][], "phi_n_AOA": f64[], "phi_n,m,AOA": f64[][], "theta_n_ZOA": f64[], "theta_n,m,ZOA": f64[][], "phi_n_AOD": f64[], "phi_n,m,AOD": f64[][], "theta_n_ZOD": f64[], "theta_n,m,ZOD": f64[][], "phi_theta_n,m,cpl": f64[][][], "XPR": f64[][], "Phi_n,m,theta,theta": f64[][], "Phi_n,m,theta,phi": f64[][], "Phi_n,m,phi,theta": f64[][], "Phi_n,m,phi, phi": f64[][], "H_u,s,n,NLOS": c128[], "H_u,s,n,i,NLOS": c128[], "H_u,s,NLOS": c128, "H_u,s,1,LOS": c128, "H_u,s": c128, "H": c128[][], "H_u,s,n": c128[][][], "cl_sp_delay_map_LOS": f64[][][], "cl_sp_delay_map_NLOS": f64[][][], "cl_sp_shadowing_map_LOS": f64[][][], "cl_sp_shadowing_map_NLOS": f64[][][], "cl_sp_offset_AOD_map_LOS": f64[][][], "cl_sp_offset_AOD_map_NLOS": f64[][][], "cl_sp_offset_AOA_map_LOS": f64[][][], "cl_sp_offset_AOA_map_NLOS": f64[][][], "cl_sp_offset_ZOD_map_LOS": f64[][][], "cl_sp_offset_ZOD_map_NLOS": f64[][][], "cl_sp_offset_ZOA_map_LOS": f64[][][], "cl_sp_offset_ZOA_map_NLOS": f64[][][], "ray_XPR_map_LOS": f64[][][], "ray_XPR_map_NLOS": f64[][][], "ray_ini_phase_theta,phi_map_LOS": f64[][][], "ray_ini_phase_theta,theta_map_LOS": f64[][][], "pr_los_map": f64[][], "cl_sp_sign_AOD_map_LOS": i32[][][], "cl_sp_sign_AOD_map_NLOS": i32[][][], "cl_sp_sign_AOA_map_LOS": i32[][][], "cl_sp_sign_AOA_map_NLOS": i32[][][], "cl_sp_sign_ZOD_map_LOS": i32[][][], "cl_sp_sign_ZOD_map_NLOS": i32[][][], "cl_sp_sign_ZOA_map_LOS": i32[][][], "cl_sp_sign_ZOA_map_NLOS": i32[][][], "ray_ini_phase_phi,phi_map_LOS": f64[][][], "ray_ini_phase_phi,theta_map_LOS": f64[][][], "ray_ini_phase_theta,phi_map_NLOS": f64[][][], "ray_ini_phase_theta,theta_map_NLOS": f64[][][], "ray_ini_phase_phi,phi_map_NLOS": f64[][][], "ray_ini_phase_phi,theta_map_NLOS": f64[][][], "Xn_map": f64[][][], "H_sc": c128[][][], "tau_n_sc": f64[][], "P_n_sc": f64[][], "P_n_pre_blk_sc": f64[][], "blk_cnt_ang_map_LOS-NLOS": f64[][][], "Cluster Blockage Data (A)": T3, "Cluster Blockage Data (B)": "blk_inf_cl_B.gtype", "P_n,drv": f64[], "P_n,drv_sc": f64[][], "P_n,drv_pre_blk_sc": f64[][], "P_n,i": f64[]}
  T5 = cluster{"SF": f64, "K": f64, "DS": f64, "ASD": f64, "ASA": f64, "ZSD": f64, "ZSA": f64, "mu_XPR_dB": f64}
  T6 = cluster{"mu_SF_dB": f64, "sig_SF_dB": f64, "mu_K_dB": f64, "sig_K_dB": f64, "mu_lgDS": f64, "sig_lgDS": f64, "mu_lgASD": f64, "sig_lgASD": f64, "mu_lgASA": f64, "sig_lgASA": f64, "mu_lgZSD": f64, "sig_lgZSD": f64, "mu_lgZSA": f64, "sig_lgZSA": f64, "mu_XPR_dB": f64, "sig_XPR_dB": f64}
  "LSP.gtype" = cluster{"LSP": T5, "LSP_mu_sig": T6, "PL_dB": f64, "mu_PL_dB": f64, "LSP_map_LOS": f64[][][], "LSP_map_NLOS": f64[][][], "n_r,grd": i32, "n_c,grd": i32}
  T7 = enum{"UMi - Street Canyon (LOS)", "UMi - Street Canyon (NLOS)"}
  "blk_inf_UT_B.gtype" = "blk_inf_cl_B.gtype"[]
  T8 = enum{"A - Generic", "B - Generic", "B - Gramercy Park"}
  T9 = cluster{"Blockage Grid Margin-X": i32, "Blockage Grid Margin-Y": i32, "Blockage Parameters (B)": "UP_blk_B.gtype"[], "t_total_blk (s)": f64, "t_stp_blk (s)": f64}
  T10 = cluster{"Class (NSB)": T1, "Velocity": f64, "Count (K)": i32, "Blocker Trajectories": "trj_blk_B.gtype"[]}
  T11 = cluster{"Blockage Grid Margin-X": i32, "Blockage Grid Margin-Y": i32, "t_max_grd": f64, "t_res_grd": f64, "Blockage Parameters (A)": T10[], "d_res_grd": f64}
  "UP_BS.gtype" = cluster{"X_BS (m)": f64, "Y_BS (m)": f64, "h_BS (m)": f64, "Omega_BS,alpha": f64, "Omega_BS,beta": f64, "Omega_BS,gamma": f64, "zeta_tx": f64, "M,tx": i32, "N,tx": i32, "M_g,tx": i32, "N_g,tx": i32, "s": i32, "BF Parameters": "UP_bf.gtype"}
  T12 = cluster{"t": f64[], "C": i32[][], "d_2D": f64[], "d_3D": f64[], "V": f64[][], "v": f64[], "v_avg": f64}
  T13 = cluster{"X_UT (m)": i32, "Y_UT (m)": i32, "h_UT (m)": i32, "v": f64, "phi_v": f64, "theta_v": f64, "t": f64, "Omega_UT,alpha": f64, "Omega_UT,beta": f64, "Omega_UT,gamma": f64, "zeta_rx": f64, "N,rx": i32, "M,rx": i32, "N_g,rx": i32, "M_g,rx": i32, "u": i32, "Introduce Blockages?": bool, "Self-blocking Mode": bool, "X_UT_end": i32, "Y_UT_end": i32, "h_UT_end": i32, "step_std_X": f64, "step_std_Y": f64, "step_std_Z": f64, "t_total (s)": f64, "t_step (s)": f64, "UT_loc_curr": i32[], "trj_UT": T12, "Blockage Model": T8, "BF Parameters": "UP_bf.gtype"}
  "UP_lnk.gtype" = cluster{"Scenario LOS-NLOS": T7, "d_2D (m)": f64, "d_3D (m)": f64, "f_C (Hz)": f64, "lambda_0": f64, "phi_LOS,AOA": f64, "phi_LOS,AOD": f64, "theta_LOS,ZOA": f64, "theta_LOS,ZOD": f64, "d_V_tx": f64, "d_H,tx": f64, "d_V_rx": f64, "d_H,rx": f64, "d_g,V,tx": f64, "d_g,H,tx": f64, "d_g,V,rx": f64, "d_g,H,rx": f64, "d_rx,u": f64[3], "d_tx,s": f64[3], "Align BS-UT?": bool, "Introduce Blockages in System?": bool, "UT Blockage Data (A)": T2[][][], "UT Blockage Data (B)": "blk_inf_UT_B.gtype", "Blockage Model": T8, "Blockage Settings (B)": T9, "Blockage Settings (A)": T11, "BS": "UP_BS.gtype", "UT": T13}
uses:
  NI::Analysis::Generation::Ramp Pattern by Increment.gvi
diagram:
  $LSP_out <- $LSP_in
  Property Node(instance in=$UP_lnk_in) -> ("BS:BF Parameters"=w1, "UT:BF Parameters"=w2, "lambda_0"=w3, "BS:BF Parameters:d"=w4, "BS:Omega_BS,alpha"=w5, "BS:Omega_BS,beta"=w6, "BS:Omega_BS,gamma"=w7, "UT:Omega_UT,alpha"=w8, "UT:Omega_UT,beta"=w9, "UT:Omega_UT,gamma"=w10, instance out=w11)
  Property Node(instance in=$SSP_in) -> ("P_n"=w12, "phi_n_AOD"=w13, "theta_n_ZOD"=w14, "phi_n_AOA"=w15, "theta_n_ZOA"=w16, instance out=w17)
  Array Max And Min(array=w12) -> (max index(es)=w18)
  Array Index(array=w13) -> (out0[w18]=w19)
  Array Index(array=w14) -> (out0[w18]=w20)
  call "conv_gcs_lcs_spherical.gvi"(phi=w19, theta=w20, alpha=w5, beta=w6, gamma=w7) -> (phi'=w21, theta'=w22)
  # NOTES:
  #
  # -- sets the beam direction along the most powerful cluster
  Negate(x=PiOver2) -> w23
  call "Ramp Pattern by Increment.gvi"(increment=0.01, end=PiOver2, start=w23, error in=$error_in) -> (ramp pattern=w24, error out=w25)
  call "Ramp Pattern by Increment.gvi"(increment=0.01, end=Pi, start=0, error in=$error_in) -> (ramp pattern=w26, error out=w27)
  for {
    w28 = each element of w24
    # phi loop
    for {
      w30 = each element of w26
      # theta loop
      s1 = 0+0i  # shift register
      for {
        w32 = each element of w4
        # antenna element loop
        Reciprocal(x=w3) -> w33
        # w3: lambda_0
        # w32: d
        call "get_crd_3D.gvi"(A=w32) -> (A_y=w34, A_z=w35)
        # w21: phi_0
        Sine(x=w21) -> w36
        # w22: theta_0
        Sine And Cosine(x=w22) -> (cos(x)=w37, sin(x)=w38)
        Multiply(w34, w38, w36) -> w39
        Multiply(w35, w37) -> w40
        Add(w39, w40) -> w41
        Multiply(0-1i, PiTimes2, w33, w41) -> w42
        Exponential(x=w42) -> w43
        # w28: phi
        Sine(x=w28) -> w44
        # w30: theta
        Sine And Cosine(x=w30) -> (cos(x)=w45, sin(x)=w46)
        Multiply(w34, w46, w44) -> w47
        Multiply(w35, w45) -> w48
        Add(w47, w48) -> w49
        Multiply(0+1i, PiTimes2, w33, w49) -> w50
        Exponential(x=w50) -> w51
        Multiply(w43, w51) -> w52
        Add(s1, w52) -> w53
        next s1 = w53
      }
      Complex To Polar(r * e^(i*theta)=s1) -> (r=w54)
      append w54 to w31
    }
    append w31 to w29
  }
  Array Max And Min(array=w29) -> (max value=w55)
  Divide(x=w29, y=w55) -> w56
  Property Node(instance in=w1, "phi_0"=w21, "theta_0"=w22, "BF Cluster Index"=w18, "AF"=w56) -> (instance out=w57)
  Array Index(array=w15) -> (out0[w18]=w58)
  Array Index(array=w16) -> (out0[w18]=w59)
  call "conv_gcs_lcs_spherical.gvi"(phi=w58, theta=w59, alpha=w8, beta=w9, gamma=w10) -> (phi'=w60, theta'=w61)
  for {
    w62 = each element of w24
    # phi loop
    for {
      w64 = each element of w26
      # theta loop
      s2 = 0+0i  # shift register
      for {
        w66 = each element of w4
        # antenna element loop
        Reciprocal(x=w3) -> w67
        # w3: lambda_0
        # w66: d
        call "get_crd_3D.gvi"(A=w66) -> (A_y=w68, A_z=w69)
        # w60: phi_0
        Sine(x=w60) -> w70
        # w61: theta_0
        Sine And Cosine(x=w61) -> (cos(x)=w71, sin(x)=w72)
        Multiply(w68, w72, w70) -> w73
        Multiply(w69, w71) -> w74
        Add(w73, w74) -> w75
        Multiply(0-1i, PiTimes2, w67, w75) -> w76
        Exponential(x=w76) -> w77
        # w62: phi
        Sine(x=w62) -> w78
        # w64: theta
        Sine And Cosine(x=w64) -> (cos(x)=w79, sin(x)=w80)
        Multiply(w68, w80, w78) -> w81
        Multiply(w69, w79) -> w82
        Add(w81, w82) -> w83
        Multiply(0+1i, PiTimes2, w67, w83) -> w84
        Exponential(x=w84) -> w85
        Multiply(w77, w85) -> w86
        Add(s2, w86) -> w87
        next s2 = w87
      }
      Complex To Polar(r * e^(i*theta)=s2) -> (r=w88)
      append w88 to w65
    }
    append w65 to w63
  }
  Array Max And Min(array=w63) -> (max value=w89)
  Divide(x=w63, y=w89) -> w90
  Property Node(instance in=w2, "phi_0"=w60, "theta_0"=w61, "BF Cluster Index"=w18, "AF"=w90) -> (instance out=w91)
  Property Node(instance in=w11, "BS:BF Parameters"=w57, "UT:BF Parameters"=w91) -> (instance out=w92)
  $UP_lnk_out <- w92
  $SSP_out <- w17
  Merge Errors(w25, w27) -> (error out=w93)
  $error_out <- w93
