vi "blk_att_subfnc.gvi"   [LabVIEW Communications System Design Suite 2.0.1]
inputs:
  "lambda_0": f64
  "r": f64
  "angle": f64
  "sign": i32 = 1
outputs:
  "F": f64
diagram:
  Multiply(Pi, 0.5) -> w1
  Multiply($sign, w1) -> w2
  Divide(x=Pi, y=$lambda_0) -> w3
  Cosine(x=$angle) -> w4
  Reciprocal(x=w4) -> w5
  Decrement(x=w5) -> w6
  Multiply(w6, $r, w3) -> w7
  Square Root(x=w7) -> w8
  Multiply(w2, w8) -> w9
  Inverse Tangent(x=w9) -> w10
  Divide(x=w10, y=Pi) -> w11
  $F <- w11
