vi "blk_att_subfnc_B.gvi"   [LabVIEW Communications System Design Suite 2.0.1]
inputs:
  "lambda_0": f64 = 1
  "sgn": i32 = 1
  "D": f64 = 1
  "r": f64 = 1
outputs:
  "F": f64
diagram:
  Multiply($sgn, Pi, 0.5) -> w1
  Subtract(x=$D, y=$r) -> w2
  Divide(x=Pi, y=$lambda_0) -> w3
  Multiply(w3, w2) -> w4
  Square Root(x=w4) -> w5
  Multiply(w1, w5) -> w6
  Inverse Tangent(x=w6) -> w7
  Divide(x=w7, y=Pi) -> w8
  $F <- w8
