vi "blk_backup_stuff_v0.gvi"   [LabVIEW Communications System Design Suite 2.0.1]
panel controls:
  "error_in": error
  "C": i32[]
  "w": f64
  "h": f64
  "Scenario LOS-NLOS": T1 = "UMi - Street Canyon (LOS)"
  "phi_n,AOA (rad)": f64
  "theta_n,ZOA (rad)": f64
  "T": i32[2]
  "R": i32[2]
  "error in": error
  "x|y of T": f64
  "y|z of T": f64
  "x|y of R": f64
  "y|z of R": f64
  "x|y of C": f64
  "y|z of C": f64
  "w_2": f64
  "h_2": f64
panel indicators:
  "error_out": error
  "intersects?": bool
  "A (rea edg azi)": f64[]
  "error out": error
  "B (top edg zen)": f64[]
  "B (frn edg azi)": f64[]
  "F (bot edg zen)": f64[]
  "D1_w1": f64
  "D1_w2": f64
  "D2_w1": f64
  "D2_w2": f64
  "D1_h1": f64
  "D1_h2": f64
  "D2_h1": f64
  "D2_h2": f64
types:
  T1 = enum{"UMi - Street Canyon (LOS)", "UMi - Street Canyon (NLOS)"}
diagram:
  Multiply($w, 0.5) -> w1
  Multiply($h, 0.5) -> w2
  # $T: T
  # $R: R
  case ($"Scenario LOS-NLOS") {
    frame "UMi - Street Canyon (LOS)", Default {
      # $T: T
      call "get_crd_3D.gvi"(A=$T) -> (A_x=w5, A_y=w6, A_z=w7)
      # $R: R
      call "get_crd_3D.gvi"(A=$R) -> (A_x=w8, A_y=w9, A_z=w10)
      # $C: C
      call "get_crd_3D.gvi"(A=$C) -> (A_x=w11, A_y=w12, A_z=w13)
      # w14: D (azi)
      call "calc_scr_pth_int_LOS_2D.gvi"(error in=$error_in, x|y of T=w5, y|z of T=w6, x|y of R=w8, y|z of R=w9, x|y of C=w11, y|z of C=w12) -> (error out=w15, D (azi|zen)=w14)
      call "calc_scr_pth_int_LOS_2D.gvi"(error in=$error_in, x|y of T=w6, y|z of T=w7, x|y of R=w9, y|z of R=w10, x|y of C=w12, y|z of C=w13) -> (error out=w16, D (azi|zen)=w17)
      # w18: xD
      # w19: yD
      call "get_crd_3D.gvi"(A=w14) -> (A_x=w18, A_y=w19)
      Is Greater(x=w18, y=w5) -> w20
      Is Less(x=w18, y=w8) -> w21
      Logical And(w20, w21) -> w22
      Is Greater(x=w19, y=w6) -> w23
      # w17: D (zen)
      Is Less(x=w19, y=w9) -> w24
      Logical And(w23, w24) -> w25
      Logical Or(w22, w25) -> w26
      case (w26) {
        frame False, Default {
          w4 = w26
        }
        frame True {
          call "get_crd_3D.gvi"(A=w14) -> (A_x=w27, A_y=w28)
          call "get_crd_3D.gvi"(A=$C) -> (A_x=w29, A_y=w30)
          call "calc_euc_dis_3D.gvi"(x_1=w27, y_1=w28, x_2=w29, y_2=w30) -> (d_12=w31)
          # w32: int_in_AZI
          Is Less Or Equal(x=w31, y=w1) -> w32
          call "get_crd_3D.gvi"(A=w17) -> (A_y=w33, A_z=w34)
          call "get_crd_3D.gvi"(A=$C) -> (A_y=w35, A_z=w36)
          call "calc_euc_dis_3D.gvi"(y_1=w33, z_1=w34, y_2=w35, z_2=w36) -> (d_12=w37)
          # w38: int_in_zen
          Is Less Or Equal(x=w37, y=w2) -> w38
          Logical And(w32, w38) -> w4
        }
      }
      Merge Errors(w15, w16) -> (error out=w3)
    }
    frame "UMi - Street Canyon (NLOS)" {
      call "get_crd_3D.gvi"(A=$R) -> (A_x=w39, A_y=w40)
      call "get_crd_3D.gvi"(A=$C) -> (A_x=w41, A_y=w42)
      call "calc_scr_pth_int_NLOS_2D.gvi"(x|y of R=w39, y|z of R=w40, x|y of C=w41, y|z of C=w42, path_angle azi|zen (rad)=$"phi_n,AOA (rad)", error in=$error_in) -> (D (azi|zen)=w43)
      # w44: xD
      # w45: yD
      call "get_crd_3D.gvi"(A=w43) -> (A_x=w44, A_y=w45)
      Is Greater(x=w44) -> w46
      Is Less(x=w44) -> w47
      Logical And(w46, w47) -> w48
      Is Greater(x=w45) -> w49
      Is Less(x=w45) -> w50
      Logical And(w49, w50) -> w51
      Logical Or(w48, w51) -> w52
      case (w52) {
        frame False, Default { }
        frame True {
          call "get_crd_3D.gvi"(A=w53) -> (A_x=w54, A_y=w55)
          call "get_crd_3D.gvi"(A=w56) -> (A_x=w57, A_y=w58)
          call "calc_euc_dis_3D.gvi"(x_1=w54, y_1=w55, x_2=w57, y_2=w58) -> (d_12=w59)
          # w60: int_in_AZI
          Is Less Or Equal(x=w59, y=w61) -> w60
          call "get_crd_3D.gvi"(A=w62) -> (A_y=w63, A_z=w64)
          call "get_crd_3D.gvi"(A=w56) -> (A_y=w65, A_z=w66)
          call "calc_euc_dis_3D.gvi"(y_1=w63, z_1=w64, y_2=w65, z_2=w66) -> (d_12=w67)
          # w68: int_in_zen
          Is Less Or Equal(x=w67, y=w69) -> w68
          Logical And(w60, w68) -> w70
        }
      }
      call "calc_scr_pth_int_NLOS_2D.gvi"(path_angle azi|zen (rad)=$"theta_n,ZOA (rad)", error in=$error_in)
      w3 = _
      w4 = _
    }
  }
  $"intersects?" <- w4
  $error_out <- w3
  Multiply($w_2, 0.5) -> w71
  Subtract(x=$"y|z of R", y=$"y|z of T") -> w72
  Subtract(x=$"x|y of R", y=$"x|y of T") -> w73
  Is Not Equal To 0(x=w73) -> w74
  # w73: [1]
  Select(s=w74, t=w73, f=1e-12) -> w75
  # w76: m_p
  Divide(x=w72, y=w75) -> w76
  Negate(x=w76) -> w77
  # w78: m_s
  Reciprocal(x=w77) -> w78
  Inverse Tangent(x=w78) -> w79
  Sine And Cosine(x=w79) -> (cos(x)=w80, sin(x)=w81)
  Multiply(w81, w71) -> w82
  Add(w82, $"y|z of C") -> w83
  Multiply(w80, w71) -> w84
  Add(w84, $"x|y of C") -> w85
  call "calc_euc_dis_3D.gvi"(x_1=$"x|y of R", y_1=$"y|z of R", x_2=w85, y_2=w83) -> (d_12=w86)
  $D1_w1 <- w86
  Build Array(w85, w83, 0) -> w87
  $"A (rea edg azi)" <- w87
  Subtract(x=$"x|y of C", y=w84) -> w88
  Subtract(x=$"y|z of C", y=w82) -> w89
  call "calc_euc_dis_3D.gvi"(x_1=$"x|y of R", y_1=$"y|z of R", x_2=w88, y_2=w89) -> (d_12=w90)
  $D1_w2 <- w90
  call "calc_euc_dis_3D.gvi"(x_1=$"x|y of T", y_1=$"y|z of T", x_2=w85, y_2=w83) -> (d_12=w91)
  $D2_w1 <- w91
  Build Array(w88, w89, 0) -> w92
  $"B (frn edg azi)" <- w92
  call "calc_euc_dis_3D.gvi"(x_1=$"x|y of T", y_1=$"y|z of T", x_2=w88, y_2=w89) -> (d_12=w93)
  $D2_w2 <- w93
  Multiply($h_2, 0.5) -> w94
  Multiply(w81, w94) -> w95
  Add(w95, $"y|z of C") -> w96
  Multiply(w80, w94) -> w97
  Add(w97, $"x|y of C") -> w98
  Build Array(0, w98, w96) -> w99
  $"B (top edg zen)" <- w99
  call "calc_euc_dis_3D.gvi"(y_1=$"x|y of R", z_1=$"y|z of R", y_2=w98, z_2=w96) -> (d_12=w100)
  $D1_h1 <- w100
  Subtract(x=$"x|y of C", y=w97) -> w101
  Subtract(x=$"y|z of C", y=w95) -> w102
  call "calc_euc_dis_3D.gvi"(y_1=$"x|y of R", z_1=$"y|z of R", y_2=w101, z_2=w102) -> (d_12=w103)
  $D1_h2 <- w103
  call "calc_euc_dis_3D.gvi"(y_1=$"x|y of T", z_1=$"y|z of T", y_2=w98, z_2=w96) -> (d_12=w104)
  $D2_h1 <- w104
  Build Array(0, w101, w102) -> w105
  $"F (bot edg zen)" <- w105
  call "calc_euc_dis_3D.gvi"(y_1=$"x|y of T", z_1=$"y|z of T", y_2=w101, z_2=w102) -> (d_12=w106)
  $D2_h2 <- w106
  # NOTES:
  #
  # AZI: X-Y plane
  # ZEN: Y-Z plane
  #
  # [1] avert divide by zero error
  # [2] round to zero if very small
  $"error out" <- $"error in"
