vi "blk_int_test_B.gvi"   [LabVIEW Communications System Design Suite 2.0.1]
inputs:
  "Scenario LOS-NLOS": T1 = "UMi - Street Canyon (LOS)"
  "error_in": error
  "T": i32[3]
  "C": i32[3]
  "w": f64
  "h": f64
  "R": i32[3]
  "phi_n,m,AOA (rad)": f64
  "theta_n,m,ZOA (rad)": f64
outputs:
  "int AZI": bool
  "error_out": error
  "r_zen": f64
  "D_F_w1": f64
  "D_F_w2": f64
  "sgn_F_w1": i32
  "sgn_F_w2": i32
  "int ZEN": bool
  "D_F_h1": f64
  "D_F_h2": f64
  "r_azi": f64
  "sgn_F_h2": i32
  "sgn_F_h1": i32
  "A (rea edg azi)": f64[]
  "B (frn edg azi)": f64[]
  "B (top edg zen)": f64[]
  "F (bot edg zen)": f64[]
types:
  T1 = enum{"UMi - Street Canyon (LOS)", "UMi - Street Canyon (NLOS)"}
diagram:
  call "conv_angle_pos.gvi"(angle_in (rad)=$"phi_n,m,AOA (rad)") -> (angle_out (rad)=w1)
  # w2: B
  call "get_crd_3D.gvi"(A=$R) -> (A_x=w3, A_y=w4)
  # $R: R
  # $C: C
  Tangent(x=w1) -> w5
  # w5: m_p
  Negate(x=w5) -> w6
  # w7: m_s
  Reciprocal(x=w6) -> w7
  Inverse Tangent(x=w7) -> w8
  Sine And Cosine(x=w8) -> (cos(x)=w9, sin(x)=w10)
  Multiply($w, 0.5) -> w11
  Multiply(w9, w11) -> w12
  call "get_crd_3D.gvi"(A=$C) -> (A_x=w13, A_y=w14)
  Subtract(x=w13, y=w12) -> w15
  Multiply(w10, w11) -> w16
  Subtract(x=w14, y=w16) -> w17
  Build Array(w15, w17, 0) -> w2
  call "get_crd_3D.gvi"(A=w2) -> (A_x=w18, A_y=w19)
  call "calc_sph_geom.gvi"(X_UT=w3, Y_UT=w4, X_BS=w18, Y_BS=w19) -> (phi,LOS,AOA (deg)=w20)
  call "conv_deg_to_rad.gvi"(angle (deg)=w20) -> (angle (rad)=w21)
  call "conv_angle_pos.gvi"(angle_in (rad)=w21) -> (angle_out (rad)=w22)
  call "get_crd_3D.gvi"(A=$R) -> (A_x=w23, A_y=w24)
  Add(w16, w14) -> w25
  Add(w12, w13) -> w26
  Build Array(w26, w25, 0) -> w27
  # w27: A
  call "get_crd_3D.gvi"(A=w27) -> (A_x=w28, A_y=w29)
  call "calc_sph_geom.gvi"(X_UT=w23, Y_UT=w24, X_BS=w28, Y_BS=w29) -> (phi,LOS,AOA (deg)=w30)
  call "conv_deg_to_rad.gvi"(angle (deg)=w30) -> (angle (rad)=w31)
  call "conv_angle_pos.gvi"(angle_in (rad)=w31) -> (angle_out (rad)=w32)
  call "get_crd_3D.gvi"(A=$R) -> (A_x=w33, A_y=w34)
  call "get_crd_3D.gvi"(A=$C) -> (A_x=w35, A_y=w36)
  call "calc_sph_geom.gvi"(X_UT=w33, Y_UT=w34, X_BS=w35, Y_BS=w36) -> (phi,LOS,AOA (deg)=w37)
  call "conv_deg_to_rad.gvi"(angle (deg)=w37) -> (angle (rad)=w38)
  call "conv_angle_pos.gvi"(angle_in (rad)=w38) -> (angle_out (rad)=w39)
  Is Greater(x=w32, y=w39) -> w40
  Select(s=w40, t=w32, f=w22) -> w41
  # w41: phi_UB
  Is Less(x=w1, y=w41) -> w42
  Select(s=w40, t=w22, f=w32) -> w43
  # w43: phi_LB
  Is Greater(x=w1, y=w43) -> w44
  Is Equal To 0(x=$"Scenario LOS-NLOS") -> w45
  call "get_crd_3D.gvi"(A=$T) -> (A_x=w46, A_y=w47)
  call "get_crd_3D.gvi"(A=$R) -> (A_x=w48, A_y=w49)
  call "get_crd_3D.gvi"(A=$C) -> (A_x=w50, A_y=w51)
  call "calc_scr_pth_int_LOS_2D.gvi"(x|y of T=w46, y|z of T=w47, x|y of R=w48, y|z of R=w49, x|y of C=w50, y|z of C=w51) -> (D (azi|zen)=w52)
  call "get_crd_3D.gvi"(A=w52) -> (A_x=w53, A_y=w54)
  Add(w46, w48) -> w55
  Multiply(w55, 0.5) -> w56
  Is Greater(x=w46, y=w56) -> w57
  Select(s=w57, t=w46, f=w48) -> w58
  # w58: UB
  Is Less(x=w53, y=w58) -> w59
  Select(s=w57, t=w48, f=w46) -> w60
  # w60: LB
  Is Greater(x=w53, y=w60) -> w61
  Logical And(w59, w61) -> w62
  Add(w47, w49) -> w63
  Multiply(w63, 0.5) -> w64
  Is Greater(x=w47, y=w64) -> w65
  Select(s=w65, t=w47, f=w49) -> w66
  # w66: UB
  Is Less(x=w54, y=w66) -> w67
  Select(s=w65, t=w49, f=w47) -> w68
  # w68: LB
  Is Greater(x=w54, y=w68) -> w69
  Logical And(w67, w69) -> w70
  Logical And(w62, w70) -> w71
  # w45: LOS?
  Select(s=w45, t=w71, f=TRUE) -> w72
  Logical And(w42, w44, w72) -> w73
  $"int AZI" <- w73
  call "get_crd_3D.gvi"(A=$R) -> (A_x=w74, A_y=w75)
  # w76: D1_w2
  call "calc_euc_dis_3D.gvi"(x_1=w74, y_1=w75, x_2=w26, y_2=w25) -> (d_12=w77)
  # w78: D2_w1
  call "calc_euc_dis_3D.gvi"(x_1=w74, y_1=w75, x_2=w15, y_2=w17) -> (d_12=w76)
  call "get_crd_3D.gvi"(A=$T) -> (A_x=w79, A_y=w80, A_z=w81)
  # w82: D2_w2
  call "calc_euc_dis_3D.gvi"(x_1=w79, y_1=w80, x_2=w26, y_2=w25) -> (d_12=w78)
  call "calc_euc_dis_3D.gvi"(x_1=w79, y_1=w80, x_2=w15, y_2=w17) -> (d_12=w82)
  call "get_crd_3D.gvi"(A=$C) -> (A_y=w83, A_z=w84)
  Multiply($h, 0.5) -> w85
  # $T: T
  call "conv_angle_pos.gvi"(angle_in (rad)=$"theta_n,m,ZOA (rad)") -> (angle_out (rad)=w86)
  Tangent(x=w86) -> w87
  # w87: m_p
  Negate(x=w87) -> w88
  Reciprocal(x=w88) -> w89
  Inverse Tangent(x=w89) -> w90
  Sine And Cosine(x=w90) -> (cos(x)=w91, sin(x)=w92)
  Multiply(w92, w85) -> w93
  # w94: B_y
  Add(w93, w83) -> w94
  Multiply(w85, w91) -> w95
  # w96: F_z
  Add(w95, w84) -> w97
  # w97: B_z
  call "get_crd_3D.gvi"(A=$R) -> (A_y=w98, A_z=w99)
  # w100: D1_h1
  # w101: D1_h2
  call "calc_euc_dis_3D.gvi"(y_1=w98, z_1=w99, y_2=w94, z_2=w97) -> (d_12=w100)
  Subtract(x=w84, y=w95) -> w96
  # w102: F_y
  Subtract(x=w83, y=w93) -> w102
  # w103: D2_h1
  call "calc_euc_dis_3D.gvi"(y_1=w98, z_1=w99, y_2=w102, z_2=w96) -> (d_12=w101)
  # w104: D2_h2
  call "calc_euc_dis_3D.gvi"(y_1=w80, z_1=w81, y_2=w94, z_2=w97) -> (d_12=w103)
  call "calc_euc_dis_3D.gvi"(y_1=w80, z_1=w81, y_2=w102, z_2=w96) -> (d_12=w104)
  call "calc_r_blk_B.gvi"(R=$R, phi_n,m,AOA (rad)=w1, T=$T, C=$C, theta_n,m,ZOA (rad)=w86) -> (r_azi=w105, r_zen=w106, r'_azi=w107, r'_zen=w108)
  call "get_crd_3D.gvi"(A=$R) -> (A_y=w109, A_z=w110)
  Build Array(0, w94, w97) -> w111
  call "get_crd_3D.gvi"(A=w111) -> (A_y=w112, A_z=w113)
  call "calc_sph_geom.gvi"(Y_UT=w109, Z_UT=w110, Y_BS=w112, Z_BS=w113) -> (theta,LOS,ZOA (deg)=w114)
  call "conv_deg_to_rad.gvi"(angle (deg)=w114) -> (angle (rad)=w115)
  call "conv_angle_pos.gvi"(angle_in (rad)=w115) -> (angle_out (rad)=w116)
  call "get_crd_3D.gvi"(A=$R) -> (A_y=w117, A_z=w118)
  Build Array(0, w102, w96) -> w119
  call "get_crd_3D.gvi"(A=w119) -> (A_y=w120, A_z=w121)
  call "calc_sph_geom.gvi"(Y_UT=w117, Z_UT=w118, Y_BS=w120, Z_BS=w121) -> (theta,LOS,ZOA (deg)=w122)
  call "conv_deg_to_rad.gvi"(angle (deg)=w122) -> (angle (rad)=w123)
  call "conv_angle_pos.gvi"(angle_in (rad)=w123) -> (angle_out (rad)=w124)
  call "get_crd_3D.gvi"(A=$R) -> (A_y=w125, A_z=w126)
  call "get_crd_3D.gvi"(A=$C) -> (A_y=w127, A_z=w128)
  call "calc_sph_geom.gvi"(Y_UT=w125, Z_UT=w126, Y_BS=w127, Z_BS=w128) -> (theta,LOS,ZOA (deg)=w129)
  call "conv_deg_to_rad.gvi"(angle (deg)=w129) -> (angle (rad)=w130)
  call "conv_angle_pos.gvi"(angle_in (rad)=w130) -> (angle_out (rad)=w131)
  Is Greater(x=w116, y=w131) -> w132
  Select(s=w132, t=w116, f=w124) -> w133
  # w133: theta_UB
  Is Less(x=w86, y=w133) -> w134
  Select(s=w132, t=w124, f=w116) -> w135
  # w135: theta_LB
  Is Greater(x=w86, y=w135) -> w136
  Is Equal To 0(x=$"Scenario LOS-NLOS") -> w137
  call "get_crd_3D.gvi"(A=$T) -> (A_y=w138, A_z=w139)
  call "get_crd_3D.gvi"(A=$R) -> (A_y=w140, A_z=w141)
  call "get_crd_3D.gvi"(A=$C) -> (A_y=w142, A_z=w143)
  call "calc_scr_pth_int_LOS_2D.gvi"(x|y of T=w138, y|z of T=w139, x|y of R=w140, y|z of R=w141, x|y of C=w142, y|z of C=w143) -> (D (azi|zen)=w144)
  call "get_crd_3D.gvi"(A=w144) -> (A_x=w145, A_y=w146)
  Add(w138, w140) -> w147
  Multiply(w147, 0.5) -> w148
  Is Greater(x=w138, y=w148) -> w149
  Select(s=w149, t=w138, f=w140) -> w150
  # w150: UB
  Is Less(x=w145, y=w150) -> w151
  Select(s=w149, t=w140, f=w138) -> w152
  # w152: LB
  Is Greater(x=w145, y=w152) -> w153
  Logical And(w151, w153) -> w154
  Add(w139, w141) -> w155
  Multiply(w155, 0.5) -> w156
  Is Greater(x=w139, y=w156) -> w157
  Select(s=w157, t=w139, f=w141) -> w158
  # w158: UB
  Is Less(x=w146, y=w158) -> w159
  Select(s=w157, t=w141, f=w139) -> w160
  # w160: LB
  Is Greater(x=w146, y=w160) -> w161
  Logical And(w159, w161) -> w162
  Logical And(w154, w162) -> w163
  # w137: LOS?
  Select(s=w137, t=w163, f=TRUE) -> w164
  Logical And(w134, w136, w164) -> w165
  # w73: Xn_azi?
  # w165: Xn_zen?
  case ($"Scenario LOS-NLOS") {
    frame "UMi - Street Canyon (LOS)", Default {
      Add(w77, w78) -> w168
      Add(w76, w82) -> w169
      case (w73) {
        frame False, Default {
          Is Less(x=w168, y=w169) -> w176
          Select(s=w176, t=-1, f=1) -> w170
          Select(s=w176, t=1, f=-1) -> w171
        }
        frame True {
          w170 = 1
          w171 = 1
        }
      }
      Add(w100, w103) -> w166
      Add(w101, w104) -> w167
      case (w165) {
        frame False, Default {
          Is Less(x=w166, y=w167) -> w177
          Select(s=w177, t=-1, f=1) -> w172
          Select(s=w177, t=1, f=-1) -> w173
        }
        frame True {
          w172 = 1
          w173 = 1
        }
      }
      w174 = w105
      w175 = w106
    }
    frame "UMi - Street Canyon (NLOS)" {
      case (w73) {
        frame False, Default {
          Is Less(x=w77, y=w76) -> w178
          Select(s=w178, t=-1, f=1) -> w170
          Select(s=w178, t=1, f=-1) -> w171
        }
        frame True {
          w170 = 1
          w171 = 1
        }
      }
      case (w165) {
        frame False, Default {
          Is Less(x=w100, y=w101) -> w179
          Select(s=w179, t=-1, f=1) -> w172
          Select(s=w179, t=1, f=-1) -> w173
        }
        frame True {
          w172 = 1
          w173 = 1
        }
      }
      w166 = w100
      w167 = w101
      w168 = w77
      w169 = w76
      w174 = w107
      w175 = w108
    }
  }
  $r_azi <- w174
  $r_zen <- w175
  $"B (frn edg azi)" <- w2
  # w77: D1_w1
  $"A (rea edg azi)" <- w27
  $D_F_w1 <- w168
  $sgn_F_w1 <- w170
  $sgn_F_w2 <- w171
  $D_F_w2 <- w169
  $"int ZEN" <- w165
  $"F (bot edg zen)" <- w119
  $D_F_h1 <- w166
  $"B (top edg zen)" <- w111
  $sgn_F_h1 <- w172
  $sgn_F_h2 <- w173
  $D_F_h2 <- w167
  $error_out <- $error_in
