vi "blockage_model_A_v0.gvi"   [LabVIEW Communications System Design Suite 2.0.1]
inputs:
  "UP_lnk_in": "UP_lnk.gtype"
  "SSP_in": "SSP.gtype"
  "LSP_in": "LSP.gtype"
  "error_in": error
outputs:
  "SSP_out": "SSP.gtype"
  "LSP_out": "LSP.gtype"
  "UP_lnk_out": "UP_lnk.gtype"
  "error_out": error
types:
  T1 = enum{"Pedestrian", "Cyclist", "City Motorist", "Freeway Motorist", "Train"}
  T2 = cluster{"Cl. No.": i32, "SB": bool, "NSB": bool, "Attn. (dB)": f64, "t": f64, "Class (NSB)": T1, "Location (C)": i32[]}
  "cl_blk_dat.gtype" = T2[]
  "SSP.gtype" = cluster{"N": i32, "M": i32, "tau_n": f64[], "tau_n,i": f64[], "min(tau'_n)": f64, "P_n": f64[], "P_n,pre_blk": f64[], "P_n,m": f64[][], "phi_n_AOA": f64[], "phi_n,m,AOA": f64[][], "theta_n_ZOA": f64[], "theta_n,m,ZOA": f64[][], "phi_n_AOD": f64[], "phi_n,m,AOD": f64[][], "theta_n_ZOD": f64[], "theta_n,m,ZOD": f64[][], "phi_theta_n,m,cpl": f64[][][], "XPR": f64[][], "Phi_n,m,theta,theta": f64[][], "Phi_n,m,theta,phi": f64[][], "Phi_n,m,phi,theta": f64[][], "Phi_n,m,phi, phi": f64[][], "H_u,s,n,NLOS": c128[], "H_u,s,n,i,NLOS": c128[], "H_u,s,NLOS": c128, "H_u,s,1,LOS": c128, "H_u,s": c128, "H": c128[][], "H_u,s,n": c128[][][], "cl_sp_delay_map_LOS": f64[][][], "cl_sp_delay_map_NLOS": f64[][][], "cl_sp_shadowing_map_LOS": f64[][][], "cl_sp_shadowing_map_NLOS": f64[][][], "cl_sp_offset_AOD_map_LOS": f64[][][], "cl_sp_offset_AOD_map_NLOS": f64[][][], "cl_sp_offset_AOA_map_LOS": f64[][][], "cl_sp_offset_AOA_map_NLOS": f64[][][], "cl_sp_offset_ZOD_map_LOS": f64[][][], "cl_sp_offset_ZOD_map_NLOS": f64[][][], "cl_sp_offset_ZOA_map_LOS": f64[][][], "cl_sp_offset_ZOA_map_NLOS": f64[][][], "ray_XPR_map_LOS": f64[][][], "ray_XPR_map_NLOS": f64[][][], "ray_ini_phase_theta,phi_map_LOS": f64[][][], "ray_ini_phase_theta,theta_map_LOS": f64[][][], "pr_los_map": f64[][], "cl_sp_sign_AOD_map_LOS": i32[][][], "cl_sp_sign_AOD_map_NLOS": i32[][][], "cl_sp_sign_AOA_map_LOS": i32[][][], "cl_sp_sign_AOA_map_NLOS": i32[][][], "cl_sp_sign_ZOD_map_LOS": i32[][][], "cl_sp_sign_ZOD_map_NLOS": i32[][][], "cl_sp_sign_ZOA_map_LOS": i32[][][], "cl_sp_sign_ZOA_map_NLOS": i32[][][], "ray_ini_phase_phi,phi_map_LOS": f64[][][], "ray_ini_phase_phi,theta_map_LOS": f64[][][], "ray_ini_phase_theta,phi_map_NLOS": f64[][][], "ray_ini_phase_theta,theta_map_NLOS": f64[][][], "ray_ini_phase_phi,phi_map_NLOS": f64[][][], "ray_ini_phase_phi,theta_map_NLOS": f64[][][], "Xn_map": f64[][][], "H_sc": c128[][][], "tau_n_sc": f64[][], "P_n_sc": f64[][], "P_n_pre_blk_sc": f64[][], "blk_cnt_ang_map_LOS-NLOS": f64[][][], "Cluster Blockage Data": "cl_blk_dat.gtype"}
  T3 = cluster{"SF": f64, "K": f64, "DS": f64, "ASD": f64, "ASA": f64, "ZSD": f64, "ZSA": f64, "mu_XPR_dB": f64}
  T4 = cluster{"mu_SF_dB": f64, "sig_SF_dB": f64, "mu_K_dB": f64, "sig_K_dB": f64, "mu_lgDS": f64, "sig_lgDS": f64, "mu_lgASD": f64, "sig_lgASD": f64, "mu_lgASA": f64, "sig_lgASA": f64, "mu_lgZSD": f64, "sig_lgZSD": f64, "mu_lgZSA": f64, "sig_lgZSA": f64, "mu_XPR_dB": f64, "sig_XPR_dB": f64}
  "LSP.gtype" = cluster{"LSP": T3, "LSP_mu_sig": T4, "PL_dB": f64, "mu_PL_dB": f64, "LSP_map_LOS": f64[][][], "LSP_map_NLOS": f64[][][], "n_r,grd": i32, "n_c,grd": i32}
  T5 = enum{"UMi - Street Canyon (LOS)", "UMi - Street Canyon (NLOS)"}
  T6 = cluster{"X_BS (m)": i32, "Y_BS (m)": i32, "h_BS (m)": i32, "Omega_BS,alpha": f64, "Omega_BS,beta": f64, "Omega_BS,gamma": f64, "zeta_tx": f64, "M,tx": i32, "N,tx": i32, "M_g,tx": i32, "N_g,tx": i32, "s": i32}
  T7 = cluster{"X_UT (m)": i32, "Y_UT (m)": i32, "h_UT (m)": i32, "v": f64, "phi_v": f64, "theta_v": f64, "t": f64, "Omega_UT,alpha": f64, "Omega_UT,beta": f64, "Omega_UT,gamma": f64, "zeta_rx": f64, "N,rx": i32, "M,rx": i32, "N_g,rx": i32, "M_g,rx": i32, "u": i32, "Introduce Blockages?": bool, "Self-blocking Mode": bool, "X_UT_end": i32, "Y_UT_end": i32, "h_UT_end": i32, "step_std_X": f64, "step_std_Y": f64, "step_std_Z": f64, "t_total (s)": f64, "t_step (s)": f64, "trj": "trj.gtype", "UT_loc_curr": i32[]}
  T8 = cluster{"Class": T1, "Velocity": f64, "Count (K)": i32, "Location (C)": i32[][]}
  T9 = cluster{"Blocker Parameters": T8[], "Blockage Grid Margin-X": i32, "Blockage Grid Margin-Y": i32, "t_max_grd": f64, "t_res_grd": f64, "Introduce Blockages in System?": bool}
  "UP_lnk.gtype" = cluster{"Scenario LOS-NLOS": T5, "d_2D (m)": f64, "d_3D (m)": f64, "f_C (Hz)": f64, "lambda_0": f64, "phi_LOS,AOA": f64, "phi_LOS,AOD": f64, "theta_LOS,ZOA": f64, "theta_LOS,ZOD": f64, "d_V_tx": f64, "d_H,tx": f64, "d_V_rx": f64, "d_H,rx": f64, "d_g,V,tx": f64, "d_g,H,tx": f64, "d_g,V,rx": f64, "d_g,H,rx": f64, "d_rx,u": f64[3], "d_tx,s": f64[3], "BS": T6, "UT": T7, "Align BS-UT?": bool, "Blockage Settings": T9, "UT Blockage Data": T2[]}
  T10 = cluster{"Cl. No.": i32, "Attn. (dB)": f64, "SB": bool, "NSB": bool}
diagram:
  $LSP_out <- $LSP_in
  Property Node(instance in=$SSP_in) -> ("P_n"=w1, "phi_n_AOA"=w2, "theta_n_ZOA"=w3, instance out=w4)
  Property Node(instance in=$UP_lnk_in) -> ("lambda_0"=w5, "UT:Omega_UT,alpha"=w6, "UT:Omega_UT,beta"=w7, "UT:Omega_UT,gamma"=w8, "UT:Self-blocking Mode"=w9, instance out=w10)
  for (N = 4) {
    Random Number() -> (number (0 to 1)=w16)
    Multiply(w16, PiTimes2) -> w17
    Random Number() -> (number (0 to 1)=w18)
    Multiply(w18, 0.1745) -> w19
    Add(w19, 0.0873) -> w20
    w21 = 10  # r
    append w17 to w11
    append w20 to w12
    append PiOver2 to w13
    append 0.0873 to w14
    append w21 to w15
  }
  # w22: x_sb
  Select(s=w9, t=2.7925, f=2.0944) -> w22
  # w23: phi'_sb
  Select(s=w9, t=0.6981, f=4.5379) -> w23
  # w24: theta'_sb
  Select(s=w9, t=1.9199, f=1.7453) -> w24
  # w25: y_sb
  Select(s=w9, t=1.309, f=1.3963) -> w25
  # w11: phi_k
  # w12: x_k
  # w13: theta_k
  # w14: y_k
  # w15: r
  # NOTES:
  #
  # -- Model A based
  # -- only UMi-SC case
  # -- all angle values have been converted to radians
  s1 = T10[] []  # shift register
  for (iteration -> i1) {
    w26 = each element of w2
    w27 = each element of w3
    w28 = each element of w1
    call "conv_gcs_lcs_spherical.gvi"(phi=w26, theta=w27, alpha=w6, beta=w7, gamma=w8) -> (phi'=w30, theta'=w31)
    # w30: phi'_AOA
    Subtract(x=w30, y=w23) -> w32
    # w31: theta'_ZOA
    Multiply(w22, 0.5) -> w33
    Is Less(x=w32, y=w33) -> w34
    Negate(x=w33) -> w35
    Is Greater(x=w32, y=w35) -> w36
    Subtract(x=w31, y=w24) -> w37
    Multiply(w25, 0.5) -> w38
    Is Less(x=w37, y=w38) -> w39
    Negate(x=w38) -> w40
    Is Greater(x=w37, y=w40) -> w41
    Logical And(w34, w36, w39, w41) -> w42
    for (N = 4) {
      w43 = each element of w11
      w44 = each element of w12
      w45 = each element of w13
      w46 = each element of w14
      w47 = each element of w15
      # w28: P_n
      # w26: phi_AOA
      # w43: phi_k
      # w44: x_k
      Subtract(x=w26, y=w43) -> w51
      Is Less(x=w51, y=w44) -> w52
      Negate(x=w44) -> w53
      Is Greater(x=w51, y=w53) -> w54
      # w27: theta_ZOA
      # w46: y_k
      # w45: theta_k
      Subtract(x=w27, y=w45) -> w55
      Is Less(x=w55, y=w46) -> w56
      Negate(x=w46) -> w57
      Is Greater(x=w55, y=w57) -> w58
      Logical And(w52, w54, w56, w58) -> w59
      Multiply(w44, 0.5) -> w60
      # w61: A_1
      Subtract(x=w51, y=w60) -> w61
      Is Greater(x=w51, y=w60) -> w62
      Is Less Or Equal(x=w51, y=w44) -> w63
      # w64: Z_2
      Logical And(w62, w63) -> w65
      Negate(x=w60) -> w66
      Is Greater(x=w51, y=w66) -> w67
      Is Less Or Equal(x=w51, y=w60) -> w68
      Logical And(w67, w68) -> w69
      Negate(x=w44) -> w70
      Is Greater(x=w51, y=w70) -> w71
      Is Less Or Equal(x=w51, y=w66) -> w72
      Logical And(w71, w72) -> w73
      Build Array(w65, w69, w73) -> w74
      Boolean Array To Number(Boolean array=w74) -> (number=w75)
      Logarithm Base 2(x=w75) -> w76
      To Long Integer(number=w76) -> w77
      Array Index(array=[[-1, 1], [1, 1], [1, -1]]) -> (out0[w77, _]=w78)
      Array Index(array=w78) -> (out0[0]=w79)
      call "blk_att_subfnc.gvi"(lambda_0=w5, r=w47, angle=w61, sign=w79) -> (F=w80)
      # w81: A_2
      # w60: x_k/2
      Add(w51, w60) -> w81
      Array Index(array=w78) -> (out0[1]=w82)
      # w83: F_A,2
      call "blk_att_subfnc.gvi"(lambda_0=w5, r=w47, angle=w81, sign=w82) -> (F=w83)
      # w80: F_A,1
      Add(w80, w83) -> w84
      # w85: y_k/2
      Multiply(w46, 0.5) -> w85
      # w86: Z_1
      Subtract(x=w55, y=w85) -> w86
      Negate(x=w46) -> w87
      Is Greater(x=w55, y=w87) -> w88
      Negate(x=w85) -> w89
      Is Less Or Equal(x=w55, y=w89) -> w90
      Logical And(w88, w90) -> w91
      Is Greater(x=w55, y=w89) -> w92
      Is Less Or Equal(x=w55, y=w85) -> w93
      Logical And(w92, w93) -> w94
      Is Greater(x=w55, y=w85) -> w95
      Is Less Or Equal(x=w55, y=w46) -> w96
      Logical And(w95, w96) -> w97
      Build Array(w91, w94, w97) -> w98
      Boolean Array To Number(Boolean array=w98) -> (number=w99)
      Logarithm Base 2(x=w99) -> w100
      To Long Integer(number=w100) -> w101
      Array Index(array=[[1, -1], [1, 1], [-1, 1]]) -> (out0[w101, _]=w102)
      Array Index(array=w102) -> (out0[0]=w103)
      call "blk_att_subfnc.gvi"(lambda_0=w5, r=w47, angle=w86, sign=w103) -> (F=w104)
      Add(w55, w85) -> w64
      Array Index(array=w102) -> (out0[1]=w105)
      # w106: F_Z,2
      call "blk_att_subfnc.gvi"(lambda_0=w5, r=w47, angle=w64, sign=w105) -> (F=w106)
      # w104: F_Z,1
      Add(w104, w106) -> w107
      Multiply(w84, w107) -> w108
      Subtract(x=1, y=w108) -> w109
      Logarithm Base 10(x=w109) -> w110
      Multiply(w110, -20) -> w111
      # w111: L_dB
      Divide(x=w111, y=20) -> w112
      # w113: L
      Power Of 10(x=w112) -> w113
      Select(s=w59, t=w113, f=1) -> w114
      Multiply(w28, w114) -> w115
      append w115 to w48
      append w59 to w49
      append w114 to w50
    }
    # w49: NSB
    Or Array Elements(Boolean array=w49) -> (logical OR=w116)
    Logical Or(w42, w116) -> w117
    # w28: P_n
    # w118: LSB (none)
    Not(x=w117) -> w118
    Build Array[ConcatenateInputs=True](w118, w42, w49) -> w119
    Boolean Array To Number(Boolean array=w119) -> (number=w120)
    Logarithm Base 2(x=w120) -> w121
    To Long Integer(number=w121) -> w122
    w123 = 0.001  # L_SB
    Build Array[ConcatenateInputs=True](1, w123, w50) -> w124
    Array Index(array=w124) -> (out0[w122]=w125)
    case (w117) {
      frame False, Default {
        w126 = s1
      }
      frame True {
        Property Node(instance in=T10 {all zero or empty}, "Cl. No."=i1, "SB"=w42, "NSB"=w116, "Attn. (dB)"=w125) -> (instance out=w127)
        Build Array[ConcatenateInputs=True](s1, w127) -> w126
      }
    }
    # w42: SB
    Select(s=w42, t=w123, f=1) -> w128
    Multiply(w28, w128) -> w129
    Build Array[ConcatenateInputs=True](w28, w129, w48) -> w130
    Array Index(array=w130) -> (out0[w122]=w131)
    append w131 to w29
    next s1 = w126
  }
  Property Node(instance in=w4, "P_n,pre_blk"=w1, "P_n"=w29, "UT Blockage Status"=s1) -> (instance out=w132)
  $SSP_out <- w132
  $UP_lnk_out <- w10
  $error_out <- $error_in
