vi "blockage_model_A_v1.gvi"   [LabVIEW Communications System Design Suite 2.0.1]
inputs:
  "UP_lnk_in": "UP_lnk.gtype"
  "SSP_in": "SSP.gtype"
  "LSP_in": "LSP.gtype"
  "error_in": error
outputs:
  "SSP_out": "SSP.gtype"
  "LSP_out": "LSP.gtype"
  "UP_lnk_out": "UP_lnk.gtype"
  "error_out": error
panel controls:
  "Cluster Blockage Data (A)": "blk_inf_cl_A.gtype"
types:
  T1 = enum{"Pedestrian", "Cyclist", "City Motorist", "Freeway Motorist", "Train"}
  T2 = cluster{"Type": enum{"SB", "NSB"}, "Class (for NSB)": T1, "Location (X,Y,Z)": i32[], "Attenuation": f64, "Cl. No.": i32, "t": f64}
  T3 = cluster{"Blocker Info": T2[][], "No. of Blocked Cl. at time t": i32}
  T4 = cluster{"Cl. Attn. (ray aggr.)": f64, "No. of Blocked Rays": i32, "Ray Blocker Array": "blk_inf_ry_B.gtype"[], "Cl. No.": i32}
  "blk_inf_cl_B.gtype" = cluster{"Cluster Blocker Array": T4[], "No. of Blocked Cl. at time t": i32}
  "SSP.gtype" = cluster{"N": i32, "M": i32, "tau_n": f64[], "tau_n,i": f64[], "min(tau'_n)": f64, "P_n": f64[], "P_n,pre_blk": f64[], "P_n,m": f64[][], "phi_n_AOA": f64[], "phi_n,m,AOA": f64[][], "theta_n_ZOA": f64[], "theta_n,m,ZOA": f64[][], "phi_n_AOD": f64[], "phi_n,m,AOD": f64[][], "theta_n_ZOD": f64[], "theta_n,m,ZOD": f64[][], "phi_theta_n,m,cpl": f64[][][], "XPR": f64[][], "Phi_n,m,theta,theta": f64[][], "Phi_n,m,theta,phi": f64[][], "Phi_n,m,phi,theta": f64[][], "Phi_n,m,phi, phi": f64[][], "H_u,s,n,NLOS": c128[], "H_u,s,n,i,NLOS": c128[], "H_u,s,NLOS": c128, "H_u,s,1,LOS": c128, "H_u,s": c128, "H": c128[][], "H_u,s,n": c128[][][], "cl_sp_delay_map_LOS": f64[][][], "cl_sp_delay_map_NLOS": f64[][][], "cl_sp_shadowing_map_LOS": f64[][][], "cl_sp_shadowing_map_NLOS": f64[][][], "cl_sp_offset_AOD_map_LOS": f64[][][], "cl_sp_offset_AOD_map_NLOS": f64[][][], "cl_sp_offset_AOA_map_LOS": f64[][][], "cl_sp_offset_AOA_map_NLOS": f64[][][], "cl_sp_offset_ZOD_map_LOS": f64[][][], "cl_sp_offset_ZOD_map_NLOS": f64[][][], "cl_sp_offset_ZOA_map_LOS": f64[][][], "cl_sp_offset_ZOA_map_NLOS": f64[][][], "ray_XPR_map_LOS": f64[][][], "ray_XPR_map_NLOS": f64[][][], "ray_ini_phase_theta,phi_map_LOS": f64[][][], "ray_ini_phase_theta,theta_map_LOS": f64[][][], "pr_los_map": f64[][], "cl_sp_sign_AOD_map_LOS": i32[][][], "cl_sp_sign_AOD_map_NLOS": i32[][][], "cl_sp_sign_AOA_map_LOS": i32[][][], "cl_sp_sign_AOA_map_NLOS": i32[][][], "cl_sp_sign_ZOD_map_LOS": i32[][][], "cl_sp_sign_ZOD_map_NLOS": i32[][][], "cl_sp_sign_ZOA_map_LOS": i32[][][], "cl_sp_sign_ZOA_map_NLOS": i32[][][], "ray_ini_phase_phi,phi_map_LOS": f64[][][], "ray_ini_phase_phi,theta_map_LOS": f64[][][], "ray_ini_phase_theta,phi_map_NLOS": f64[][][], "ray_ini_phase_theta,theta_map_NLOS": f64[][][], "ray_ini_phase_phi,phi_map_NLOS": f64[][][], "ray_ini_phase_phi,theta_map_NLOS": f64[][][], "Xn_map": f64[][][], "H_sc": c128[][][], "tau_n_sc": f64[][], "P_n_sc": f64[][], "P_n_pre_blk_sc": f64[][], "blk_cnt_ang_map_LOS-NLOS": f64[][][], "Cluster Blockage Data (A)": T3, "Cluster Blockage Data (B)": "blk_inf_cl_B.gtype", "P_n,drv": f64[], "P_n,drv_sc": f64[][], "P_n,drv_pre_blk_sc": f64[][], "P_n,i": f64[]}
  T5 = cluster{"SF": f64, "K": f64, "DS": f64, "ASD": f64, "ASA": f64, "ZSD": f64, "ZSA": f64, "mu_XPR_dB": f64}
  T6 = cluster{"mu_SF_dB": f64, "sig_SF_dB": f64, "mu_K_dB": f64, "sig_K_dB": f64, "mu_lgDS": f64, "sig_lgDS": f64, "mu_lgASD": f64, "sig_lgASD": f64, "mu_lgASA": f64, "sig_lgASA": f64, "mu_lgZSD": f64, "sig_lgZSD": f64, "mu_lgZSA": f64, "sig_lgZSA": f64, "mu_XPR_dB": f64, "sig_XPR_dB": f64}
  "LSP.gtype" = cluster{"LSP": T5, "LSP_mu_sig": T6, "PL_dB": f64, "mu_PL_dB": f64, "LSP_map_LOS": f64[][][], "LSP_map_NLOS": f64[][][], "n_r,grd": i32, "n_c,grd": i32}
  T7 = enum{"UMi - Street Canyon (LOS)", "UMi - Street Canyon (NLOS)"}
  "blk_inf_UT_B.gtype" = "blk_inf_cl_B.gtype"[]
  T8 = enum{"A - Generic", "B - Generic", "B - Gramercy Park"}
  T9 = cluster{"Blockage Grid Margin-X": i32, "Blockage Grid Margin-Y": i32, "Blockage Parameters (B)": "UP_blk_B.gtype"[], "t_total_blk (s)": f64, "t_stp_blk (s)": f64}
  T10 = cluster{"Class (NSB)": T1, "Velocity": f64, "Count (K)": i32, "Blocker Trajectories": "trj_blk_B.gtype"[]}
  T11 = cluster{"Blockage Grid Margin-X": i32, "Blockage Grid Margin-Y": i32, "t_max_grd": f64, "t_res_grd": f64, "Blockage Parameters (A)": T10[], "d_res_grd": f64}
  "UP_BS.gtype" = cluster{"X_BS (m)": f64, "Y_BS (m)": f64, "h_BS (m)": f64, "Omega_BS,alpha": f64, "Omega_BS,beta": f64, "Omega_BS,gamma": f64, "zeta_tx": f64, "M,tx": i32, "N,tx": i32, "M_g,tx": i32, "N_g,tx": i32, "s": i32, "BF Parameters": "UP_bf.gtype"}
  T12 = cluster{"t": f64[], "C": i32[][], "d_2D": f64[], "d_3D": f64[], "V": f64[][], "v": f64[], "v_avg": f64}
  T13 = cluster{"X_UT (m)": i32, "Y_UT (m)": i32, "h_UT (m)": i32, "v": f64, "phi_v": f64, "theta_v": f64, "t": f64, "Omega_UT,alpha": f64, "Omega_UT,beta": f64, "Omega_UT,gamma": f64, "zeta_rx": f64, "N,rx": i32, "M,rx": i32, "N_g,rx": i32, "M_g,rx": i32, "u": i32, "Introduce Blockages?": bool, "Self-blocking Mode": bool, "X_UT_end": i32, "Y_UT_end": i32, "h_UT_end": i32, "step_std_X": f64, "step_std_Y": f64, "step_std_Z": f64, "t_total (s)": f64, "t_step (s)": f64, "UT_loc_curr": i32[], "trj_UT": T12, "Blockage Model": T8, "BF Parameters": "UP_bf.gtype"}
  "UP_lnk.gtype" = cluster{"Scenario LOS-NLOS": T7, "d_2D (m)": f64, "d_3D (m)": f64, "f_C (Hz)": f64, "lambda_0": f64, "phi_LOS,AOA": f64, "phi_LOS,AOD": f64, "theta_LOS,ZOA": f64, "theta_LOS,ZOD": f64, "d_V_tx": f64, "d_H,tx": f64, "d_V_rx": f64, "d_H,rx": f64, "d_g,V,tx": f64, "d_g,H,tx": f64, "d_g,V,rx": f64, "d_g,H,rx": f64, "d_rx,u": f64[3], "d_tx,s": f64[3], "Align BS-UT?": bool, "Introduce Blockages in System?": bool, "UT Blockage Data (A)": T2[][][], "UT Blockage Data (B)": "blk_inf_UT_B.gtype", "Blockage Model": T8, "Blockage Settings (B)": T9, "Blockage Settings (A)": T11, "BS": "UP_BS.gtype", "UT": T13}
  T14 = cluster{"Type": enum{"SB", "NSB"}, "Class (for NSB)": T1, "Location (X,Y,Z)": f64[], "Attenuation": f64, "Cl. No.": i32, "t": f64}
  "blk_inf_cl_A.gtype" = cluster{"Blocker Info": T14[][], "No. of Blocked Cl. at time t": i32}
diagram:
  $LSP_out <- $LSP_in
  Property Node(instance in=$SSP_in) -> ("P_n"=w1, "phi_n_AOA"=w2, "theta_n_ZOA"=w3, "blk_cnt_ang_map_LOS-NLOS"=w4, instance out=w5)
  Property Node(instance in=$UP_lnk_in) -> ("lambda_0"=w6, "UT:Omega_UT,alpha"=w7, "UT:Omega_UT,beta"=w8, "UT:Omega_UT,gamma"=w9, "UT:Self-blocking Mode"=w10, "Blockage Settings (A)"=w11, "UT:UT_loc_curr"=w12, "UT:t"=w13, instance out=w14)
  Property Node(instance in=w11) -> ("Blockage Parameters (A)"=w15, "t_res_grd"=w16)
  Divide(x=w13, y=w16) -> w17
  To Long Integer(number=w17) -> w18
  # w19: phi_k
  # w20: x_k
  # w21: theta_k
  # w22: y_k
  # w23: r
  s1 = 0  # shift register
  for {
    w24 = each element of w15
    Property Node(instance in=w24) -> ("Class (NSB)"=w27, "Count (K)"=w28, "Blocker Trajectories"=w29)
    # blocker class loop
    Array Subset(array=w4, index0=s1, length0=w28) -> w30
    for {
      w31 = each element of w30
      w32 = each element of w29
      # blocker loop
      Property Node(instance in=w32) -> ("C"=w40)
      Array Index(array=w40) -> (out0[w18, _]=w41)
      call "get_crd_3D.gvi"(A=w41) -> (A_x=w42, A_y=w43, A_z=w44)
      # w45: loc at t=0
      Array Index(array=w40) -> (out0[0, _]=w45)
      call "get_crd_3D.gvi"(A=w45) -> (A_x=w46, A_y=w47, A_z=w48)
      call "calc_euc_dis_3D.gvi"(x_1=w42, y_1=w43, z_1=w44, x_2=w46, y_2=w47, z_2=w48) -> (d_12=w49)
      To Long Integer(number=w49) -> w50
      Is Equal To 0(x=w18) -> w51
      Select(s=w51, t=0, f=w50) -> w52
      Select(s=w51, t=0, f=w18) -> w53
      Array Index(array=w31) -> (out0[w52, w53]=w54)
      Multiply(w54, PiTimes2) -> w55
      Random Number() -> (number (0 to 1)=w56)
      Multiply(w56, 0.1745) -> w57
      Add(w57, 0.0873) -> w58
      w59 = 10  # r
      append w55 to w33
      append w58 to w34
      append PiOver2 to w35
      append 0.0873 to w36
      append w59 to w37
      append w27 to w38
      append w41 to w39
    }
    concatenate w33 onto w19
    concatenate w34 onto w20
    concatenate w35 onto w21
    concatenate w36 onto w22
    concatenate w37 onto w23
    concatenate w38 onto w25
    concatenate w39 onto w26
    next s1 = w28
  }
  Property Node(instance in=$"Cluster Blockage Data (A)") -> ("Blocker Info"=w60)
  # w61: x_sb
  Select(s=w10, t=2.7925, f=2.0944) -> w61
  # w10: T: LS mode
  call "conv_rad_to_deg.gvi"(angle (rad)=0.6981) -> (angle (deg)=w62)
  call "angle_mirr_azi.gvi"(angle_in (deg)=w62) -> (angle_out (deg)=w63)
  call "conv_deg_to_rad.gvi"(angle (deg)=w63) -> (angle (rad)=w64)
  call "conv_rad_to_deg.gvi"(angle (rad)=4.5379) -> (angle (deg)=w65)
  call "angle_mirr_azi.gvi"(angle_in (deg)=w65) -> (angle_out (deg)=w66)
  call "conv_deg_to_rad.gvi"(angle (deg)=w66) -> (angle (rad)=w67)
  # w68: phi'_sb
  Select(s=w10, t=w64, f=w67) -> w68
  # w69: theta'_sb
  Select(s=w10, t=1.9199, f=1.7453) -> w69
  # w70: y_sb
  Select(s=w10, t=1.309, f=1.3963) -> w70
  Array Index(array=w60) -> (out0[_, _]=w71)
  s2 = w60  # shift register
  for (iteration -> i1) {
    w72 = each element of w2
    w73 = each element of w3
    w74 = each element of w1
    # cluster loop
    # w76: phi'_AOA
    # w77: theta'_ZOA
    call "conv_gcs_lcs_spherical.gvi"(phi=w72, theta=w73, alpha=w7, beta=w8, gamma=w9) -> (phi'=w76, theta'=w77)
    Subtract(x=w76, y=w68) -> w78
    Multiply(w61, 0.5) -> w79
    Is Less(x=w78, y=w79) -> w80
    Negate(x=w79) -> w81
    Is Greater(x=w78, y=w81) -> w82
    Subtract(x=w77, y=w69) -> w83
    Multiply(w70, 0.5) -> w84
    Is Less(x=w83, y=w84) -> w85
    Negate(x=w84) -> w86
    Is Greater(x=w83, y=w86) -> w87
    Logical And(w80, w82, w85, w87) -> w88
    s3 = w71  # shift register
    s4 = 1  # shift register
    for (iteration -> i2) {
      w89 = each element of w19
      w90 = each element of w20
      w91 = each element of w21
      w92 = each element of w22
      w93 = each element of w23
      w94 = each element of w25
      w95 = each element of w26
      # blocker loop
      # w72: phi_AOA
      # w89: phi_k
      Subtract(x=w72, y=w89) -> w97
      Is Less(x=w97, y=w90) -> w98
      Negate(x=w90) -> w99
      Is Greater(x=w97, y=w99) -> w100
      # w90: x_k
      # w73: theta_ZOA
      # w91: theta_k
      Subtract(x=w73, y=w91) -> w101
      Is Less(x=w101, y=w92) -> w102
      Negate(x=w92) -> w103
      Is Greater(x=w101, y=w103) -> w104
      Logical And(w98, w100, w102, w104) -> w105
      # w92: y_k
      Multiply(w90, 0.5) -> w106
      # w107: A_1
      Subtract(x=w97, y=w106) -> w107
      Is Greater(x=w97, y=w106) -> w108
      Is Less Or Equal(x=w97, y=w90) -> w109
      # w110: Z_2
      Logical And(w108, w109) -> w111
      Negate(x=w106) -> w112
      Is Greater(x=w97, y=w112) -> w113
      Is Less Or Equal(x=w97, y=w106) -> w114
      Logical And(w113, w114) -> w115
      Negate(x=w90) -> w116
      Is Greater(x=w97, y=w116) -> w117
      Is Less Or Equal(x=w97, y=w112) -> w118
      Logical And(w117, w118) -> w119
      Build Array(w111, w115, w119) -> w120
      Boolean Array To Number(Boolean array=w120) -> (number=w121)
      Logarithm Base 2(x=w121) -> w122
      To Long Integer(number=w122) -> w123
      Array Index(array=[[-1, 1], [1, 1], [1, -1]]) -> (out0[w123, _]=w124)
      Array Index(array=w124) -> (out0[0]=w125)
      # w126: F_A,1
      call "blk_att_subfnc.gvi"(lambda_0=w6, r=w93, angle=w107, sign=w125) -> (F=w126)
      # w127: A_2
      # w106: x_k/2
      Add(w97, w106) -> w127
      Array Index(array=w124) -> (out0[1]=w128)
      # w129: F_A,2
      call "blk_att_subfnc.gvi"(lambda_0=w6, r=w93, angle=w127, sign=w128) -> (F=w129)
      Add(w126, w129) -> w130
      # w131: y_k/2
      Multiply(w92, 0.5) -> w131
      # w132: Z_1
      Subtract(x=w101, y=w131) -> w132
      Negate(x=w92) -> w133
      Is Greater(x=w101, y=w133) -> w134
      Negate(x=w131) -> w135
      Is Less Or Equal(x=w101, y=w135) -> w136
      Logical And(w134, w136) -> w137
      Is Greater(x=w101, y=w135) -> w138
      Is Less Or Equal(x=w101, y=w131) -> w139
      Logical And(w138, w139) -> w140
      Is Greater(x=w101, y=w131) -> w141
      Is Less Or Equal(x=w101, y=w92) -> w142
      Logical And(w141, w142) -> w143
      Build Array(w137, w140, w143) -> w144
      Boolean Array To Number(Boolean array=w144) -> (number=w145)
      Logarithm Base 2(x=w145) -> w146
      To Long Integer(number=w146) -> w147
      Array Index(array=[[1, -1], [1, 1], [-1, 1]]) -> (out0[w147, _]=w148)
      Array Index(array=w148) -> (out0[0]=w149)
      call "blk_att_subfnc.gvi"(lambda_0=w6, r=w93, angle=w132, sign=w149) -> (F=w150)
      Add(w101, w131) -> w110
      Array Index(array=w148) -> (out0[1]=w151)
      # w152: F_Z,2
      call "blk_att_subfnc.gvi"(lambda_0=w6, r=w93, angle=w110, sign=w151) -> (F=w152)
      # w150: F_Z,1
      Add(w150, w152) -> w153
      Multiply(w130, w153) -> w154
      Subtract(x=1, y=w154) -> w155
      # w156: compounded attn.
      case (w105) {
        frame False, Default {
          # s4: =1, if no NSB blockers
          w157 = s3
          w156 = s4
        }
        frame True {
          # store active blockers' info
          Multiply(s4, w155) -> w156
          Array Index(array=s3) -> (out0[_]=w158)
          Property Node(instance in=w158, "Type"="NSB", "Class (for NSB)"=w94, "Location (X,Y,Z)"=w95, "Attenuation"=w155, "Cl. No."=i1, "t"=w13) -> (instance out=w159)
          Build Array[ConcatenateInputs=True](s3, w159) -> w157
        }
      }
      append w105 to w96
      next s3 = w157
      next s4 = w156
    }
    Or Array Elements(Boolean array=w96) -> (logical OR=w160)
    Logical Or(w88, w160) -> w161
    # w74: P_n
    w162 = 0.001  # L_SB
    case (w88) {
      frame False, Default {
        w163 = w71
      }
      frame True {
        Array Index(array=w71) -> (out0[_]=w164)
        Property Node(instance in=w164, "Type"="SB", "Attenuation"=w162, "Cl. No."=i1, "t"=w13, "Location (X,Y,Z)"=w12) -> (instance out=w165)
        Build Array[ConcatenateInputs=True](w71, w165) -> w163
      }
    }
    Build Array[ConcatenateInputs=True](w163, s3) -> w166
    case (w161) {
      frame False, Default {
        w167 = s2
      }
      frame True {
        Build Array[ConcatenateInputs=True](s2, w166) -> w167
      }
    }
    # w88: SB
    Select(s=w88, t=w162, f=1) -> w168
    Multiply(w74, w168, s4) -> w169
    append w169 to w75
    next s2 = w167
  }
  Array Size(array=s2) -> (size(s)=w170)
  Array Index(array=w170) -> (out0[_]=w171)
  Property Node(instance in=w5, "P_n,pre_blk"=w1, "P_n"=w75, "Cluster Blockage Data (A):Blocker Info"=s2, "Cluster Blockage Data (A):No. of Blocked Cl. at time t"=w171) -> (instance out=w172)
  $SSP_out <- w172
  $UP_lnk_out <- w14
  # NOTES:
  #
  # -- v1: spatially correlated
  # -- Model A based
  # -- only UMi-SC case
  # -- all angle values have been converted to radians
  # -- SB azimuth angles need mirroring, zenith ones do not. Can set to constants, however, left as is now.
  $error_out <- $error_in
