vi "blockage_model_A_v2.gvi"   [LabVIEW Communications System Design Suite 2.0.1]
inputs:
  "UP_lnk_in": "UP_lnk.gtype"
  "SSP_in": "SSP.gtype"
  "LSP_in": "LSP.gtype"
  "error_in": error
outputs:
  "SSP_out": "SSP.gtype"
  "LSP_out": "LSP.gtype"
  "UP_lnk_out": "UP_lnk.gtype"
  "error_out": error
panel controls:
  "Cluster Blockage Data": "blk_inf_cl_A.gtype"
types:
  T1 = enum{"Pedestrian", "Cyclist", "City Motorist", "Freeway Motorist", "Train"}
  T2 = cluster{"Type": enum{"SB", "NSB"}, "Class (for NSB)": T1, "Location (X,Y,Z)": i32[], "Attenuation": f64, "Cl. No.": i32, "t": f64}
  T3 = cluster{"Blocker Info": T2[][], "No. of Blocked Cl. at time t": i32}
  T4 = cluster{"Cl. Attn. (ray aggr.)": f64, "No. of Blocked Rays": i32, "Ray Blocker Array (B)": "blk_inf_ry_B.gtype"[]}
  "blk_inf_cl_B.gtype" = cluster{"Blocker Info": T4[], "No. of Blocked Cl. at time t": i32}
  "SSP.gtype" = cluster{"N": i32, "M": i32, "tau_n": f64[], "tau_n,i": f64[], "min(tau'_n)": f64, "P_n": f64[], "P_n,pre_blk": f64[], "P_n,m": f64[][], "phi_n_AOA": f64[], "phi_n,m,AOA": f64[][], "theta_n_ZOA": f64[], "theta_n,m,ZOA": f64[][], "phi_n_AOD": f64[], "phi_n,m,AOD": f64[][], "theta_n_ZOD": f64[], "theta_n,m,ZOD": f64[][], "phi_theta_n,m,cpl": f64[][][], "XPR": f64[][], "Phi_n,m,theta,theta": f64[][], "Phi_n,m,theta,phi": f64[][], "Phi_n,m,phi,theta": f64[][], "Phi_n,m,phi, phi": f64[][], "H_u,s,n,NLOS": c128[], "H_u,s,n,i,NLOS": c128[], "H_u,s,NLOS": c128, "H_u,s,1,LOS": c128, "H_u,s": c128, "H": c128[][], "H_u,s,n": c128[][][], "cl_sp_delay_map_LOS": f64[][][], "cl_sp_delay_map_NLOS": f64[][][], "cl_sp_shadowing_map_LOS": f64[][][], "cl_sp_shadowing_map_NLOS": f64[][][], "cl_sp_offset_AOD_map_LOS": f64[][][], "cl_sp_offset_AOD_map_NLOS": f64[][][], "cl_sp_offset_AOA_map_LOS": f64[][][], "cl_sp_offset_AOA_map_NLOS": f64[][][], "cl_sp_offset_ZOD_map_LOS": f64[][][], "cl_sp_offset_ZOD_map_NLOS": f64[][][], "cl_sp_offset_ZOA_map_LOS": f64[][][], "cl_sp_offset_ZOA_map_NLOS": f64[][][], "ray_XPR_map_LOS": f64[][][], "ray_XPR_map_NLOS": f64[][][], "ray_ini_phase_theta,phi_map_LOS": f64[][][], "ray_ini_phase_theta,theta_map_LOS": f64[][][], "pr_los_map": f64[][], "cl_sp_sign_AOD_map_LOS": i32[][][], "cl_sp_sign_AOD_map_NLOS": i32[][][], "cl_sp_sign_AOA_map_LOS": i32[][][], "cl_sp_sign_AOA_map_NLOS": i32[][][], "cl_sp_sign_ZOD_map_LOS": i32[][][], "cl_sp_sign_ZOD_map_NLOS": i32[][][], "cl_sp_sign_ZOA_map_LOS": i32[][][], "cl_sp_sign_ZOA_map_NLOS": i32[][][], "ray_ini_phase_phi,phi_map_LOS": f64[][][], "ray_ini_phase_phi,theta_map_LOS": f64[][][], "ray_ini_phase_theta,phi_map_NLOS": f64[][][], "ray_ini_phase_theta,theta_map_NLOS": f64[][][], "ray_ini_phase_phi,phi_map_NLOS": f64[][][], "ray_ini_phase_phi,theta_map_NLOS": f64[][][], "Xn_map": f64[][][], "H_sc": c128[][][], "tau_n_sc": f64[][], "P_n_sc": f64[][], "P_n_pre_blk_sc": f64[][], "blk_cnt_ang_map_LOS-NLOS": f64[][][], "Cluster Blockage Data (A)": T3, "Cluster Blockage Data (B)": "blk_inf_cl_B.gtype"}
  T5 = cluster{"SF": f64, "K": f64, "DS": f64, "ASD": f64, "ASA": f64, "ZSD": f64, "ZSA": f64, "mu_XPR_dB": f64}
  T6 = cluster{"mu_SF_dB": f64, "sig_SF_dB": f64, "mu_K_dB": f64, "sig_K_dB": f64, "mu_lgDS": f64, "sig_lgDS": f64, "mu_lgASD": f64, "sig_lgASD": f64, "mu_lgASA": f64, "sig_lgASA": f64, "mu_lgZSD": f64, "sig_lgZSD": f64, "mu_lgZSA": f64, "sig_lgZSA": f64, "mu_XPR_dB": f64, "sig_XPR_dB": f64}
  "LSP.gtype" = cluster{"LSP": T5, "LSP_mu_sig": T6, "PL_dB": f64, "mu_PL_dB": f64, "LSP_map_LOS": f64[][][], "LSP_map_NLOS": f64[][][], "n_r,grd": i32, "n_c,grd": i32}
  T7 = enum{"UMi - Street Canyon (LOS)", "UMi - Street Canyon (NLOS)"}
  T8 = cluster{"X_BS (m)": i32, "Y_BS (m)": i32, "h_BS (m)": i32, "Omega_BS,alpha": f64, "Omega_BS,beta": f64, "Omega_BS,gamma": f64, "zeta_tx": f64, "M,tx": i32, "N,tx": i32, "M_g,tx": i32, "N_g,tx": i32, "s": i32}
  T9 = cluster{"Class": T1, "Velocity": f64, "Count (K)": i32, "Location (C)": i32[][]}
  T10 = cluster{"Blocker Parameters (A)": T9[], "Blockage Grid Margin-X": i32, "Blockage Grid Margin-Y": i32, "t_max_grd": f64, "t_res_grd": f64}
  T11 = cluster{"t": f64[], "C": i32[][], "d_2D": f64[], "d_3D": f64[], "V": f64[][], "v": f64[], "v_avg": f64}
  T12 = cluster{"X_UT (m)": i32, "Y_UT (m)": i32, "h_UT (m)": i32, "v": f64, "phi_v": f64, "theta_v": f64, "t": f64, "Omega_UT,alpha": f64, "Omega_UT,beta": f64, "Omega_UT,gamma": f64, "zeta_rx": f64, "N,rx": i32, "M,rx": i32, "N_g,rx": i32, "M_g,rx": i32, "u": i32, "Introduce Blockages?": bool, "Self-blocking Mode": bool, "X_UT_end": i32, "Y_UT_end": i32, "h_UT_end": i32, "step_std_X": f64, "step_std_Y": f64, "step_std_Z": f64, "t_total (s)": f64, "t_step (s)": f64, "UT_loc_curr": i32[], "Blockage Model": enum{"A", "B"}, "trj_UT": T11}
  T13 = cluster{"Blockage Grid Margin-X": i32, "Blockage Grid Margin-Y": i32, "Blockage Parameters (B)": "UP_blk_B.gtype"[]}
  "UP_lnk.gtype" = cluster{"Scenario LOS-NLOS": T7, "d_2D (m)": f64, "d_3D (m)": f64, "f_C (Hz)": f64, "lambda_0": f64, "phi_LOS,AOA": f64, "phi_LOS,AOD": f64, "theta_LOS,ZOA": f64, "theta_LOS,ZOD": f64, "d_V_tx": f64, "d_H,tx": f64, "d_V_rx": f64, "d_H,rx": f64, "d_g,V,tx": f64, "d_g,H,tx": f64, "d_g,V,rx": f64, "d_g,H,rx": f64, "d_rx,u": f64[3], "d_tx,s": f64[3], "BS": T8, "Align BS-UT?": bool, "Blockage Settings (A)": T10, "Introduce Blockages in System?": bool, "UT Blockage Data (A)": T2[][][], "UT": T12, "Blockage Settings (B)": T13}
  "blk_inf_cl_A.gtype" = cluster{"Blocker Info": T2[][], "No. of Blocked Cl. at time t": i32}
diagram:
  $LSP_out <- $LSP_in
  Property Node(instance in=$SSP_in) -> ("P_n"=w1, "phi_n_AOA"=w2, "theta_n_ZOA"=w3, "blk_cnt_ang_map_LOS-NLOS"=w4, instance out=w5)
  Property Node(instance in=$UP_lnk_in) -> ("lambda_0"=w6, "UT:Omega_UT,alpha"=w7, "UT:Omega_UT,beta"=w8, "UT:Omega_UT,gamma"=w9, "UT:Self-blocking Mode"=w10, "Blockage Settings (A)"=w11, "UT:UT_loc_curr"=w12, "UT:t"=w13, instance out=w14)
  Property Node(instance in=w11) -> ("Blocker Parameters (A)"=w15, "t_res_grd"=w16)
  Array Index(array=w12) -> (out0[0]=w17)
  Array Index(array=w12) -> (out0[1]=w18)
  Array Index(array=w12) -> (out0[2]=w19)
  Divide(x=w13, y=w16) -> w20
  To Long Integer(number=w20) -> w21
  for {
    w22 = each element of w15
    w23 = each element of w4
    Property Node(instance in=w22) -> ("Class"=w31, "Location (C)"=w32)
    # blocker class loop
    for {
      w33 = each element of w32
      # blocker loop
      Array Index(array=w33) -> (out0[0]=w40)
      Subtract(x=w40, y=w17) -> w41
      Square(x=w41) -> w42
      Array Index(array=w33) -> (out0[1]=w43)
      Subtract(x=w43, y=w18) -> w44
      Square(x=w44) -> w45
      Array Index(array=w33) -> (out0[2]=w46)
      Subtract(x=w46, y=w19) -> w47
      Square(x=w47) -> w48
      Add(w42, w45, w48) -> w49
      Square Root(x=w49) -> w50
      # w51: d_UT-blk
      To Long Integer(number=w50) -> w51
      Array Index(array=w23) -> (out0[w51, w21]=w52)
      Multiply(w52, PiTimes2) -> w53
      Random Number() -> (number (0 to 1)=w54)
      Multiply(w54, 0.1745) -> w55
      Add(w55, 0.0873) -> w56
      w57 = 10  # r
      append w53 to w34
      append w56 to w35
      append PiOver2 to w36
      append 0.0873 to w37
      append w57 to w38
      append w31 to w39
    }
    concatenate w34 onto w24
    concatenate w35 onto w25
    concatenate w36 onto w26
    concatenate w37 onto w27
    concatenate w38 onto w28
    concatenate w39 onto w29
    concatenate w32 onto w30
  }
  Property Node(instance in=$"Cluster Blockage Data") -> ("Blocker Info"=w58)
  Select(s=w10, t=2.7925, f=2.0944) -> w59
  Select(s=w10, t=0.6981, f=4.5379) -> w60
  Select(s=w10, t=1.9199, f=1.7453) -> w61
  Select(s=w10, t=1.309, f=1.3963) -> w62
  Array Index(array=w58) -> (out0[_, _]=w63)
  # w59: x_sb
  # w60: phi'_sb
  # w61: theta'_sb
  # w62: y_sb
  # w24: phi_k
  # w25: x_k
  # w26: theta_k
  # w27: y_k
  # w28: r
  s1 = w58  # shift register
  for (iteration -> i1) {
    w64 = each element of w2
    w65 = each element of w3
    w66 = each element of w1
    # cluster loop
    # w68: phi'_AOA
    # w69: theta'_ZOA
    call "conv_gcs_lcs_spherical.gvi"(phi=w64, theta=w65, alpha=w7, beta=w8, gamma=w9) -> (phi'=w68, theta'=w69)
    Subtract(x=w68, y=w60) -> w70
    Multiply(w59, 0.5) -> w71
    Is Less(x=w70, y=w71) -> w72
    Negate(x=w71) -> w73
    Is Greater(x=w70, y=w73) -> w74
    Subtract(x=w69, y=w61) -> w75
    Multiply(w62, 0.5) -> w76
    Is Less(x=w75, y=w76) -> w77
    Negate(x=w76) -> w78
    Is Greater(x=w75, y=w78) -> w79
    Logical And(w72, w74, w77, w79) -> w80
    s2 = T1[] []  # shift register
    s3 = i32[][] []  # shift register
    s4 = w63  # shift register
    s5 = uninitialised  # shift register
    s6 = 1  # shift register
    for {
      w81 = each element of w24
      w82 = each element of w25
      w83 = each element of w26
      w84 = each element of w27
      w85 = each element of w28
      w86 = each element of w29
      w87 = each element of w30
      # blocker loop
      # w64: phi_AOA
      # w81: phi_k
      Subtract(x=w64, y=w81) -> w89
      Is Less(x=w89, y=w82) -> w90
      Negate(x=w82) -> w91
      Is Greater(x=w89, y=w91) -> w92
      # w82: x_k
      # w65: theta_ZOA
      # w83: theta_k
      Subtract(x=w65, y=w83) -> w93
      Is Less(x=w93, y=w84) -> w94
      Negate(x=w84) -> w95
      Is Greater(x=w93, y=w95) -> w96
      Logical And(w90, w92, w94, w96) -> w97
      # w84: y_k
      Multiply(w82, 0.5) -> w98
      # w99: A_1
      Subtract(x=w89, y=w98) -> w99
      Is Greater(x=w89, y=w98) -> w100
      Is Less Or Equal(x=w89, y=w82) -> w101
      # w102: Z_2
      Logical And(w100, w101) -> w103
      Negate(x=w98) -> w104
      Is Greater(x=w89, y=w104) -> w105
      Is Less Or Equal(x=w89, y=w98) -> w106
      Logical And(w105, w106) -> w107
      Negate(x=w82) -> w108
      Is Greater(x=w89, y=w108) -> w109
      Is Less Or Equal(x=w89, y=w104) -> w110
      Logical And(w109, w110) -> w111
      Build Array(w103, w107, w111) -> w112
      Boolean Array To Number(Boolean array=w112) -> (number=w113)
      Logarithm Base 2(x=w113) -> w114
      To Long Integer(number=w114) -> w115
      Array Index(array=[[-1, 1], [1, 1], [1, -1]]) -> (out0[w115, _]=w116)
      Array Index(array=w116) -> (out0[0]=w117)
      # w118: F_A,1
      call "blk_att_subfnc.gvi"(lambda_0=w6, r=w85, angle=w99, sign=w117) -> (F=w118)
      # w119: A_2
      # w98: x_k/2
      Add(w89, w98) -> w119
      Array Index(array=w116) -> (out0[1]=w120)
      # w121: F_A,2
      call "blk_att_subfnc.gvi"(lambda_0=w6, r=w85, angle=w119, sign=w120) -> (F=w121)
      Add(w118, w121) -> w122
      # w123: y_k/2
      Multiply(w84, 0.5) -> w123
      # w124: Z_1
      Subtract(x=w93, y=w123) -> w124
      Negate(x=w84) -> w125
      Is Greater(x=w93, y=w125) -> w126
      Negate(x=w123) -> w127
      Is Less Or Equal(x=w93, y=w127) -> w128
      Logical And(w126, w128) -> w129
      Is Greater(x=w93, y=w127) -> w130
      Is Less Or Equal(x=w93, y=w123) -> w131
      Logical And(w130, w131) -> w132
      Is Greater(x=w93, y=w123) -> w133
      Is Less Or Equal(x=w93, y=w84) -> w134
      Logical And(w133, w134) -> w135
      Build Array(w129, w132, w135) -> w136
      Boolean Array To Number(Boolean array=w136) -> (number=w137)
      Logarithm Base 2(x=w137) -> w138
      To Long Integer(number=w138) -> w139
      Array Index(array=[[1, -1], [1, 1], [-1, 1]]) -> (out0[w139, _]=w140)
      Array Index(array=w140) -> (out0[0]=w141)
      call "blk_att_subfnc.gvi"(lambda_0=w6, r=w85, angle=w124, sign=w141) -> (F=w142)
      Add(w93, w123) -> w102
      Array Index(array=w140) -> (out0[1]=w143)
      # w144: F_Z,2
      call "blk_att_subfnc.gvi"(lambda_0=w6, r=w85, angle=w102, sign=w143) -> (F=w144)
      # w142: F_Z,1
      Add(w142, w144) -> w145
      Multiply(w122, w145) -> w146
      Subtract(x=1, y=w146) -> w147
      # w148: compounded attn.
      case (w97) {
        frame False, Default {
          # s6: =1, if no NSB blockers
          w149 = s3
          w150 = s2
          w151 = s4
          w152 = s5
          w148 = s6
        }
        frame True {
          # store active blockers' info
          Build Array[ConcatenateInputs=True](s5, w147) -> w152
          Multiply(s6, w147) -> w148
          Build Array[ConcatenateInputs=True](s3, w87) -> w149
          Build Array[ConcatenateInputs=True](s2, w86) -> w150
          Array Index(array=s4) -> (out0[_]=w153)
          Property Node(instance in=w153, "Type"="NSB", "Class (for NSB)"=w86, "Location (X,Y,Z)"=w87, "Attenuation"=w147, "Cl. No."=i1, "t"=w13) -> (instance out=w154)
          Build Array[ConcatenateInputs=True](s4, w154) -> w151
        }
      }
      append w97 to w88
      next s2 = w150
      next s3 = w149
      next s4 = w151
      next s5 = w152
      next s6 = w148
    }
    Or Array Elements(Boolean array=w88) -> (logical OR=w155)
    Logical Or(w80, w155) -> w156
    # w66: P_n
    w157 = 0.001  # L_SB
    case (w80) {
      frame False, Default {
        w158 = w63
      }
      frame True {
        Array Index(array=w63) -> (out0[_]=w159)
        Property Node(instance in=w159, "Type"="SB", "Attenuation"=w157, "Cl. No."=i1, "t"=w13, "Location (X,Y,Z)"=w12) -> (instance out=w160)
        Build Array[ConcatenateInputs=True](w63, w160) -> w158
      }
    }
    Build Array[ConcatenateInputs=True](w158, s4) -> w161
    case (w156) {
      frame False, Default {
        w162 = s1
      }
      frame True {
        Build Array[ConcatenateInputs=True](s1, w161) -> w162
      }
    }
    # w80: SB
    Select(s=w80, t=w157, f=1) -> w163
    Multiply(w66, w163, s6) -> w164
    append w164 to w67
    next s1 = w162
  }
  Array Size(array=s1) -> (size(s)=w165)
  Array Index(array=w165) -> (out0[_]=w166)
  Property Node(instance in=w5, "P_n,pre_blk"=w1, "P_n"=w67, "Cluster Blockage Data (A):Blocker Info"=s1, "Cluster Blockage Data (A):No. of Blocked Cl. at time t"=w166) -> (instance out=w167)
  $SSP_out <- w167
  $UP_lnk_out <- w14
  # NOTES:
  #
  # -- v2: each blocker has a trajectory and autocorr. is computed w.r.t. the blocker distance and time
  # -- Model A based
  # -- only UMi-SC case
  # -- all angle values have been converted to radians
  $error_out <- $error_in
