vi "blokage_model_B_v0.gvi"   [LabVIEW Communications System Design Suite 2.0.1]
inputs:
  "UP_lnk_in": "UP_lnk.gtype"
  "LSP_in": "LSP.gtype"
  "SSP_in": "SSP.gtype"
  "error_in": error
outputs:
  "error_out": error
  "UP_lnk_out": "UP_lnk.gtype"
  "LSP_out": "LSP.gtype"
  "SSP_out": "SSP.gtype"
types:
  T1 = enum{"Pedestrian", "Cyclist", "City Motorist", "Freeway Motorist", "Train"}
  T2 = cluster{"Type": enum{"SB", "NSB"}, "Class (for NSB)": T1, "Location (X,Y,Z)": i32[], "Attenuation": f64, "Cl. No.": i32, "t": f64}
  T3 = cluster{"Blocker Info": T2[][], "No. of Blocked Cl. at time t": i32}
  T4 = cluster{"Cl. Attn. (ray aggr.)": f64, "No. of Blocked Rays": i32, "Ray Blocker Array": "blk_inf_ry_B.gtype"[], "Cl. No.": i32}
  "blk_inf_cl_B.gtype" = cluster{"Cluster Blocker Array": T4[], "No. of Blocked Cl. at time t": i32}
  "SSP.gtype" = cluster{"N": i32, "M": i32, "tau_n": f64[], "tau_n,i": f64[], "min(tau'_n)": f64, "P_n": f64[], "P_n,pre_blk": f64[], "P_n,m": f64[][], "phi_n_AOA": f64[], "phi_n,m,AOA": f64[][], "theta_n_ZOA": f64[], "theta_n,m,ZOA": f64[][], "phi_n_AOD": f64[], "phi_n,m,AOD": f64[][], "theta_n_ZOD": f64[], "theta_n,m,ZOD": f64[][], "phi_theta_n,m,cpl": f64[][][], "XPR": f64[][], "Phi_n,m,theta,theta": f64[][], "Phi_n,m,theta,phi": f64[][], "Phi_n,m,phi,theta": f64[][], "Phi_n,m,phi, phi": f64[][], "H_u,s,n,NLOS": c128[], "H_u,s,n,i,NLOS": c128[], "H_u,s,NLOS": c128, "H_u,s,1,LOS": c128, "H_u,s": c128, "H": c128[][], "H_u,s,n": c128[][][], "cl_sp_delay_map_LOS": f64[][][], "cl_sp_delay_map_NLOS": f64[][][], "cl_sp_shadowing_map_LOS": f64[][][], "cl_sp_shadowing_map_NLOS": f64[][][], "cl_sp_offset_AOD_map_LOS": f64[][][], "cl_sp_offset_AOD_map_NLOS": f64[][][], "cl_sp_offset_AOA_map_LOS": f64[][][], "cl_sp_offset_AOA_map_NLOS": f64[][][], "cl_sp_offset_ZOD_map_LOS": f64[][][], "cl_sp_offset_ZOD_map_NLOS": f64[][][], "cl_sp_offset_ZOA_map_LOS": f64[][][], "cl_sp_offset_ZOA_map_NLOS": f64[][][], "ray_XPR_map_LOS": f64[][][], "ray_XPR_map_NLOS": f64[][][], "ray_ini_phase_theta,phi_map_LOS": f64[][][], "ray_ini_phase_theta,theta_map_LOS": f64[][][], "pr_los_map": f64[][], "cl_sp_sign_AOD_map_LOS": i32[][][], "cl_sp_sign_AOD_map_NLOS": i32[][][], "cl_sp_sign_AOA_map_LOS": i32[][][], "cl_sp_sign_AOA_map_NLOS": i32[][][], "cl_sp_sign_ZOD_map_LOS": i32[][][], "cl_sp_sign_ZOD_map_NLOS": i32[][][], "cl_sp_sign_ZOA_map_LOS": i32[][][], "cl_sp_sign_ZOA_map_NLOS": i32[][][], "ray_ini_phase_phi,phi_map_LOS": f64[][][], "ray_ini_phase_phi,theta_map_LOS": f64[][][], "ray_ini_phase_theta,phi_map_NLOS": f64[][][], "ray_ini_phase_theta,theta_map_NLOS": f64[][][], "ray_ini_phase_phi,phi_map_NLOS": f64[][][], "ray_ini_phase_phi,theta_map_NLOS": f64[][][], "Xn_map": f64[][][], "H_sc": c128[][][], "tau_n_sc": f64[][], "P_n_sc": f64[][], "P_n_pre_blk_sc": f64[][], "blk_cnt_ang_map_LOS-NLOS": f64[][][], "Cluster Blockage Data (A)": T3, "Cluster Blockage Data (B)": "blk_inf_cl_B.gtype", "P_n,drv": f64[], "P_n,drv_sc": f64[][], "P_n,drv_pre_blk_sc": f64[][], "P_n,i": f64[]}
  T5 = cluster{"SF": f64, "K": f64, "DS": f64, "ASD": f64, "ASA": f64, "ZSD": f64, "ZSA": f64, "mu_XPR_dB": f64}
  T6 = cluster{"mu_SF_dB": f64, "sig_SF_dB": f64, "mu_K_dB": f64, "sig_K_dB": f64, "mu_lgDS": f64, "sig_lgDS": f64, "mu_lgASD": f64, "sig_lgASD": f64, "mu_lgASA": f64, "sig_lgASA": f64, "mu_lgZSD": f64, "sig_lgZSD": f64, "mu_lgZSA": f64, "sig_lgZSA": f64, "mu_XPR_dB": f64, "sig_XPR_dB": f64}
  "LSP.gtype" = cluster{"LSP": T5, "LSP_mu_sig": T6, "PL_dB": f64, "mu_PL_dB": f64, "LSP_map_LOS": f64[][][], "LSP_map_NLOS": f64[][][], "n_r,grd": i32, "n_c,grd": i32}
  T7 = enum{"UMi - Street Canyon (LOS)", "UMi - Street Canyon (NLOS)"}
  "blk_inf_UT_B.gtype" = "blk_inf_cl_B.gtype"[]
  T8 = enum{"A - Generic", "B - Generic", "B - Gramercy Park"}
  T9 = cluster{"Blockage Grid Margin-X": i32, "Blockage Grid Margin-Y": i32, "Blockage Parameters (B)": "UP_blk_B.gtype"[], "t_total_blk (s)": f64, "t_stp_blk (s)": f64}
  T10 = cluster{"Class (NSB)": T1, "Velocity": f64, "Count (K)": i32, "Blocker Trajectories": "trj_blk_B.gtype"[]}
  T11 = cluster{"Blockage Grid Margin-X": i32, "Blockage Grid Margin-Y": i32, "t_max_grd": f64, "t_res_grd": f64, "Blockage Parameters (A)": T10[], "d_res_grd": f64}
  "UP_BS.gtype" = cluster{"X_BS (m)": f64, "Y_BS (m)": f64, "h_BS (m)": f64, "Omega_BS,alpha": f64, "Omega_BS,beta": f64, "Omega_BS,gamma": f64, "zeta_tx": f64, "M,tx": i32, "N,tx": i32, "M_g,tx": i32, "N_g,tx": i32, "s": i32, "BF Parameters": "UP_bf.gtype"}
  T12 = cluster{"t": f64[], "C": i32[][], "d_2D": f64[], "d_3D": f64[], "V": f64[][], "v": f64[], "v_avg": f64}
  T13 = cluster{"X_UT (m)": i32, "Y_UT (m)": i32, "h_UT (m)": i32, "v": f64, "phi_v": f64, "theta_v": f64, "t": f64, "Omega_UT,alpha": f64, "Omega_UT,beta": f64, "Omega_UT,gamma": f64, "zeta_rx": f64, "N,rx": i32, "M,rx": i32, "N_g,rx": i32, "M_g,rx": i32, "u": i32, "Introduce Blockages?": bool, "Self-blocking Mode": bool, "X_UT_end": i32, "Y_UT_end": i32, "h_UT_end": i32, "step_std_X": f64, "step_std_Y": f64, "step_std_Z": f64, "t_total (s)": f64, "t_step (s)": f64, "UT_loc_curr": i32[], "trj_UT": T12, "Blockage Model": T8, "BF Parameters": "UP_bf.gtype"}
  "UP_lnk.gtype" = cluster{"Scenario LOS-NLOS": T7, "d_2D (m)": f64, "d_3D (m)": f64, "f_C (Hz)": f64, "lambda_0": f64, "phi_LOS,AOA": f64, "phi_LOS,AOD": f64, "theta_LOS,ZOA": f64, "theta_LOS,ZOD": f64, "d_V_tx": f64, "d_H,tx": f64, "d_V_rx": f64, "d_H,rx": f64, "d_g,V,tx": f64, "d_g,H,tx": f64, "d_g,V,rx": f64, "d_g,H,rx": f64, "d_rx,u": f64[3], "d_tx,s": f64[3], "Align BS-UT?": bool, "Introduce Blockages in System?": bool, "UT Blockage Data (A)": T2[][][], "UT Blockage Data (B)": "blk_inf_UT_B.gtype", "Blockage Model": T8, "Blockage Settings (B)": T9, "Blockage Settings (A)": T11, "BS": "UP_BS.gtype", "UT": T13}
  "blk_inf_ry_B.gtype" = cluster{"Location (X,Y,Z)": i32[], "Ray Attn.": f64, "Ray No.": i32, "t": f64, "Class": enum{"Pedestrian", "Vehicle"}}
diagram:
  $LSP_out <- $LSP_in
  Property Node(instance in=$SSP_in) -> ("P_n"=w1, "phi_n,m,AOA"=w2, "theta_n,m,ZOA"=w3, "P_n,m"=w4, instance out=w5)
  # NOTES:
  #
  # [1] UT and blocker time is synchronized in Model B
  Property Node(instance in=$UP_lnk_in) -> ("Scenario LOS-NLOS"=w6, "lambda_0"=w7, "BS:X_BS (m)"=w8, "BS:Y_BS (m)"=w9, "BS:h_BS (m)"=w10, "UT:UT_loc_curr"=w11, "UT:t"=w12, "Blockage Settings (B):Blockage Parameters (B)"=w13, "Blockage Settings (B):t_stp_blk (s)"=w14, instance out=w15)
  Property Node(instance in="blk_inf_cl_B.gtype" {all zero or empty}) -> ("Cluster Blocker Array"=w16)
  # w17: [1]
  for {
    w18 = each element of w13
    # blocker class loop
    Property Node(instance in=w18) -> ("Blocker Trajectories"=w23, "Class"=w24, "Count (K)"=w25, "w"=w26, "h"=w27)
    Initialize Array(element=w24, size=w25) -> w28
    Initialize Array(element=w26, size=w25) -> w29
    Initialize Array(element=w27, size=w25) -> w30
    concatenate w23 onto w19
    concatenate w28 onto w20
    concatenate w29 onto w21
    concatenate w30 onto w22
  }
  Divide(x=w12, y=w14) -> w31
  To Long Integer(number=w31) -> w17
  Build Array(w8, w9, w10) -> w32
  Array Index(array=w16) -> (out0[0]=w33)
  Property Node(instance in=w33) -> ("Ray Blocker Array"=w34)
  Array Index(array=w34) -> (out0[_]=w35)
  s1 = w16  # shift register
  for (iteration -> i1) {
    w36 = each element of w2
    w37 = each element of w3
    w38 = each element of w4
    w39 = each element of w1
    # cluster loop
    case (w6) {
      frame "UMi - Street Canyon (LOS)", Default {
        Is Equal To 0(x=i1) -> w44
        Select(s=w44, t="UMi - Street Canyon (LOS)", f="UMi - Street Canyon (NLOS)") -> w43
      }
      frame "UMi - Street Canyon (NLOS)" {
        w43 = w6
      }
    }
    s2 = "blk_inf_ry_B.gtype"[] []  # shift register
    for (iteration -> i2) {
      w45 = each element of w36
      w46 = each element of w37
      w47 = each element of w38
      # ray loop
      s3 = 1  # shift register
      s4 = s2  # shift register
      for {
        w51 = each element of w19
        w52 = each element of w20
        w53 = each element of w21
        w54 = each element of w22
        # w17: curr_t_idx
        Property Node(instance in=w51) -> ("C"=w56)
        Array Index(array=w56) -> (out0[w17, _]=w57)
        call "blk_int_test_B.gvi"(Scenario LOS-NLOS=w43, error_in=$error_in, T=w32, C=w57, w=w53, h=w54, R=w11, phi_n,m,AOA (rad)=w45, theta_n,m,ZOA (rad)=w46) -> (int AZI=w58, error_out=w59, r_zen=w60, D_F_w1=w61, D_F_w2=w62, sgn_F_w1=w63, sgn_F_w2=w64, int ZEN=w65, D_F_h1=w66, D_F_h2=w67, r_azi=w68, sgn_F_h2=w69, sgn_F_h1=w70)
        Logical Or(w58, w65) -> w71
        # w72: F_w,1
        call "blk_att_subfnc_B.gvi"(lambda_0=w7, sgn=w63, D=w61, r=w68) -> (F=w72)
        # w73: F_w,2
        call "blk_att_subfnc_B.gvi"(lambda_0=w7, sgn=w64, D=w62, r=w68) -> (F=w73)
        Add(w72, w73) -> w74
        # w75: F_h,1
        call "blk_att_subfnc_B.gvi"(lambda_0=w7, sgn=w70, D=w66, r=w60) -> (F=w75)
        # w76: F_h,2
        call "blk_att_subfnc_B.gvi"(lambda_0=w7, sgn=w69, D=w67, r=w60) -> (F=w76)
        Add(w75, w76) -> w77
        Multiply(w74, w77) -> w78
        Subtract(x=1, y=w78) -> w79
        Select(s=w71, t=w79, f=1) -> w80
        # blocker loop
        Property Node(instance in=w35, "Class"=w52, "Location (X,Y,Z)"=w57, "Ray Attn."=w80, "t"=w12, "Ray No."=i2) -> (instance out=w81)
        Build Array[ConcatenateInputs=True](s4, w81) -> w82
        Select(s=w71, t=w82, f=s4) -> w83
        Multiply(s3, w80) -> w84
        append w71 to w55
        next s3 = w84
        next s4 = w83
      }
      Multiply(w47, s3) -> w85
      Or Array Elements(Boolean array=w55) -> (logical OR=w86)
      Boolean To Integer(Boolean=w86) -> (0, 1=w87)
      append w85 to w48
      append w87 to w49
      append w86 to w50
      next s2 = s4
    }
    Add Array Elements(numeric array=w48) -> (sum=w88)
    Or Array Elements(Boolean array=w50) -> (logical OR=w89)
    Select(s=w89, t=w88, f=w39) -> w90
    Add Array Elements(numeric array=w49) -> (sum=w91)
    Divide(x=w88, y=w39) -> w92
    Property Node(instance in=w33, "Cl. No."=i1, "Cl. Attn. (ray aggr.)"=w92, "No. of Blocked Rays"=w91, "Ray Blocker Array"=s2) -> (instance out=w93)
    Build Array[ConcatenateInputs=True](s1, w93) -> w94
    Select(s=w89, t=w94, f=s1) -> w95
    Boolean To Integer(Boolean=w89) -> (0, 1=w96)
    append w48 to w40
    append w90 to w41
    append w96 to w42
    next s1 = w95
  }
  Add Array Elements(numeric array=w42) -> (sum=w97)
  Property Node(instance in="blk_inf_cl_B.gtype" {all zero or empty}, "Cluster Blocker Array"=s1, "No. of Blocked Cl. at time t"=w97) -> (instance out=w98)
  Property Node(instance in=w5, "P_n,pre_blk"=w1, "P_n"=w41, "P_n,m"=w40, "Cluster Blockage Data (B)"=w98) -> (instance out=w99)
  $SSP_out <- w99
  $UP_lnk_out <- w15
  $error_out <- w59
