vi "cal_phasor.gvi"   [LabVIEW Communications System Design Suite 2.0.1]
inputs:
  "x": f64
  "lambda_0": f64
outputs:
  "exp(i*2*pi*x/lambda_0)": c128
diagram:
  Reciprocal(x=$lambda_0) -> w1
  Multiply(0+1i, PiTimes2, w1, $x) -> w2
  Exponential(x=w2) -> w3
  $"exp(i*2*pi*x/lambda_0)" <- w3
