vi "calc_2d_conv.gvi"   [LabVIEW Communications System Design Suite 2.0.1]
inputs:
  "input": f64[][] = [[1, 2, 3], [4, 5, 6], [7, 8, 9]]
  "kernel": f64[][] = [[-1, -2, -1], [0, 0, 0], [1, 2, 1]]
  "n_r,grd": i32
  "n_c,grd": i32
outputs:
  "output": f64[][]
diagram:
  Array Size(array=$kernel) -> (size(s)=w1)
  Array Index(array=w1) -> (out0[0]=w2, out1[1]=w3)
  Array Size(array=$input) -> (size(s)=w4)
  Array Index(array=w4) -> (out0[0]=w5, out1[1]=w6)
  Subtract(x=w5, y=$"n_r,grd") -> w7
  Quotient And Remainder(x=$"n_r,grd", y=2) -> (x-y*floor(x/y)=w8)
  Is Equal To 0(x=w8) -> w9
  Increment(x=w7) -> w10
  Select(s=w9, t=w7, f=w10) -> w11
  Subtract(x=w6, y=$"n_c,grd") -> w12
  Quotient And Remainder(x=$"n_c,grd", y=2) -> (x-y*floor(x/y)=w13)
  Is Equal To 0(x=w13) -> w14
  # w2: n_r_ker
  # w3: n_c_ker
  Increment(x=w12) -> w15
  Select(s=w14, t=w12, f=w15) -> w16
  Divide(x=w2, y=2) -> w17
  Round Toward Negative Infinity(x=w17) -> w18
  To Long Integer(number=w18) -> w19
  Divide(x=w3, y=2) -> w20
  Round Toward Negative Infinity(x=w20) -> w21
  To Long Integer(number=w21) -> w22
  # NOTES:
  #
  # Code is based on the following literature: http://www.songho.ca/dsp/convolution/convolution2d_example.html. User must refer to the explanation therein for a sample visualisation of the process.
  #
  # 1. By virtue of the array indexing process in LV, we do not have to check for the 'dummy' invalid values and ignore them, they are ignored by default as the array output for invalid indices is zero.
  #     In other words, the products corresponding to invalid indices in the SOP terms are zero.
  # 2. Size of the output is equal to the size of the input.
  for (N = w11) (iteration -> i1) {
    # input row loop
    # i1: i
    for (N = w16) (iteration -> i2) {
      # input column loop
      # i2: j
      s1 = 0  # shift register
      for (N = w2) (iteration -> i3) {
        Decrement(x=w2) -> w25
        # i3: m
        Subtract(x=w25, y=i3) -> w26
        # kernel row loop
        s2 = s1  # shift register
        for (N = w3) (iteration -> i4) (after w19) (after w22) {
          # $kernel: kernel
          # i1: i
          # w27: ii
          Add(i1, i3) -> w27
          # i2: j
          # w28: jj
          Add(i2, i4) -> w28
          Array Index(array=$input) -> (out0[w27, w28]=w29)
          # kernel column loop
          # i4: n
          Decrement(x=w3) -> w30
          # w26: mm
          # w31: nn
          # $input: input
          Subtract(x=w30, y=i4) -> w31
          Array Index(array=$kernel) -> (out0[w26, w31]=w32)
          Multiply(w29, w32) -> w33
          Add(w33, s2) -> w34
          next s2 = w34
        }
        next s1 = s2
      }
      append s1 to w24
    }
    append w24 to w23
  }
  $output <- w23
