vi "calc_angular_spread.gvi"   [LabVIEW Communications System Design Suite 2.0.1]
inputs:
  "phi_n,m": f64[][]
  "P_n,m": f64[][]
  "error_in": error
outputs:
  "AS": f64
  "error_out": error
diagram:
  s1 = 0+0i  # shift register
  s2 = 0  # shift register
  for {
    w1 = each element of $"phi_n,m"
    w2 = each element of $"P_n,m"
    s3 = s1  # shift register
    s4 = s2  # shift register
    for {
      w3 = each element of w1
      w4 = each element of w2
      Multiply(w3, 0+1i) -> w5
      Exponential(x=w5) -> w6
      Multiply(w4, w6) -> w7
      Add(s3, w7) -> w8
      Add(s4, w4) -> w9
      next s3 = w8
      next s4 = w9
    }
    next s1 = s3
    next s2 = s4
  }
  Divide(x=s1, y=s2) -> w10
  Absolute Value(x=w10) -> w11
  Natural Logarithm(x=w11) -> w12
  Multiply(-2, w12) -> w13
  Square Root(x=w13) -> w14
  $AS <- w14
  $error_out <- $error_in
