vi "calc_ant_arr_geom_uca.gvi"   [LabVIEW Communications System Design Suite 2.0.1]
inputs:
  "UP_lnk_in": "UP_lnk.gtype"
  "error_in": error
outputs:
  "UP_lnk_out": "UP_lnk.gtype"
  "error_out": error
  "d'_tx,s": f64[]
  "d'_rx,u": f64[]
types:
  T1 = enum{"UMi - Street Canyon (LOS)", "UMi - Street Canyon (NLOS)"}
  T2 = cluster{"X_BS (m)": f64, "Y_BS (m)": f64, "h_BS (m)": f64, "Omega_BS,alpha": f64, "Omega_BS,beta": f64, "Omega_BS,gamma": f64, "zeta_tx": f64, "M,tx": i32, "N,tx": i32, "M_g,tx": i32, "N_g,tx": i32, "s": i32}
  T3 = cluster{"h_UT (m)": f64, "v": f64, "phi_v": f64, "theta_v": f64, "t": f64, "Omega_UT,alpha": f64, "Omega_UT,beta": f64, "Omega_UT,gamma": f64, "zeta_rx": f64, "Y_UT (m)": f64, "X_UT (m)": f64, "N,rx": i32, "M,rx": i32, "N_g,rx": i32, "M_g,rx": i32, "u": i32}
  "UP_lnk.gtype" = cluster{"Scenario LOS-NLOS": T1, "d_2D (m)": f64, "d_3D (m)": f64, "f_C (Hz)": f64, "lambda_0": f64, "phi_LOS,AOA": f64, "phi_LOS,AOD": f64, "theta_LOS,ZOA": f64, "theta_LOS,ZOD": f64, "BS": T2, "d_V_tx": f64, "d_H,tx": f64, "d_V_rx": f64, "d_H,rx": f64, "d_g,V,tx": f64, "d_g,H,tx": f64, "d_g,V,rx": f64, "d_g,H,rx": f64, "d_rx,u": f64[3], "d_tx,s": f64[3], "UT": T3, "Align BS-UT?": bool}
diagram:
  Property Node(instance in=$UP_lnk_in) -> ("BS:M,tx"=w1, "UT:M,rx"=w2, "BS:s"=w3, "UT:u"=w4, instance out=w5)
  w6 = 0.0428  # r (m)
  # w7: theta
  Divide(x=PiTimes2, y=w1) -> w7
  Multiply(w7, w3) -> w8
  Sine And Cosine(x=w8) -> (cos(x)=w9, sin(x)=w10)
  Multiply(w6, w9) -> w11
  # w12: y
  Add(w11, w6) -> w12
  Multiply(w6, w10) -> w13
  Add(w13, w6) -> w14
  # w14: z
  Build Array(0, w12, w14) -> w15
  # w15: d'_tx,s
  Property Node(instance in=w5) -> ("BS:Omega_BS,alpha"=w16, "BS:Omega_BS,beta"=w17, "BS:Omega_BS,gamma"=w18)
  # w19: d_tx,s
  call "conv_lcs_gcs_cartesian.gvi"(vector_lcs=w15, alpha=w16, beta=w17, gamma=w18, error_in=$error_in) -> (error_out=w20, vector_gcs=w19)
  # w21: theta
  Divide(x=PiTimes2, y=w2) -> w21
  Multiply(w21, w4) -> w22
  Sine And Cosine(x=w22) -> (cos(x)=w23, sin(x)=w24)
  Multiply(w6, w23) -> w25
  # w26: y
  Add(w25, w6) -> w26
  Multiply(w6, w24) -> w27
  # w28: z
  # NOTES:
  #
  # -- temporary VI for testing with UCA
  # -- to run to the following:
  # 	- set M,tx and M,rx to the desired number of antenna elements
  # 	- set all other parameters to 1
  # 	- radius is a constant to be set here
  Add(w27, w6) -> w28
  Build Array(0, w26, w28) -> w29
  # w29: d'_rx,u
  Property Node(instance in=w5) -> ("UT:Omega_UT,alpha"=w30, "UT:Omega_UT,beta"=w31, "UT:Omega_UT,gamma"=w32)
  # w33: d_rx,u
  call "conv_lcs_gcs_cartesian.gvi"(vector_lcs=w29, alpha=w30, beta=w31, gamma=w32, error_in=$error_in) -> (error_out=w34, vector_gcs=w33)
  Property Node(instance in=w5, "d_tx,s"=w19, "d_rx,u"=w33) -> (instance out=w35)
  $UP_lnk_out <- w35
  $"d'_tx,s" <- w15
  $"d'_rx,u" <- w29
  Merge Errors(w20, w34) -> (error out=w36)
  $error_out <- w36
