vi "calc_ant_elm_crd_upa.gvi"   [LabVIEW Communications System Design Suite 2.0.1]
inputs:
  "UP_lnk_in": "UP_lnk.gtype"
  "error_in": error
outputs:
  "UP_lnk_out": "UP_lnk.gtype"
  "error_out": error
  "d'_tx,s": f64[3]
  "d'_rx,u": f64[3]
types:
  T1 = enum{"UMi - Street Canyon (LOS)", "UMi - Street Canyon (NLOS)"}
  T2 = enum{"Pedestrian", "Cyclist", "City Motorist", "Freeway Motorist", "Train"}
  T3 = cluster{"Type": enum{"SB", "NSB"}, "Class (for NSB)": T2, "Location (X,Y,Z)": i32[], "Attenuation": f64, "Cl. No.": i32, "t": f64}
  T4 = cluster{"Cl. Attn. (ray aggr.)": f64, "No. of Blocked Rays": i32, "Ray Blocker Array": "blk_inf_ry_B.gtype"[], "Cl. No.": i32}
  "blk_inf_cl_B.gtype" = cluster{"Cluster Blocker Array": T4[], "No. of Blocked Cl. at time t": i32}
  "blk_inf_UT_B.gtype" = "blk_inf_cl_B.gtype"[]
  T5 = enum{"A - Generic", "B - Generic", "B - Gramercy Park"}
  T6 = cluster{"Blockage Grid Margin-X": i32, "Blockage Grid Margin-Y": i32, "Blockage Parameters (B)": "UP_blk_B.gtype"[], "t_total_blk (s)": f64, "t_stp_blk (s)": f64}
  T7 = cluster{"Class (NSB)": T2, "Velocity": f64, "Count (K)": i32, "Blocker Trajectories": "trj_blk_B.gtype"[]}
  T8 = cluster{"Blockage Grid Margin-X": i32, "Blockage Grid Margin-Y": i32, "t_max_grd": f64, "t_res_grd": f64, "Blockage Parameters (A)": T7[], "d_res_grd": f64}
  "UP_BS.gtype" = cluster{"X_BS (m)": f64, "Y_BS (m)": f64, "h_BS (m)": f64, "Omega_BS,alpha": f64, "Omega_BS,beta": f64, "Omega_BS,gamma": f64, "zeta_tx": f64, "M,tx": i32, "N,tx": i32, "M_g,tx": i32, "N_g,tx": i32, "s": i32, "BF Parameters": "UP_bf.gtype"}
  T9 = cluster{"t": f64[], "C": i32[][], "d_2D": f64[], "d_3D": f64[], "V": f64[][], "v": f64[], "v_avg": f64}
  T10 = cluster{"X_UT (m)": i32, "Y_UT (m)": i32, "h_UT (m)": i32, "v": f64, "phi_v": f64, "theta_v": f64, "t": f64, "Omega_UT,alpha": f64, "Omega_UT,beta": f64, "Omega_UT,gamma": f64, "zeta_rx": f64, "N,rx": i32, "M,rx": i32, "N_g,rx": i32, "M_g,rx": i32, "u": i32, "Introduce Blockages?": bool, "Self-blocking Mode": bool, "X_UT_end": i32, "Y_UT_end": i32, "h_UT_end": i32, "step_std_X": f64, "step_std_Y": f64, "step_std_Z": f64, "t_total (s)": f64, "t_step (s)": f64, "UT_loc_curr": i32[], "trj_UT": T9, "Blockage Model": T5, "BF Parameters": "UP_bf.gtype"}
  "UP_lnk.gtype" = cluster{"Scenario LOS-NLOS": T1, "d_2D (m)": f64, "d_3D (m)": f64, "f_C (Hz)": f64, "lambda_0": f64, "phi_LOS,AOA": f64, "phi_LOS,AOD": f64, "theta_LOS,ZOA": f64, "theta_LOS,ZOD": f64, "d_V_tx": f64, "d_H,tx": f64, "d_V_rx": f64, "d_H,rx": f64, "d_g,V,tx": f64, "d_g,H,tx": f64, "d_g,V,rx": f64, "d_g,H,rx": f64, "d_rx,u": f64[3], "d_tx,s": f64[3], "Align BS-UT?": bool, "Introduce Blockages in System?": bool, "UT Blockage Data (A)": T3[][][], "UT Blockage Data (B)": "blk_inf_UT_B.gtype", "Blockage Model": T5, "Blockage Settings (B)": T6, "Blockage Settings (A)": T8, "BS": "UP_BS.gtype", "UT": T10}
diagram:
  Property Node(instance in=$UP_lnk_in) -> ("lambda_0"=w1, "BS:s"=w2, "BS:N,tx"=w3, "BS:M,tx"=w4, "BS:N_g,tx"=w5, "BS:M_g,tx"=w6, "UT:u"=w7, "UT:N,rx"=w8, "UT:M,rx"=w9, "UT:N_g,rx"=w10, "UT:M_g,rx"=w11, instance out=w12)
  # NOTES:
  #
  # [1] inter-element and inter-panel spacing has been fixed for both the TX anf the RX; multiples of wavelength are also fixed for ease of operation from the user end.
  # [1]
  w13 = 0.5  # m_g,V
  Multiply(w13, w1) -> w14
  w15 = 0.5  # m_g,H
  Multiply(w15, w1) -> w16
  w17 = 0.5  # m_V
  Multiply(w17, w1) -> w18
  w19 = 0.5  # m_H
  Multiply(w19, w1) -> w20
  call "calc_ant_elm_loc_vec.gvi"(error_in=$error_in, N=w3, M=w4, N_g=w5, M_g=w6, element index=w2, d_H=w20, d_V=w18, d_g,H=w16, d_g,V=w14) -> (error_out=w21, distance vector (LCS)=w22)
  # w22: d'_tx,s
  Property Node(instance in=w12) -> ("BS:Omega_BS,alpha"=w23, "BS:Omega_BS,beta"=w24, "BS:Omega_BS,gamma"=w25)
  # w26: d_tx,s
  call "conv_lcs_gcs_cartesian.gvi"(vector_lcs=w22, alpha=w23, beta=w24, gamma=w25, error_in=w21) -> (error_out=w27, vector_gcs=w26)
  call "calc_ant_elm_loc_vec.gvi"(error_in=$error_in, N=w8, M=w9, N_g=w10, M_g=w11, element index=w7, d_H=w20, d_V=w18, d_g,H=w16, d_g,V=w14) -> (error_out=w28, distance vector (LCS)=w29)
  Merge Errors(w21, w28) -> (error out=w30)
  # w29: d'_rx,u
  Property Node(instance in=w12) -> ("UT:Omega_UT,alpha"=w31, "UT:Omega_UT,beta"=w32, "UT:Omega_UT,gamma"=w33)
  call "conv_lcs_gcs_cartesian.gvi"(vector_lcs=w29, alpha=w31, beta=w32, gamma=w33, error_in=w30) -> (error_out=w34, vector_gcs=w35)
  Property Node(instance in=w12, "d_tx,s"=w26, "d_rx,u"=w35) -> (instance out=w36)
  $UP_lnk_out <- w36
  $"d'_tx,s" <- w22
  $"d'_rx,u" <- w29
  # w35: d_rx,u
  Merge Errors(w27, w34) -> (error out=w37)
  $error_out <- w37
