vi "calc_ant_elm_loc_vec.gvi"   [LabVIEW Communications System Design Suite 2.0.1]
inputs:
  "error_in": error
  "N": i32
  "M": i32
  "N_g": i32 = 8
  "M_g": i32 = 8
  "element index": i32
  "d_H": f64
  "d_V": f64
  "d_g,H": f64
  "d_g,V": f64
outputs:
  "error_out": error
  "distance vector (LCS)": f64[3]
  "total antenna elements": i32
diagram:
  Divide(x=$"element index", y=$N) -> w1
  Round Toward Negative Infinity(x=w1) -> w2
  Quotient And Remainder(x=w2, y=$N_g) -> (x-y*floor(x/y)=w3)
  # $"element index": l
  # w4: C
  Multiply($N_g, $N) -> w4
  # w3: J
  Quotient And Remainder(x=$"element index", y=w4) -> (x-y*floor(x/y)=w5)
  Subtract(x=w5, y=w3) -> w6
  Multiply(w6, $d_H) -> w7
  Multiply(w3, $"d_g,H") -> w8
  Add(w7, w8) -> w9
  Multiply(w4, $M) -> w10
  Divide(x=$"element index", y=w10) -> w11
  Round Toward Negative Infinity(x=w11) -> w12
  # w12: K
  Divide(x=$"element index", y=w4) -> w13
  Round Toward Negative Infinity(x=w13) -> w14
  Subtract(x=w14, y=w12) -> w15
  Multiply(w15, $d_V) -> w16
  Multiply(w12, $"d_g,V") -> w17
  Add(w16, w17) -> w18
  Build Array(0, w9, w18) -> w19
  $"distance vector (LCS)" <- w19
  Multiply($M_g, $M) -> w20
  Multiply(w4, w20) -> w21
  $"total antenna elements" <- w21
  Is Greater Or Equal(x=$"element index", y=w21) -> w22
  call "Build Error Cluster.gvi"(code=3, description="Antenna element index exceeds number of elements. ") -> (error out=w23)
  Select(s=w22, t=w23, f=$error_in) -> w24
  $error_out <- w24
