vi "calc_arr_fac.gvi"   [LabVIEW Communications System Design Suite 2.0.1]
inputs:
  "UP_bf_in": "UP_bf.gtype"
outputs:
  "AF": c128
types:
  "UP_bf.gtype" = cluster{"Beamform?": bool, "lambda_0": f64, "d": f64[][], "phi_0": f64, "theta_0": f64, "phi": f64, "theta": f64, "BF Cluster Index": i32}
diagram:
  Property Node(instance in=$UP_bf_in) -> ("lambda_0"=w1, "d"=w2, "phi_0"=w3, "theta_0"=w4, "phi"=w5, "theta"=w6)
  # NOTE:
  #
  # -- all calculations are in the LCS here.
  s1 = 0+0i  # shift register
  for {
    w7 = each element of w2
    # antenna element loop
    Reciprocal(x=w1) -> w8
    call "get_crd_3D.gvi"(A=w7) -> (A_y=w9, A_z=w10)
    Sine(x=w3) -> w11
    Sine And Cosine(x=w4) -> (cos(x)=w12, sin(x)=w13)
    Multiply(w9, w13, w11) -> w14
    Multiply(w10, w12) -> w15
    Add(w14, w15) -> w16
    Multiply(0-1i, PiTimes2, w8, w16) -> w17
    Exponential(x=w17) -> w18
    Sine(x=w5) -> w19
    Sine And Cosine(x=w6) -> (cos(x)=w20, sin(x)=w21)
    Multiply(w9, w21, w19) -> w22
    Multiply(w10, w20) -> w23
    Add(w22, w23) -> w24
    Multiply(0+1i, PiTimes2, w8, w24) -> w25
    Exponential(x=w25) -> w26
    Multiply(w18, w26) -> w27
    Add(s1, w27) -> w28
    next s1 = w28
  }
  $AF <- s1
