vi "calc_blk_dim_B.gvi"   [LabVIEW Communications System Design Suite 2.0.1]
inputs:
  "x|y of T": f64
  "y|z of T": f64
  "x|y of R": f64
  "y|z of R": f64
  "x|y of C": f64
  "y|z of C": f64
  "w": f64
  "h": f64
  "error in": error
outputs:
  "D1_w1": f64
  "D1_w2": f64
  "D2_w1": f64
  "D2_w2": f64
  "D1_h1": f64
  "D1_h2": f64
  "D2_h1": f64
  "D2_h2": f64
  "error out": error
panel indicators:
  "A (rea edg azi)": f64[]
  "B (top edg zen)": f64[]
  "B (frn edg azi)": f64[]
  "F (bot edg zen)": f64[]
diagram:
  Multiply($w, 0.5) -> w1
  Subtract(x=$"y|z of R", y=$"y|z of T") -> w2
  # w3: [1]
  Subtract(x=$"x|y of R", y=$"x|y of T") -> w3
  Is Not Equal To 0(x=w3) -> w4
  Select(s=w4, t=w3, f=1e-12) -> w5
  # w6: m_p
  Divide(x=w2, y=w5) -> w6
  Negate(x=w6) -> w7
  # w8: m_s
  Reciprocal(x=w7) -> w8
  Inverse Tangent(x=w8) -> w9
  Sine And Cosine(x=w9) -> (cos(x)=w10, sin(x)=w11)
  Multiply(w11, w1) -> w12
  Add(w12, $"y|z of C") -> w13
  Multiply(w10, w1) -> w14
  Add(w14, $"x|y of C") -> w15
  call "calc_euc_dis_3D.gvi"(x_1=$"x|y of R", y_1=$"y|z of R", x_2=w15, y_2=w13) -> (d_12=w16)
  $D1_w1 <- w16
  Build Array(w15, w13, 0) -> w17
  $"A (rea edg azi)" <- w17
  Subtract(x=$"x|y of C", y=w14) -> w18
  Subtract(x=$"y|z of C", y=w12) -> w19
  call "calc_euc_dis_3D.gvi"(x_1=$"x|y of R", y_1=$"y|z of R", x_2=w18, y_2=w19) -> (d_12=w20)
  $D1_w2 <- w20
  call "calc_euc_dis_3D.gvi"(x_1=$"x|y of T", y_1=$"y|z of T", x_2=w15, y_2=w13) -> (d_12=w21)
  $D2_w1 <- w21
  Build Array(w18, w19, 0) -> w22
  $"B (frn edg azi)" <- w22
  call "calc_euc_dis_3D.gvi"(x_1=$"x|y of T", y_1=$"y|z of T", x_2=w18, y_2=w19) -> (d_12=w23)
  $D2_w2 <- w23
  Multiply($h, 0.5) -> w24
  Multiply(w11, w24) -> w25
  Add(w25, $"y|z of C") -> w26
  Multiply(w10, w24) -> w27
  Add(w27, $"x|y of C") -> w28
  Build Array(0, w28, w26) -> w29
  $"B (top edg zen)" <- w29
  call "calc_euc_dis_3D.gvi"(y_1=$"x|y of R", z_1=$"y|z of R", y_2=w28, z_2=w26) -> (d_12=w30)
  $D1_h1 <- w30
  Subtract(x=$"x|y of C", y=w27) -> w31
  Subtract(x=$"y|z of C", y=w25) -> w32
  call "calc_euc_dis_3D.gvi"(y_1=$"x|y of R", z_1=$"y|z of R", y_2=w31, z_2=w32) -> (d_12=w33)
  $D1_h2 <- w33
  call "calc_euc_dis_3D.gvi"(y_1=$"x|y of T", z_1=$"y|z of T", y_2=w28, z_2=w26) -> (d_12=w34)
  $D2_h1 <- w34
  Build Array(0, w31, w32) -> w35
  $"F (bot edg zen)" <- w35
  call "calc_euc_dis_3D.gvi"(y_1=$"x|y of T", z_1=$"y|z of T", y_2=w31, z_2=w32) -> (d_12=w36)
  $D2_h2 <- w36
  # NOTES:
  #
  # AZI: X-Y plane
  # ZEN: Y-Z plane
  #
  # [1] avert divide by zero error
  # [2] round to zero if very small
  $"error out" <- $"error in"
