vi "calc_blk_r_NLOS.gvi"   [LabVIEW Communications System Design Suite 2.0.1]
panel controls:
  "C": i32[]
  "R": i32[2]
  "phi_n,m,AOA (rad)": f64
uses:
  NI::Analysis::LinearAlgebra::Real Dot Product.gvi
diagram:
  call "get_crd_3D.gvi"(A=$C) -> (A_x=w1, A_y=w2)
  call "get_crd_3D.gvi"(A=$R) -> (A_x=w3, A_y=w4)
  Subtract(x=w1, y=w3) -> w5
  Subtract(x=w2, y=w4) -> w6
  Build Array(w5, w6) -> w7
  call "Real Dot Product.gvi"(vector x=w7)
  Tangent(x=$"phi_n,m,AOA (rad)") -> w8
  Build Array(1, w8)
