vi "calc_euc_dis_3D.gvi"   [LabVIEW Communications System Design Suite 2.0.1]
inputs:
  "x_1": f64
  "y_1": f64
  "z_1": f64
  "x_2": f64
  "y_2": f64
  "z_2": f64
outputs:
  "d_12": f64
diagram:
  Subtract(x=$x_1, y=$x_2) -> w1
  Square(x=w1) -> w2
  Subtract(x=$y_1, y=$y_2) -> w3
  Square(x=w3) -> w4
  Subtract(x=$z_1, y=$z_2) -> w5
  Square(x=w5) -> w6
  Add(w2, w4, w6) -> w7
  Square Root(x=w7) -> w8
  $d_12 <- w8
