vi "calc_mean_angle.gvi"   [LabVIEW Communications System Design Suite 2.0.1]
inputs:
  "phi_n,m (rad)": f64[][]
  "P_n,m": f64[][]
  "error_in": error
outputs:
  "mu_phi": f64
  "error_out": error
diagram:
  s1 = 0+0i  # shift register
  for {
    w1 = each element of $"phi_n,m (rad)"
    w2 = each element of $"P_n,m"
    s2 = s1  # shift register
    for {
      w3 = each element of w1
      w4 = each element of w2
      Multiply(w3, 0+1i) -> w5
      Exponential(x=w5) -> w6
      Multiply(w4, w6) -> w7
      Add(s2, w7) -> w8
      next s2 = w8
    }
    next s1 = s2
  }
  Complex To Polar(r * e^(i*theta)=s1) -> (theta=w9)
  $mu_phi <- w9
  $error_out <- $error_in
