vi "calc_polar_coord.gvi"   [LabVIEW Communications System Design Suite 2.0.1]
inputs:
  "angle (rad)": f64[] = [4.70865550732, 8.70489644232, -9.21039051424, 11.5949043709, -2.08963648874]
outputs:
  "polar coordinates": c128[]
diagram:
  Multiply(0+1i, $"angle (rad)") -> w1
  Exponential(x=w1) -> w2
  $"polar coordinates" <- w2
