vi "calc_prob_los.gvi"   [LabVIEW Communications System Design Suite 2.0.1]
inputs:
  "d_2D-out": f64 = 250
  "error_in": error
outputs:
  "Pr_LOS": f64
  "error_out": error
diagram:
  Is Less Or Equal(x=$"d_2D-out", y=18) -> w1
  Divide(x=18, y=$"d_2D-out") -> w2
  Divide(x=$"d_2D-out", y=-36) -> w3
  Divide(x=18, y=$"d_2D-out") -> w4
  Subtract(x=1, y=w4) -> w5
  Multiply(w3, w5) -> w6
  Exponential(x=w6) -> w7
  Add(w2, w7) -> w8
  Select(s=w1, t=1, f=w8) -> w9
  $Pr_LOS <- w9
  $error_out <- $error_in
