vi "calc_r_blk_B.gvi"   [LabVIEW Communications System Design Suite 2.0.1]
inputs:
  "R": i32[3]
  "phi_n,m,AOA (rad)": f64
  "T": i32[3]
  "C": i32[3]
  "theta_n,m,ZOA (rad)": f64
outputs:
  "r_azi": f64
  "r_zen": f64
  "r'_azi": f64
  "r'_zen": f64
diagram:
  # $C: C
  # $R: R
  call "get_crd_3D.gvi"(A=$C) -> (A_x=w1, A_y=w2, A_z=w3)
  call "get_crd_3D.gvi"(A=$R) -> (A_x=w4, A_y=w5, A_z=w6)
  call "calc_sph_geom.gvi"(X_UT=w4, Y_UT=w5, X_BS=w1, Y_BS=w2) -> (d_2D (azi)=w7, phi,LOS,AOA (deg)=w8)
  # $"phi_n,m,AOA (rad)": phi_n,m,AOA
  call "conv_deg_to_rad.gvi"(angle (deg)=w8) -> (angle (rad)=w9)
  Subtract(x=w9, y=$"phi_n,m,AOA (rad)") -> w10
  Absolute Value(x=w10) -> w11
  # w7: |RC| (azi)
  Cosine(x=w11) -> w12
  Multiply(w12, w7) -> w13
  # w13: r'_azi
  $"r'_azi" <- w13
  call "calc_euc_dis_3D.gvi"(y_1=w5, z_1=w6, y_2=w2, z_2=w3) -> (d_12=w14)
  # $"theta_n,m,ZOA (rad)": theta_n,m,ZOA
  call "calc_sph_geom.gvi"(X_UT=w6, Y_UT=w5, X_BS=w3, Y_BS=w2) -> (phi,LOS,AOA (deg)=w15)
  call "conv_deg_to_rad.gvi"(angle (deg)=w15) -> (angle (rad)=w16)
  Subtract(x=w16, y=$"theta_n,m,ZOA (rad)") -> w17
  Absolute Value(x=w17) -> w18
  # w14: |RC| (zen) - [1]
  Cosine(x=w18) -> w19
  Multiply(w19, w14) -> w20
  # w20: r'_zen
  $"r'_zen" <- w20
  call "get_crd_3D.gvi"(A=$R) -> (A_x=w21, A_y=w22)
  # $T: T
  call "get_crd_3D.gvi"(A=$T) -> (A_x=w23, A_y=w24)
  call "calc_euc_dis_3D.gvi"(x_1=w21, y_1=w22, x_2=w23, y_2=w24) -> (d_12=w25)
  $r_azi <- w25
  call "get_crd_3D.gvi"(A=$R) -> (A_y=w26, A_z=w27)
  call "get_crd_3D.gvi"(A=$T) -> (A_y=w28, A_z=w29)
  # NOTES:
  #
  # -- we treat the azimuth and the zenith as the same here, azimuth is X-Y and zenith is Z-Y (not Y-Z as the angle is measured from Z to Y)
  # -- thus zenith values are calculated from the azimuth with axes replaced
  #
  # [1] d2D is azi only, hence compute separately below
  call "calc_euc_dis_3D.gvi"(y_1=w26, z_1=w27, y_2=w28, z_2=w29) -> (d_12=w30)
  $r_zen <- w30
