vi "calc_scr_pth_int_LOS_2D.gvi"   [LabVIEW Communications System Design Suite 2.0.1]
inputs:
  "error in": error
  "x|y of T": f64
  "y|z of T": f64
  "x|y of R": f64
  "y|z of R": f64
  "x|y of C": f64
  "y|z of C": f64
outputs:
  "error out": error
  "D (azi|zen)": f64[2]
uses:
  NI::Analysis::LinearAlgebra::Solve Linear Equations (single right hand).gvi
diagram:
  # NOTES:
  #
  # AZI: X-Y plane
  # ZEN: Y-Z plane
  #
  # [1] avert divide by zero error
  # [2] round to zero if very small
  Subtract(x=$"y|z of R", y=$"y|z of T") -> w1
  # w2: [1]
  Subtract(x=$"x|y of R", y=$"x|y of T") -> w2
  Is Not Equal To 0(x=w2) -> w3
  # $"x|y of C": xC
  # $"y|z of C": yC
  Select(s=w3, t=w2, f=1e-12) -> w4
  # w5: m_p
  Divide(x=w1, y=w4) -> w5
  Negate(x=w5) -> w6
  Build Array(w6, 1) -> w7
  Reciprocal(x=w5) -> w8
  Build Array(w8, 1) -> w9
  Build Array(w7, w9) -> w10
  Multiply(w8, $"x|y of C") -> w11
  # w12: c_s
  Add(w11, $"y|z of C") -> w12
  Multiply($"x|y of R", w6) -> w13
  # w14: c_p
  Add($"y|z of R", w13) -> w14
  Build Array(w14, w12) -> w15
  call "Solve Linear Equations (single right hand).gvi"(matrix=w10, known vector=w15, error in=$"error in") -> (solution vector=w16, error out=w17)
  for {
    w18 = each element of w16
    # w18: [2]
    Absolute Value(x=w18) -> w20
    Is Less(x=w20, y=0.001) -> w21
    Select(s=w21, t=0, f=w18) -> w22
    append w22 to w19
  }
  $"D (azi|zen)" <- w19
  $"error out" <- w17
