vi "calc_scr_pth_int_NLOS_2D.gvi"   [LabVIEW Communications System Design Suite 2.0.1]
inputs:
  "x|y of R": f64
  "y|z of R": f64
  "x|y of C": f64
  "y|z of C": f64
  "path_angle azi|zen (rad)": f64
  "error in": error
outputs:
  "error out": error
  "D (azi|zen)": f64[2]
uses:
  NI::Analysis::LinearAlgebra::Solve Linear Equations (single right hand).gvi
diagram:
  # NOTES:
  #
  # AZI: X-Y plane
  # ZEN: Y-Z plane
  #
  # [1] avert divide by zero error
  # [2] round to zero if very small
  Tangent(x=$"path_angle azi|zen (rad)") -> w1
  # w1: m_p
  Negate(x=w1) -> w2
  Build Array(w2, 1) -> w3
  Reciprocal(x=w1) -> w4
  Build Array(w4, 1) -> w5
  Build Array(w3, w5) -> w6
  # $"x|y of C": xC
  # $"y|z of C": yC
  Multiply(w4, $"x|y of C") -> w7
  # w8: c_s
  Add(w7, $"y|z of C") -> w8
  Multiply($"x|y of R", w2) -> w9
  # w10: c_p
  Add($"y|z of R", w9) -> w10
  Build Array(w10, w8) -> w11
  call "Solve Linear Equations (single right hand).gvi"(matrix=w6, known vector=w11, error in=$"error in") -> (solution vector=w12, error out=w13)
  for {
    w14 = each element of w12
    # w14: [2]
    Absolute Value(x=w14) -> w16
    Is Less(x=w16, y=0.001) -> w17
    Select(s=w17, t=0, f=w14) -> w18
    append w18 to w15
  }
  $"D (azi|zen)" <- w15
  $"error out" <- w13
