vi "calc_sph_geom.gvi"   [LabVIEW Communications System Design Suite 2.0.1]
inputs:
  "X_UT": f64
  "Y_UT": f64
  "Z_UT": f64
  "X_BS": f64
  "Y_BS": f64
  "Z_BS": f64
  "error_in": error
outputs:
  "d_2D (azi)": f64
  "d_3D": f64
  "phi,LOS,AOA (deg)": f64
  "phi_LOS,AOD (deg)": f64
  "theta,LOS,ZOA (deg)": f64
  "theta,LOS,ZOD (deg)": f64
  "error_out": error
diagram:
  Subtract(x=$Y_UT, y=$Y_BS) -> w1
  Is Less Than 0(x=w1) -> w2
  Subtract(x=$X_UT, y=$X_BS) -> w3
  Is Less Than 0(x=w3) -> w4
  Divide(x=w1, y=w3) -> w5
  Inverse Tangent(x=w5) -> w6
  case (w2) {
    frame False, Default {
      case (w4) {
        frame True {
          # Q-IV
          Add(w6, Pi) -> w7
          w8 = w6
        }
        frame False {
          # Q-I
          Subtract(x=w6, y=Pi) -> w8
          w7 = w6
        }
      }
    }
    frame True {
      case (w4) {
        frame False, Default {
          # Q-II
          Add(w6, Pi) -> w8
          w7 = w6
        }
        frame True {
          # Q-III
          Subtract(x=w6, y=Pi) -> w7
          w8 = w6
        }
      }
    }
  }
  call "conv_rad_to_deg.gvi"(angle (rad)=w7) -> (angle (deg)=w9)
  $"phi_LOS,AOD (deg)" <- w9
  call "conv_rad_to_deg.gvi"(angle (rad)=w8) -> (angle (deg)=w10)
  $"phi,LOS,AOA (deg)" <- w10
  Subtract(x=$Z_UT, y=$Z_BS) -> w11
  Is Less Than 0(x=w11) -> w12
  Build Array(w1, w3) -> w13
  s1 = 0  # shift register
  for {
    w14 = each element of w13
    Square(x=w14) -> w15
    Add(s1, w15) -> w16
    next s1 = w16
  }
  # w17: d_2D
  Square Root(x=s1) -> w17
  Build Array(w1, w3, w11) -> w18
  # NOTES:
  #
  # [1] Zenith: 0 degrees corresponds to true north or up, 90 deg to ahead and 180 deg to down
  s2 = 0  # shift register
  for {
    w19 = each element of w18
    Square(x=w19) -> w20
    Add(s2, w20) -> w21
    next s2 = w21
  }
  # w22: d_3D
  Square Root(x=s2) -> w22
  Divide(x=w17, y=w22) -> w23
  Inverse Cosine(x=w23) -> w24
  case (w12) {
    frame False {
      # Q-I
      Subtract(x=PiOver2, y=w24) -> w25
      Add(w24, PiOver2) -> w26
    }
    frame True {
      # Q-IV
      Add(w24, PiOver2) -> w25
      Subtract(x=PiOver2, y=w24) -> w26
    }
  }
  call "conv_rad_to_deg.gvi"(angle (rad)=w25) -> (angle (deg)=w27)
  $"theta,LOS,ZOD (deg)" <- w27
  call "conv_rad_to_deg.gvi"(angle (rad)=w26) -> (angle (deg)=w28)
  $"theta,LOS,ZOA (deg)" <- w28
  $"d_2D (azi)" <- w17
  $d_3D <- w22
  $error_out <- $error_in
