vi "calc_ut_trajectory.gvi"   [LabVIEW Communications System Design Suite 2.0.1]
inputs:
  "UP_lnk_in": "UP_lnk.gtype"
  "error_in": error
outputs:
  "error_out": error
  "UP_lnk_out": "UP_lnk.gtype"
types:
  T1 = enum{"UMi - Street Canyon (LOS)", "UMi - Street Canyon (NLOS)"}
  T2 = cluster{"X_BS (m)": i32, "Y_BS (m)": i32, "h_BS (m)": i32, "Omega_BS,alpha": f64, "Omega_BS,beta": f64, "Omega_BS,gamma": f64, "zeta_tx": f64, "M,tx": i32, "N,tx": i32, "M_g,tx": i32, "N_g,tx": i32, "s": i32}
  T3 = enum{"Pedestrian", "Cyclist", "City Motorist", "Freeway Motorist", "Train"}
  T4 = cluster{"Class": T3, "Velocity": f64, "Count (K)": i32, "Location (C)": i32[][]}
  T5 = cluster{"Blocker Parameters (A)": T4[], "Blockage Grid Margin-X": i32, "Blockage Grid Margin-Y": i32, "t_max_grd": f64, "t_res_grd": f64}
  T6 = cluster{"Type": enum{"SB", "NSB"}, "Class (for NSB)": T3, "Location (X,Y,Z)": i32[], "Attenuation": f64, "Cl. No.": i32, "t": f64}
  T7 = cluster{"t": f64[], "C": i32[][], "d_2D": f64[], "d_3D": f64[], "V": f64[][], "v": f64[], "v_avg": f64}
  T8 = cluster{"X_UT (m)": i32, "Y_UT (m)": i32, "h_UT (m)": i32, "v": f64, "phi_v": f64, "theta_v": f64, "t": f64, "Omega_UT,alpha": f64, "Omega_UT,beta": f64, "Omega_UT,gamma": f64, "zeta_rx": f64, "N,rx": i32, "M,rx": i32, "N_g,rx": i32, "M_g,rx": i32, "u": i32, "Introduce Blockages?": bool, "Self-blocking Mode": bool, "X_UT_end": i32, "Y_UT_end": i32, "h_UT_end": i32, "step_std_X": f64, "step_std_Y": f64, "step_std_Z": f64, "t_total (s)": f64, "t_step (s)": f64, "UT_loc_curr": i32[], "Blockage Model": enum{"A", "B"}, "trj_UT": T7}
  "UP_lnk.gtype" = cluster{"Scenario LOS-NLOS": T1, "d_2D (m)": f64, "d_3D (m)": f64, "f_C (Hz)": f64, "lambda_0": f64, "phi_LOS,AOA": f64, "phi_LOS,AOD": f64, "theta_LOS,ZOA": f64, "theta_LOS,ZOD": f64, "d_V_tx": f64, "d_H,tx": f64, "d_V_rx": f64, "d_H,rx": f64, "d_g,V,tx": f64, "d_g,H,tx": f64, "d_g,V,rx": f64, "d_g,H,rx": f64, "d_rx,u": f64[3], "d_tx,s": f64[3], "BS": T2, "Align BS-UT?": bool, "Blockage Settings (A)": T5, "Introduce Blockages in System?": bool, "UT Blockage Data (A)": T6[][][], "UT": T8}
uses:
  NI::Analysis::Generation::Gaussian White Noise.gvi
  NI::Analysis::Statistics::Measures of Mean.gvi
  NI::Analysis::Statistics::Statistics (1D DBL).gvi
diagram:
  Property Node(instance in=$UP_lnk_in) -> ("BS"=w1, instance out=w2)
  Property Node(instance in=w2) -> ("UT:trj_UT"=w3, instance out=w4)
  Property Node(instance in=$UP_lnk_in) -> ("UT"=w5)
  Property Node(instance in=w5) -> ("t_total (s)"=w6, "t_step (s)"=w7, "step_std_X"=w8, "X_UT_end"=w9, "X_UT (m)"=w10, "step_std_Y"=w11, "Y_UT_end"=w12, "Y_UT (m)"=w13, "h_UT (m)"=w14)
  # w15: n_step
  Divide(x=w6, y=w7) -> w15
  Decrement(x=w15) -> w16
  s1 = 0  # shift register
  for (N = w16) {
    Add(s1, w7) -> w18
    append w18 to w17
    next s1 = w18
  }
  Build Array[ConcatenateInputs=True](0, w17) -> w19
  # w14: [1]
  Initialize Array(element=w14, size=w15) -> w20
  call "Gaussian White Noise.gvi"(samples=w16) -> (Gaussian white noise=w21)
  Multiply(w8, w21) -> w22
  call "Measures of Mean.gvi"(x=w22) -> (mean value=w23)
  Subtract(x=w22, y=w23) -> w24
  Subtract(x=w9, y=w10) -> w25
  # w25: X_span_UT
  Divide(x=w25, y=w16) -> w26
  Add(w24, w26) -> w27
  Sort 1D Array(array=w27) -> (sorted array=w28)
  s2 = w10  # shift register
  for {
    w29 = each element of w28
    Add(w29, s2) -> w31
    append w31 to w30
    next s2 = w31
  }
  # w32: X
  Build Array[ConcatenateInputs=True](w10, w30) -> w32
  call "Gaussian White Noise.gvi"(samples=w16) -> (Gaussian white noise=w33)
  Multiply(w11, w33) -> w34
  call "Measures of Mean.gvi"(x=w34) -> (mean value=w35)
  Subtract(x=w34, y=w35) -> w36
  Subtract(x=w12, y=w13) -> w37
  # w37: Y_span_UT
  # NOTE:
  # [1] for UMi-SC, height if the UT is fixed for mobility
  #
  # -- C is the matrix of coord. where each row is a coord. vector and
  #     there are n_step rows
  # -- V is the velocity vector matrix where each row is a velocity coord.
  #     vector and there are n_step rows
  Divide(x=w37, y=w16) -> w38
  Add(w36, w38) -> w39
  Sort 1D Array(array=w39) -> (sorted array=w40)
  s3 = w13  # shift register
  for {
    w41 = each element of w40
    Add(w41, s3) -> w43
    append w43 to w42
    next s3 = w43
  }
  # w44: Y
  Build Array[ConcatenateInputs=True](w13, w42) -> w44
  Build Array(w32, w44, w20) -> w45
  Transpose 2D Array(2D array=w45) -> (transposed array=w46)
  Initialize Array(element=0, size=w15) -> w47
  for (N = w16) (iteration -> i1) {
    Increment(x=i1) -> w49
    Array Index(array=w32) -> (out0[w49]=w50)
    Array Index(array=w32) -> (out0[i1]=w51)
    Subtract(x=w50, y=w51) -> w52
    Divide(x=w52, y=w7) -> w53
    append w53 to w48
  }
  # w54: V_X
  Build Array[ConcatenateInputs=True](0, w48) -> w54
  for (N = w16) (iteration -> i2) {
    Increment(x=i2) -> w56
    Array Index(array=w44) -> (out0[w56]=w57)
    Array Index(array=w44) -> (out0[i2]=w58)
    Subtract(x=w57, y=w58) -> w59
    Divide(x=w59, y=w7) -> w60
    append w60 to w55
  }
  # w61: V_Y
  Build Array[ConcatenateInputs=True](0, w55) -> w61
  # w46: C
  for {
    w62 = each element of w54
    w63 = each element of w61
    w64 = each element of w47
    Square(x=w62) -> w66
    Square(x=w63) -> w67
    Square(x=w64) -> w68
    Add(w66, w67, w68) -> w69
    Square Root(x=w69) -> w70
    append w70 to w65
  }
  Property Node(instance in=w1) -> ("X_BS (m)"=w71, "Y_BS (m)"=w72, "h_BS (m)"=w73)
  Subtract(x=w32, y=w71) -> w74
  Subtract(x=w44, y=w72) -> w75
  Subtract(x=w20, y=w73) -> w76
  # w47: V_Z
  # w77: d_2D
  # w78: d_3D
  for {
    w79 = each element of w74
    w80 = each element of w75
    w81 = each element of w76
    Square(x=w79) -> w82
    Square(x=w80) -> w83
    Add(w82, w83) -> w84
    Square Root(x=w84) -> w85
    Square(x=w81) -> w86
    Add(w82, w83, w86) -> w87
    Square Root(x=w87) -> w88
    append w88 to w78
    append w85 to w77
  }
  Build Array(w54, w61, w47) -> w89
  # w19: t
  # w90: V
  Transpose 2D Array(2D array=w89) -> (transposed array=w90)
  # w65: v
  call "Statistics (1D DBL).gvi"(signal=w65) -> (mean=w91)
  Property Node(instance in=w3, "t"=w19, "C"=w46, "d_2D"=w77, "d_3D"=w78, "V"=w90, "v"=w65, "v_avg"=w91) -> (instance out=w92)
  Property Node(instance in=w4, "UT:trj_UT"=w92) -> (instance out=w93)
  $UP_lnk_out <- w93
  $error_out <- $error_in
