vi "cluster_split_wk_st_2D.gvi"   [LabVIEW Communications System Design Suite 2.0.1]
inputs:
  "clusters": f64[][]
outputs:
  "strongest clusters": f64[][]
  "weakest clusters": f64[][]
diagram:
  Array Subset(array=$clusters, index0=0, length0=2) -> w1
  $"strongest clusters" <- w1
  Array Subset(array=$clusters, index0=2) -> w2
  $"weakest clusters" <- w2
