vi "condition_blockage_data.gvi"   [LabVIEW Communications System Design Suite 2.0.1]
inputs:
  "UT Blockage Data (A)": "blk_inf_UT_A.gtype"
outputs:
  "output array": f64[][]
types:
  T1 = enum{"Pedestrian", "Cyclist", "City Motorist", "Freeway Motorist", "Train"}
  T2 = cluster{"Type": enum{"SB", "NSB"}, "Class (for NSB)": T1, "Location (X,Y,Z)": i32[], "Attenuation": f64, "Cl. No.": i32, "t": f64}
  "blk_inf_UT_A.gtype" = T2[][][]
diagram:
  Array Size(array=$"UT Blockage Data (A)") -> (size(s)=w1)
  Array Index(array=w1)
  Array Index(array=w1) -> (out0[1]=w2)
  s1 = f64[] []  # shift register
  for (N = w2) (iteration -> i1) {
    # cluster loop
    Array Index(array=$"UT Blockage Data (A)") -> (out0[_, i1, _]=w3)
    Array Size(array=w3) -> (size(s)=w4)
    Array Index(array=w4) -> (out0[0]=w5)
    Array Index(array=w4) -> (out0[1]=w6)
    Multiply(w5, w6) -> w7
    Reshape Array(inArray=w3, size=w7) -> w8
    s2 = T2[] []  # shift register
    for {
      w9 = each element of w8
      Property Node(instance in=w9) -> ("Attenuation"=w10, instance out=w11)
      Is Not Equal(x=w10, y=0) -> w12
      # remove dummy entries
      case (w12) {
        frame False, Default {
          w13 = s2
        }
        frame True {
          Build Array[ConcatenateInputs=True](s2, w11) -> w13
        }
      }
      next s2 = w13
    }
    for {
      w14 = each element of s2
      Property Node(instance in=w14) -> ("Cl. No."=w16, "t"=w17, "Type"=w18, "Class (for NSB)"=w19, "Attenuation"=w20, "Location (X,Y,Z)"=w21)
      Array Index(array=w21) -> (out0[0]=w22)
      Array Index(array=w21) -> (out0[1]=w23)
      Array Index(array=w21) -> (out0[2]=w24)
      Build Array(w16, w17, w18, w19, w20, w22, w23, w24) -> w25
      concatenate w25 onto w15
    }
    Build Array[ConcatenateInputs=True](s1, w15) -> w26
    next s1 = w26
  }
  Array Size(array=s1) -> (size(s)=w27)
  Divide(x=w27, y=8) -> w28
  Reshape Array(inArray=s1, size=w28, size=8) -> w29
  $"output array" <- w29
  Array Index(array=w1)
