vi "condition_blockage_data_B.gvi"   [LabVIEW Communications System Design Suite 2.0.1]
inputs:
  "UT Blockage Data (B)": "blk_inf_UT_B.gtype"
outputs:
  "array_out": f64[][]
types:
  T1 = cluster{"Cl. Attn. (ray aggr.)": f64, "No. of Blocked Rays": i32, "Ray Blocker Array": "blk_inf_ry_B.gtype"[], "Cl. No.": i32}
  "blk_inf_cl_B.gtype" = cluster{"Cluster Blocker Array": T1[], "No. of Blocked Cl. at time t": i32}
  "blk_inf_UT_B.gtype" = "blk_inf_cl_B.gtype"[]
diagram:
  for {
    w1 = each element of $"UT Blockage Data (B)"
    # time loop
    Property Node(instance in=w1) -> ("Cluster Blocker Array"=w3)
    for {
      w4 = each element of w3
      # cluster loop
      Property Node(instance in=w4) -> ("Cl. No."=w6, "Cl. Attn. (ray aggr.)"=w7, "Ray Blocker Array"=w8)
      for {
        w9 = each element of w8
        # ray loop
        Property Node(instance in=w9) -> ("Location (X,Y,Z)"=w11, "t"=w12, "Class"=w13)
        Build Array[ConcatenateInputs=True](w6, w12, w13, w7, w11) -> w14
        append w14 to w10
      }
      concatenate w10 onto w5
    }
    concatenate w5 onto w2
  }
  $array_out <- w2
