vi "conv_angle_pos.gvi"   [LabVIEW Communications System Design Suite 2.0.1]
inputs:
  "angle_in (rad)": f64
outputs:
  "angle_out (rad)": f64
diagram:
  Add($"angle_in (rad)", PiTimes2) -> w1
  Is Less Than 0(x=$"angle_in (rad)") -> w2
  Select(s=w2, t=w1, f=$"angle_in (rad)") -> w3
  $"angle_out (rad)" <- w3
