vi "conv_crt_sph.gvi"   [LabVIEW Communications System Design Suite 2.0.1]
inputs:
  "x": f64
  "y": f64
  "z": f64
outputs:
  "r": f64
  "phi": f64
  "theta": f64
diagram:
  Is Less Than 0(x=$x) -> w1
  Divide(x=$y, y=$x) -> w2
  Inverse Tangent(x=w2) -> w3
  Is Less Than 0(x=$y) -> w4
  case (w4) {
    frame False, Default {
      case (w1) {
        frame True {
          # Q-IV
          Add(w3, Pi) -> w5
        }
        frame False {
          # Q-I
          w5 = w3
        }
      }
    }
    frame True {
      case (w1) {
        frame False, Default {
          # Q-II
          w5 = w3
        }
        frame True {
          # Q-III
          Subtract(x=w3, y=Pi) -> w5
        }
      }
    }
  }
  $phi <- w5
  Square(x=$x) -> w6
  Square(x=$y) -> w7
  Square(x=$z) -> w8
  Add(w6, w7, w8) -> w9
  Square Root(x=w9) -> w10
  Divide(x=$z, y=w10) -> w11
  Inverse Cosine(x=w11) -> w12
  $theta <- w12
  $r <- w10
