vi "conv_deg_to_rad.gvi"   [LabVIEW Communications System Design Suite 2.0.1]
inputs:
  "angle (deg)": f64
outputs:
  "angle (rad)": f64
diagram:
  Divide(x=Pi, y=180) -> w1
  Multiply($"angle (deg)", w1) -> w2
  $"angle (rad)" <- w2
