vi "conv_deg_to_rad_1D.gvi"   [LabVIEW Communications System Design Suite 2.0.1]
inputs:
  "angle (deg)": f64[]
outputs:
  "angle (rad)": f64[]
diagram:
  Array Size(array=$"angle (deg)") -> (size(s)=w1)
  for (N = w1) {
    w2 = each element of $"angle (deg)"
    Divide(x=Pi, y=180) -> w4
    Multiply(w2, w4) -> w5
    append w5 to w3
  }
  $"angle (rad)" <- w3
