vi "conv_deg_to_rad_2D.gvi"   [LabVIEW Communications System Design Suite 2.0.1]
inputs:
  "angle (deg)": f64[][]
outputs:
  "angle (rad)": f64[][]
diagram:
  Array Size(array=$"angle (deg)") -> (size(s)=w1)
  Array Index(array=w1) -> (out0[0]=w2)
  Array Index(array=w1) -> (out0[1]=w3)
  for (N = w2) {
    w4 = each element of $"angle (deg)"
    for (N = w3) {
      w6 = each element of w4
      Divide(x=Pi, y=180) -> w8
      Multiply(w6, w8) -> w9
      append w9 to w7
    }
    append w7 to w5
  }
  $"angle (rad)" <- w5
