vi "conv_gcs_lcs_spherical.gvi"   [LabVIEW Communications System Design Suite 2.0.1]
inputs:
  "phi": f64
  "theta": f64
  "alpha": f64
  "beta": f64
  "gamma": f64
outputs:
  "phi'": f64
  "theta'": f64
diagram:
  Sine And Cosine(x=$theta) -> (cos(x)=w1, sin(x)=w2)
  Sine And Cosine(x=$beta) -> (cos(x)=w3, sin(x)=w4)
  Sine And Cosine(x=$gamma) -> (cos(x)=w5, sin(x)=w6)
  Multiply(w1, w3, w5) -> w7
  Subtract(x=$phi, y=$alpha) -> w8
  Sine And Cosine(x=w8) -> (cos(x)=w9, sin(x)=w10)
  Multiply(w9, w4, w5) -> w11
  Multiply(w10, w2, w6) -> w12
  Subtract(x=w11, y=w12) -> w13
  Multiply(w2, w13) -> w14
  Add(w7, w14) -> w15
  Inverse Cosine(x=w15) -> w16
  $"theta'" <- w16
  Multiply(w9, w2, w3) -> w17
  Multiply(w1, w4) -> w18
  Subtract(x=w17, y=w18) -> w19
  Multiply(w1, w3, w6) -> w20
  Multiply(w9, w4, w6) -> w21
  Multiply(w10, w5) -> w22
  Add(w21, w22) -> w23
  Multiply(w2, w23) -> w24
  Add(w20, w24) -> w25
  Real And Imaginary To Complex(x=w19, y=w25) -> w26
  Complex To Polar(r * e^(i*theta)=w26) -> (theta=w27)
  $"phi'" <- w27
