vi "conv_lcs_gcs_cartesian.gvi"   [LabVIEW Communications System Design Suite 2.0.1]
inputs:
  "vector_lcs": f64[3] = [0, 0, 0]
  "alpha": f64
  "beta": f64
  "gamma": f64
  "error_in": error
outputs:
  "error_out": error
  "vector_gcs": f64[3]
uses:
  NI::Analysis::LinearAlgebra::Real Transpose Matrix.gvi
  NI::Analysis::LinearAlgebra::A x Vector.gvi
diagram:
  # w1: sin(a)
  # w2: cos(a)
  Sine And Cosine(x=$alpha) -> (cos(x)=w2, sin(x)=w1)
  # w3: sin(b)
  # w4: cos(b)
  Sine And Cosine(x=$beta) -> (cos(x)=w4, sin(x)=w3)
  Multiply(w2, w4) -> w5
  Multiply(w1, w4) -> w6
  Negate(x=w3) -> w7
  # w8: sin(g)
  # w9: cos(g)
  Sine And Cosine(x=$gamma) -> (cos(x)=w9, sin(x)=w8)
  Multiply(w4, w8) -> w10
  Multiply(w4, w9) -> w11
  Multiply(w2, w3, w8) -> w12
  Multiply(w1, w9) -> w13
  Subtract(x=w12, y=w13) -> w14
  Multiply(w2, w3, w9) -> w15
  Multiply(w1, w8) -> w16
  Add(w15, w16) -> w17
  Multiply(w1, w3, w8) -> w18
  Multiply(w2, w9) -> w19
  Add(w18, w19) -> w20
  Multiply(w1, w3, w9) -> w21
  Multiply(w2, w8) -> w22
  Subtract(x=w21, y=w22) -> w23
  Build Array(w5, w14, w17, w6, w20, w23, w7, w10, w11) -> w24
  Reshape Array(inArray=w24, size=3, size=3) -> w25
  call "Real Transpose Matrix.gvi"(matrix=w25, error in=$error_in) -> (matrix transpose=w26, error out=w27)
  call "A x Vector.gvi"(matrix A=w26, vector v=$vector_lcs, error in=w27) -> (A x v=w28, error out=w29)
  $vector_gcs <- w28
  $error_out <- w29
