vi "conv_rad_to_deg.gvi"   [LabVIEW Communications System Design Suite 2.0.1]
inputs:
  "angle (rad)": f64
outputs:
  "angle (deg)": f64
diagram:
  Divide(x=180, y=Pi) -> w1
  Multiply($"angle (rad)", w1) -> w2
  $"angle (deg)" <- w2
