vi "conv_rad_to_deg_1D.gvi"   [LabVIEW Communications System Design Suite 2.0.1]
inputs:
  "angle (rad)": f64[]
outputs:
  "angle (deg)": f64[]
diagram:
  for {
    w1 = each element of $"angle (rad)"
    Divide(x=180, y=Pi) -> w3
    Multiply(w1, w3) -> w4
    append w4 to w2
  }
  $"angle (deg)" <- w2
