vi "ecdf_lsp.gvi"   [LabVIEW Communications System Design Suite 2.0.1]
inputs:
  "UP_sys_in": "UP_sys.gtype"
  "error_in": error
  "Limit Angle Spreads?": bool
outputs:
  "LSP_data": T2
  "error_out": error
  "LSP_mu_sig": T1
panel indicators:
  "UP_lnk_out": "UP_lnk.gtype"
  "means of LSPs": f64[]
  "stdev of LSPs": f64[]
types:
  T1 = cluster{"mu_SF_dB": f64, "sig_SF_dB": f64, "mu_K_dB": f64, "sig_K_dB": f64, "mu_DS": f64, "sig_DS": f64, "mu_ASD": f64, "sig_ASD": f64, "mu_ASA": f64, "sig_ASA": f64, "mu_ZSD": f64, "sig_ZSD": f64, "mu_ZSA": f64, "sig_ZSA": f64}
  T2 = cluster{"SF": f64[][], "K": f64[][], "DS": f64[][], "ASD": f64[][], "ASA": f64[][], "ZSD": f64[][], "ZSA": f64[][]}
  T3 = cluster{"X_BS (m)": i32, "Y_BS (m)": i32, "h_BS (m)": i32, "Omega_BS,alpha": f64, "Omega_BS,beta": f64, "Omega_BS,gamma": f64, "zeta_tx": f64, "M,tx": i32, "N,tx": i32, "M_g,tx": i32, "N_g,tx": i32, "s": i32}
  T4 = cluster{"h_UT (m)": i32, "v": f64, "phi_v": f64, "theta_v": f64, "t": f64, "Omega_UT,alpha": f64, "Omega_UT,beta": f64, "Omega_UT,gamma": f64, "zeta_rx": f64, "Y_UT (m)": i32, "X_UT (m)": i32, "N,rx": i32, "M,rx": i32, "N_g,rx": i32, "M_g,rx": i32, "u": i32, "Introduce Blockages?": bool, "Self-blocking Mode": bool}
  "UP_sys.gtype" = cluster{"Scenario": enum{"UMi - Street Canyon"}, "f_C (Hz)": f64, "No. of UT": i32, "UP_BS": T3, "UP_UT": T4[], "Align BS-UT?": bool}
  T5 = enum{"UMi - Street Canyon (LOS)", "UMi - Street Canyon (NLOS)"}
  T6 = cluster{"X_BS (m)": f64, "Y_BS (m)": f64, "h_BS (m)": f64, "Omega_BS,alpha": f64, "Omega_BS,beta": f64, "Omega_BS,gamma": f64, "zeta_tx": f64, "M,tx": i32, "N,tx": i32, "M_g,tx": i32, "N_g,tx": i32, "s": i32}
  T7 = cluster{"h_UT (m)": f64, "v": f64, "phi_v": f64, "theta_v": f64, "t": f64, "Omega_UT,alpha": f64, "Omega_UT,beta": f64, "Omega_UT,gamma": f64, "zeta_rx": f64, "Y_UT (m)": f64, "X_UT (m)": f64, "N,rx": i32, "M,rx": i32, "N_g,rx": i32, "M_g,rx": i32, "u": i32, "Introduce Blockages?": bool, "Self-blocking Mode": bool}
  "UP_lnk.gtype" = cluster{"Scenario LOS-NLOS": T5, "d_2D (m)": f64, "d_3D (m)": f64, "f_C (Hz)": f64, "lambda_0": f64, "phi_LOS,AOA": f64, "phi_LOS,AOD": f64, "theta_LOS,ZOA": f64, "theta_LOS,ZOD": f64, "BS": T6, "d_V_tx": f64, "d_H,tx": f64, "d_V_rx": f64, "d_H,rx": f64, "d_g,V,tx": f64, "d_g,H,tx": f64, "d_g,V,rx": f64, "d_g,H,rx": f64, "d_rx,u": f64[3], "d_tx,s": f64[3], "UT": T7, "Align BS-UT?": bool}
uses:
  NI::Analysis::Statistics::Statistics (1D DBL).gvi
  NI::Analysis::LinearAlgebra::A x Vector.gvi
diagram:
  call "gen_lsp_map.gvi"(UP_sys_in=$UP_sys_in) -> (LSP_out=w1)
  Property Node(instance in=w1) -> ("LSP_map_LOS"=w2, "LSP_map_NLOS"=w3, "n_r,grd"=w4, "n_c,grd"=w5)
  Is Equal To 0(x="UMi - Street Canyon (LOS)") -> w6
  Select(s=w6, t=w2, f=w3) -> w7
  for {
    w8 = each element of w7
    Array Size(array=w8) -> (size(s)=w11)
    Array Index(array=w11) -> (out0[_]=w12)
    Array Index(array=w11) -> (out0[1]=w13)
    Multiply(w12, w13) -> w14
    Reshape Array(inArray=w8, size=w14) -> w15
    call "Statistics (1D DBL).gvi"(signal=w15) -> (mean=w16, standard deviation=w17)
    append w16 to w9
    append w17 to w10
  }
  $"means of LSPs" <- w9
  $"stdev of LSPs" <- w10
  call "init_sys_params.gvi"(UP_sys_in=$UP_sys_in) -> (UP_lnk_arr_out=w18)
  Array Index(array=w18) -> (out0[_]=w19)
  Property Node(instance in=w19) -> ("f_C (Hz)"=w20, "d_2D (m)"=w21, "UT:h_UT (m)"=w22, "BS:h_BS (m)"=w23, instance out=w24)
  $UP_lnk_out <- w24
  Multiply(w20, 1e-09) -> w25
  case ("UMi - Street Canyon (LOS)") {
    frame "UMi - Street Canyon (LOS)", Default {
      Increment(x=w25) -> w48
      Logarithm Base 10(x=w48) -> w49
      Multiply(w49, -0.24) -> w50
      # w36: mu_lgDS
      Add(w50, -7.14) -> w36
      Increment(x=w25) -> w51
      Logarithm Base 10(x=w51) -> w52
      Multiply(w52, -0.05) -> w53
      # w38: mu_lgASD
      Add(w53, 1.21) -> w38
      Increment(x=w25) -> w54
      Logarithm Base 10(x=w54) -> w55
      Multiply(w55, 0.014) -> w56
      # w41: sig_lgASA
      Add(w56, 0.28) -> w41
      Increment(x=w25) -> w57
      Logarithm Base 10(x=w57) -> w58
      Multiply(w58, -0.08) -> w59
      # w40: mu_lgASA
      Add(w59, 1.73) -> w40
      Increment(x=w25) -> w60
      Logarithm Base 10(x=w60) -> w61
      Multiply(w61, -0.1) -> w62
      # w46: mu_lgZSA
      Add(w62, 0.73) -> w46
      Increment(x=w25) -> w63
      Logarithm Base 10(x=w63) -> w64
      Multiply(w64, -0.04) -> w65
      # w47: sig_lgZSA
      Add(w65, 0.34) -> w47
      Multiply(w21, -0.0148) -> w66
      Subtract(x=w22, y=w23) -> w67
      Absolute Value(x=w67) -> w68
      Multiply(w68, 0.01) -> w69
      Add(w66, w69, 0.83) -> w70
      # w42: mu_lgZSD
      Max And Min(x=w70, y=-0.21) -> (max(x,y)=w42: f64)
      w71 = 0.41  # sig_lgASD
      w72 = 0.38  # sig_lgDS
      w73 = 0.35  # sig_lgZSD
      w74 = 5  # sig_K_dB
      Multiply(w74, 0.1) -> w75
      w76 = 9  # mu_K_dB
      Multiply(w76, 0.1) -> w77
      w78 = 4  # sig_SF_dB
      Multiply(w78, 0.1) -> w79
      # w4: n_r_grd (y-axis)
      # w5: n_c_grd (x-axis)
      # w26: SF
      # w27: K
      # w28: DS
      # w29: ASD
      # w30: ASA
      # w31: ZSD
      # w32: ZSA
      for (N = w4) (iteration -> i1) {
        for (N = w5) (iteration -> i2) {
          Array Index(array=w7) -> (out0[_, i1, i2]=w87)
          w88 = [[1, 0, 0, 0, 0, 0, 0], [0.5, 0.866025403784, 0, 0, 0, 0, 0], [-0.4, -0.57735026919, 0.711805216802, 0, 0, 0, 0], [-0.5, 0.057735026919, 0.468292905791, 0.726201363984, 0, 0, 0], [-0.4, -0.115470053838, 0.80546379796, -0.234819602725, 0.350363369972, 0, 0], [0, 0, 0, 0.688514267251, 0.461454194597, 0.559471295136, 0], [0, 0, 0.280975743475, 0.231920595284, -0.49050871796, 0.119160120003, 0.782603049104]]
          call "A x Vector.gvi"(matrix A=w88, vector v=w87, error in=$error_in) -> (A x v=w89, error out=w33)
          Array Index(array=w89) -> (out0[0]=w90)
          # w91: SF_dB
          Multiply(w90, w79) -> w91
          Power Of 10(x=w91) -> w92
          Array Index(array=w89) -> (out0[1]=w93)
          Multiply(w93, w75) -> w94
          # w95: K_dB
          Add(w94, w77) -> w95
          Power Of 10(x=w95) -> w96
          Array Index(array=w89) -> (out0[2]=w97)
          Multiply(w97, w72) -> w98
          # w99: lgDS
          Add(w98, w36) -> w99
          Power Of 10(x=w99) -> w100
          Array Index(array=w89) -> (out0[3]=w101)
          Multiply(w101, w71) -> w102
          # w103: lgASD
          Add(w102, w38) -> w103
          Power Of 10(x=w103) -> w104
          Is Less(x=w104, y=104) -> w105
          Select(s=w105, t=w104, f=104) -> w106
          Select(s=$"Limit Angle Spreads?", t=w106, f=w104) -> w107
          Array Index(array=w89) -> (out0[4]=w108)
          Multiply(w108, w41) -> w109
          # w110: lgASA
          Add(w109, w40) -> w110
          Power Of 10(x=w110) -> w111
          Is Less(x=w111, y=104) -> w112
          Select(s=w112, t=w111, f=104) -> w113
          Select(s=$"Limit Angle Spreads?", t=w113, f=w111) -> w114
          Array Index(array=w89) -> (out0[5]=w115)
          Multiply(w115, w73) -> w116
          # w117: lgZSD
          Add(w116, w42) -> w117
          Power Of 10(x=w117) -> w118
          Is Less(x=w118, y=52) -> w119
          Select(s=w119, t=w118, f=52) -> w120
          Select(s=$"Limit Angle Spreads?", t=w120, f=w118) -> w121
          Array Index(array=w89) -> (out0[6]=w122)
          Multiply(w122, w47) -> w123
          # w124: lgZSA
          Add(w123, w46) -> w124
          Power Of 10(x=w124) -> w125
          Is Less(x=w125, y=52) -> w126
          Select(s=w126, t=w125, f=52) -> w127
          Select(s=$"Limit Angle Spreads?", t=w127, f=w125) -> w128
          append w92 to w80
          append w96 to w81
          append w100 to w82
          append w107 to w83
          append w114 to w84
          append w121 to w85
          append w128 to w86
        }
        append w80 to w26
        append w81 to w27
        append w82 to w28
        append w83 to w29
        append w84 to w30
        append w85 to w31
        append w86 to w32
      }
      w34 = w78
      w35 = 0
      w37 = w72
      w39 = w71
      w43 = w73
      w44 = w76
      w45 = w74
    }
    frame "UMi - Street Canyon (NLOS)" {
      Increment(x=w25) -> w129
      Logarithm Base 10(x=w129) -> w130
      Multiply(w130, -0.24) -> w131
      # w36: mu_lgDS
      Add(w131, -6.83) -> w36
      Increment(x=w25) -> w132
      Logarithm Base 10(x=w132) -> w133
      Multiply(w133, -0.23) -> w134
      # w38: mu_lgASD
      Add(w134, 1.53) -> w38
      Increment(x=w25) -> w135
      Logarithm Base 10(x=w135) -> w136
      Multiply(w136, 0.05) -> w137
      # w41: sig_lgASA
      Add(w137, 0.3) -> w41
      Increment(x=w25) -> w138
      Logarithm Base 10(x=w138) -> w139
      Multiply(w139, -0.08) -> w140
      # w40: mu_lgASA
      Add(w140, 1.81) -> w40
      Increment(x=w25) -> w141
      Logarithm Base 10(x=w141) -> w142
      Multiply(w142, -0.07) -> w143
      # w47: sig_lgZSA
      Add(w143, 0.41) -> w47
      Increment(x=w25) -> w144
      Logarithm Base 10(x=w144) -> w145
      Multiply(w145, -0.04) -> w146
      # w46: mu_lgZSA
      Add(w146, 0.92) -> w46
      Increment(x=w25) -> w147
      Logarithm Base 10(x=w147) -> w148
      Multiply(w148, 0.16) -> w149
      # w37: sig_lgDS
      Add(w149, 0.28) -> w37
      Increment(x=w25) -> w150
      Logarithm Base 10(x=w150) -> w151
      Multiply(w151, 0.11) -> w152
      # w39: sig_lgASD
      Add(w152, 0.33) -> w39
      Multiply(w21, -0.0031) -> w153
      Subtract(x=w22, y=w23) -> w154
      Max And Min(x=w154, y=0) -> (max(x,y)=w155: f64)
      Multiply(w155, 0.01) -> w156
      Add(w153, w156, 0.2) -> w157
      # w42: mu_lgZSD
      Max And Min(x=w157, y=-0.5) -> (max(x,y)=w42: f64)
      w158 = 0.35  # sig_lgZSD
      w159 = 7.82  # sig_SF_dB
      Multiply(w159, 0.1) -> w160
      # w26: SF
      # w27: K
      # w28: DS
      # w29: ASD
      # w30: ASA
      # w31: ZSD
      # w32: ZSA
      for (N = w4) (iteration -> i3) {
        for (N = w5) (iteration -> i4) {
          Array Index(array=w7) -> (out0[_, i3, i4]=w168)
          w169 = [[1, 0, 0, 0, 0, 0, 0], [0, 1, 0, 0, 0, 0, 0], [-0.7, 0, 0.714142842854, 0, 0, 0, 0], [0, 0, 0, 1, 0, 0, 0], [-0.4, 0, 0.168033610083, 0, 0.900979858755, 0, 0], [0, 0, -0.700140042014, 0.5, 0.130576791124, 0.492700338125, 0], [0, 0, 0, 0.5, 0.221980544911, -0.566237702024, 0.616522102189]]
          call "A x Vector.gvi"(matrix A=w169, vector v=w168, error in=$error_in) -> (A x v=w170, error out=w33)
          Array Index(array=w170) -> (out0[0]=w171)
          # [2]
          Multiply(w171, w160) -> w172
          # w172: SF_dB
          Power Of 10(x=w172) -> w173
          w174 = 0  # K
          Array Index(array=w170) -> (out0[2]=w175)
          Multiply(w175, w37) -> w176
          # w177: lgDS
          Add(w176, w36) -> w177
          Power Of 10(x=w177) -> w178
          Array Index(array=w170) -> (out0[3]=w179)
          Multiply(w179, w39) -> w180
          # w181: lgASD
          Add(w180, w38) -> w181
          Power Of 10(x=w181) -> w182
          Is Less(x=w182, y=104) -> w183
          Select(s=w183, t=w182, f=104) -> w184
          Select(s=$"Limit Angle Spreads?", t=w184, f=w182) -> w185
          Array Index(array=w170) -> (out0[4]=w186)
          Multiply(w186, w41) -> w187
          # w188: lgASA
          Add(w187, w40) -> w188
          Power Of 10(x=w188) -> w189
          Is Less(x=w189, y=104) -> w190
          Select(s=w190, t=w189, f=104) -> w191
          Select(s=$"Limit Angle Spreads?", t=w191, f=w189) -> w192
          Array Index(array=w170) -> (out0[5]=w193)
          Multiply(w193, w158) -> w194
          # w195: lgZSD
          Add(w194, w42) -> w195
          Power Of 10(x=w195) -> w196
          Is Less(x=w196, y=52) -> w197
          Select(s=w197, t=w196, f=52) -> w198
          Select(s=$"Limit Angle Spreads?", t=w198, f=w196) -> w199
          Array Index(array=w170) -> (out0[6]=w200)
          Multiply(w200, w47) -> w201
          # w202: lgZSA
          Add(w201, w46) -> w202
          Power Of 10(x=w202) -> w203
          Is Less(x=w203, y=52) -> w204
          Select(s=w204, t=w203, f=52) -> w205
          Select(s=$"Limit Angle Spreads?", t=w205, f=w203) -> w206
          append w173 to w161
          append w178 to w162
          append w185 to w163
          append w192 to w164
          append w199 to w165
          append w206 to w166
          append w174 to w167
        }
        append w161 to w26
        append w162 to w28
        append w163 to w29
        append w164 to w30
        append w165 to w31
        append w166 to w32
        append w167 to w27
      }
      w34 = w159
      w35 = 0
      w43 = w158
      w44 = 0
      w45 = 0
    }
  }
  Build Cluster(w26, w27, w28, w29, w30, w31, w32) -> w207
  $LSP_data <- w207
  Build Cluster(w35, w34, w44, w45, w36, w37, w38, w39, w40, w41, w42, w43, w46, w47) -> w208
  $LSP_mu_sig <- w208
  $error_out <- w33
