vi "expt_gen_blk_B_Gramercy.gvi"   [LabVIEW Communications System Design Suite 2.0.1]
inputs:
  "UP_sys_in": "UP_sys.gtype"
  "SSP_in": "SSP.gtype"
  "error_in": error
  "prf_prm_gramercy": T11
outputs:
  "UP_sys_out": "UP_sys.gtype"
  "SSP_out": "SSP.gtype"
  "error out": error
panel indicators:
  "Trajectory (Azimuth)": cluster{"Element 1": f64[], "Element 2": f64[]}
types:
  T1 = enum{"Pedestrian", "Cyclist", "City Motorist", "Freeway Motorist", "Train"}
  T2 = cluster{"Type": enum{"SB", "NSB"}, "Class (for NSB)": T1, "Location (X,Y,Z)": i32[], "Attenuation": f64, "Cl. No.": i32, "t": f64}
  T3 = cluster{"Blocker Info": T2[][], "No. of Blocked Cl. at time t": i32}
  T4 = cluster{"Cl. Attn. (ray aggr.)": f64, "No. of Blocked Rays": i32, "Ray Blocker Array": "blk_inf_ry_B.gtype"[], "Cl. No.": i32}
  "blk_inf_cl_B.gtype" = cluster{"Cluster Blocker Array": T4[], "No. of Blocked Cl. at time t": i32}
  "SSP.gtype" = cluster{"N": i32, "M": i32, "tau_n": f64[], "tau_n,i": f64[], "min(tau'_n)": f64, "P_n": f64[], "P_n,pre_blk": f64[], "P_n,m": f64[][], "phi_n_AOA": f64[], "phi_n,m,AOA": f64[][], "theta_n_ZOA": f64[], "theta_n,m,ZOA": f64[][], "phi_n_AOD": f64[], "phi_n,m,AOD": f64[][], "theta_n_ZOD": f64[], "theta_n,m,ZOD": f64[][], "phi_theta_n,m,cpl": f64[][][], "XPR": f64[][], "Phi_n,m,theta,theta": f64[][], "Phi_n,m,theta,phi": f64[][], "Phi_n,m,phi,theta": f64[][], "Phi_n,m,phi, phi": f64[][], "H_u,s,n,NLOS": c128[], "H_u,s,n,i,NLOS": c128[], "H_u,s,NLOS": c128, "H_u,s,1,LOS": c128, "H_u,s": c128, "H": c128[][], "H_u,s,n": c128[][][], "cl_sp_delay_map_LOS": f64[][][], "cl_sp_delay_map_NLOS": f64[][][], "cl_sp_shadowing_map_LOS": f64[][][], "cl_sp_shadowing_map_NLOS": f64[][][], "cl_sp_offset_AOD_map_LOS": f64[][][], "cl_sp_offset_AOD_map_NLOS": f64[][][], "cl_sp_offset_AOA_map_LOS": f64[][][], "cl_sp_offset_AOA_map_NLOS": f64[][][], "cl_sp_offset_ZOD_map_LOS": f64[][][], "cl_sp_offset_ZOD_map_NLOS": f64[][][], "cl_sp_offset_ZOA_map_LOS": f64[][][], "cl_sp_offset_ZOA_map_NLOS": f64[][][], "ray_XPR_map_LOS": f64[][][], "ray_XPR_map_NLOS": f64[][][], "ray_ini_phase_theta,phi_map_LOS": f64[][][], "ray_ini_phase_theta,theta_map_LOS": f64[][][], "pr_los_map": f64[][], "cl_sp_sign_AOD_map_LOS": i32[][][], "cl_sp_sign_AOD_map_NLOS": i32[][][], "cl_sp_sign_AOA_map_LOS": i32[][][], "cl_sp_sign_AOA_map_NLOS": i32[][][], "cl_sp_sign_ZOD_map_LOS": i32[][][], "cl_sp_sign_ZOD_map_NLOS": i32[][][], "cl_sp_sign_ZOA_map_LOS": i32[][][], "cl_sp_sign_ZOA_map_NLOS": i32[][][], "ray_ini_phase_phi,phi_map_LOS": f64[][][], "ray_ini_phase_phi,theta_map_LOS": f64[][][], "ray_ini_phase_theta,phi_map_NLOS": f64[][][], "ray_ini_phase_theta,theta_map_NLOS": f64[][][], "ray_ini_phase_phi,phi_map_NLOS": f64[][][], "ray_ini_phase_phi,theta_map_NLOS": f64[][][], "Xn_map": f64[][][], "H_sc": c128[][][], "tau_n_sc": f64[][], "P_n_sc": f64[][], "P_n_pre_blk_sc": f64[][], "blk_cnt_ang_map_LOS-NLOS": f64[][][], "Cluster Blockage Data (A)": T3, "Cluster Blockage Data (B)": "blk_inf_cl_B.gtype", "P_n,drv": f64[], "P_n,drv_sc": f64[][]}
  T5 = cluster{"Class (NSB)": T1, "Velocity": f64, "Count (K)": i32, "Blocker Trajectories": "trj_blk_B.gtype"[]}
  T6 = cluster{"Blockage Grid Margin-X": i32, "Blockage Grid Margin-Y": i32, "t_max_grd": f64, "t_res_grd": f64, "Blockage Parameters (A)": T5[], "d_res_grd": f64}
  T7 = enum{"A - Generic", "B - Generic", "B - Gramercy Park"}
  T8 = cluster{"Blockage Grid Margin-X": i32, "Blockage Grid Margin-Y": i32, "Blockage Parameters (B)": "UP_blk_B.gtype"[], "t_total_blk (s)": f64, "t_stp_blk (s)": f64}
  T9 = cluster{"t": f64[], "C": i32[][], "d_2D": f64[], "d_3D": f64[], "V": f64[][], "v": f64[], "v_avg": f64}
  T10 = cluster{"X_UT (m)": i32, "Y_UT (m)": i32, "h_UT (m)": i32, "v": f64, "phi_v": f64, "theta_v": f64, "t": f64, "Omega_UT,alpha": f64, "Omega_UT,beta": f64, "Omega_UT,gamma": f64, "zeta_rx": f64, "N,rx": i32, "M,rx": i32, "N_g,rx": i32, "M_g,rx": i32, "u": i32, "Introduce Blockages?": bool, "Self-blocking Mode": bool, "X_UT_end": i32, "Y_UT_end": i32, "h_UT_end": i32, "step_std_X": f64, "step_std_Y": f64, "step_std_Z": f64, "t_total (s)": f64, "t_step (s)": f64, "UT_loc_curr": i32[], "trj_UT": T9, "Blockage Model": T7, "BF Parameters": "UP_bf.gtype"}
  "UP_UT.gtype" = T10[]
  "UP_BS.gtype" = cluster{"X_BS (m)": f64, "Y_BS (m)": f64, "h_BS (m)": f64, "Omega_BS,alpha": f64, "Omega_BS,beta": f64, "Omega_BS,gamma": f64, "zeta_tx": f64, "M,tx": i32, "N,tx": i32, "M_g,tx": i32, "N_g,tx": i32, "s": i32, "BF Parameters": "UP_bf.gtype"}
  "UP_sys.gtype" = cluster{"Scenario": enum{"UMi - Street Canyon"}, "f_C (Hz)": f64, "No. of UT": i32, "Align BS-UT?": bool, "Blockage Settings (A)": T6, "Introduce Blockages in System?": bool, "Blockage Model": T7, "Blockage Settings (B)": T8, "UP_UT": "UP_UT.gtype", "UP_BS": "UP_BS.gtype"}
  "UP_str_prf.gtype" = cluster{"l_str": f64, "w_sw_L": f64, "den_hmn_l_L (/m2)": f64, "v_hmn_L": f64, "w_hmn_L": f64, "h_hmn_L": f64, "personal_space_l_L (X)": f64, "personal_space_w_L (Y)": f64, "w_rd": f64, "den_veh (/m)": f64, "v_veh": f64, "w_veh": f64, "h_veh": f64, "l_veh": f64, "int_veh_spc": f64, "t_trj": f64, "t_stp": f64, "w_sw_R": f64, "den_hmn_l_R (/m2)": f64, "v_hmn_R": f64, "w_hmn_R": f64, "h_hmn_R": f64, "personal_space_l_R (X)": f64, "personal_space_w_R (Y)": f64, "alpha (deg)": f64, "X_shf": f64, "Y_shf": f64, "Z_shf": f64}
  "UP_prk_prf.gtype" = cluster{"l_prk": f64, "w_prk": f64, "t_trj": f64, "den_hmn_l (/m2)": f64, "v_hmn": f64, "t_stp": f64, "w_hmn": f64, "h_hmn": f64, "personal_space_l (X)": f64, "personal_space_w (Y)": f64, "alpha (deg)": f64, "X_shf": f64, "Y_shf": f64, "Z_shf": f64}
  T11 = cluster{"E_20_St": "UP_str_prf.gtype", "E_21_St": "UP_str_prf.gtype", "E_22_St": "UP_str_prf.gtype", "Park_Ave_S": "UP_str_prf.gtype", "3rd_Ave": "UP_str_prf.gtype", "Lex_Ave": "UP_str_prf.gtype", "Gram_Prk_W": "UP_str_prf.gtype", "Gram_Prk_E": "UP_str_prf.gtype", "Park Profile Parameters": "UP_prk_prf.gtype"}
diagram:
  $SSP_out <- $SSP_in
  Property Node(instance in=$UP_sys_in) -> ("UP_UT"=w1)
  for {
    w2 = each element of w1
    Property Node(instance in=w2) -> ("t_total (s)"=w5, "t_step (s)"=w6)
    append w5 to w3
    append w6 to w4
  }
  Array Max And Min(array=w3) -> (max value=w7)
  Array Max And Min(array=w4) -> (min value=w8)
  Property Node(instance in=$UP_sys_in, "Blockage Settings (B):t_total_blk (s)"=w7, "Blockage Settings (B):t_stp_blk (s)"=w8) -> (instance out=w9)
  Property Node(instance in=$prf_prm_gramercy) -> ("E_20_St"=w10, "E_21_St"=w11, "E_22_St"=w12, "Park_Ave_S"=w13, "3rd_Ave"=w14, "Lex_Ave"=w15, "Gram_Prk_W"=w16, "Gram_Prk_E"=w17, "Park Profile Parameters"=w18)
  Property Node(instance in=w10, "t_trj"=w7, "t_stp"=w8) -> (instance out=w19)
  call "gen_str_prf.gvi"(Street Profile Parameters=w19, error_in=$error_in) -> (UP_sys_out=w20, error_out=w21)
  Property Node(instance in=w11, "t_trj"=w7, "t_stp"=w8) -> (instance out=w22)
  call "gen_str_prf.gvi"(Street Profile Parameters=w22, error_in=$error_in) -> (UP_sys_out=w23, error_out=w24)
  Property Node(instance in=w12, "t_trj"=w7, "t_stp"=w8) -> (instance out=w25)
  call "gen_str_prf.gvi"(Street Profile Parameters=w25, error_in=$error_in) -> (UP_sys_out=w26, error_out=w27)
  Property Node(instance in=w13, "t_trj"=w7, "t_stp"=w8) -> (instance out=w28)
  call "gen_str_prf.gvi"(Street Profile Parameters=w28, error_in=$error_in) -> (UP_sys_out=w29, error_out=w30)
  Property Node(instance in=w14, "t_trj"=w7, "t_stp"=w8) -> (instance out=w31)
  call "gen_str_prf.gvi"(Street Profile Parameters=w31, error_in=$error_in) -> (UP_sys_out=w32, error_out=w33)
  Property Node(instance in=w15, "t_trj"=w7, "t_stp"=w8) -> (instance out=w34)
  call "gen_str_prf.gvi"(Street Profile Parameters=w34, error_in=$error_in) -> (UP_sys_out=w35, error_out=w36)
  Property Node(instance in=w16, "t_trj"=w7, "t_stp"=w8) -> (instance out=w37)
  call "gen_str_prf.gvi"(Street Profile Parameters=w37, error_in=$error_in) -> (UP_sys_out=w38, error_out=w39)
  Property Node(instance in=w17, "t_trj"=w7, "t_stp"=w8) -> (instance out=w40)
  call "gen_str_prf.gvi"(Street Profile Parameters=w40, error_in=$error_in) -> (UP_sys_out=w41, error_out=w42)
  Property Node(instance in=w18, "t_trj"=w7, "t_stp"=w8) -> (instance out=w43)
  call "gen_prk_prf.gvi"(Park Profile Parameters=w43, error_in=$error_in) -> (UP_sys_out=w44, error_out=w45)
  Build Array(w20, w23, w26, w29, w32, w35, w38, w41, w44) -> w46
  for {
    w47 = each element of w46
    Property Node(instance in=w47) -> ("Blockage Settings (B):Blockage Parameters (B)"=w49)
    concatenate w49 onto w48
  }
  Property Node(instance in=w9, "Blockage Settings (B):Blockage Parameters (B)"=w48) -> (instance out=w50)
  $UP_sys_out <- w50
  for {
    w51 = each element of w48
    Property Node(instance in=w51) -> ("Blocker Trajectories"=w54)
    for {
      w55 = each element of w54
      Property Node(instance in=w55) -> ("C"=w58)
      for {
        w59 = each element of w58
        call "get_crd_3D.gvi"(A=w59) -> (A_x=w62, A_y=w63)
        append w62 to w60
        append w63 to w61
      }
      concatenate w60 onto w56
      concatenate w61 onto w57
    }
    concatenate w56 onto w52
    concatenate w57 onto w53
  }
  Build Cluster(w52, w53) -> w64
  $"Trajectory (Azimuth)" <- w64
  Merge Errors(w21, w24, w27, w30, w33, w36, w39, w42, w45) -> (error out=w65)
  $"error out" <- w65
