vi "expt_pr_blk_data_cond.gvi"   [LabVIEW Communications System Design Suite 2.0.1]
panel controls:
  "path": path = path "C:\\Users\\Swapnil\\Google Drive\\00 academic\\99 research\\20 link analysis\\code\\labview\\5G_Channel_3GPP_TR_38.901_v14.1.1\\Data"
  "error_in": error
  "Run ID": string = "33376"
panel indicators:
  "all rows": f64[][]
  "P_mag": f64[][]
  "subarray_2": f64[]
  "subarray_3": f64[]
  "subarray_4": f64[]
  "subarray_5": f64[]
  "x / y": f64
  "error_out": error
  "Graph": cluster{"Element 1": f64[], "Element 2": f64[]}[]
  "slope": f64
  "intercept": f64
uses:
  NI::Analysis::Fitting::Linear Fit Waveform.gvi
  NI::Analysis::Generation::Ramp Pattern by Increment.gvi
diagram:
  Path To String(path=$path) -> (string=w1)
  Concatenate Strings(w1, "\\expt_pr_blk_v1_plr_plt_mag_ID", $"Run ID", ".txt") -> w2
  String To Path(string=w2) -> (path=w3)
  # w4: p_mag_dat
  call "Read from Spreadsheet File (DBL).gvi"(file path=w3) -> (all rows=w4)
  # w5: p_mag
  Array Subset(array=w4, index1=4) -> w5
  $P_mag <- w5
  Array Index(array=w5) -> (out0[_, 34]=w6)
  Property Node(instance in=waveform<f64> {dt=1, Y=[]}, "Y"=w6, "dt"=1) -> (instance out=w7)
  call "Linear Fit Waveform.gvi"(signal=w7, error in=$error_in) -> (best linear fit=w8, slope=w9, intercept=w10, error out=w11)
  $slope <- w9
  $intercept <- w10
  $"all rows" <- w4
  Array Size(array=w6) -> (size(s)=w12)
  Decrement(x=w12) -> w13
  call "Ramp Pattern by Increment.gvi"(increment=1, end=w13) -> (ramp pattern=w14)
  Build Cluster(w14, w6) -> w15
  Property Node(instance in=w8) -> ("Y"=w16)
  Build Cluster(w14, w16) -> w17
  Build Array(w15, w17) -> w18
  $Graph <- w18
  Array Index(array=w4) -> (out0[_, 0]=w19)
  # w19: n_b
  $subarray_2 <- w19
  Array Index(array=w4) -> (out0[_, 1]=w20)
  $subarray_3 <- w20
  Array Index(array=w4) -> (out0[_, 2]=w21)
  # w20: n_b_vld
  # w21: den_avg
  $subarray_4 <- w21
  Array Index(array=w4) -> (out0[_, 3]=w22)
  # w22: vel_avg
  $subarray_5 <- w22
  Array Size(array=w5) -> (size(s)=w23)
  # NOTE:
  #
  # -- VI to approximate the probability of blockage
  # -- reads the output of 'expt_pr_blk_v1.gvi'
  # -- "expt_pr_blk_v1_plr_plt_mag_IDxx.txt" --> [vel_avg; den_avg; n_blk; n_blk_vld; P_blk]
  Array Index(array=w23) -> (out0[1]=w24)
  Decrement(x=w24) -> w25
  Divide(x=360, y=w25) -> w26
  # w26: phi_stp
  $"x / y" <- w26
  $error_out <- w11
