vi "expt_pr_blk_v1.gvi"   [LabVIEW Communications System Design Suite 2.0.1]
panel controls:
  "error_in": error
  "UP_sys_in": "UP_sys.gtype"
  "LOS-NLOS?": T8 = "UMi - Street Canyon (NLOS)"
  "theta_n,m,ZOA_end (deg)": f64 = 80
  "phi_n,m,AOA_end (deg)": f64 = 360
  "f_C (Hz)": f64 = 28000000000
  "BS Location": f64[] = [10, 20, 10]
  "UT Location": i32[] = [1, 95, 2]
  "t_stp": f64 = 1
  "t_total": f64
  "n_trials": i32 = 100
  "d_th": f64 = 50
  "phi_n,m,AOA_stp (deg)": f64 = 1
  "theta_n,m,ZOA_stp (deg)": f64 = 5
  "phi_n,m,AOA_str (deg)": f64
  "theta_n,m,ZOA_str (deg)": f64 = 80
  "velocity ranges": f64[][] = [[1.1, 2], [1.1, 2], [8, 13], [1.1, 2], [1.1, 2], [8, 13], [1.1, 2], [1.1, 2], [8, 13], [1.1, 2], [1.1, 2], [8, 13], [1.1, 2], [1.1, 2], [8, 13], [1.1, 2], [1.1, 2], [8, 13], [1.1, 2], [1.1, 2], [8, 13], [1.1, 2], [1.1, 2], [8, 13], [1.1, 2]]
  "Tab": i32
  "prf_prm_gramercy": T9 = {295, 2, 0.07, 1.1, 0.3, 1.7, 1, 0.6, 5.5, 0.05, 8, 4.8, 1.4, 5, 1.5, 4, 0.2, 2, 0.01, 1.1, 0.3, 1.7, 1, 0.6, 0, 0, 0, 0, 295, 2, 0.07, 1.1, 0.3, 1.7, 1, 0.6, 5.5, 0.05, 8, 4.8, 1.4, 5, 1.5, 3, 0.2, 2, 0.01, 1.1, 0.3, 1.7, 1, 0.6, 0, 0, 77.5, 0, 295, 2, 0.07, 1.1, 0.3, 1.7, 1, 0.6, 5.5, 0.05, 8, 4.8, 1.4, 5, 1.5, 3, 0.2, 2, 0.01, 1.1, 0.3, 1.4, 1, 0.6, 0, 0, 161, 0, 170.5, 2, 0.005, 1.1, 0.3, 1.7, 1, 0.6, 5.5, 0.05, 12, 4.8, 1.4, 5, 1.5, 3, 0.2, 2, 0.01, 1.1, 0.3, 1.7, 1, 0.6, -90, -9.5, 0, 0, 170.5, 2, 0.0002, 1.1, 0.3, 1.7, 1, 0.6, 5.5, 0.05, 10, 4.8, 1.4, 5, 1.5, 3, 0.2, 2, 0.01, 1.1, 0.3, 1.7, 1, 0.6, -270, 295, 170.5, 0, 74, 2, 0.08, 1.1, 0.3, 1.7, 1, 0.6, 5.5, 0.05, 8, 4.8, 1.4, 5, 1.5, 3, 0.2, 2, 0.01, 1.1, 0.3, 1.7, 1, 0.6, -270, 144.02, 170.5, 0, 68, 2, 0.07, 1.1, 0.3, 1.7, 1, 0.6, 5.5, 0.05, 6, 4.8, 1.4, 5, 1.5, 3, 0.2, 2, 0.01, 1.1, 0.3, 1.7, 1, 0.6, -270, 70.8, 77.5, 0, 68, 2, 0.03, 1.1, 0.3, 1.7, 1, 0.6, 5.5, 0.05, 6, 4.8, 1.4, 5, 1.5, 3, 0.2, 2, 0.01, 1.1, 0.3, 1.7, 1, 0.6, -90, 217.24, 9.5, 0, 136.94, 68, 3, 0.003, 1.1, 0.2, 0.3, 1.7, 1, 0.6, 0, 80.3, 9.5, 0}
  "Store Results to File?": bool = TRUE
  "path": path = path "C:\\Users\\Swapnil\\Google Drive\\00 academic\\99 research\\20 link analysis\\code\\labview\\5G_Channel_3GPP_TR_38.901_v14.1.1\\Data"
  "str_den_hmn_min": f64
  "str_den_hmn_max": f64 = 0.5
  "str_den_hmn_stp": f64 = 0.01
  "str_den_veh_min": f64
  "str_den_veh_max": f64 = 0.07
panel indicators:
  "error_out": error
  "P_b(t)": f64[][]
  "Pr{blockage}": cluster{"Element 1": f64[], "Element 2": f64[]}[]
  "AOA": c128[][]
  "Progress Bar": f64
  "density ranges": f64[][]
  "data": i16[][][]
  "den_avg": f64[]
  "vel_avg": f64[]
  "n_blk": i32[][]
  "run_id": string
  "n_blk_vld": i16[][]
  "L": f64[]
  "L_vld": f64[]
types:
  T1 = enum{"Pedestrian", "Cyclist", "City Motorist", "Freeway Motorist", "Train"}
  T2 = cluster{"Class (NSB)": T1, "Velocity": f64, "Count (K)": i32, "Blocker Trajectories": "trj_blk_B.gtype"[]}
  T3 = cluster{"Blockage Grid Margin-X": i32, "Blockage Grid Margin-Y": i32, "t_max_grd": f64, "t_res_grd": f64, "Blockage Parameters (A)": T2[], "d_res_grd": f64}
  T4 = enum{"A - Generic", "B - Generic", "B - Gramercy Park"}
  T5 = cluster{"Blockage Grid Margin-X": i32, "Blockage Grid Margin-Y": i32, "Blockage Parameters (B)": "UP_blk_B.gtype"[], "t_total_blk (s)": f64, "t_stp_blk (s)": f64}
  T6 = cluster{"t": f64[], "C": i32[][], "d_2D": f64[], "d_3D": f64[], "V": f64[][], "v": f64[], "v_avg": f64}
  T7 = cluster{"X_UT (m)": i32, "Y_UT (m)": i32, "h_UT (m)": i32, "v": f64, "phi_v": f64, "theta_v": f64, "t": f64, "Omega_UT,alpha": f64, "Omega_UT,beta": f64, "Omega_UT,gamma": f64, "zeta_rx": f64, "N,rx": i32, "M,rx": i32, "N_g,rx": i32, "M_g,rx": i32, "u": i32, "Introduce Blockages?": bool, "Self-blocking Mode": bool, "X_UT_end": i32, "Y_UT_end": i32, "h_UT_end": i32, "step_std_X": f64, "step_std_Y": f64, "step_std_Z": f64, "t_total (s)": f64, "t_step (s)": f64, "UT_loc_curr": i32[], "trj_UT": T6, "Blockage Model": T4, "BF Parameters": "UP_bf.gtype"}
  "UP_UT.gtype" = T7[]
  "UP_BS.gtype" = cluster{"X_BS (m)": f64, "Y_BS (m)": f64, "h_BS (m)": f64, "Omega_BS,alpha": f64, "Omega_BS,beta": f64, "Omega_BS,gamma": f64, "zeta_tx": f64, "M,tx": i32, "N,tx": i32, "M_g,tx": i32, "N_g,tx": i32, "s": i32, "BF Parameters": "UP_bf.gtype"}
  "UP_sys.gtype" = cluster{"Scenario": enum{"UMi - Street Canyon"}, "f_C (Hz)": f64, "No. of UT": i32, "Align BS-UT?": bool, "Blockage Settings (A)": T3, "Introduce Blockages in System?": bool, "Blockage Model": T4, "Blockage Settings (B)": T5, "UP_UT": "UP_UT.gtype", "UP_BS": "UP_BS.gtype"}
  T8 = enum{"UMi - Street Canyon (LOS)", "UMi - Street Canyon (NLOS)"}
  "UP_str_prf.gtype" = cluster{"l_str": f64, "w_sw_L": f64, "den_hmn_l_L (/m2)": f64, "v_hmn_L": f64, "w_hmn_L": f64, "h_hmn_L": f64, "personal_space_l_L (X)": f64, "personal_space_w_L (Y)": f64, "w_rd": f64, "den_veh (/m)": f64, "v_veh": f64, "w_veh": f64, "h_veh": f64, "l_veh": f64, "int_veh_spc": f64, "t_trj": f64, "t_stp": f64, "w_sw_R": f64, "den_hmn_l_R (/m2)": f64, "v_hmn_R": f64, "w_hmn_R": f64, "h_hmn_R": f64, "personal_space_l_R (X)": f64, "personal_space_w_R (Y)": f64, "alpha (deg)": f64, "X_shf": f64, "Y_shf": f64, "Z_shf": f64}
  "UP_prk_prf.gtype" = cluster{"l_prk": f64, "w_prk": f64, "t_trj": f64, "den_hmn_l (/m2)": f64, "v_hmn": f64, "t_stp": f64, "w_hmn": f64, "h_hmn": f64, "personal_space_l (X)": f64, "personal_space_w (Y)": f64, "alpha (deg)": f64, "X_shf": f64, "Y_shf": f64, "Z_shf": f64}
  T9 = cluster{"Element 1": "UP_str_prf.gtype", "Element 2": "UP_str_prf.gtype", "Element 3": "UP_str_prf.gtype", "Element 4": "UP_str_prf.gtype", "Element 5": "UP_str_prf.gtype", "Element 6": "UP_str_prf.gtype", "Element 7": "UP_str_prf.gtype", "Element 8": "UP_str_prf.gtype", "Element 9": "UP_prk_prf.gtype"}
uses:
  NI::Analysis::Generation::Ramp Pattern by Increment.gvi
  NI::Analysis::Generation::Ramp Pattern by Samples.gvi
  NI::Analysis::Generation::Uniform White Noise.gvi
diagram:
  call "Ramp Pattern by Increment.gvi"(increment=$str_den_hmn_stp, end=$str_den_hmn_max, start=$str_den_hmn_min) -> (ramp pattern=w1)
  Array Size(array=w1) -> (size(s)=w2)
  call "Ramp Pattern by Samples.gvi"(samples=w2, end=$str_den_veh_max, start=$str_den_veh_min) -> (ramp pattern=w3)
  # Park Ave S profile
  Initialize Array(element=0, size=25, size=w2) -> w4
  Replace Array Subset(inArray=w4, index=9, index=_, new=w1) -> w5
  Replace Array Subset(inArray=w5, index=10, index=_, new=w1) -> w6
  Replace Array Subset(inArray=w6, index=11, index=_, new=w3) -> w7
  $"density ranges" <- w7
  w8 = $n_trials
  w9 = $"BS Location"
  w10 = $"UT Location"
  w11 = $d_th
  w12 = $prf_prm_gramercy
  w13 = $"LOS-NLOS?"
  Divide(x=SpeedOfLight, y=$"f_C (Hz)") -> w14
  Array Subset(array=$"velocity ranges", index1=1, length1=1) -> w15
  # w15: [1]
  Transpose 2D Array(2D array=w15) -> (transposed array=w16)
  Transpose 2D Array(2D array=w7) -> (transposed array=w17)
  call "Ramp Pattern by Increment.gvi"(increment=$t_stp, end=$t_total, start=0, error in=$error_in) -> (ramp pattern=w18, error out=w19)
  call "Ramp Pattern by Increment.gvi"(increment=$"phi_n,m,AOA_stp (deg)", end=$"phi_n,m,AOA_end (deg)", start=$"phi_n,m,AOA_str (deg)", error in=$error_in) -> (ramp pattern=w20, error out=w21)
  call "Ramp Pattern by Increment.gvi"(increment=$"theta_n,m,ZOA_stp (deg)", end=$"theta_n,m,ZOA_end (deg)", start=$"theta_n,m,ZOA_str (deg)", error in=$error_in) -> (error out=w22)
  Merge Errors(w21, w22, w19) -> (error out=w23)
  Property Node(instance in=$UP_sys_in) -> ("UP_UT"=w24, instance out=w25)
  Array Index(array=w24) -> (out0[_]=w26)
  Property Node(instance in=w26, "t_total (s)"=$t_total, "t_step (s)"=$t_stp) -> (instance out=w27)
  for (N = 1) {
    append w27 to w28
  }
  Property Node(instance in=w25, "UP_UT"=w28) -> (instance out=w29)
  call "conv_deg_to_rad_1D.gvi"(angle (deg)=w20) -> (angle (rad)=w30)
  call "conv_deg_to_rad.gvi"(angle (deg)=$"theta_n,m,ZOA_str (deg)") -> (angle (rad)=w31)
  Array Size(array=w30) -> (size(s)=w32)
  Initialize Array(element=0, size=w32) -> w33
  Array Size(array=w30) -> (size(s)=w34)
  Array Size(array=w17) -> (size(s)=w35)
  Array Index(array=w35) -> (out0[0]=w36)
  # NOTE:
  #
  # [1] there is a provision for simulating with multiple velocities, but for now it has been set to a single velocity profile.
  s1 = 0  # shift register
  for {
    w37 = each element of w17
    Add Array Elements(numeric array=w37) -> (sum=w47)
    Array Size(array=w37) -> (size(s)=w48)
    Divide(x=w47, y=w48) -> w49
    Array Index(array=w37) -> (out0[11]=w50)
    Array Index(array=w37) -> (out0[9]=w51)
    Array Index(array=w37) -> (out0[10]=w52)
    Add(w51, w52) -> w53
    Multiply(2, w53) -> w54
    Add(w54, w50) -> w55
    Array Size(array=w16) -> (size(s)=w56)
    Array Index(array=w56) -> (out0[0]=w57)
    call "expt_w_den_gramercy.gvi"(prf_prm_gramercy_in=w12, density ranges=w37) -> (prf_prm_gramercy_out=w58)
    # blocker density loop
    s2 = s1  # shift register
    for {
      w59 = each element of w16
      call "expt_w_vel_gramercy.gvi"(prf_prm_gramercy_in=w58, velocity ranges=w59) -> (prf_prm_gramercy_out=w67)
      # blocker velocity loop
      s3 = s2  # shift register
      for {
        w68 = each element of w30
        # phi loop
        s4 = w33  # shift register
        s5 = s3  # shift register
        for (N = w8) {
          call "expt_gen_blk_B_Gramercy.gvi"(UP_sys_in=w29, error_in=w23, prf_prm_gramercy=w67) -> (UP_sys_out=w70, error out=w71)
          Property Node(instance in=w70) -> ("Blockage Settings (B):Blockage Parameters (B)"=w72)
          # trial loop
          for {
            w73 = each element of w72
            # blocker class loop
            Property Node(instance in=w73) -> ("Blocker Trajectories"=w77, "Class"=w78, "Count (K)"=w79, "w"=w80, "h"=w81)
            Initialize Array(element=w78, size=w79) -> w82
            Initialize Array(element=w80, size=w79) -> w83
            Initialize Array(element=w81, size=w79) -> w84
            concatenate w77 onto w74
            concatenate w83 onto w75
            concatenate w84 onto w76
          }
          Array Size(array=w18) -> (size(s)=w85)
          Array Size(array=w76) -> (size(s)=w86)
          s6 = s5  # shift register
          for (iteration -> i1) (after w18) {
            # time loop
            s7 = 1  # shift register
            for (iteration -> i2) {
              w88 = each element of w74
              w89 = each element of w75
              w90 = each element of w76
              Property Node(instance in=w88) -> ("C"=w93)
              Array Index(array=w93) -> (out0[i1, _]=w94)
              call "blk_int_test_B.gvi"(Scenario LOS-NLOS=w13, error_in=w71, T=w9, C=w94, w=w89, h=w90, R=w10, phi_n,m,AOA (rad)=w68, theta_n,m,ZOA (rad)=w31) -> (int AZI=w95, error_out=w96, r_zen=w97, D_F_w1=w98, D_F_w2=w99, sgn_F_w1=w100, sgn_F_w2=w101, int ZEN=w102, D_F_h1=w103, D_F_h2=w104, r_azi=w105, sgn_F_h2=w106, sgn_F_h1=w107)
              # blocker loop
              call "get_crd_3D.gvi"(A=w10) -> (A_x=w108, A_y=w109, A_z=w110)
              call "get_crd_3D.gvi"(A=w94) -> (A_x=w111, A_y=w112, A_z=w113)
              call "calc_euc_dis_3D.gvi"(x_1=w108, y_1=w109, z_1=w110, x_2=w111, y_2=w112, z_2=w113) -> (d_12=w114)
              Is Less(x=w114, y=w11) -> w115
              Logical Or(w95, w102) -> w116
              Logical And(w115, w116) -> w117
              case (FALSE) {
                frame False, Default {
                  w118 = 1
                }
                frame True {
                  # w119: F_w,1
                  call "blk_att_subfnc_B.gvi"(lambda_0=w14, sgn=w100, D=w98, r=w105) -> (F=w119)
                  # w120: F_w,2
                  call "blk_att_subfnc_B.gvi"(lambda_0=w14, sgn=w101, D=w99, r=w105) -> (F=w120)
                  Add(w119, w120) -> w121
                  # w122: F_h,1
                  call "blk_att_subfnc_B.gvi"(lambda_0=w14, sgn=w107, D=w103, r=w97) -> (F=w122)
                  # w123: F_h,2
                  call "blk_att_subfnc_B.gvi"(lambda_0=w14, sgn=w106, D=w104, r=w97) -> (F=w123)
                  Add(w122, w123) -> w124
                  Multiply(w121, w124) -> w125
                  Subtract(x=1, y=w125) -> w126
                  Select(s=w117, t=w126, f=1) -> w118
                }
              }
              Multiply(s7, w118) -> w127
              Boolean To Integer(Boolean=w115) -> (0, 1=w128)
              Multiply(w86, w85, w8, w34, w57, w36) -> w129
              Increment(x=i2) -> w130
              Add(s6, w130) -> w131
              Divide(x=w131, y=w129) -> w132
              $"Progress Bar" <- w132
              append w117 to w91
              append w128 to w92
              next s7 = w127
            }
            Or Array Elements(Boolean array=w91) -> (logical OR=w133)
            Boolean To Integer(Boolean=w133) -> (0, 1=w134)
            Add Array Elements(numeric array=w92) -> (sum=w135)
            append w134 to w87
            next s6 = w131
          }
          Add(s4, w87) -> w136
          next s4 = w136
          next s5 = s6
        }
        concatenate s4 onto w69
        next s3 = s5
      }
      Divide(x=w69, y=w8) -> w137
      Build Cluster(w30, w137) -> w138
      call "calc_polar_coord.gvi"(angle (rad)=w30) -> (polar coordinates=w139)
      Complex To Polar(r * e^(i*theta)=w139) -> (r=w140, theta=w141)
      Multiply(w137, w140) -> w142
      Polar To Complex(r=w142, theta=w141) -> (r * e^(i*theta)=w143)
      Add Array Elements(numeric array=w59) -> (sum=w144)
      Array Size(array=w59) -> (size(s)=w145)
      Divide(x=w144, y=w145) -> w146
      append w69 to w60
      append w138 to w61
      append w143 to w62
      append w146 to w63
      append w86 to w64
      append w137 to w65
      append w135 to w66
      next s2 = s3
    }
    Array Index(array=w66) -> (out0[_]=w147)
    Divide(x=w147, y=w55) -> w148
    Array Index(array=w64) -> (out0[_]=w149)
    Divide(x=w149, y=w55) -> w150
    append w60 to w38
    concatenate w61 onto w39
    concatenate w62 onto w40
    append w49 to w41
    append w64 to w42
    concatenate w65 onto w43
    append w66 to w44
    append w150 to w45
    append w148 to w46
    next s1 = s2
  }
  Array Index(array=w42) -> (out0[_, 0]=w151)
  Array Index(array=w44) -> (out0[_, 0]=w152)
  Insert Into Array(inArray=w43, index1=0, new=w63) -> w153
  Insert Into Array(inArray=w153, index1=0, new=w41) -> w154
  Insert Into Array(inArray=w154, index1=0, new=w152) -> w155
  Insert Into Array(inArray=w155, index1=0, new=w151) -> w156
  case ($"Store Results to File?") {
    frame False, Default { }
    frame True {
      Tick Count[Units=Ticks]() -> (timer value=w157)
      call "Uniform White Noise.gvi"(samples=100, seed=w157) -> (uniform white noise=w158)
      Absolute Value(x=w158) -> w159
      Multiply(w159, 100000) -> w160
      To Long Integer(number=w160) -> w161
      Array Index(array=w161) -> (out0[_]=w162)
      Number To Decimal String(number=w162) -> (decimal integer string=w163)
      $run_id <- w163
      Path To String(path=$path) -> (string=w164)
      Concatenate Strings(w164, "\\expt_pr_blk_v1_plr_plt_mag_ID", w163, ".txt") -> w165
      String To Path(string=w165) -> (path=w166)
      call "Write to Spreadsheet File (DBL).gvi"(format="%.32f", file path=w166, 2D data=w156)
    }
  }
  $data <- w38
  $"Pr{blockage}" <- w39
  $"P_b(t)" <- w43
  $AOA <- w40
  $n_blk_vld <- w44
  $error_out <- w96
  $n_blk <- w42
  $L_vld <- w46
  $vel_avg <- w63
  $den_avg <- w41
  $L <- w45
