vi "expt_w_den_gramercy.gvi"   [LabVIEW Communications System Design Suite 2.0.1]
inputs:
  "prf_prm_gramercy_in": T1
  "density ranges": f64[]
outputs:
  "prf_prm_gramercy_out": T1
types:
  "UP_str_prf.gtype" = cluster{"l_str": f64, "w_sw_L": f64, "den_hmn_l_L (/m2)": f64, "v_hmn_L": f64, "w_hmn_L": f64, "h_hmn_L": f64, "personal_space_l_L (X)": f64, "personal_space_w_L (Y)": f64, "w_rd": f64, "den_veh (/m)": f64, "v_veh": f64, "w_veh": f64, "h_veh": f64, "l_veh": f64, "int_veh_spc": f64, "t_trj": f64, "t_stp": f64, "w_sw_R": f64, "den_hmn_l_R (/m2)": f64, "v_hmn_R": f64, "w_hmn_R": f64, "h_hmn_R": f64, "personal_space_l_R (X)": f64, "personal_space_w_R (Y)": f64, "alpha (deg)": f64, "X_shf": f64, "Y_shf": f64, "Z_shf": f64}
  "UP_prk_prf.gtype" = cluster{"l_prk": f64, "w_prk": f64, "t_trj": f64, "den_hmn_l (/m2)": f64, "v_hmn": f64, "t_stp": f64, "w_hmn": f64, "h_hmn": f64, "personal_space_l (X)": f64, "personal_space_w (Y)": f64, "alpha (deg)": f64, "X_shf": f64, "Y_shf": f64, "Z_shf": f64}
  T1 = cluster{"E_20_St": "UP_str_prf.gtype", "E_21_St": "UP_str_prf.gtype", "E_22_St": "UP_str_prf.gtype", "Park_Ave_S": "UP_str_prf.gtype", "3rd_Ave": "UP_str_prf.gtype", "Lex_Ave": "UP_str_prf.gtype", "Gram_Prk_W": "UP_str_prf.gtype", "Gram_Prk_E": "UP_str_prf.gtype", "Park Profile Parameters": "UP_prk_prf.gtype"}
diagram:
  Property Node(instance in=$prf_prm_gramercy_in) -> ("E_20_St"=w1, "E_21_St"=w2, "E_22_St"=w3, "Park_Ave_S"=w4, "3rd_Ave"=w5, "Lex_Ave"=w6, "Gram_Prk_W"=w7, "Gram_Prk_E"=w8, "Park Profile Parameters"=w9, instance out=w10)
  Array Index(array=$"density ranges") -> (out0[0]=w11)
  Array Index(array=$"density ranges") -> (out0[1]=w12)
  Array Index(array=$"density ranges") -> (out0[2]=w13)
  Property Node(instance in=w1, "den_hmn_l_L (/m2)"=w11, "den_hmn_l_R (/m2)"=w12, "den_veh (/m)"=w13) -> (instance out=w14)
  Array Index(array=$"density ranges") -> (out0[3]=w15)
  Array Index(array=$"density ranges") -> (out0[4]=w16)
  Array Index(array=$"density ranges") -> (out0[5]=w17)
  Property Node(instance in=w2, "den_hmn_l_L (/m2)"=w15, "den_hmn_l_R (/m2)"=w16, "den_veh (/m)"=w17) -> (instance out=w18)
  Array Index(array=$"density ranges") -> (out0[6]=w19)
  Array Index(array=$"density ranges") -> (out0[7]=w20)
  Array Index(array=$"density ranges") -> (out0[8]=w21)
  Property Node(instance in=w3, "den_hmn_l_L (/m2)"=w19, "den_hmn_l_R (/m2)"=w20, "den_veh (/m)"=w21) -> (instance out=w22)
  Array Index(array=$"density ranges") -> (out0[9]=w23)
  Array Index(array=$"density ranges") -> (out0[10]=w24)
  Array Index(array=$"density ranges") -> (out0[11]=w25)
  Property Node(instance in=w4, "den_hmn_l_L (/m2)"=w23, "den_hmn_l_R (/m2)"=w24, "den_veh (/m)"=w25) -> (instance out=w26)
  Array Index(array=$"density ranges") -> (out0[12]=w27)
  Array Index(array=$"density ranges") -> (out0[13]=w28)
  Array Index(array=$"density ranges") -> (out0[14]=w29)
  Property Node(instance in=w5, "den_hmn_l_L (/m2)"=w27, "den_hmn_l_R (/m2)"=w28, "den_veh (/m)"=w29) -> (instance out=w30)
  Array Index(array=$"density ranges") -> (out0[15]=w31)
  Array Index(array=$"density ranges") -> (out0[16]=w32)
  Array Index(array=$"density ranges") -> (out0[17]=w33)
  Property Node(instance in=w6, "den_hmn_l_L (/m2)"=w31, "den_hmn_l_R (/m2)"=w32, "den_veh (/m)"=w33) -> (instance out=w34)
  Array Index(array=$"density ranges") -> (out0[18]=w35)
  Array Index(array=$"density ranges") -> (out0[19]=w36)
  Array Index(array=$"density ranges") -> (out0[20]=w37)
  Property Node(instance in=w7, "den_hmn_l_L (/m2)"=w35, "den_hmn_l_R (/m2)"=w36, "den_veh (/m)"=w37) -> (instance out=w38)
  Array Index(array=$"density ranges") -> (out0[21]=w39)
  Array Index(array=$"density ranges") -> (out0[22]=w40)
  Array Index(array=$"density ranges") -> (out0[23]=w41)
  Property Node(instance in=w8, "den_hmn_l_L (/m2)"=w39, "den_hmn_l_R (/m2)"=w40, "den_veh (/m)"=w41) -> (instance out=w42)
  Array Index(array=$"density ranges") -> (out0[24]=w43)
  Property Node(instance in=w9, "den_hmn_l (/m2)"=w43) -> (instance out=w44)
  Property Node(instance in=w10, "E_20_St"=w14, "E_21_St"=w18, "E_22_St"=w22, "Park_Ave_S"=w26, "3rd_Ave"=w30, "Lex_Ave"=w34, "Gram_Prk_W"=w38, "Gram_Prk_E"=w42, "Park Profile Parameters"=w44) -> (instance out=w45)
  $prf_prm_gramercy_out <- w45
