vi "gen_angle_aoa.gvi"   [LabVIEW Communications System Design Suite 2.0.1]
inputs:
  "UP_lnk_in": "UP_lnk.gtype"
  "SSP_in": "SSP.gtype"
  "LSP_in": "LSP.gtype"
  "error_in": error
outputs:
  "SSP_out": "SSP.gtype"
  "LSP_out": "LSP.gtype"
  "UP_lnk_out": "UP_lnk.gtype"
  "error_out": error
types:
  T1 = cluster{"Cl. No.": i32, "Attn. (dB)": f64, "SB": bool, "NSB": bool}
  "SSP.gtype" = cluster{"N": i32, "M": i32, "tau_n": f64[], "tau_n,i": f64[], "min(tau'_n)": f64, "P_n": f64[], "P_n,pre_blk": f64[], "P_n,m": f64[][], "phi_n_AOA": f64[], "phi_n,m,AOA": f64[][], "theta_n_ZOA": f64[], "theta_n,m,ZOA": f64[][], "phi_n_AOD": f64[], "phi_n,m,AOD": f64[][], "theta_n_ZOD": f64[], "theta_n,m,ZOD": f64[][], "phi_theta_n,m,cpl": f64[][][], "XPR": f64[][], "Phi_n,m,theta,theta": f64[][], "Phi_n,m,theta,phi": f64[][], "Phi_n,m,phi,theta": f64[][], "Phi_n,m,phi, phi": f64[][], "H_u,s,n,NLOS": c128[], "H_u,s,n,i,NLOS": c128[], "H_u,s,NLOS": c128, "H_u,s,1,LOS": c128, "H_u,s": c128, "H": c128[][], "H_u,s,n": c128[][][], "UT Blockage Status": T1[], "cl_sp_delay_map_LOS": f64[][][], "cl_sp_delay_map_NLOS": f64[][][], "cl_sp_shadowing_map_LOS": f64[][][], "cl_sp_shadowing_map_NLOS": f64[][][], "cl_sp_offset_AOD_map_LOS": f64[][][], "cl_sp_offset_AOD_map_NLOS": f64[][][], "cl_sp_offset_AOA_map_LOS": f64[][][], "cl_sp_offset_AOA_map_NLOS": f64[][][], "cl_sp_offset_ZOD_map_LOS": f64[][][], "cl_sp_offset_ZOD_map_NLOS": f64[][][], "cl_sp_offset_ZOA_map_LOS": f64[][][], "cl_sp_offset_ZOA_map_NLOS": f64[][][], "ray_XPR_map_LOS": f64[][][], "ray_XPR_map_NLOS": f64[][][], "ray_ini_phase_theta,phi_map_LOS": f64[][][], "ray_ini_phase_theta,theta_map_LOS": f64[][][], "pr_los_map": f64[][], "cl_sp_sign_AOD_map_LOS": i32[][][], "cl_sp_sign_AOD_map_NLOS": i32[][][], "cl_sp_sign_AOA_map_LOS": i32[][][], "cl_sp_sign_AOA_map_NLOS": i32[][][], "cl_sp_sign_ZOD_map_LOS": i32[][][], "cl_sp_sign_ZOD_map_NLOS": i32[][][], "cl_sp_sign_ZOA_map_LOS": i32[][][], "cl_sp_sign_ZOA_map_NLOS": i32[][][], "ray_ini_phase_phi,phi_map_LOS": f64[][][], "ray_ini_phase_phi,theta_map_LOS": f64[][][], "ray_ini_phase_theta,phi_map_NLOS": f64[][][], "ray_ini_phase_theta,theta_map_NLOS": f64[][][], "ray_ini_phase_phi,phi_map_NLOS": f64[][][], "ray_ini_phase_phi,theta_map_NLOS": f64[][][], "Xn_map": f64[][][]}
  T2 = cluster{"SF": f64, "K": f64, "DS": f64, "ASD": f64, "ASA": f64, "ZSD": f64, "ZSA": f64, "mu_XPR_dB": f64}
  T3 = cluster{"mu_SF_dB": f64, "sig_SF_dB": f64, "mu_K_dB": f64, "sig_K_dB": f64, "mu_lgDS": f64, "sig_lgDS": f64, "mu_lgASD": f64, "sig_lgASD": f64, "mu_lgASA": f64, "sig_lgASA": f64, "mu_lgZSD": f64, "sig_lgZSD": f64, "mu_lgZSA": f64, "sig_lgZSA": f64, "mu_XPR_dB": f64, "sig_XPR_dB": f64}
  "LSP.gtype" = cluster{"LSP": T2, "LSP_mu_sig": T3, "PL_dB": f64, "mu_PL_dB": f64, "LSP_map_LOS": f64[][][], "LSP_map_NLOS": f64[][][], "n_r,grd": i32, "n_c,grd": i32}
  T4 = enum{"UMi - Street Canyon (LOS)", "UMi - Street Canyon (NLOS)"}
  T5 = cluster{"X_BS (m)": f64, "Y_BS (m)": f64, "h_BS (m)": f64, "Omega_BS,alpha": f64, "Omega_BS,beta": f64, "Omega_BS,gamma": f64, "zeta_tx": f64, "M,tx": i32, "N,tx": i32, "M_g,tx": i32, "N_g,tx": i32, "s": i32}
  T6 = cluster{"h_UT (m)": f64, "v": f64, "phi_v": f64, "theta_v": f64, "t": f64, "Omega_UT,alpha": f64, "Omega_UT,beta": f64, "Omega_UT,gamma": f64, "zeta_rx": f64, "Y_UT (m)": f64, "X_UT (m)": f64, "N,rx": i32, "M,rx": i32, "N_g,rx": i32, "M_g,rx": i32, "u": i32, "Introduce Blockages?": bool, "Self-blocking Mode": bool, "X_UT_end": f64, "Y_UT_end": f64, "h_UT_end": f64, "step_std_X": f64, "step_std_Y": f64, "step_std_Z": f64, "t_total (s)": f64, "t_step (s)": f64}
  "UP_lnk.gtype" = cluster{"Scenario LOS-NLOS": T4, "d_2D (m)": f64, "d_3D (m)": f64, "f_C (Hz)": f64, "lambda_0": f64, "phi_LOS,AOA": f64, "phi_LOS,AOD": f64, "theta_LOS,ZOA": f64, "theta_LOS,ZOD": f64, "BS": T5, "d_V_tx": f64, "d_H,tx": f64, "d_V_rx": f64, "d_H,rx": f64, "d_g,V,tx": f64, "d_g,H,tx": f64, "d_g,V,rx": f64, "d_g,H,rx": f64, "d_rx,u": f64[3], "d_tx,s": f64[3], "UT": T6, "Align BS-UT?": bool}
uses:
  NI::Analysis::Generation::Bernoulli Noise.gvi
  NI::Analysis::Generation::Gaussian White Noise.gvi
diagram:
  Property Node(instance in=$UP_lnk_in) -> ("Scenario LOS-NLOS"=w1, "phi_LOS,AOA"=w2, instance out=w3)
  call "conv_deg_to_rad.gvi"(angle (deg)=w2) -> (angle (rad)=w4)
  Property Node(instance in=w3, "phi_LOS,AOA"=w4) -> (instance out=w5)
  $UP_lnk_out <- w5
  Property Node(instance in=$SSP_in) -> ("P_n"=w6, instance out=w7)
  Property Node(instance in=$LSP_in) -> ("LSP:K"=w8, "LSP:ASA"=w9, instance out=w10)
  # NOTES:
  #
  # [2] eq. (7.5-9) has been reduced, C_phi is factored in the multi-product.
  case (w1) {
    frame "UMi - Street Canyon (LOS)", Default {
      w14 = 1.146  # C_phi_NLOS
      Multiply(w8, -0.028) -> w15
      Power Of X(x=w8, y=2) -> w16
      Multiply(w16, -0.002) -> w17
      Power Of X(x=w8, y=3) -> w18
      Multiply(w18, 0.0001) -> w19
      Add(1.1035, w15, w17, w19) -> w20
      # [2]
      Multiply(w20, w14, 0.7) -> w21
      Reciprocal(x=w21) -> w22
      Array Max And Min(array=w6) -> (max value=w23)
      Reciprocal(x=w23) -> w24
      Multiply(w6, w24) -> w25
      Natural Logarithm(x=w25) -> w26
      Negate(x=w26) -> w27
      Square Root(x=w27) -> w28
      Multiply(w28, w9, w22) -> w29
      Array Size(array=w29) -> (size(s)=w30)
      # w29: phi'_n,AOA
      call "Bernoulli Noise.gvi"(error in=$error_in, samples=w30) -> (error out=w31, Bernoulli noise=w32)
      Multiply(w32, 2) -> w33
      Decrement(x=w33) -> w34
      Multiply(w29, w34) -> w35
      Divide(x=w9, y=7) -> w36
      call "Gaussian White Noise.gvi"(samples=w30, standard deviation=w36, error in=w31) -> (Gaussian white noise=w37, error out=w13)
      # w38: phi_n,AOA
      Add(w35, w37, w2) -> w38
      Replace Array Subset(inArray=w38, index=0, new=w2) -> w11
      w39 = 17  # c_ASA
      w12 = w39
    }
    frame "UMi - Street Canyon (NLOS)" {
      w40 = 1.273  # C_phi_NLOS
      Multiply(w40, 0.7) -> w41
      Reciprocal(x=w41) -> w42
      Array Max And Min(array=w6) -> (max value=w43)
      Reciprocal(x=w43) -> w44
      Multiply(w6, w44) -> w45
      Natural Logarithm(x=w45) -> w46
      Negate(x=w46) -> w47
      Square Root(x=w47) -> w48
      Multiply(w48, w9, w42) -> w49
      Array Size(array=w49) -> (size(s)=w50)
      # w49: phi'_n_AOA
      call "Bernoulli Noise.gvi"(error in=$error_in, samples=w50) -> (error out=w51, Bernoulli noise=w52)
      Multiply(w52, 2) -> w53
      Decrement(x=w53) -> w54
      Multiply(w49, w54) -> w55
      Divide(x=w9, y=7) -> w56
      call "Gaussian White Noise.gvi"(samples=w50, standard deviation=w56, error in=w51) -> (Gaussian white noise=w57, error out=w13)
      # w11: phi_n,AOA
      Add(w55, w57, w2) -> w11
      w58 = 22  # c_ASA
      w12 = w58
    }
  }
  call "angle_mirr_azi_1D.gvi"(angle_in (deg)=w11, error_in=w13) -> (angle_out (deg)=w59, error_out=w60)
  call "conv_deg_to_rad_1D.gvi"(angle (deg)=w59) -> (angle (rad)=w61)
  w62 = [0.0447, -0.0447, 0.1413, -0.1413, 0.2492, -0.2492, 0.3715, -0.3715, 0.5129, -0.5129, 0.6797, -0.6797, 0.8844, -0.8844, 1.1481, -1.1481, 1.5195, -1.5195, 2.1551, -2.1551]
  Multiply(w62, w12) -> w63
  for {
    w64 = each element of w11
    Add(w64, w63) -> w66
    append w66 to w65
  }
  call "angle_mirr_azi_2D.gvi"(angle_in (deg)=w65, error_in=w13) -> (angle_out (deg)=w67, error_out=w68)
  call "conv_deg_to_rad_2D.gvi"(angle (deg)=w67) -> (angle (rad)=w69)
  Property Node(instance in=w7, "phi_n_AOA"=w61, "phi_n,m,AOA"=w69) -> (instance out=w70)
  $SSP_out <- w70
  $LSP_out <- w10
  Merge Errors(w60, w68) -> (error out=w71)
  $error_out <- w71
