vi "gen_angle_zoa.gvi"   [LabVIEW Communications System Design Suite 2.0.1]
inputs:
  "UP_lnk_in": "UP_lnk.gtype" = {"Scenario LOS-NLOS"="UMi - Street Canyon (LOS)", "d_2D (m)"=50, "f_C (Hz)"=28, "phi_LOS,AOA"=24, "phi_LOS,AOD"=57, "theta_LOS,ZOA"=31, "theta_LOS,ZOD"=45, "d_rx,u"=[0, 0, 0], "d_tx,s"=[0, 0, 0]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}
  "SSP_in": "SSP.gtype"
  "LSP_in": "LSP.gtype"
  "error_in": error
outputs:
  "SSP_out": "SSP.gtype"
  "LSP_out": "LSP.gtype"
  "UP_lnk_out": "UP_lnk.gtype"
  "error_out": error
types:
  "SSP.gtype" = cluster{"N": i32, "M": i32, "tau_n": f64[], "tau_n,i": f64[], "P_n": f64[], "P_ray": f64[][], "phi_n_AOA": f64[], "phi_n,m,AOA": f64[][], "theta_n_ZOA": f64[], "theta_n,m,ZOA": f64[][], "phi_n_AOD": f64[], "phi_n,m,AOD": f64[][], "theta_n_ZOD": f64[], "theta_n,m,ZOD": f64[][], "phi_theta_n,m,cpl": f64[][][], "XPR": f64[][], "Phi_n,m,theta,theta": f64[][], "Phi_n,m,theta,phi": f64[][], "Phi_n,m,phi,theta": f64[][], "Phi_n,m,phi, phi": f64[][], "H_u,s,n,NLOS": c128[], "H_u,s,n,i,NLOS": c128[], "H_u,s,NLOS": c128, "H_u,s,1,LOS": c128, "H_u,s": c128, "H": c128[][], "H_u,s,n": c128[][][]}
  T1 = cluster{"SF": f64, "K": f64, "DS": f64, "ASD": f64, "ASA": f64, "ZSD": f64, "ZSA": f64, "mu_XPR_dB": f64}
  T2 = cluster{"mu_SF_dB": f64, "sig_SF_dB": f64, "mu_K_dB": f64, "sig_K_dB": f64, "mu_lgDS": f64, "sig_lgDS": f64, "mu_lgASD": f64, "sig_lgASD": f64, "mu_lgASA": f64, "sig_lgASA": f64, "mu_lgZSD": f64, "sig_lgZSD": f64, "mu_lgZSA": f64, "sig_lgZSA": f64, "mu_XPR_dB": f64, "sig_XPR_dB": f64}
  "LSP.gtype" = cluster{"LSP": T1, "LSP_mu_sig": T2, "PL_dB": f64, "mu_PL_dB": f64, "LSP_map": f64[][][]}
  T3 = enum{"UMi - Street Canyon (LOS)", "UMi - Street Canyon (NLOS)"}
  T4 = cluster{"X_BS (m)": f64, "Y_BS (m)": f64, "h_BS (m)": f64, "Omega_BS,alpha": f64, "Omega_BS,beta": f64, "Omega_BS,gamma": f64, "zeta_tx": f64, "M,tx": i32, "N,tx": i32, "M_g,tx": i32, "N_g,tx": i32, "s": i32}
  T5 = cluster{"h_UT (m)": f64, "v": f64, "phi_v": f64, "theta_v": f64, "t": f64, "Omega_UT,alpha": f64, "Omega_UT,beta": f64, "Omega_UT,gamma": f64, "zeta_rx": f64, "Y_UT (m)": f64, "X_UT (m)": f64, "N,rx": i32, "M,rx": i32, "N_g,rx": i32, "M_g,rx": i32, "u": i32}
  "UP_lnk.gtype" = cluster{"Scenario LOS-NLOS": T3, "d_2D (m)": f64, "d_3D (m)": f64, "f_C (Hz)": f64, "lambda_0": f64, "phi_LOS,AOA": f64, "phi_LOS,AOD": f64, "theta_LOS,ZOA": f64, "theta_LOS,ZOD": f64, "BS": T4, "d_V_tx": f64, "d_H,tx": f64, "d_V_rx": f64, "d_H,rx": f64, "d_g,V,tx": f64, "d_g,H,tx": f64, "d_g,V,rx": f64, "d_g,H,rx": f64, "d_rx,u": f64[3], "d_tx,s": f64[3], "UT": T5}
uses:
  NI::Analysis::Generation::Bernoulli Noise.gvi
  NI::Analysis::Generation::Gaussian White Noise.gvi
diagram:
  Property Node(instance in=$UP_lnk_in) -> ("Scenario LOS-NLOS"=w1, "theta_LOS,ZOA"=w2, instance out=w3)
  call "conv_deg_to_rad.gvi"(angle (deg)=w2) -> (angle (rad)=w4)
  Property Node(instance in=w3, "theta_LOS,ZOA"=w4) -> (instance out=w5)
  $UP_lnk_out <- w5
  Property Node(instance in=$SSP_in) -> ("P_n"=w6, instance out=w7)
  Property Node(instance in=$LSP_in) -> ("LSP:K"=w8, "LSP:ZSA"=w9, instance out=w10)
  # NOTES:
  #
  # [2] eq. (7.5-16): theta_bar_ZOA=90 deg if O2I or =theta_LOS,ZOA; currently we have not implemented the O2I case, hence it is defaulted to theta_LOS,ZOA.
  case (w1) {
    frame "UMi - Street Canyon (LOS)", Default {
      Array Max And Min(array=w6) -> (max value=w14)
      Reciprocal(x=w14) -> w15
      Multiply(w6, w15) -> w16
      Natural Logarithm(x=w16) -> w17
      Negate(x=w17) -> w18
      w19 = 1.104  # C_theta_NLOS
      Multiply(w8, 0.0339) -> w20
      Power Of X(x=w8, y=2) -> w21
      Multiply(w21, -0.0077) -> w22
      Power Of X(x=w8, y=3) -> w23
      Multiply(w23, 0.0002) -> w24
      Add(1.3086, w20, w22, w24) -> w25
      Multiply(w25, w19) -> w26
      Reciprocal(x=w26) -> w27
      Multiply(w18, w9, w27) -> w28
      Array Size(array=w28) -> (size(s)=w29)
      # w28: theta'_n,ZOA
      call "Bernoulli Noise.gvi"(error in=$error_in, samples=w29) -> (error out=w30, Bernoulli noise=w31)
      Multiply(w31, 2) -> w32
      Decrement(x=w32) -> w33
      Multiply(w28, w33) -> w34
      Divide(x=w9, y=7) -> w35
      call "Gaussian White Noise.gvi"(samples=w29, standard deviation=w35, error in=w30) -> (Gaussian white noise=w36, error out=w13)
      # w37: theta_n,ZOA
      Add(w34, w36, w2) -> w37
      # w2: [2]
      Replace Array Subset(inArray=w37, index=0, new=w2) -> w11
      w38 = 7  # c_ZSA
      w12 = w38
    }
    frame "UMi - Street Canyon (NLOS)" {
      Array Max And Min(array=w6) -> (max value=w39)
      Reciprocal(x=w39) -> w40
      Multiply(w6, w40) -> w41
      Natural Logarithm(x=w41) -> w42
      Negate(x=w42) -> w43
      w44 = 1.184  # C_theta_NLOS
      Reciprocal(x=w44) -> w45
      Multiply(w43, w9, w45) -> w46
      Array Size(array=w46) -> (size(s)=w47)
      call "Bernoulli Noise.gvi"(error in=$error_in, samples=w47) -> (error out=w48, Bernoulli noise=w49)
      Multiply(w49, 2) -> w50
      Decrement(x=w50) -> w51
      Multiply(w46, w51) -> w52
      Divide(x=w9, y=7) -> w53
      call "Gaussian White Noise.gvi"(samples=w47, standard deviation=w53, error in=w48) -> (Gaussian white noise=w54, error out=w13)
      # w11: theta_n,ZOA
      Add(w52, w54, w2) -> w11
      w55 = 7  # c_ZSA
      w12 = w55
    }
  }
  call "angle_mirr_zen_1D.gvi"(angle_in (deg)=w11, error_in=w13) -> (angle_out (deg)=w56, error_out=w57)
  call "conv_deg_to_rad_1D.gvi"(angle (deg)=w56) -> (angle (rad)=w58)
  w59 = [0.0447, -0.0447, 0.1413, -0.1413, 0.2492, -0.2492, 0.3715, -0.3715, 0.5129, -0.5129, 0.6797, -0.6797, 0.8844, -0.8844, 1.1481, -1.1481, 1.5195, -1.5195, 2.1551, -2.1551]
  Multiply(w59, w12) -> w60
  for {
    w61 = each element of w11
    Add(w61, w60) -> w63
    append w63 to w62
  }
  call "angle_mirr_zen_2D.gvi"(angle_in (deg)=w62, error_in=w13) -> (angle_out (deg)=w64, error_out=w65)
  call "conv_deg_to_rad_2D.gvi"(angle (deg)=w64) -> (angle (rad)=w66)
  Property Node(instance in=w7, "theta_n_ZOA"=w58, "theta_n,m,ZOA"=w66) -> (instance out=w67)
  $SSP_out <- w67
  $LSP_out <- w10
  Merge Errors(w57, w65) -> (error out=w68)
  $error_out <- w68
