vi "gen_angle_zoa_sc.gvi"   [LabVIEW Communications System Design Suite 2.0.1]
inputs:
  "UP_lnk_in": "UP_lnk.gtype"
  "SSP_in": "SSP.gtype"
  "LSP_in": "LSP.gtype"
  "error_in": error
outputs:
  "SSP_out": "SSP.gtype"
  "LSP_out": "LSP.gtype"
  "UP_lnk_out": "UP_lnk.gtype"
  "error_out": error
types:
  T1 = enum{"Pedestrian", "Cyclist", "City Motorist", "Freeway Motorist", "Train"}
  T2 = cluster{"Type": enum{"SB", "NSB"}, "Class (for NSB)": T1, "Location (X,Y,Z)": i32[], "Attenuation": f64, "Cl. No.": i32, "t": f64}
  T3 = cluster{"Blocker Info": T2[][], "No. of Blocked Cl. at time t": i32}
  T4 = cluster{"Cl. Attn. (ray aggr.)": f64, "No. of Blocked Rays": i32, "Ray Blocker Array": "blk_inf_ry_B.gtype"[], "Cl. No.": i32}
  "blk_inf_cl_B.gtype" = cluster{"Cluster Blocker Array": T4[], "No. of Blocked Cl. at time t": i32}
  "SSP.gtype" = cluster{"N": i32, "M": i32, "tau_n": f64[], "tau_n,i": f64[], "min(tau'_n)": f64, "P_n": f64[], "P_n,pre_blk": f64[], "P_n,m": f64[][], "phi_n_AOA": f64[], "phi_n,m,AOA": f64[][], "theta_n_ZOA": f64[], "theta_n,m,ZOA": f64[][], "phi_n_AOD": f64[], "phi_n,m,AOD": f64[][], "theta_n_ZOD": f64[], "theta_n,m,ZOD": f64[][], "phi_theta_n,m,cpl": f64[][][], "XPR": f64[][], "Phi_n,m,theta,theta": f64[][], "Phi_n,m,theta,phi": f64[][], "Phi_n,m,phi,theta": f64[][], "Phi_n,m,phi, phi": f64[][], "H_u,s,n,NLOS": c128[], "H_u,s,n,i,NLOS": c128[], "H_u,s,NLOS": c128, "H_u,s,1,LOS": c128, "H_u,s": c128, "H": c128[][], "H_u,s,n": c128[][][], "cl_sp_delay_map_LOS": f64[][][], "cl_sp_delay_map_NLOS": f64[][][], "cl_sp_shadowing_map_LOS": f64[][][], "cl_sp_shadowing_map_NLOS": f64[][][], "cl_sp_offset_AOD_map_LOS": f64[][][], "cl_sp_offset_AOD_map_NLOS": f64[][][], "cl_sp_offset_AOA_map_LOS": f64[][][], "cl_sp_offset_AOA_map_NLOS": f64[][][], "cl_sp_offset_ZOD_map_LOS": f64[][][], "cl_sp_offset_ZOD_map_NLOS": f64[][][], "cl_sp_offset_ZOA_map_LOS": f64[][][], "cl_sp_offset_ZOA_map_NLOS": f64[][][], "ray_XPR_map_LOS": f64[][][], "ray_XPR_map_NLOS": f64[][][], "ray_ini_phase_theta,phi_map_LOS": f64[][][], "ray_ini_phase_theta,theta_map_LOS": f64[][][], "pr_los_map": f64[][], "cl_sp_sign_AOD_map_LOS": i32[][][], "cl_sp_sign_AOD_map_NLOS": i32[][][], "cl_sp_sign_AOA_map_LOS": i32[][][], "cl_sp_sign_AOA_map_NLOS": i32[][][], "cl_sp_sign_ZOD_map_LOS": i32[][][], "cl_sp_sign_ZOD_map_NLOS": i32[][][], "cl_sp_sign_ZOA_map_LOS": i32[][][], "cl_sp_sign_ZOA_map_NLOS": i32[][][], "ray_ini_phase_phi,phi_map_LOS": f64[][][], "ray_ini_phase_phi,theta_map_LOS": f64[][][], "ray_ini_phase_theta,phi_map_NLOS": f64[][][], "ray_ini_phase_theta,theta_map_NLOS": f64[][][], "ray_ini_phase_phi,phi_map_NLOS": f64[][][], "ray_ini_phase_phi,theta_map_NLOS": f64[][][], "Xn_map": f64[][][], "H_sc": c128[][][], "tau_n_sc": f64[][], "P_n_sc": f64[][], "P_n_pre_blk_sc": f64[][], "blk_cnt_ang_map_LOS-NLOS": f64[][][], "Cluster Blockage Data (A)": T3, "Cluster Blockage Data (B)": "blk_inf_cl_B.gtype", "P_n,drv": f64[], "P_n,drv_sc": f64[][], "P_n,drv_pre_blk_sc": f64[][], "P_n,i": f64[]}
  T5 = cluster{"SF": f64, "K": f64, "DS": f64, "ASD": f64, "ASA": f64, "ZSD": f64, "ZSA": f64, "mu_XPR_dB": f64}
  T6 = cluster{"mu_SF_dB": f64, "sig_SF_dB": f64, "mu_K_dB": f64, "sig_K_dB": f64, "mu_lgDS": f64, "sig_lgDS": f64, "mu_lgASD": f64, "sig_lgASD": f64, "mu_lgASA": f64, "sig_lgASA": f64, "mu_lgZSD": f64, "sig_lgZSD": f64, "mu_lgZSA": f64, "sig_lgZSA": f64, "mu_XPR_dB": f64, "sig_XPR_dB": f64}
  "LSP.gtype" = cluster{"LSP": T5, "LSP_mu_sig": T6, "PL_dB": f64, "mu_PL_dB": f64, "LSP_map_LOS": f64[][][], "LSP_map_NLOS": f64[][][], "n_r,grd": i32, "n_c,grd": i32}
  T7 = enum{"UMi - Street Canyon (LOS)", "UMi - Street Canyon (NLOS)"}
  "blk_inf_UT_B.gtype" = "blk_inf_cl_B.gtype"[]
  T8 = enum{"A - Generic", "B - Generic", "B - Gramercy Park"}
  T9 = cluster{"Blockage Grid Margin-X": i32, "Blockage Grid Margin-Y": i32, "Blockage Parameters (B)": "UP_blk_B.gtype"[], "t_total_blk (s)": f64, "t_stp_blk (s)": f64}
  T10 = cluster{"Class (NSB)": T1, "Velocity": f64, "Count (K)": i32, "Blocker Trajectories": "trj_blk_B.gtype"[]}
  T11 = cluster{"Blockage Grid Margin-X": i32, "Blockage Grid Margin-Y": i32, "t_max_grd": f64, "t_res_grd": f64, "Blockage Parameters (A)": T10[], "d_res_grd": f64}
  "UP_BS.gtype" = cluster{"X_BS (m)": f64, "Y_BS (m)": f64, "h_BS (m)": f64, "Omega_BS,alpha": f64, "Omega_BS,beta": f64, "Omega_BS,gamma": f64, "zeta_tx": f64, "M,tx": i32, "N,tx": i32, "M_g,tx": i32, "N_g,tx": i32, "s": i32, "BF Parameters": "UP_bf.gtype"}
  T12 = cluster{"t": f64[], "C": i32[][], "d_2D": f64[], "d_3D": f64[], "V": f64[][], "v": f64[], "v_avg": f64}
  T13 = cluster{"X_UT (m)": i32, "Y_UT (m)": i32, "h_UT (m)": i32, "v": f64, "phi_v": f64, "theta_v": f64, "t": f64, "Omega_UT,alpha": f64, "Omega_UT,beta": f64, "Omega_UT,gamma": f64, "zeta_rx": f64, "N,rx": i32, "M,rx": i32, "N_g,rx": i32, "M_g,rx": i32, "u": i32, "Introduce Blockages?": bool, "Self-blocking Mode": bool, "X_UT_end": i32, "Y_UT_end": i32, "h_UT_end": i32, "step_std_X": f64, "step_std_Y": f64, "step_std_Z": f64, "t_total (s)": f64, "t_step (s)": f64, "UT_loc_curr": i32[], "trj_UT": T12, "Blockage Model": T8, "BF Parameters": "UP_bf.gtype"}
  "UP_lnk.gtype" = cluster{"Scenario LOS-NLOS": T7, "d_2D (m)": f64, "d_3D (m)": f64, "f_C (Hz)": f64, "lambda_0": f64, "phi_LOS,AOA": f64, "phi_LOS,AOD": f64, "theta_LOS,ZOA": f64, "theta_LOS,ZOD": f64, "d_V_tx": f64, "d_H,tx": f64, "d_V_rx": f64, "d_H,rx": f64, "d_g,V,tx": f64, "d_g,H,tx": f64, "d_g,V,rx": f64, "d_g,H,rx": f64, "d_rx,u": f64[3], "d_tx,s": f64[3], "Align BS-UT?": bool, "Introduce Blockages in System?": bool, "UT Blockage Data (A)": T2[][][], "UT Blockage Data (B)": "blk_inf_UT_B.gtype", "Blockage Model": T8, "Blockage Settings (B)": T9, "Blockage Settings (A)": T11, "BS": "UP_BS.gtype", "UT": T13}
diagram:
  Property Node(instance in=$UP_lnk_in) -> ("UT:X_UT (m)"=w1, "BS:X_BS (m)"=w2, "UT:Y_UT (m)"=w3, "BS:Y_BS (m)"=w4, "Scenario LOS-NLOS"=w5, "theta_LOS,ZOA"=w6, instance out=w7)
  call "conv_deg_to_rad.gvi"(angle (deg)=w6) -> (angle (rad)=w8)
  Property Node(instance in=w7, "theta_LOS,ZOA"=w8) -> (instance out=w9)
  $UP_lnk_out <- w9
  Property Node(instance in=$SSP_in) -> ("cl_sp_offset_ZOA_map_LOS"=w10, "cl_sp_offset_ZOA_map_NLOS"=w11, "cl_sp_sign_ZOA_map_LOS"=w12, "cl_sp_sign_ZOA_map_NLOS"=w13, "P_n"=w14, instance out=w15)
  Property Node(instance in=$LSP_in) -> ("LSP:K"=w16, "LSP:ZSA"=w17, instance out=w18)
  Subtract(x=w1, y=w2) -> w19
  Subtract(x=w3, y=w4) -> w20
  Is Equal To 0(x=w5) -> w21
  Select(s=w21, t=w12, f=w13) -> w22
  Array Index(array=w22) -> (out0[_, w20, w19]=w23)
  Select(s=w21, t=w10, f=w11) -> w24
  Array Index(array=w24) -> (out0[_, w20, w19]=w25)
  # NOTES:
  #
  # [2] eq. (7.5-16): theta_bar_ZOA=90 deg if O2I or =theta_LOS,ZOA; currently we have not implemented the O2I case, hence it is defaulted to theta_LOS,ZOA.
  case (w5) {
    frame "UMi - Street Canyon (LOS)", Default {
      Array Max And Min(array=w14) -> (max value=w29)
      Reciprocal(x=w29) -> w30
      Multiply(w14, w30) -> w31
      Natural Logarithm(x=w31) -> w32
      Negate(x=w32) -> w33
      w34 = 1.104  # C_theta_NLOS
      Multiply(w16, 0.0339) -> w35
      Power Of X(x=w16, y=2) -> w36
      Multiply(w36, -0.0077) -> w37
      Power Of X(x=w16, y=3) -> w38
      Multiply(w38, 0.0002) -> w39
      Add(1.3086, w35, w37, w39) -> w40
      Multiply(w40, w34) -> w41
      Reciprocal(x=w41) -> w42
      # w43: theta'_n,ZOA
      Multiply(w33, w17, w42) -> w43
      Array Size(array=w43) -> (size(s)=w44)
      Array Subset(array=w25, length0=w44) -> w45
      Divide(x=w17, y=7) -> w46
      Multiply(w45, w46) -> w47
      Array Subset(array=w23, length0=w44) -> w48
      Multiply(w48, 2) -> w49
      Decrement(x=w49) -> w50
      Multiply(w43, w50) -> w51
      # w52: theta_n,ZOA
      Add(w51, w47, w6) -> w52
      # w6: [2]
      Replace Array Subset(inArray=w52, index=0, new=w6) -> w26
      w53 = 7  # c_ZSA
      w27 = w53
      w28 = $error_in
    }
    frame "UMi - Street Canyon (NLOS)" {
      Array Max And Min(array=w14) -> (max value=w54)
      Reciprocal(x=w54) -> w55
      Multiply(w14, w55) -> w56
      Natural Logarithm(x=w56) -> w57
      Negate(x=w57) -> w58
      w59 = 1.184  # C_theta_NLOS
      # w23: Bern(0,1)
      # w25: N(0,1)
      Reciprocal(x=w59) -> w60
      Multiply(w58, w17, w60) -> w61
      Array Size(array=w61) -> (size(s)=w62)
      Array Subset(array=w25, length0=w62) -> w63
      Divide(x=w17, y=7) -> w64
      Multiply(w63, w64) -> w65
      Array Subset(array=w23, length0=w62) -> w66
      Multiply(w66, 2) -> w67
      Decrement(x=w67) -> w68
      Multiply(w61, w68) -> w69
      # w26: theta_n,ZOA
      Add(w69, w65, w6) -> w26
      w70 = 7  # c_ZSA
      w27 = w70
      w28 = $error_in
    }
  }
  call "angle_mirr_zen_1D.gvi"(angle_in (deg)=w26, error_in=w28) -> (angle_out (deg)=w71, error_out=w72)
  call "conv_deg_to_rad_1D.gvi"(angle (deg)=w71) -> (angle (rad)=w73)
  w74 = [0.0447, -0.0447, 0.1413, -0.1413, 0.2492, -0.2492, 0.3715, -0.3715, 0.5129, -0.5129, 0.6797, -0.6797, 0.8844, -0.8844, 1.1481, -1.1481, 1.5195, -1.5195, 2.1551, -2.1551]
  Multiply(w74, w27) -> w75
  for {
    w76 = each element of w26
    Add(w76, w75) -> w78
    append w78 to w77
  }
  call "angle_mirr_zen_2D.gvi"(angle_in (deg)=w77, error_in=w28) -> (angle_out (deg)=w79, error_out=w80)
  call "conv_deg_to_rad_2D.gvi"(angle (deg)=w79) -> (angle (rad)=w81)
  Property Node(instance in=w15, "theta_n_ZOA"=w73, "theta_n,m,ZOA"=w81) -> (instance out=w82)
  $SSP_out <- w82
  $LSP_out <- w18
  Merge Errors(w72, w80) -> (error out=w83)
  $error_out <- w83
