vi "gen_angle_zod.gvi"   [LabVIEW Communications System Design Suite 2.0.1]
inputs:
  "UP_lnk_in": "UP_lnk.gtype" = {"Scenario LOS-NLOS"="UMi - Street Canyon (LOS)", "d_2D (m)"=50, "f_C (Hz)"=28, "phi_LOS,AOA"=24, "phi_LOS,AOD"=57, "theta_LOS,ZOA"=31, "theta_LOS,ZOD"=45, "d_rx,u"=[0, 0, 0], "d_tx,s"=[0, 0, 0]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}
  "SSP_in": "SSP.gtype"
  "LSP_in": "LSP.gtype"
  "error_in": error
outputs:
  "SSP_out": "SSP.gtype"
  "LSP_out": "LSP.gtype"
  "UP_lnk_out": "UP_lnk.gtype"
  "error_out": error
types:
  "SSP.gtype" = cluster{"N": i32, "M": i32, "tau_n": f64[], "tau_n,i": f64[], "P_n": f64[], "P_ray": f64[][], "phi_n_AOA": f64[], "phi_n,m,AOA": f64[][], "theta_n_ZOA": f64[], "theta_n,m,ZOA": f64[][], "phi_n_AOD": f64[], "phi_n,m,AOD": f64[][], "theta_n_ZOD": f64[], "theta_n,m,ZOD": f64[][], "phi_theta_n,m,cpl": f64[][][], "XPR": f64[][], "Phi_n,m,theta,theta": f64[][], "Phi_n,m,theta,phi": f64[][], "Phi_n,m,phi,theta": f64[][], "Phi_n,m,phi, phi": f64[][], "H_u,s,n,NLOS": c128[], "H_u,s,n,i,NLOS": c128[], "H_u,s,NLOS": c128, "H_u,s,1,LOS": c128, "H_u,s": c128, "H": c128[][], "H_u,s,n": c128[][][]}
  T1 = cluster{"SF": f64, "K": f64, "DS": f64, "ASD": f64, "ASA": f64, "ZSD": f64, "ZSA": f64, "mu_XPR_dB": f64}
  T2 = cluster{"mu_SF_dB": f64, "sig_SF_dB": f64, "mu_K_dB": f64, "sig_K_dB": f64, "mu_lgDS": f64, "sig_lgDS": f64, "mu_lgASD": f64, "sig_lgASD": f64, "mu_lgASA": f64, "sig_lgASA": f64, "mu_lgZSD": f64, "sig_lgZSD": f64, "mu_lgZSA": f64, "sig_lgZSA": f64, "mu_XPR_dB": f64, "sig_XPR_dB": f64}
  "LSP.gtype" = cluster{"LSP": T1, "LSP_mu_sig": T2, "PL_dB": f64, "mu_PL_dB": f64, "LSP_map": f64[][][]}
  T3 = enum{"UMi - Street Canyon (LOS)", "UMi - Street Canyon (NLOS)"}
  T4 = cluster{"X_BS (m)": f64, "Y_BS (m)": f64, "h_BS (m)": f64, "Omega_BS,alpha": f64, "Omega_BS,beta": f64, "Omega_BS,gamma": f64, "zeta_tx": f64, "M,tx": i32, "N,tx": i32, "M_g,tx": i32, "N_g,tx": i32, "s": i32}
  T5 = cluster{"h_UT (m)": f64, "v": f64, "phi_v": f64, "theta_v": f64, "t": f64, "Omega_UT,alpha": f64, "Omega_UT,beta": f64, "Omega_UT,gamma": f64, "zeta_rx": f64, "Y_UT (m)": f64, "X_UT (m)": f64, "N,rx": i32, "M,rx": i32, "N_g,rx": i32, "M_g,rx": i32, "u": i32}
  "UP_lnk.gtype" = cluster{"Scenario LOS-NLOS": T3, "d_2D (m)": f64, "d_3D (m)": f64, "f_C (Hz)": f64, "lambda_0": f64, "phi_LOS,AOA": f64, "phi_LOS,AOD": f64, "theta_LOS,ZOA": f64, "theta_LOS,ZOD": f64, "BS": T4, "d_V_tx": f64, "d_H,tx": f64, "d_V_rx": f64, "d_H,rx": f64, "d_g,V,tx": f64, "d_g,H,tx": f64, "d_g,V,rx": f64, "d_g,H,rx": f64, "d_rx,u": f64[3], "d_tx,s": f64[3], "UT": T5}
uses:
  NI::Analysis::Generation::Bernoulli Noise.gvi
  NI::Analysis::Generation::Gaussian White Noise.gvi
diagram:
  Property Node(instance in=$UP_lnk_in) -> ("Scenario LOS-NLOS"=w1, "theta_LOS,ZOD"=w2, "d_2D (m)"=w3, "UT:h_UT (m)"=w4, "BS:h_BS (m)"=w5, instance out=w6)
  call "conv_deg_to_rad.gvi"(angle (deg)=w2) -> (angle (rad)=w7)
  Property Node(instance in=w6, "theta_LOS,ZOD"=w7) -> (instance out=w8)
  $UP_lnk_out <- w8
  Property Node(instance in=$SSP_in) -> ("P_n"=w9, instance out=w10)
  Property Node(instance in=$LSP_in) -> ("LSP:K"=w11, "LSP:ZSD"=w12, instance out=w13)
  # NOTES:
  #
  # [1] max(P_n) is the first value due to the ascending order.
  # [2] eq. (7.5-16): theta_bar_ZOD=90 deg if O2I or =theta_LOS,ZOD; currently we have not implemented the O2I case, hence it is defaulted to theta_LOS,ZOD.
  case (w1) {
    frame "UMi - Street Canyon (LOS)", Default {
      Array Max And Min(array=w9) -> (max value=w17)
      Reciprocal(x=w17) -> w18
      Multiply(w9, w18) -> w19
      Natural Logarithm(x=w19) -> w20
      Negate(x=w20) -> w21
      w22 = 1.104  # C_theta_NLOS
      Multiply(w11, 0.0339) -> w23
      Power Of X(x=w11, y=2) -> w24
      Multiply(w24, -0.0077) -> w25
      Power Of X(x=w11, y=3) -> w26
      Multiply(w26, 0.0002) -> w27
      Add(1.3086, w23, w25, w27) -> w28
      # w29: C_theta
      Multiply(w28, w22) -> w29
      Reciprocal(x=w29) -> w30
      Multiply(w21, w12, w30) -> w31
      Array Size(array=w31) -> (size(s)=w32)
      # w31: theta'_n,ZOA
      call "Bernoulli Noise.gvi"(error in=$error_in, samples=w32) -> (error out=w33, Bernoulli noise=w34)
      Multiply(w34, 2) -> w35
      Decrement(x=w35) -> w36
      Multiply(w31, w36) -> w37
      Divide(x=w12, y=7) -> w38
      # w2: [2]
      call "Gaussian White Noise.gvi"(samples=w32, standard deviation=w38, error in=w33) -> (Gaussian white noise=w39, error out=w16)
      # w40: theta_n,ZOA
      Add(w37, w39, w2) -> w40
      Replace Array Subset(inArray=w40, index=0, new=w2) -> w14
      Multiply(-0.0148, w3) -> w41
      Subtract(x=w4, y=w5) -> w42
      Absolute Value(x=w42) -> w43
      Multiply(w43, 0.01) -> w44
      Add(0.83, w41, w44) -> w45
      # w15: mu_lgZSD
      Max And Min(x=w45, y=-0.21) -> (max(x,y)=w15: f64)
    }
    frame "UMi - Street Canyon (NLOS)" {
      Max And Min(x=w3, y=10) -> (max(x,y)=w46: f64)
      Logarithm Base 10(x=w46) -> w47
      Multiply(-1.5, w47) -> w48
      Add(w48, 3.3) -> w49
      Power Of 10(x=w49) -> w50
      # w51: mu_offset,ZOD
      Negate(x=w50) -> w51
      Array Max And Min(array=w9) -> (max value=w52)
      Reciprocal(x=w52) -> w53
      Multiply(w9, w53) -> w54
      Natural Logarithm(x=w54) -> w55
      Negate(x=w55) -> w56
      w57 = 1.184  # C_theta_NLOS
      Reciprocal(x=w57) -> w58
      Multiply(w56, w12, w58) -> w59
      Array Size(array=w59) -> (size(s)=w60)
      # w59: theta'_n,ZOD
      call "Bernoulli Noise.gvi"(error in=$error_in, samples=w60) -> (error out=w61, Bernoulli noise=w62)
      Multiply(w62, 2) -> w63
      Decrement(x=w63) -> w64
      Multiply(w59, w64) -> w65
      Divide(x=w12, y=7) -> w66
      call "Gaussian White Noise.gvi"(samples=w60, standard deviation=w66, error in=w61) -> (Gaussian white noise=w67, error out=w16)
      # w14: theta_n,ZOD
      Add(w65, w67, w2, w51) -> w14
      Multiply(-0.0031, w3) -> w68
      Subtract(x=w4, y=w5) -> w69
      Max And Min(x=w69, y=0) -> (max(x,y)=w70: f64)
      Multiply(w70, 0.01) -> w71
      Add(0.2, w68, w71) -> w72
      # w15: mu_lgZSD
      Max And Min(x=w72, y=-0.5) -> (max(x,y)=w15: f64)
    }
  }
  call "angle_mirr_zen_1D.gvi"(angle_in (deg)=w14, error_in=w16) -> (angle_out (deg)=w73, error_out=w74)
  call "conv_deg_to_rad_1D.gvi"(angle (deg)=w73) -> (angle (rad)=w75)
  Power Of 10(x=w15) -> w76
  w77 = [0.0447, -0.0447, 0.1413, -0.1413, 0.2492, -0.2492, 0.3715, -0.3715, 0.5129, -0.5129, 0.6797, -0.6797, 0.8844, -0.8844, 1.1481, -1.1481, 1.5195, -1.5195, 2.1551, -2.1551]
  Multiply(w77, 0.375, w76) -> w78
  for {
    w79 = each element of w14
    Add(w79, w78) -> w81
    append w81 to w80
  }
  call "angle_mirr_zen_2D.gvi"(angle_in (deg)=w80, error_in=w16) -> (angle_out (deg)=w82, error_out=w83)
  call "conv_deg_to_rad_2D.gvi"(angle (deg)=w82) -> (angle (rad)=w84)
  Property Node(instance in=w10, "theta_n_ZOD"=w75, "theta_n,m,ZOD"=w84) -> (instance out=w85)
  $SSP_out <- w85
  $LSP_out <- w13
  Merge Errors(w74, w83) -> (error out=w86)
  $error_out <- w86
