vi "gen_angle_zod_sc.gvi"   [LabVIEW Communications System Design Suite 2.0.1]
inputs:
  "UP_lnk_in": "UP_lnk.gtype"
  "SSP_in": "SSP.gtype"
  "LSP_in": "LSP.gtype"
  "error_in": error
outputs:
  "SSP_out": "SSP.gtype"
  "LSP_out": "LSP.gtype"
  "UP_lnk_out": "UP_lnk.gtype"
  "error_out": error
types:
  T1 = enum{"Pedestrian", "Cyclist", "City Motorist", "Freeway Motorist", "Train"}
  T2 = cluster{"Type": enum{"SB", "NSB"}, "Class (for NSB)": T1, "Location (X,Y,Z)": i32[], "Attenuation": f64, "Cl. No.": i32, "t": f64}
  T3 = cluster{"Blocker Info": T2[][], "No. of Blocked Cl. at time t": i32}
  T4 = cluster{"Cl. Attn. (ray aggr.)": f64, "No. of Blocked Rays": i32, "Ray Blocker Array": "blk_inf_ry_B.gtype"[], "Cl. No.": i32}
  "blk_inf_cl_B.gtype" = cluster{"Cluster Blocker Array": T4[], "No. of Blocked Cl. at time t": i32}
  "SSP.gtype" = cluster{"N": i32, "M": i32, "tau_n": f64[], "tau_n,i": f64[], "min(tau'_n)": f64, "P_n": f64[], "P_n,pre_blk": f64[], "P_n,m": f64[][], "phi_n_AOA": f64[], "phi_n,m,AOA": f64[][], "theta_n_ZOA": f64[], "theta_n,m,ZOA": f64[][], "phi_n_AOD": f64[], "phi_n,m,AOD": f64[][], "theta_n_ZOD": f64[], "theta_n,m,ZOD": f64[][], "phi_theta_n,m,cpl": f64[][][], "XPR": f64[][], "Phi_n,m,theta,theta": f64[][], "Phi_n,m,theta,phi": f64[][], "Phi_n,m,phi,theta": f64[][], "Phi_n,m,phi, phi": f64[][], "H_u,s,n,NLOS": c128[], "H_u,s,n,i,NLOS": c128[], "H_u,s,NLOS": c128, "H_u,s,1,LOS": c128, "H_u,s": c128, "H": c128[][], "H_u,s,n": c128[][][], "cl_sp_delay_map_LOS": f64[][][], "cl_sp_delay_map_NLOS": f64[][][], "cl_sp_shadowing_map_LOS": f64[][][], "cl_sp_shadowing_map_NLOS": f64[][][], "cl_sp_offset_AOD_map_LOS": f64[][][], "cl_sp_offset_AOD_map_NLOS": f64[][][], "cl_sp_offset_AOA_map_LOS": f64[][][], "cl_sp_offset_AOA_map_NLOS": f64[][][], "cl_sp_offset_ZOD_map_LOS": f64[][][], "cl_sp_offset_ZOD_map_NLOS": f64[][][], "cl_sp_offset_ZOA_map_LOS": f64[][][], "cl_sp_offset_ZOA_map_NLOS": f64[][][], "ray_XPR_map_LOS": f64[][][], "ray_XPR_map_NLOS": f64[][][], "ray_ini_phase_theta,phi_map_LOS": f64[][][], "ray_ini_phase_theta,theta_map_LOS": f64[][][], "pr_los_map": f64[][], "cl_sp_sign_AOD_map_LOS": i32[][][], "cl_sp_sign_AOD_map_NLOS": i32[][][], "cl_sp_sign_AOA_map_LOS": i32[][][], "cl_sp_sign_AOA_map_NLOS": i32[][][], "cl_sp_sign_ZOD_map_LOS": i32[][][], "cl_sp_sign_ZOD_map_NLOS": i32[][][], "cl_sp_sign_ZOA_map_LOS": i32[][][], "cl_sp_sign_ZOA_map_NLOS": i32[][][], "ray_ini_phase_phi,phi_map_LOS": f64[][][], "ray_ini_phase_phi,theta_map_LOS": f64[][][], "ray_ini_phase_theta,phi_map_NLOS": f64[][][], "ray_ini_phase_theta,theta_map_NLOS": f64[][][], "ray_ini_phase_phi,phi_map_NLOS": f64[][][], "ray_ini_phase_phi,theta_map_NLOS": f64[][][], "Xn_map": f64[][][], "H_sc": c128[][][], "tau_n_sc": f64[][], "P_n_sc": f64[][], "P_n_pre_blk_sc": f64[][], "blk_cnt_ang_map_LOS-NLOS": f64[][][], "Cluster Blockage Data (A)": T3, "Cluster Blockage Data (B)": "blk_inf_cl_B.gtype", "P_n,drv": f64[], "P_n,drv_sc": f64[][], "P_n,drv_pre_blk_sc": f64[][], "P_n,i": f64[]}
  T5 = cluster{"SF": f64, "K": f64, "DS": f64, "ASD": f64, "ASA": f64, "ZSD": f64, "ZSA": f64, "mu_XPR_dB": f64}
  T6 = cluster{"mu_SF_dB": f64, "sig_SF_dB": f64, "mu_K_dB": f64, "sig_K_dB": f64, "mu_lgDS": f64, "sig_lgDS": f64, "mu_lgASD": f64, "sig_lgASD": f64, "mu_lgASA": f64, "sig_lgASA": f64, "mu_lgZSD": f64, "sig_lgZSD": f64, "mu_lgZSA": f64, "sig_lgZSA": f64, "mu_XPR_dB": f64, "sig_XPR_dB": f64}
  "LSP.gtype" = cluster{"LSP": T5, "LSP_mu_sig": T6, "PL_dB": f64, "mu_PL_dB": f64, "LSP_map_LOS": f64[][][], "LSP_map_NLOS": f64[][][], "n_r,grd": i32, "n_c,grd": i32}
  T7 = enum{"UMi - Street Canyon (LOS)", "UMi - Street Canyon (NLOS)"}
  "blk_inf_UT_B.gtype" = "blk_inf_cl_B.gtype"[]
  T8 = enum{"A - Generic", "B - Generic", "B - Gramercy Park"}
  T9 = cluster{"Blockage Grid Margin-X": i32, "Blockage Grid Margin-Y": i32, "Blockage Parameters (B)": "UP_blk_B.gtype"[], "t_total_blk (s)": f64, "t_stp_blk (s)": f64}
  T10 = cluster{"Class (NSB)": T1, "Velocity": f64, "Count (K)": i32, "Blocker Trajectories": "trj_blk_B.gtype"[]}
  T11 = cluster{"Blockage Grid Margin-X": i32, "Blockage Grid Margin-Y": i32, "t_max_grd": f64, "t_res_grd": f64, "Blockage Parameters (A)": T10[], "d_res_grd": f64}
  "UP_BS.gtype" = cluster{"X_BS (m)": f64, "Y_BS (m)": f64, "h_BS (m)": f64, "Omega_BS,alpha": f64, "Omega_BS,beta": f64, "Omega_BS,gamma": f64, "zeta_tx": f64, "M,tx": i32, "N,tx": i32, "M_g,tx": i32, "N_g,tx": i32, "s": i32, "BF Parameters": "UP_bf.gtype"}
  T12 = cluster{"t": f64[], "C": i32[][], "d_2D": f64[], "d_3D": f64[], "V": f64[][], "v": f64[], "v_avg": f64}
  T13 = cluster{"X_UT (m)": i32, "Y_UT (m)": i32, "h_UT (m)": i32, "v": f64, "phi_v": f64, "theta_v": f64, "t": f64, "Omega_UT,alpha": f64, "Omega_UT,beta": f64, "Omega_UT,gamma": f64, "zeta_rx": f64, "N,rx": i32, "M,rx": i32, "N_g,rx": i32, "M_g,rx": i32, "u": i32, "Introduce Blockages?": bool, "Self-blocking Mode": bool, "X_UT_end": i32, "Y_UT_end": i32, "h_UT_end": i32, "step_std_X": f64, "step_std_Y": f64, "step_std_Z": f64, "t_total (s)": f64, "t_step (s)": f64, "UT_loc_curr": i32[], "trj_UT": T12, "Blockage Model": T8, "BF Parameters": "UP_bf.gtype"}
  "UP_lnk.gtype" = cluster{"Scenario LOS-NLOS": T7, "d_2D (m)": f64, "d_3D (m)": f64, "f_C (Hz)": f64, "lambda_0": f64, "phi_LOS,AOA": f64, "phi_LOS,AOD": f64, "theta_LOS,ZOA": f64, "theta_LOS,ZOD": f64, "d_V_tx": f64, "d_H,tx": f64, "d_V_rx": f64, "d_H,rx": f64, "d_g,V,tx": f64, "d_g,H,tx": f64, "d_g,V,rx": f64, "d_g,H,rx": f64, "d_rx,u": f64[3], "d_tx,s": f64[3], "Align BS-UT?": bool, "Introduce Blockages in System?": bool, "UT Blockage Data (A)": T2[][][], "UT Blockage Data (B)": "blk_inf_UT_B.gtype", "Blockage Model": T8, "Blockage Settings (B)": T9, "Blockage Settings (A)": T11, "BS": "UP_BS.gtype", "UT": T13}
diagram:
  Property Node(instance in=$UP_lnk_in) -> ("UT:X_UT (m)"=w1, "BS:X_BS (m)"=w2, "UT:Y_UT (m)"=w3, "BS:Y_BS (m)"=w4, "Scenario LOS-NLOS"=w5, "theta_LOS,ZOD"=w6, "d_2D (m)"=w7, "UT:h_UT (m)"=w8, "BS:h_BS (m)"=w9, instance out=w10)
  call "conv_deg_to_rad.gvi"(angle (deg)=w6) -> (angle (rad)=w11)
  Property Node(instance in=w10, "theta_LOS,ZOD"=w11) -> (instance out=w12)
  $UP_lnk_out <- w12
  Property Node(instance in=$SSP_in) -> ("cl_sp_offset_ZOD_map_LOS"=w13, "cl_sp_offset_ZOD_map_NLOS"=w14, "cl_sp_sign_ZOD_map_LOS"=w15, "cl_sp_sign_ZOD_map_NLOS"=w16, "P_n"=w17, instance out=w18)
  Property Node(instance in=$LSP_in) -> ("LSP:K"=w19, "LSP:ZSD"=w20, instance out=w21)
  Subtract(x=w1, y=w2) -> w22
  Subtract(x=w3, y=w4) -> w23
  Is Equal To 0(x=w5) -> w24
  Select(s=w24, t=w15, f=w16) -> w25
  Array Index(array=w25) -> (out0[_, w23, w22]=w26)
  Select(s=w24, t=w13, f=w14) -> w27
  Array Index(array=w27) -> (out0[_, w23, w22]=w28)
  # NOTES:
  #
  # [1] max(P_n) is the first value due to the ascending order.
  # [2] eq. (7.5-16): theta_bar_ZOD=90 deg if O2I or =theta_LOS,ZOD; currently we have not implemented the O2I case, hence it is defaulted to theta_LOS,ZOD.
  case (w5) {
    frame "UMi - Street Canyon (LOS)", Default {
      Array Max And Min(array=w17) -> (max value=w32)
      Reciprocal(x=w32) -> w33
      Multiply(w17, w33) -> w34
      Natural Logarithm(x=w34) -> w35
      Negate(x=w35) -> w36
      w37 = 1.104  # C_theta_NLOS
      Multiply(w19, 0.0339) -> w38
      Power Of X(x=w19, y=2) -> w39
      Multiply(w39, -0.0077) -> w40
      Power Of X(x=w19, y=3) -> w41
      Multiply(w41, 0.0002) -> w42
      Add(1.3086, w38, w40, w42) -> w43
      # w44: C_theta
      Multiply(w43, w37) -> w44
      Reciprocal(x=w44) -> w45
      Multiply(w36, w20, w45) -> w46
      Array Size(array=w46) -> (size(s)=w47)
      Array Subset(array=w28, length0=w47) -> w48
      Divide(x=w20, y=7) -> w49
      Multiply(w48, w49) -> w50
      Array Subset(array=w26, length0=w47) -> w51
      # w46: theta'_n,ZOA
      Multiply(w51, 2) -> w52
      Decrement(x=w52) -> w53
      Multiply(w46, w53) -> w54
      Add(w54, w50, w6) -> w55
      # w55: theta_n,ZOA
      # w6: [2]
      Replace Array Subset(inArray=w55, index=0, new=w6) -> w29
      Multiply(-0.0148, w7) -> w56
      Subtract(x=w8, y=w9) -> w57
      Absolute Value(x=w57) -> w58
      Multiply(w58, 0.01) -> w59
      Add(0.83, w56, w59) -> w60
      # w30: mu_lgZSD
      Max And Min(x=w60, y=-0.21) -> (max(x,y)=w30: f64)
      w31 = $error_in
    }
    frame "UMi - Street Canyon (NLOS)" {
      Array Max And Min(array=w17) -> (max value=w61)
      Reciprocal(x=w61) -> w62
      Multiply(w17, w62) -> w63
      Natural Logarithm(x=w63) -> w64
      Negate(x=w64) -> w65
      w66 = 1.184  # C_theta_NLOS
      Reciprocal(x=w66) -> w67
      Multiply(w65, w20, w67) -> w68
      Array Size(array=w68) -> (size(s)=w69)
      Array Subset(array=w28, length0=w69) -> w70
      Divide(x=w20, y=7) -> w71
      Multiply(w70, w71) -> w72
      Max And Min(x=w7, y=10) -> (max(x,y)=w73: f64)
      Logarithm Base 10(x=w73) -> w74
      Multiply(-1.5, w74) -> w75
      Add(w75, 3.3) -> w76
      Power Of 10(x=w76) -> w77
      # w78: mu_offset,ZOD
      Negate(x=w77) -> w78
      Array Subset(array=w26, length0=w69) -> w79
      # w68: theta'_n,ZOD
      Multiply(w79, 2) -> w80
      Decrement(x=w80) -> w81
      Multiply(w68, w81) -> w82
      # w29: theta_n,ZOD
      Add(w82, w72, w6, w78) -> w29
      Multiply(-0.0031, w7) -> w83
      Subtract(x=w8, y=w9) -> w84
      Max And Min(x=w84, y=0) -> (max(x,y)=w85: f64)
      Multiply(w85, 0.01) -> w86
      Add(0.2, w83, w86) -> w87
      # w30: mu_lgZSD
      Max And Min(x=w87, y=-0.5) -> (max(x,y)=w30: f64)
      w31 = $error_in
    }
  }
  call "angle_mirr_zen_1D.gvi"(angle_in (deg)=w29, error_in=w31) -> (angle_out (deg)=w88, error_out=w89)
  call "conv_deg_to_rad_1D.gvi"(angle (deg)=w88) -> (angle (rad)=w90)
  Power Of 10(x=w30) -> w91
  w92 = [0.0447, -0.0447, 0.1413, -0.1413, 0.2492, -0.2492, 0.3715, -0.3715, 0.5129, -0.5129, 0.6797, -0.6797, 0.8844, -0.8844, 1.1481, -1.1481, 1.5195, -1.5195, 2.1551, -2.1551]
  Multiply(w92, 0.375, w91) -> w93
  for {
    w94 = each element of w29
    Add(w94, w93) -> w96
    append w96 to w95
  }
  call "angle_mirr_zen_2D.gvi"(angle_in (deg)=w95, error_in=w31) -> (angle_out (deg)=w97, error_out=w98)
  call "conv_deg_to_rad_2D.gvi"(angle (deg)=w97) -> (angle (rad)=w99)
  Property Node(instance in=w18, "theta_n_ZOD"=w90, "theta_n,m,ZOD"=w99) -> (instance out=w100)
  $SSP_out <- w100
  $LSP_out <- w21
  Merge Errors(w89, w98) -> (error out=w101)
  $error_out <- w101
