vi "gen_blk_A.gvi"   [LabVIEW Communications System Design Suite 2.0.1]
inputs:
  "UP_sys_in": "UP_sys.gtype"
  "error_in": error
  "SSP_in": "SSP.gtype"
outputs:
  "SSP_out": "SSP.gtype"
  "error_out": error
  "UP_sys_out": "UP_sys.gtype"
  "Trajectory (Zenith)": cluster{"Element 1": f64[], "Element 2": f64[]}[]
  "Trajectory (Azimuth)": cluster{"Element 1": f64[], "Element 2": f64[]}[]
types:
  T1 = enum{"Pedestrian", "Cyclist", "City Motorist", "Freeway Motorist", "Train"}
  T2 = cluster{"Class (NSB)": T1, "Velocity": f64, "Count (K)": f64, "Blocker Trajectories": "trj_blk_B.gtype"[]}
  T3 = cluster{"Blockage Grid Margin-X": i32, "Blockage Grid Margin-Y": i32, "t_max_grd": f64, "t_res_grd": f64, "Blockage Parameters (A)": T2[]}
  T4 = cluster{"X_BS (m)": i32, "Y_BS (m)": i32, "h_BS (m)": i32, "Omega_BS,alpha": f64, "Omega_BS,beta": f64, "Omega_BS,gamma": f64, "zeta_tx": f64, "M,tx": i32, "N,tx": i32, "M_g,tx": i32, "N_g,tx": i32, "s": i32}
  T5 = enum{"A - Generic", "B - Generic", "B - Gramercy Park"}
  T6 = cluster{"Blockage Grid Margin-X": i32, "Blockage Grid Margin-Y": i32, "Blockage Parameters (B)": "UP_blk_B.gtype"[], "t_total_blk (s)": f64, "t_stp_blk (s)": f64}
  T7 = cluster{"t": f64[], "C": i32[][], "d_2D": f64[], "d_3D": f64[], "V": f64[][], "v": f64[], "v_avg": f64}
  T8 = cluster{"X_UT (m)": i32, "Y_UT (m)": i32, "h_UT (m)": i32, "v": f64, "phi_v": f64, "theta_v": f64, "t": f64, "Omega_UT,alpha": f64, "Omega_UT,beta": f64, "Omega_UT,gamma": f64, "zeta_rx": f64, "N,rx": i32, "M,rx": i32, "N_g,rx": i32, "M_g,rx": i32, "u": i32, "Introduce Blockages?": bool, "Self-blocking Mode": bool, "X_UT_end": i32, "Y_UT_end": i32, "h_UT_end": i32, "step_std_X": f64, "step_std_Y": f64, "step_std_Z": f64, "t_total (s)": f64, "t_step (s)": f64, "UT_loc_curr": i32[], "trj_UT": T7, "Blockage Model": T5}
  "UP_UT.gtype" = T8[]
  "UP_sys.gtype" = cluster{"Scenario": enum{"UMi - Street Canyon"}, "f_C (Hz)": f64, "No. of UT": i32, "Align BS-UT?": bool, "Blockage Settings (A)": T3, "UP_BS": T4, "Introduce Blockages in System?": bool, "Blockage Model": T5, "Blockage Settings (B)": T6, "UP_UT": "UP_UT.gtype"}
  T9 = cluster{"Type": enum{"SB", "NSB"}, "Class (for NSB)": T1, "Location (X,Y,Z)": i32[], "Attenuation": f64, "Cl. No.": i32, "t": f64}
  T10 = cluster{"Blocker Info": T9[][], "No. of Blocked Cl. at time t": i32}
  T11 = cluster{"Cl. Attn. (ray aggr.)": f64, "No. of Blocked Rays": i32, "Ray Blocker Array": "blk_inf_ry_B.gtype"[], "Cl. No.": i32}
  "blk_inf_cl_B.gtype" = cluster{"Cluster Blocker Array": T11[], "No. of Blocked Cl. at time t": i32}
  "SSP.gtype" = cluster{"N": i32, "M": i32, "tau_n": f64[], "tau_n,i": f64[], "min(tau'_n)": f64, "P_n": f64[], "P_n,pre_blk": f64[], "P_n,m": f64[][], "phi_n_AOA": f64[], "phi_n,m,AOA": f64[][], "theta_n_ZOA": f64[], "theta_n,m,ZOA": f64[][], "phi_n_AOD": f64[], "phi_n,m,AOD": f64[][], "theta_n_ZOD": f64[], "theta_n,m,ZOD": f64[][], "phi_theta_n,m,cpl": f64[][][], "XPR": f64[][], "Phi_n,m,theta,theta": f64[][], "Phi_n,m,theta,phi": f64[][], "Phi_n,m,phi,theta": f64[][], "Phi_n,m,phi, phi": f64[][], "H_u,s,n,NLOS": c128[], "H_u,s,n,i,NLOS": c128[], "H_u,s,NLOS": c128, "H_u,s,1,LOS": c128, "H_u,s": c128, "H": c128[][], "H_u,s,n": c128[][][], "cl_sp_delay_map_LOS": f64[][][], "cl_sp_delay_map_NLOS": f64[][][], "cl_sp_shadowing_map_LOS": f64[][][], "cl_sp_shadowing_map_NLOS": f64[][][], "cl_sp_offset_AOD_map_LOS": f64[][][], "cl_sp_offset_AOD_map_NLOS": f64[][][], "cl_sp_offset_AOA_map_LOS": f64[][][], "cl_sp_offset_AOA_map_NLOS": f64[][][], "cl_sp_offset_ZOD_map_LOS": f64[][][], "cl_sp_offset_ZOD_map_NLOS": f64[][][], "cl_sp_offset_ZOA_map_LOS": f64[][][], "cl_sp_offset_ZOA_map_NLOS": f64[][][], "ray_XPR_map_LOS": f64[][][], "ray_XPR_map_NLOS": f64[][][], "ray_ini_phase_theta,phi_map_LOS": f64[][][], "ray_ini_phase_theta,theta_map_LOS": f64[][][], "pr_los_map": f64[][], "cl_sp_sign_AOD_map_LOS": i32[][][], "cl_sp_sign_AOD_map_NLOS": i32[][][], "cl_sp_sign_AOA_map_LOS": i32[][][], "cl_sp_sign_AOA_map_NLOS": i32[][][], "cl_sp_sign_ZOD_map_LOS": i32[][][], "cl_sp_sign_ZOD_map_NLOS": i32[][][], "cl_sp_sign_ZOA_map_LOS": i32[][][], "cl_sp_sign_ZOA_map_NLOS": i32[][][], "ray_ini_phase_phi,phi_map_LOS": f64[][][], "ray_ini_phase_phi,theta_map_LOS": f64[][][], "ray_ini_phase_theta,phi_map_NLOS": f64[][][], "ray_ini_phase_theta,theta_map_NLOS": f64[][][], "ray_ini_phase_phi,phi_map_NLOS": f64[][][], "ray_ini_phase_phi,theta_map_NLOS": f64[][][], "Xn_map": f64[][][], "H_sc": c128[][][], "tau_n_sc": f64[][], "P_n_sc": f64[][], "P_n_pre_blk_sc": f64[][], "blk_cnt_ang_map_LOS-NLOS": f64[][][], "Cluster Blockage Data (A)": T10, "Cluster Blockage Data (B)": "blk_inf_cl_B.gtype"}
uses:
  NI::Analysis::Generation::Ramp Pattern by Increment.gvi
  NI::Analysis::Probability::Riffle Array (I32).gvi
diagram:
  $SSP_out <- $SSP_in
  Property Node(instance in=$UP_sys_in) -> ("Blockage Settings (A):Blockage Parameters (A)"=w1, "UP_UT"=w2, "UP_BS:X_BS (m)"=w3, "UP_BS:Y_BS (m)"=w4, "No. of UT"=w5, "Blockage Settings (A):Blockage Grid Margin-X"=w6, "Blockage Settings (A):Blockage Grid Margin-Y"=w7, "Blockage Settings (A):t_max_grd"=w8, "Blockage Settings (A):t_res_grd"=w9, instance out=w10)
  # NOTES:
  #
  # [1] set z-crd of the center of the screen to h/2 i.e. blocker on the ground
  # [2] generate a random direction for the blocker in the X-Y plane (angle measured from the X-axis to the Y-axis)
  for {
    w11 = each element of w2
    Property Node(instance in=w11) -> ("X_UT (m)"=w16, "Y_UT (m)"=w17, "X_UT_end"=w18, "Y_UT_end"=w19)
    Subtract(x=w16, y=w3) -> w20
    Subtract(x=w18, y=w3) -> w21
    # [1]
    Build Array(w20, w21) -> w22
    # w23: max_trj_span_X
    Array Max And Min(array=w22) -> (max value=w23)
    Subtract(x=w17, y=w4) -> w24
    Subtract(x=w19, y=w4) -> w25
    Build Array(w24, w25) -> w26
    # w27: max_trj_span_Y
    Array Max And Min(array=w26) -> (max value=w27)
    concatenate w22 onto w12
    append w23 to w13
    append w27 to w14
    concatenate w26 onto w15
  }
  Array Max And Min(array=w12) -> (max value=w28, min value=w29)
  Subtract(x=w28, y=w29) -> w30
  Array Index(array=w13) -> (out0[0]=w31)
  Is Equal(x=1, y=w5) -> w32
  Select(s=w32, t=w31, f=w30) -> w33
  Add(w33, w6) -> w34
  Array Max And Min(array=w15) -> (max value=w35, min value=w36)
  Subtract(x=w35, y=w36) -> w37
  Array Index(array=w14) -> (out0[0]=w38)
  Select(s=w32, t=w38, f=w37) -> w39
  Add(w39, w7) -> w40
  for {
    w41 = each element of w1
    # blocker class loop
    Property Node(instance in=w41) -> ("Count (K)"=w45, "Velocity"=w46, instance out=w47)
    call "Ramp Pattern by Increment.gvi"(increment=1, end=w34, error in=$error_in) -> (ramp pattern=w48, error out=w49)
    To Long Integer(number=w48) -> w50
    call "Riffle Array (I32).gvi"(error in=w49, input array=w50) -> (error out=w51, riffled array=w52)
    call "Ramp Pattern by Increment.gvi"(increment=1, end=w40, error in=$error_in) -> (ramp pattern=w53, error out=w54)
    To Long Integer(number=w53) -> w55
    call "Riffle Array (I32).gvi"(error in=w54, input array=w55) -> (error out=w56, riffled array=w57)
    # w8: total trj time
    Merge Errors(w51, w56) -> (error out=w58)
    Array Subset(array=w52, length0=w45) -> w59
    Array Subset(array=w57, length0=w45) -> w60
    Multiply(w46, w8) -> w61
    for {
      w62 = each element of w60
      w63 = each element of w59
      Property Node(instance in=w47) -> ("Blocker Trajectories"=w67)
      Array Index(array=w67) -> (out0[_]=w68)
      # blocker loop
      # w69: trj_str
      Build Array(w63, w62, 0) -> w69
      # w61: total trj len
      Random Number() -> (number (0 to 1)=w70)
      Multiply(w70, PiTimes2) -> w71
      # w71: [2]
      Sine And Cosine(x=w71) -> (cos(x)=w72, sin(x)=w73)
      Multiply(w61, w73) -> w74
      Add(w62, w74) -> w75
      To Long Integer(number=w75) -> w76
      Multiply(w61, w72) -> w77
      Add(w63, w77) -> w78
      To Long Integer(number=w78) -> w79
      # w80: trj_end
      Build Array(w79, w76, 0) -> w80
      Random Number() -> (number (0 to 1)=w81)
      Multiply(w81, 0.2) -> w82
      Random Number() -> (number (0 to 1)=w83)
      Multiply(w83, 0.2) -> w84
      Random Number() -> (number (0 to 1)=w85)
      Multiply(w85, 0.002) -> w86
      call "gen_blk_trj_B.gvi"(error_in=w58, C_str=w69, C_end=w80, t_total (s)=w8, t_step (s)=w9, stp_std_X=w82, stp_std_Y=w84, stp_std_Z=w86) -> (error_out=w87, C=w88, t=w89, V=w90, v_inst=w91, v_avg=w92, Trajectory (Azimuth)=w93, Trajectory (Zenith)=w94)
      Property Node(instance in=w68, "C"=w88, "t"=w89, "V"=w90, "v_ins"=w91, "v_avg"=w92) -> (instance out=w95)
      append w95 to w64
      append w93 to w65
      append w94 to w66
    }
    Property Node(instance in=w47, "Blocker Trajectories"=w64) -> (instance out=w96)
    append w96 to w42
    concatenate w65 onto w43
    concatenate w66 onto w44
  }
  Property Node(instance in=w10, "Blockage Settings (A):Blockage Parameters (A)"=w42) -> (instance out=w97)
  $UP_sys_out <- w97
  $"Trajectory (Azimuth)" <- w43
  $"Trajectory (Zenith)" <- w44
  $error_out <- w87
