vi "gen_blk_B.gvi"   [LabVIEW Communications System Design Suite 2.0.1]
inputs:
  "UP_sys_in": "UP_sys.gtype"
  "error_in": error
  "SSP_in": "SSP.gtype"
outputs:
  "SSP_out": "SSP.gtype"
  "error_out": error
  "UP_sys_out": "UP_sys.gtype"
  "Trajectory (Zenith)": cluster{"Element 1": f64[], "Element 2": f64[]}[]
  "Trajectory (Azimuth)": cluster{"Element 1": f64[], "Element 2": f64[]}[]
types:
  T1 = enum{"Pedestrian", "Cyclist", "City Motorist", "Freeway Motorist", "Train"}
  T2 = cluster{"Class (NSB)": T1, "Velocity": f64, "Count (K)": i32, "Blocker Trajectories": "trj_blk_B.gtype"[]}
  T3 = cluster{"Blockage Grid Margin-X": i32, "Blockage Grid Margin-Y": i32, "t_max_grd": f64, "t_res_grd": f64, "Blockage Parameters (A)": T2[], "d_res_grd": f64}
  T4 = enum{"A - Generic", "B - Generic", "B - Gramercy Park"}
  T5 = cluster{"Blockage Grid Margin-X": i32, "Blockage Grid Margin-Y": i32, "Blockage Parameters (B)": "UP_blk_B.gtype"[], "t_total_blk (s)": f64, "t_stp_blk (s)": f64}
  T6 = cluster{"t": f64[], "C": i32[][], "d_2D": f64[], "d_3D": f64[], "V": f64[][], "v": f64[], "v_avg": f64}
  T7 = cluster{"X_UT (m)": i32, "Y_UT (m)": i32, "h_UT (m)": i32, "v": f64, "phi_v": f64, "theta_v": f64, "t": f64, "Omega_UT,alpha": f64, "Omega_UT,beta": f64, "Omega_UT,gamma": f64, "zeta_rx": f64, "N,rx": i32, "M,rx": i32, "N_g,rx": i32, "M_g,rx": i32, "u": i32, "Introduce Blockages?": bool, "Self-blocking Mode": bool, "X_UT_end": i32, "Y_UT_end": i32, "h_UT_end": i32, "step_std_X": f64, "step_std_Y": f64, "step_std_Z": f64, "t_total (s)": f64, "t_step (s)": f64, "UT_loc_curr": i32[], "trj_UT": T6, "Blockage Model": T4, "BF Parameters": "UP_bf.gtype"}
  "UP_UT.gtype" = T7[]
  "UP_BS.gtype" = cluster{"X_BS (m)": f64, "Y_BS (m)": f64, "h_BS (m)": f64, "Omega_BS,alpha": f64, "Omega_BS,beta": f64, "Omega_BS,gamma": f64, "zeta_tx": f64, "M,tx": i32, "N,tx": i32, "M_g,tx": i32, "N_g,tx": i32, "s": i32, "BF Parameters": "UP_bf.gtype"}
  "UP_sys.gtype" = cluster{"Scenario": enum{"UMi - Street Canyon"}, "f_C (Hz)": f64, "No. of UT": i32, "Align BS-UT?": bool, "Blockage Settings (A)": T3, "Introduce Blockages in System?": bool, "Blockage Model": T4, "Blockage Settings (B)": T5, "UP_UT": "UP_UT.gtype", "UP_BS": "UP_BS.gtype"}
  T8 = cluster{"Type": enum{"SB", "NSB"}, "Class (for NSB)": T1, "Location (X,Y,Z)": i32[], "Attenuation": f64, "Cl. No.": i32, "t": f64}
  T9 = cluster{"Blocker Info": T8[][], "No. of Blocked Cl. at time t": i32}
  T10 = cluster{"Cl. Attn. (ray aggr.)": f64, "No. of Blocked Rays": i32, "Ray Blocker Array": "blk_inf_ry_B.gtype"[], "Cl. No.": i32}
  "blk_inf_cl_B.gtype" = cluster{"Cluster Blocker Array": T10[], "No. of Blocked Cl. at time t": i32}
  "SSP.gtype" = cluster{"N": i32, "M": i32, "tau_n": f64[], "tau_n,i": f64[], "min(tau'_n)": f64, "P_n": f64[], "P_n,pre_blk": f64[], "P_n,m": f64[][], "phi_n_AOA": f64[], "phi_n,m,AOA": f64[][], "theta_n_ZOA": f64[], "theta_n,m,ZOA": f64[][], "phi_n_AOD": f64[], "phi_n,m,AOD": f64[][], "theta_n_ZOD": f64[], "theta_n,m,ZOD": f64[][], "phi_theta_n,m,cpl": f64[][][], "XPR": f64[][], "Phi_n,m,theta,theta": f64[][], "Phi_n,m,theta,phi": f64[][], "Phi_n,m,phi,theta": f64[][], "Phi_n,m,phi, phi": f64[][], "H_u,s,n,NLOS": c128[], "H_u,s,n,i,NLOS": c128[], "H_u,s,NLOS": c128, "H_u,s,1,LOS": c128, "H_u,s": c128, "H": c128[][], "H_u,s,n": c128[][][], "cl_sp_delay_map_LOS": f64[][][], "cl_sp_delay_map_NLOS": f64[][][], "cl_sp_shadowing_map_LOS": f64[][][], "cl_sp_shadowing_map_NLOS": f64[][][], "cl_sp_offset_AOD_map_LOS": f64[][][], "cl_sp_offset_AOD_map_NLOS": f64[][][], "cl_sp_offset_AOA_map_LOS": f64[][][], "cl_sp_offset_AOA_map_NLOS": f64[][][], "cl_sp_offset_ZOD_map_LOS": f64[][][], "cl_sp_offset_ZOD_map_NLOS": f64[][][], "cl_sp_offset_ZOA_map_LOS": f64[][][], "cl_sp_offset_ZOA_map_NLOS": f64[][][], "ray_XPR_map_LOS": f64[][][], "ray_XPR_map_NLOS": f64[][][], "ray_ini_phase_theta,phi_map_LOS": f64[][][], "ray_ini_phase_theta,theta_map_LOS": f64[][][], "pr_los_map": f64[][], "cl_sp_sign_AOD_map_LOS": i32[][][], "cl_sp_sign_AOD_map_NLOS": i32[][][], "cl_sp_sign_AOA_map_LOS": i32[][][], "cl_sp_sign_AOA_map_NLOS": i32[][][], "cl_sp_sign_ZOD_map_LOS": i32[][][], "cl_sp_sign_ZOD_map_NLOS": i32[][][], "cl_sp_sign_ZOA_map_LOS": i32[][][], "cl_sp_sign_ZOA_map_NLOS": i32[][][], "ray_ini_phase_phi,phi_map_LOS": f64[][][], "ray_ini_phase_phi,theta_map_LOS": f64[][][], "ray_ini_phase_theta,phi_map_NLOS": f64[][][], "ray_ini_phase_theta,theta_map_NLOS": f64[][][], "ray_ini_phase_phi,phi_map_NLOS": f64[][][], "ray_ini_phase_phi,theta_map_NLOS": f64[][][], "Xn_map": f64[][][], "H_sc": c128[][][], "tau_n_sc": f64[][], "P_n_sc": f64[][], "P_n_pre_blk_sc": f64[][], "blk_cnt_ang_map_LOS-NLOS": f64[][][], "Cluster Blockage Data (A)": T9, "Cluster Blockage Data (B)": "blk_inf_cl_B.gtype", "P_n,drv": f64[], "P_n,drv_sc": f64[][], "P_n,drv_pre_blk_sc": f64[][], "P_n,i": f64[]}
uses:
  NI::Analysis::Generation::Ramp Pattern by Increment.gvi
  NI::Analysis::Probability::Riffle Array (I32).gvi
diagram:
  $SSP_out <- $SSP_in
  Property Node(instance in=$UP_sys_in) -> ("Blockage Settings (B):Blockage Parameters (B)"=w1, "UP_UT"=w2, "UP_BS:X_BS (m)"=w3, "UP_BS:Y_BS (m)"=w4, "No. of UT"=w5, "Blockage Settings (B):Blockage Grid Margin-X"=w6, "Blockage Settings (B):Blockage Grid Margin-Y"=w7, instance out=w8)
  for {
    w9 = each element of w2
    Property Node(instance in=w9) -> ("X_UT (m)"=w16, "Y_UT (m)"=w17, "X_UT_end"=w18, "Y_UT_end"=w19, "t_total (s)"=w20, "t_step (s)"=w21)
    Subtract(x=w16, y=w3) -> w22
    Subtract(x=w18, y=w3) -> w23
    # [1]
    Build Array(w22, w23) -> w24
    # w25: max_trj_span_X
    Array Max And Min(array=w24) -> (max value=w25)
    Subtract(x=w17, y=w4) -> w26
    Subtract(x=w19, y=w4) -> w27
    Build Array(w26, w27) -> w28
    # w29: max_trj_span_Y
    Array Max And Min(array=w28) -> (max value=w29)
    concatenate w24 onto w10
    append w25 to w11
    append w29 to w12
    concatenate w28 onto w13
    append w20 to w14
    append w21 to w15
  }
  Array Max And Min(array=w14) -> (max value=w30)
  Array Max And Min(array=w15) -> (min value=w31)
  Property Node(instance in=w8, "Blockage Settings (B):t_total_blk (s)"=w30, "Blockage Settings (B):t_stp_blk (s)"=w31) -> (instance out=w32)
  # NOTES:
  #
  # [1] set z-crd of the center of the screen to h/2 i.e. blocker on the ground
  # [2] generate a random direction for the blocker in the X-Y plane (angle measured from the X-axis to the Y-axis)
  Array Max And Min(array=w10) -> (max value=w33, min value=w34)
  Subtract(x=w33, y=w34) -> w35
  Array Index(array=w11) -> (out0[0]=w36)
  Is Equal(x=1, y=w5) -> w37
  Select(s=w37, t=w36, f=w35) -> w38
  Add(w38, w6) -> w39
  Array Max And Min(array=w13) -> (max value=w40, min value=w41)
  Subtract(x=w40, y=w41) -> w42
  Array Index(array=w12) -> (out0[0]=w43)
  Select(s=w37, t=w43, f=w42) -> w44
  Add(w44, w7) -> w45
  for {
    w46 = each element of w1
    # blocker class loop
    Property Node(instance in=w46) -> ("Class"=w50, "Count (K)"=w51, "Velocity"=w52, instance out=w53)
    call "Ramp Pattern by Increment.gvi"(increment=1, end=w39, error in=$error_in) -> (ramp pattern=w54, error out=w55)
    To Long Integer(number=w54) -> w56
    call "Riffle Array (I32).gvi"(error in=w55, input array=w56) -> (error out=w57, riffled array=w58)
    call "Ramp Pattern by Increment.gvi"(increment=1, end=w45, error in=$error_in) -> (ramp pattern=w59, error out=w60)
    To Long Integer(number=w59) -> w61
    call "Riffle Array (I32).gvi"(error in=w60, input array=w61) -> (error out=w62, riffled array=w63)
    # w30: total trj time
    Merge Errors(w57, w62) -> (error out=w64)
    Array Subset(array=w58, length0=w51) -> w65
    Array Subset(array=w63, length0=w51) -> w66
    case (w50) {
      frame "Pedestrian", Default {
        w68 = 0.3  # w
        w69 = 1.7  # h
        w67 = w69
      }
      frame "Vehicle" {
        w70 = 4.8  # w
        w71 = 1.4  # h
        w67 = w71
      }
    }
    # w72: [1]
    Multiply(w67, 0.5) -> w72
    To Long Integer(number=w72) -> w73
    Initialize Array(element=w73, size=w51) -> w74
    Multiply(w52, w30) -> w75
    for {
      w76 = each element of w74
      w77 = each element of w66
      w78 = each element of w65
      Property Node(instance in=w53) -> ("Blocker Trajectories"=w82)
      Array Index(array=w82) -> (out0[_]=w83)
      # blocker loop
      # w84: trj_str
      Build Array(w78, w77, w76) -> w84
      # w75: total trj len
      Random Number() -> (number (0 to 1)=w85)
      Multiply(w85, PiTimes2) -> w86
      # w86: [2]
      Sine And Cosine(x=w86) -> (cos(x)=w87, sin(x)=w88)
      Multiply(w75, w88) -> w89
      Add(w77, w89) -> w90
      To Long Integer(number=w90) -> w91
      Multiply(w75, w87) -> w92
      Add(w78, w92) -> w93
      To Long Integer(number=w93) -> w94
      # w95: trj_end
      Build Array(w94, w91, w76) -> w95
      Random Number() -> (number (0 to 1)=w96)
      Multiply(w96, 0.2) -> w97
      Random Number() -> (number (0 to 1)=w98)
      Multiply(w98, 0.2) -> w99
      Random Number() -> (number (0 to 1)=w100)
      Multiply(w100, 0.002) -> w101
      call "gen_blk_trj_B.gvi"(error_in=w64, C_str=w84, C_end=w95, t_total (s)=w30, t_step (s)=w31, stp_std_X=w97, stp_std_Y=w99, stp_std_Z=w101) -> (error_out=w102, C=w103, t=w104, V=w105, v_inst=w106, v_avg=w107, Trajectory (Azimuth)=w108, Trajectory (Zenith)=w109)
      Property Node(instance in=w83, "C"=w103, "t"=w104, "V"=w105, "v_ins"=w106, "v_avg"=w107) -> (instance out=w110)
      append w110 to w79
      append w108 to w80
      append w109 to w81
    }
    Property Node(instance in=w53, "Blocker Trajectories"=w79) -> (instance out=w111)
    append w111 to w47
    concatenate w80 onto w48
    concatenate w81 onto w49
  }
  Property Node(instance in=w32, "Blockage Settings (B):Blockage Parameters (B)"=w47) -> (instance out=w112)
  $UP_sys_out <- w112
  $"Trajectory (Azimuth)" <- w48
  $"Trajectory (Zenith)" <- w49
  $error_out <- w102
