vi "gen_blk_B_Gramercy.gvi"   [LabVIEW Communications System Design Suite 2.0.1]
inputs:
  "UP_sys_in": "UP_sys.gtype"
  "SSP_in": "SSP.gtype"
  "error_in": error
outputs:
  "UP_sys_out": "UP_sys.gtype"
  "SSP_out": "SSP.gtype"
  "error out": error
panel controls:
  "E_20_St": "UP_str_prf.gtype" = {"l_str"=295, "w_sw_L"=2, "den_hmn_l_L (/m2)"=0.07, "v_hmn_L"=1.1, "w_hmn_L"=0.3, "h_hmn_L"=1.7, "personal_space_l_L (X)"=1, "personal_space_w_L (Y)"=0.6, "w_rd"=5.5, "den_veh (/m)"=0.05, "v_veh"=8, "w_veh"=4.8, "h_veh"=1.4, "l_veh"=5, "int_veh_spc"=1.5, "t_trj"=4, "t_stp"=0.2, "w_sw_R"=2, "den_hmn_l_R (/m2)"=0.01, "v_hmn_R"=1.1, "w_hmn_R"=0.3, "h_hmn_R"=1.7, "personal_space_l_R (X)"=1, "personal_space_w_R (Y)"=0.6, "alpha (deg)"=0, "X_shf"=0, "Y_shf"=0, "Z_shf"=0}
  "E_21_St": "UP_str_prf.gtype" = {"l_str"=295, "w_sw_L"=2, "den_hmn_l_L (/m2)"=0.07, "v_hmn_L"=1.1, "w_hmn_L"=0.3, "h_hmn_L"=1.7, "personal_space_l_L (X)"=1, "personal_space_w_L (Y)"=0.6, "w_rd"=5.5, "den_veh (/m)"=0.05, "v_veh"=8, "w_veh"=4.8, "h_veh"=1.4, "l_veh"=5, "int_veh_spc"=1.5, "t_trj"=3, "t_stp"=0.2, "w_sw_R"=2, "den_hmn_l_R (/m2)"=0.01, "v_hmn_R"=1.1, "w_hmn_R"=0.3, "h_hmn_R"=1.7, "personal_space_l_R (X)"=1, "personal_space_w_R (Y)"=0.6, "alpha (deg)"=0, "X_shf"=0, "Y_shf"=77.5, "Z_shf"=0}
  "E_22_St": "UP_str_prf.gtype" = {"l_str"=295, "w_sw_L"=2, "den_hmn_l_L (/m2)"=0.07, "v_hmn_L"=1.1, "w_hmn_L"=0.3, "h_hmn_L"=1.7, "personal_space_l_L (X)"=1, "personal_space_w_L (Y)"=0.6, "w_rd"=5.5, "den_veh (/m)"=0.05, "v_veh"=8, "w_veh"=4.8, "h_veh"=1.4, "l_veh"=5, "int_veh_spc"=1.5, "t_trj"=3, "t_stp"=0.2, "w_sw_R"=2, "den_hmn_l_R (/m2)"=0.01, "v_hmn_R"=1.1, "w_hmn_R"=0.3, "h_hmn_R"=1.4, "personal_space_l_R (X)"=1, "personal_space_w_R (Y)"=0.6, "alpha (deg)"=0, "X_shf"=0, "Y_shf"=161, "Z_shf"=0}
  "Park_Ave_S": "UP_str_prf.gtype" = {"l_str"=170.5, "w_sw_L"=2, "den_hmn_l_L (/m2)"=0.005, "v_hmn_L"=1.1, "w_hmn_L"=0.3, "h_hmn_L"=1.7, "personal_space_l_L (X)"=1, "personal_space_w_L (Y)"=0.6, "w_rd"=5.5, "den_veh (/m)"=0.05, "v_veh"=12, "w_veh"=4.8, "h_veh"=1.4, "l_veh"=5, "int_veh_spc"=1.5, "t_trj"=3, "t_stp"=0.2, "w_sw_R"=2, "den_hmn_l_R (/m2)"=0.01, "v_hmn_R"=1.1, "w_hmn_R"=0.3, "h_hmn_R"=1.7, "personal_space_l_R (X)"=1, "personal_space_w_R (Y)"=0.6, "alpha (deg)"=-90, "X_shf"=-9.5, "Y_shf"=0, "Z_shf"=0}
  "3rd_Ave": "UP_str_prf.gtype" = {"l_str"=170.5, "w_sw_L"=2, "den_hmn_l_L (/m2)"=0.0002, "v_hmn_L"=1.1, "w_hmn_L"=0.3, "h_hmn_L"=1.7, "personal_space_l_L (X)"=1, "personal_space_w_L (Y)"=0.6, "w_rd"=5.5, "den_veh (/m)"=0.05, "v_veh"=10, "w_veh"=4.8, "h_veh"=1.4, "l_veh"=5, "int_veh_spc"=1.5, "t_trj"=3, "t_stp"=0.2, "w_sw_R"=2, "den_hmn_l_R (/m2)"=0.01, "v_hmn_R"=1.1, "w_hmn_R"=0.3, "h_hmn_R"=1.7, "personal_space_l_R (X)"=1, "personal_space_w_R (Y)"=0.6, "alpha (deg)"=-270, "X_shf"=295, "Y_shf"=170.5, "Z_shf"=0}
  "Lex_Ave": "UP_str_prf.gtype" = {"l_str"=74, "w_sw_L"=2, "den_hmn_l_L (/m2)"=0.08, "v_hmn_L"=1.1, "w_hmn_L"=0.3, "h_hmn_L"=1.7, "personal_space_l_L (X)"=1, "personal_space_w_L (Y)"=0.6, "w_rd"=5.5, "den_veh (/m)"=0.05, "v_veh"=8, "w_veh"=4.8, "h_veh"=1.4, "l_veh"=5, "int_veh_spc"=1.5, "t_trj"=3, "t_stp"=0.2, "w_sw_R"=2, "den_hmn_l_R (/m2)"=0.01, "v_hmn_R"=1.1, "w_hmn_R"=0.3, "h_hmn_R"=1.7, "personal_space_l_R (X)"=1, "personal_space_w_R (Y)"=0.6, "alpha (deg)"=-270, "X_shf"=144.02, "Y_shf"=170.5, "Z_shf"=0}
  "Tab": i32 = 7
  "Gram_Prk_W": "UP_str_prf.gtype" = {"l_str"=68, "w_sw_L"=2, "den_hmn_l_L (/m2)"=0.07, "v_hmn_L"=1.1, "w_hmn_L"=0.3, "h_hmn_L"=1.7, "personal_space_l_L (X)"=1, "personal_space_w_L (Y)"=0.6, "w_rd"=5.5, "den_veh (/m)"=0.05, "v_veh"=6, "w_veh"=4.8, "h_veh"=1.4, "l_veh"=5, "int_veh_spc"=1.5, "t_trj"=3, "t_stp"=0.2, "w_sw_R"=2, "den_hmn_l_R (/m2)"=0.01, "v_hmn_R"=1.1, "w_hmn_R"=0.3, "h_hmn_R"=1.7, "personal_space_l_R (X)"=1, "personal_space_w_R (Y)"=0.6, "alpha (deg)"=-270, "X_shf"=70.8, "Y_shf"=77.5, "Z_shf"=0}
  "Gram_Prk_E": "UP_str_prf.gtype" = {"l_str"=68, "w_sw_L"=2, "den_hmn_l_L (/m2)"=0.03, "v_hmn_L"=1.1, "w_hmn_L"=0.3, "h_hmn_L"=1.7, "personal_space_l_L (X)"=1, "personal_space_w_L (Y)"=0.6, "w_rd"=5.5, "den_veh (/m)"=0.05, "v_veh"=6, "w_veh"=4.8, "h_veh"=1.4, "l_veh"=5, "int_veh_spc"=1.5, "t_trj"=3, "t_stp"=0.2, "w_sw_R"=2, "den_hmn_l_R (/m2)"=0.01, "v_hmn_R"=1.1, "w_hmn_R"=0.3, "h_hmn_R"=1.7, "personal_space_l_R (X)"=1, "personal_space_w_R (Y)"=0.6, "alpha (deg)"=-90, "X_shf"=217.24, "Y_shf"=9.5, "Z_shf"=0}
  "Park Profile Parameters": "UP_prk_prf.gtype" = {"l_prk"=136.94, "w_prk"=68, "t_trj"=3, "den_hmn_l (/m2)"=0.003, "v_hmn"=1.1, "t_stp"=0.2, "w_hmn"=0.3, "h_hmn"=1.7, "personal_space_l (X)"=1, "personal_space_w (Y)"=0.6, "alpha (deg)"=0, "X_shf"=80.3, "Y_shf"=9.5, "Z_shf"=0}
panel indicators:
  "Trajectory (Azimuth)": cluster{"Element 1": f64[], "Element 2": f64[]}
types:
  "UP_str_prf.gtype" = cluster{"l_str": f64, "w_sw_L": f64, "den_hmn_l_L (/m2)": f64, "v_hmn_L": f64, "w_hmn_L": f64, "h_hmn_L": f64, "personal_space_l_L (X)": f64, "personal_space_w_L (Y)": f64, "w_rd": f64, "den_veh (/m)": f64, "v_veh": f64, "w_veh": f64, "h_veh": f64, "l_veh": f64, "int_veh_spc": f64, "t_trj": f64, "t_stp": f64, "w_sw_R": f64, "den_hmn_l_R (/m2)": f64, "v_hmn_R": f64, "w_hmn_R": f64, "h_hmn_R": f64, "personal_space_l_R (X)": f64, "personal_space_w_R (Y)": f64, "alpha (deg)": f64, "X_shf": f64, "Y_shf": f64, "Z_shf": f64}
  "UP_prk_prf.gtype" = cluster{"l_prk": f64, "w_prk": f64, "t_trj": f64, "den_hmn_l (/m2)": f64, "v_hmn": f64, "t_stp": f64, "w_hmn": f64, "h_hmn": f64, "personal_space_l (X)": f64, "personal_space_w (Y)": f64, "alpha (deg)": f64, "X_shf": f64, "Y_shf": f64, "Z_shf": f64}
  T1 = enum{"Pedestrian", "Cyclist", "City Motorist", "Freeway Motorist", "Train"}
  T2 = cluster{"Type": enum{"SB", "NSB"}, "Class (for NSB)": T1, "Location (X,Y,Z)": i32[], "Attenuation": f64, "Cl. No.": i32, "t": f64}
  T3 = cluster{"Blocker Info": T2[][], "No. of Blocked Cl. at time t": i32}
  T4 = cluster{"Cl. Attn. (ray aggr.)": f64, "No. of Blocked Rays": i32, "Ray Blocker Array": "blk_inf_ry_B.gtype"[], "Cl. No.": i32}
  "blk_inf_cl_B.gtype" = cluster{"Cluster Blocker Array": T4[], "No. of Blocked Cl. at time t": i32}
  "SSP.gtype" = cluster{"N": i32, "M": i32, "tau_n": f64[], "tau_n,i": f64[], "min(tau'_n)": f64, "P_n": f64[], "P_n,pre_blk": f64[], "P_n,m": f64[][], "phi_n_AOA": f64[], "phi_n,m,AOA": f64[][], "theta_n_ZOA": f64[], "theta_n,m,ZOA": f64[][], "phi_n_AOD": f64[], "phi_n,m,AOD": f64[][], "theta_n_ZOD": f64[], "theta_n,m,ZOD": f64[][], "phi_theta_n,m,cpl": f64[][][], "XPR": f64[][], "Phi_n,m,theta,theta": f64[][], "Phi_n,m,theta,phi": f64[][], "Phi_n,m,phi,theta": f64[][], "Phi_n,m,phi, phi": f64[][], "H_u,s,n,NLOS": c128[], "H_u,s,n,i,NLOS": c128[], "H_u,s,NLOS": c128, "H_u,s,1,LOS": c128, "H_u,s": c128, "H": c128[][], "H_u,s,n": c128[][][], "cl_sp_delay_map_LOS": f64[][][], "cl_sp_delay_map_NLOS": f64[][][], "cl_sp_shadowing_map_LOS": f64[][][], "cl_sp_shadowing_map_NLOS": f64[][][], "cl_sp_offset_AOD_map_LOS": f64[][][], "cl_sp_offset_AOD_map_NLOS": f64[][][], "cl_sp_offset_AOA_map_LOS": f64[][][], "cl_sp_offset_AOA_map_NLOS": f64[][][], "cl_sp_offset_ZOD_map_LOS": f64[][][], "cl_sp_offset_ZOD_map_NLOS": f64[][][], "cl_sp_offset_ZOA_map_LOS": f64[][][], "cl_sp_offset_ZOA_map_NLOS": f64[][][], "ray_XPR_map_LOS": f64[][][], "ray_XPR_map_NLOS": f64[][][], "ray_ini_phase_theta,phi_map_LOS": f64[][][], "ray_ini_phase_theta,theta_map_LOS": f64[][][], "pr_los_map": f64[][], "cl_sp_sign_AOD_map_LOS": i32[][][], "cl_sp_sign_AOD_map_NLOS": i32[][][], "cl_sp_sign_AOA_map_LOS": i32[][][], "cl_sp_sign_AOA_map_NLOS": i32[][][], "cl_sp_sign_ZOD_map_LOS": i32[][][], "cl_sp_sign_ZOD_map_NLOS": i32[][][], "cl_sp_sign_ZOA_map_LOS": i32[][][], "cl_sp_sign_ZOA_map_NLOS": i32[][][], "ray_ini_phase_phi,phi_map_LOS": f64[][][], "ray_ini_phase_phi,theta_map_LOS": f64[][][], "ray_ini_phase_theta,phi_map_NLOS": f64[][][], "ray_ini_phase_theta,theta_map_NLOS": f64[][][], "ray_ini_phase_phi,phi_map_NLOS": f64[][][], "ray_ini_phase_phi,theta_map_NLOS": f64[][][], "Xn_map": f64[][][], "H_sc": c128[][][], "tau_n_sc": f64[][], "P_n_sc": f64[][], "P_n_pre_blk_sc": f64[][], "blk_cnt_ang_map_LOS-NLOS": f64[][][], "Cluster Blockage Data (A)": T3, "Cluster Blockage Data (B)": "blk_inf_cl_B.gtype", "P_n,drv": f64[], "P_n,drv_sc": f64[][]}
  T5 = cluster{"Class (NSB)": T1, "Velocity": f64, "Count (K)": i32, "Blocker Trajectories": "trj_blk_B.gtype"[]}
  T6 = cluster{"Blockage Grid Margin-X": i32, "Blockage Grid Margin-Y": i32, "t_max_grd": f64, "t_res_grd": f64, "Blockage Parameters (A)": T5[], "d_res_grd": f64}
  T7 = enum{"A - Generic", "B - Generic", "B - Gramercy Park"}
  T8 = cluster{"Blockage Grid Margin-X": i32, "Blockage Grid Margin-Y": i32, "Blockage Parameters (B)": "UP_blk_B.gtype"[], "t_total_blk (s)": f64, "t_stp_blk (s)": f64}
  T9 = cluster{"t": f64[], "C": i32[][], "d_2D": f64[], "d_3D": f64[], "V": f64[][], "v": f64[], "v_avg": f64}
  T10 = cluster{"X_UT (m)": i32, "Y_UT (m)": i32, "h_UT (m)": i32, "v": f64, "phi_v": f64, "theta_v": f64, "t": f64, "Omega_UT,alpha": f64, "Omega_UT,beta": f64, "Omega_UT,gamma": f64, "zeta_rx": f64, "N,rx": i32, "M,rx": i32, "N_g,rx": i32, "M_g,rx": i32, "u": i32, "Introduce Blockages?": bool, "Self-blocking Mode": bool, "X_UT_end": i32, "Y_UT_end": i32, "h_UT_end": i32, "step_std_X": f64, "step_std_Y": f64, "step_std_Z": f64, "t_total (s)": f64, "t_step (s)": f64, "UT_loc_curr": i32[], "trj_UT": T9, "Blockage Model": T7, "BF Parameters": "UP_bf.gtype"}
  "UP_UT.gtype" = T10[]
  "UP_BS.gtype" = cluster{"X_BS (m)": f64, "Y_BS (m)": f64, "h_BS (m)": f64, "Omega_BS,alpha": f64, "Omega_BS,beta": f64, "Omega_BS,gamma": f64, "zeta_tx": f64, "M,tx": i32, "N,tx": i32, "M_g,tx": i32, "N_g,tx": i32, "s": i32, "BF Parameters": "UP_bf.gtype"}
  "UP_sys.gtype" = cluster{"Scenario": enum{"UMi - Street Canyon"}, "f_C (Hz)": f64, "No. of UT": i32, "Align BS-UT?": bool, "Blockage Settings (A)": T6, "Introduce Blockages in System?": bool, "Blockage Model": T7, "Blockage Settings (B)": T8, "UP_UT": "UP_UT.gtype", "UP_BS": "UP_BS.gtype"}
diagram:
  $SSP_out <- $SSP_in
  Property Node(instance in=$UP_sys_in) -> ("UP_UT"=w1)
  for {
    w2 = each element of w1
    Property Node(instance in=w2) -> ("t_total (s)"=w5, "t_step (s)"=w6)
    append w5 to w3
    append w6 to w4
  }
  Array Max And Min(array=w3) -> (max value=w7)
  Array Max And Min(array=w4) -> (min value=w8)
  Property Node(instance in=$UP_sys_in, "Blockage Settings (B):t_total_blk (s)"=w7, "Blockage Settings (B):t_stp_blk (s)"=w8) -> (instance out=w9)
  Property Node(instance in=$E_20_St, "t_trj"=w7, "t_stp"=w8) -> (instance out=w10)
  call "gen_str_prf.gvi"(Street Profile Parameters=w10, error_in=$error_in) -> (UP_sys_out=w11, error_out=w12)
  Property Node(instance in=$E_21_St, "t_trj"=w7, "t_stp"=w8) -> (instance out=w13)
  call "gen_str_prf.gvi"(Street Profile Parameters=w13, error_in=$error_in) -> (UP_sys_out=w14, error_out=w15)
  Property Node(instance in=$E_22_St, "t_trj"=w7, "t_stp"=w8) -> (instance out=w16)
  call "gen_str_prf.gvi"(Street Profile Parameters=w16, error_in=$error_in) -> (UP_sys_out=w17, error_out=w18)
  Property Node(instance in=$Park_Ave_S, "t_trj"=w7, "t_stp"=w8) -> (instance out=w19)
  call "gen_str_prf.gvi"(Street Profile Parameters=w19, error_in=$error_in) -> (UP_sys_out=w20, error_out=w21)
  Property Node(instance in=$"3rd_Ave", "t_trj"=w7, "t_stp"=w8) -> (instance out=w22)
  call "gen_str_prf.gvi"(Street Profile Parameters=w22, error_in=$error_in) -> (UP_sys_out=w23, error_out=w24)
  Property Node(instance in=$Lex_Ave, "t_trj"=w7, "t_stp"=w8) -> (instance out=w25)
  call "gen_str_prf.gvi"(Street Profile Parameters=w25, error_in=$error_in) -> (UP_sys_out=w26, error_out=w27)
  Property Node(instance in=$Gram_Prk_W, "t_trj"=w7, "t_stp"=w8) -> (instance out=w28)
  call "gen_str_prf.gvi"(Street Profile Parameters=w28, error_in=$error_in) -> (UP_sys_out=w29, error_out=w30)
  Property Node(instance in=$Gram_Prk_E, "t_trj"=w7, "t_stp"=w8) -> (instance out=w31)
  call "gen_str_prf.gvi"(Street Profile Parameters=w31, error_in=$error_in) -> (UP_sys_out=w32, error_out=w33)
  Property Node(instance in=$"Park Profile Parameters", "t_trj"=w7, "t_stp"=w8) -> (instance out=w34)
  call "gen_prk_prf.gvi"(Park Profile Parameters=w34, error_in=$error_in) -> (UP_sys_out=w35, error_out=w36)
  Build Array(w11, w14, w17, w20, w23, w26, w29, w32, w35) -> w37
  for {
    w38 = each element of w37
    Property Node(instance in=w38) -> ("Blockage Settings (B):Blockage Parameters (B)"=w40)
    concatenate w40 onto w39
  }
  Property Node(instance in=w9, "Blockage Settings (B):Blockage Parameters (B)"=w39) -> (instance out=w41)
  $UP_sys_out <- w41
  for {
    w42 = each element of w39
    Property Node(instance in=w42) -> ("Blocker Trajectories"=w45)
    for {
      w46 = each element of w45
      Property Node(instance in=w46) -> ("C"=w49)
      for {
        w50 = each element of w49
        call "get_crd_3D.gvi"(A=w50) -> (A_x=w53, A_y=w54)
        append w53 to w51
        append w54 to w52
      }
      concatenate w51 onto w47
      concatenate w52 onto w48
    }
    concatenate w47 onto w43
    concatenate w48 onto w44
  }
  Build Cluster(w43, w44) -> w55
  $"Trajectory (Azimuth)" <- w55
  Merge Errors(w12, w15, w18, w21, w24, w27, w30, w33, w36) -> (error out=w56)
  $"error out" <- w56
