vi "gen_blk_trj_B.gvi"   [LabVIEW Communications System Design Suite 2.0.1]
inputs:
  "error_in": error
  "C_str": f64[3] = [10, 20, 2]
  "C_end": f64[3] = [15, 50, 2]
  "t_total (s)": f64 = 10
  "t_step (s)": f64 = 0.1
  "stp_std_X": f64 = 0.1
  "stp_std_Y": f64 = 0.1
  "stp_std_Z": f64 = 0.1
outputs:
  "error_out": error
  "C": f64[][]
  "t": f64[]
  "V": f64[][]
  "v_inst": f64[]
  "v_avg": f64
  "Trajectory (Azimuth)": cluster{"Element 1": f64[], "Element 2": f64[]}
  "Trajectory (Zenith)": cluster{"Element 1": f64[], "Element 2": f64[]}
uses:
  NI::Analysis::Generation::Gaussian White Noise.gvi
  NI::Analysis::Statistics::Measures of Mean.gvi
  NI::Analysis::Statistics::Statistics (1D DBL).gvi
diagram:
  # w1: n_step
  Divide(x=$"t_total (s)", y=$"t_step (s)") -> w1
  Decrement(x=w1) -> w2
  call "get_crd_3D.gvi"(A=$C_str) -> (A_x=w3, A_y=w4, A_z=w5)
  call "Gaussian White Noise.gvi"(samples=w2) -> (Gaussian white noise=w6)
  Multiply($stp_std_X, w6) -> w7
  call "Measures of Mean.gvi"(x=w7) -> (mean value=w8)
  Subtract(x=w7, y=w8) -> w9
  call "get_crd_3D.gvi"(A=$C_end) -> (A_x=w10, A_y=w11, A_z=w12)
  Subtract(x=w10, y=w3) -> w13
  # w13: X_span_UT
  Divide(x=w13, y=w2) -> w14
  Add(w9, w14) -> w15
  Sort 1D Array(array=w15) -> (sorted array=w16)
  s1 = w3  # shift register
  for {
    w17 = each element of w16
    Add(w17, s1) -> w19
    append w19 to w18
    next s1 = w19
  }
  # w20: X
  Build Array[ConcatenateInputs=True](w3, w18) -> w20
  for (N = w2) (iteration -> i1) {
    Increment(x=i1) -> w22
    Array Index(array=w20) -> (out0[w22]=w23)
    Array Index(array=w20) -> (out0[i1]=w24)
    Subtract(x=w23, y=w24) -> w25
    Divide(x=w25, y=$"t_step (s)") -> w26
    append w26 to w21
  }
  # w27: V_X
  Build Array[ConcatenateInputs=True](0, w21) -> w27
  call "Gaussian White Noise.gvi"(samples=w2) -> (Gaussian white noise=w28)
  Multiply($stp_std_Y, w28) -> w29
  call "Measures of Mean.gvi"(x=w29) -> (mean value=w30)
  Subtract(x=w29, y=w30) -> w31
  Subtract(x=w11, y=w4) -> w32
  # w32: Y_span_UT
  Divide(x=w32, y=w2) -> w33
  Add(w31, w33) -> w34
  Sort 1D Array(array=w34) -> (sorted array=w35)
  s2 = w4  # shift register
  for {
    w36 = each element of w35
    Add(w36, s2) -> w38
    append w38 to w37
    next s2 = w38
  }
  # w39: Y
  Build Array[ConcatenateInputs=True](w4, w37) -> w39
  for (N = w2) (iteration -> i2) {
    Increment(x=i2) -> w41
    Array Index(array=w39) -> (out0[w41]=w42)
    Array Index(array=w39) -> (out0[i2]=w43)
    Subtract(x=w42, y=w43) -> w44
    Divide(x=w44, y=$"t_step (s)") -> w45
    append w45 to w40
  }
  # w46: V_Y
  Build Array[ConcatenateInputs=True](0, w40) -> w46
  call "Gaussian White Noise.gvi"(samples=w2) -> (Gaussian white noise=w47)
  Multiply($stp_std_Z, w47) -> w48
  call "Measures of Mean.gvi"(x=w48) -> (mean value=w49)
  Subtract(x=w48, y=w49) -> w50
  Subtract(x=w12, y=w5) -> w51
  # w51: Z_span_UT
  Divide(x=w51, y=w2) -> w52
  Add(w50, w52) -> w53
  Sort 1D Array(array=w53) -> (sorted array=w54)
  # w5: [1]
  s3 = w5  # shift register
  for {
    w55 = each element of w54
    Add(w55, s3) -> w57
    append w57 to w56
    next s3 = w57
  }
  # w58: Z
  Build Array[ConcatenateInputs=True](w5, w56) -> w58
  for (N = w2) (iteration -> i3) {
    Increment(x=i3) -> w60
    Array Index(array=w58) -> (out0[w60]=w61)
    Array Index(array=w58) -> (out0[i3]=w62)
    Subtract(x=w61, y=w62) -> w63
    Divide(x=w63, y=$"t_step (s)") -> w64
    append w64 to w59
  }
  # w65: V_Z
  Build Array[ConcatenateInputs=True](0, w59) -> w65
  Build Array(w27, w46, w65) -> w66
  Transpose 2D Array(2D array=w66) -> (transposed array=w67)
  # w67: V
  $V <- w67
  s4 = 0  # shift register
  for (N = w2) {
    Add(s4, $"t_step (s)") -> w69
    append w69 to w68
    next s4 = w69
  }
  Build Array[ConcatenateInputs=True](0, w68) -> w70
  # w70: t
  $t <- w70
  Build Array(w20, w39, w58) -> w71
  Transpose 2D Array(2D array=w71) -> (transposed array=w72)
  $C <- w72
  Array Index(array=w72) -> (out0[_, 0]=w73)
  Array Index(array=w72) -> (out0[_, 1]=w74)
  Build Cluster(w73, w74) -> w75
  $"Trajectory (Azimuth)" <- w75
  # w72: C
  for {
    w76 = each element of w27
    w77 = each element of w46
    w78 = each element of w65
    Square(x=w76) -> w80
    Square(x=w77) -> w81
    Square(x=w78) -> w82
    Add(w80, w81, w82) -> w83
    Square Root(x=w83) -> w84
    append w84 to w79
  }
  $v_inst <- w79
  # w79: v
  call "Statistics (1D DBL).gvi"(signal=w79) -> (mean=w85)
  $v_avg <- w85
  Array Index(array=w72) -> (out0[_, 2]=w86)
  Build Cluster(w74, w86) -> w87
  $"Trajectory (Zenith)" <- w87
  # NOTES:
  #
  # -- C is the center of the blocker screen
  $error_out <- $error_in
