vi "gen_blockage_map.gvi"   [LabVIEW Communications System Design Suite 2.0.1]
inputs:
  "UP_sys_in": "UP_sys.gtype"
  "SSP_in": "SSP.gtype"
  "error_in": error
outputs:
  "error_out": error
  "SSP_out": "SSP.gtype"
types:
  T1 = enum{"Pedestrian", "Cyclist", "City Motorist", "Freeway Motorist", "Train"}
  T2 = cluster{"Class (NSB)": T1, "Velocity": f64, "Count (K)": i32, "Blocker Trajectories": "trj_blk_B.gtype"[]}
  T3 = cluster{"Blockage Grid Margin-X": i32, "Blockage Grid Margin-Y": i32, "t_max_grd": f64, "t_res_grd": f64, "Blockage Parameters (A)": T2[], "d_res_grd": f64}
  T4 = cluster{"X_BS (m)": i32, "Y_BS (m)": i32, "h_BS (m)": i32, "Omega_BS,alpha": f64, "Omega_BS,beta": f64, "Omega_BS,gamma": f64, "zeta_tx": f64, "M,tx": i32, "N,tx": i32, "M_g,tx": i32, "N_g,tx": i32, "s": i32}
  T5 = enum{"A - Generic", "B - Generic", "B - Gramercy Park"}
  T6 = cluster{"Blockage Grid Margin-X": i32, "Blockage Grid Margin-Y": i32, "Blockage Parameters (B)": "UP_blk_B.gtype"[], "t_total_blk (s)": f64, "t_stp_blk (s)": f64}
  T7 = cluster{"t": f64[], "C": i32[][], "d_2D": f64[], "d_3D": f64[], "V": f64[][], "v": f64[], "v_avg": f64}
  T8 = cluster{"X_UT (m)": i32, "Y_UT (m)": i32, "h_UT (m)": i32, "v": f64, "phi_v": f64, "theta_v": f64, "t": f64, "Omega_UT,alpha": f64, "Omega_UT,beta": f64, "Omega_UT,gamma": f64, "zeta_rx": f64, "N,rx": i32, "M,rx": i32, "N_g,rx": i32, "M_g,rx": i32, "u": i32, "Introduce Blockages?": bool, "Self-blocking Mode": bool, "X_UT_end": i32, "Y_UT_end": i32, "h_UT_end": i32, "step_std_X": f64, "step_std_Y": f64, "step_std_Z": f64, "t_total (s)": f64, "t_step (s)": f64, "UT_loc_curr": i32[], "trj_UT": T7, "Blockage Model": T5}
  "UP_UT.gtype" = T8[]
  "UP_sys.gtype" = cluster{"Scenario": enum{"UMi - Street Canyon"}, "f_C (Hz)": f64, "No. of UT": i32, "Align BS-UT?": bool, "Blockage Settings (A)": T3, "UP_BS": T4, "Introduce Blockages in System?": bool, "Blockage Model": T5, "Blockage Settings (B)": T6, "UP_UT": "UP_UT.gtype"}
  T9 = cluster{"Type": enum{"SB", "NSB"}, "Class (for NSB)": T1, "Location (X,Y,Z)": i32[], "Attenuation": f64, "Cl. No.": i32, "t": f64}
  T10 = cluster{"Blocker Info": T9[][], "No. of Blocked Cl. at time t": i32}
  T11 = cluster{"Cl. Attn. (ray aggr.)": f64, "No. of Blocked Rays": i32, "Ray Blocker Array": "blk_inf_ry_B.gtype"[], "Cl. No.": i32}
  "blk_inf_cl_B.gtype" = cluster{"Cluster Blocker Array": T11[], "No. of Blocked Cl. at time t": i32}
  "SSP.gtype" = cluster{"N": i32, "M": i32, "tau_n": f64[], "tau_n,i": f64[], "min(tau'_n)": f64, "P_n": f64[], "P_n,pre_blk": f64[], "P_n,m": f64[][], "phi_n_AOA": f64[], "phi_n,m,AOA": f64[][], "theta_n_ZOA": f64[], "theta_n,m,ZOA": f64[][], "phi_n_AOD": f64[], "phi_n,m,AOD": f64[][], "theta_n_ZOD": f64[], "theta_n,m,ZOD": f64[][], "phi_theta_n,m,cpl": f64[][][], "XPR": f64[][], "Phi_n,m,theta,theta": f64[][], "Phi_n,m,theta,phi": f64[][], "Phi_n,m,phi,theta": f64[][], "Phi_n,m,phi, phi": f64[][], "H_u,s,n,NLOS": c128[], "H_u,s,n,i,NLOS": c128[], "H_u,s,NLOS": c128, "H_u,s,1,LOS": c128, "H_u,s": c128, "H": c128[][], "H_u,s,n": c128[][][], "cl_sp_delay_map_LOS": f64[][][], "cl_sp_delay_map_NLOS": f64[][][], "cl_sp_shadowing_map_LOS": f64[][][], "cl_sp_shadowing_map_NLOS": f64[][][], "cl_sp_offset_AOD_map_LOS": f64[][][], "cl_sp_offset_AOD_map_NLOS": f64[][][], "cl_sp_offset_AOA_map_LOS": f64[][][], "cl_sp_offset_AOA_map_NLOS": f64[][][], "cl_sp_offset_ZOD_map_LOS": f64[][][], "cl_sp_offset_ZOD_map_NLOS": f64[][][], "cl_sp_offset_ZOA_map_LOS": f64[][][], "cl_sp_offset_ZOA_map_NLOS": f64[][][], "ray_XPR_map_LOS": f64[][][], "ray_XPR_map_NLOS": f64[][][], "ray_ini_phase_theta,phi_map_LOS": f64[][][], "ray_ini_phase_theta,theta_map_LOS": f64[][][], "pr_los_map": f64[][], "cl_sp_sign_AOD_map_LOS": i32[][][], "cl_sp_sign_AOD_map_NLOS": i32[][][], "cl_sp_sign_AOA_map_LOS": i32[][][], "cl_sp_sign_AOA_map_NLOS": i32[][][], "cl_sp_sign_ZOD_map_LOS": i32[][][], "cl_sp_sign_ZOD_map_NLOS": i32[][][], "cl_sp_sign_ZOA_map_LOS": i32[][][], "cl_sp_sign_ZOA_map_NLOS": i32[][][], "ray_ini_phase_phi,phi_map_LOS": f64[][][], "ray_ini_phase_phi,theta_map_LOS": f64[][][], "ray_ini_phase_theta,phi_map_NLOS": f64[][][], "ray_ini_phase_theta,theta_map_NLOS": f64[][][], "ray_ini_phase_phi,phi_map_NLOS": f64[][][], "ray_ini_phase_phi,theta_map_NLOS": f64[][][], "Xn_map": f64[][][], "H_sc": c128[][][], "tau_n_sc": f64[][], "P_n_sc": f64[][], "P_n_pre_blk_sc": f64[][], "blk_cnt_ang_map_LOS-NLOS": f64[][][], "Cluster Blockage Data (A)": T10, "Cluster Blockage Data (B)": "blk_inf_cl_B.gtype"}
uses:
  NI::Analysis::Generation::Uniform White Noise.gvi
  NI::Analysis::Operations::2D Convolution (DBL).gvi
  NI::Analysis::Statistics::Statistics (1D DBL).gvi
  NI::Analysis::SpecialFunc::Error Function.gvi
diagram:
  # NOTES:
  #
  # [1] shift the BS to the origin of the grid to be generated.
  # [2] kernel size has been set to the non-padded grid size.
  # [3] if only single UT, max-min diff. must be ignored.
  # [4] each page in the output 3D array corresponds to a blocker (all blockers from a class are filtered with the same kernel which is velocity dependent).
  # [5] largest distance in the area is chosen to generate grid, so that all possible UT-blocker distances are covered.
  # [6] d_corr=10 for both LOS and NLOS cases in the UMi-SC scenario.
  Property Node(instance in=$UP_sys_in) -> ("Blockage Settings (A):Blockage Parameters (A)"=w1, "UP_UT"=w2, "UP_BS:X_BS (m)"=w3, "UP_BS:Y_BS (m)"=w4, "No. of UT"=w5, "Blockage Settings (A):Blockage Grid Margin-X"=w6, "Blockage Settings (A):Blockage Grid Margin-Y"=w7, "Blockage Settings (A):t_max_grd"=w8, "Blockage Settings (A):t_res_grd"=w9, "Blockage Settings (A):d_res_grd"=w10)
  for {
    w11 = each element of w2
    Property Node(instance in=w11) -> ("X_UT (m)"=w16, "Y_UT (m)"=w17, "X_UT_end"=w18, "Y_UT_end"=w19)
    Subtract(x=w16, y=w3) -> w20
    Subtract(x=w18, y=w3) -> w21
    # w20: [1]
    Build Array(w20, w21) -> w22
    # w23: max_trj_span_X
    Array Max And Min(array=w22) -> (max value=w23)
    Subtract(x=w17, y=w4) -> w24
    Subtract(x=w19, y=w4) -> w25
    Build Array(w24, w25) -> w26
    # w27: max_trj_span_Y
    Array Max And Min(array=w26) -> (max value=w27)
    concatenate w22 onto w12
    append w23 to w13
    append w27 to w14
    concatenate w26 onto w15
  }
  Array Max And Min(array=w12) -> (max value=w28, min value=w29)
  Subtract(x=w28, y=w29) -> w30
  # [3]
  Array Index(array=w13) -> (out0[0]=w31)
  Is Equal(x=1, y=w5) -> w32
  Select(s=w32, t=w31, f=w30) -> w33
  # w34: X_span
  Add(w33, w6) -> w34
  Square(x=w34) -> w35
  Array Max And Min(array=w15) -> (max value=w36, min value=w37)
  Subtract(x=w36, y=w37) -> w38
  Array Index(array=w14) -> (out0[0]=w39)
  Select(s=w32, t=w39, f=w38) -> w40
  # w41: Y_span
  Add(w40, w7) -> w41
  Square(x=w41) -> w42
  Add(w35, w42) -> w43
  # w44: d_max [5]
  Square Root(x=w43) -> w44
  Round Toward Positive Infinity(x=w44) -> w45
  # w46: n_t
  Divide(x=w8, y=w9) -> w46
  Divide(x=w45, y=w10) -> w47
  w48 = 10  # d_corr
  # w47: n_d
  Multiply(w47, w46) -> w49
  # w50: LOS, NLOS
  # w48: [6]
  for {
    w51 = each element of w1
    Property Node(instance in=w51) -> ("Velocity"=w52, "Count (K)"=w53)
    # blocker class loop
    Divide(x=w48, y=w52) -> w54
    call "gen_temporal_spatial_ac_ker.gvi"(d_max=w45, d_corr=w48, t_max=w8, t_corr=w54, t_res=w9) -> (exp_kernel_norm_rms=w55)
    for (N = w53) {
      call "Uniform White Noise.gvi"(samples=w49, error in=$error_in) -> (uniform white noise=w57, error out=w58)
      # blocker loop
      Reshape Array(inArray=w57, size=w47, size=w46) -> w59
      call "2D Convolution (DBL).gvi"(X=w59, Y=w55, output size="size X", error in=w58) -> (X * Y=w60, error out=w61)
      call "vectorize_2d_array.gvi"(2D array=w60) -> (vector=w62)
      call "Statistics (1D DBL).gvi"(signal=w62) -> (mean=w63, standard deviation=w64)
      Subtract(x=w60, y=w63) -> w65
      Divide(x=w65, y=w64) -> w66
      append w66 to w56
    }
    concatenate w56 onto w50
  }
  # convert N(0,1) to U(0,1)
  for {
    w67 = each element of w50
    for {
      w69 = each element of w67
      for {
        w71 = each element of w69
        Divide(x=w71, y=1.41421356237) -> w73
        call "Error Function.gvi"(error in=w61, x=w73) -> (error out=w74, erf(x)=w75)
        Increment(x=w75) -> w76
        Multiply(w76, 0.5) -> w77
        append w77 to w72
      }
      append w72 to w70
    }
    append w70 to w68
  }
  Property Node(instance in=$SSP_in, "blk_cnt_ang_map_LOS-NLOS"=w68) -> (instance out=w78)
  $SSP_out <- w78
  $error_out <- w74
