vi "gen_blockers.gvi"   [LabVIEW Communications System Design Suite 2.0.1]
inputs:
  "UP_sys_in": "UP_sys.gtype"
  "SSP_in": "SSP.gtype"
  "error_in": error
outputs:
  "UP_sys_out": "UP_sys.gtype"
  "SSP_out": "SSP.gtype"
  "error_out": error
types:
  T1 = enum{"Pedestrian", "Cyclist", "City Motorist", "Freeway Motorist", "Train"}
  T2 = cluster{"Class": T1, "Velocity": f64, "Count (K)": i32, "Location (C)": i32[][]}
  T3 = cluster{"Blocker Parameters (A)": T2[], "Blockage Grid Margin-X": i32, "Blockage Grid Margin-Y": i32, "t_max_grd": f64, "t_res_grd": f64}
  T4 = cluster{"X_BS (m)": i32, "Y_BS (m)": i32, "h_BS (m)": i32, "Omega_BS,alpha": f64, "Omega_BS,beta": f64, "Omega_BS,gamma": f64, "zeta_tx": f64, "M,tx": i32, "N,tx": i32, "M_g,tx": i32, "N_g,tx": i32, "s": i32}
  T5 = cluster{"t": f64[], "C": i32[][], "d_2D": f64[], "d_3D": f64[], "V": f64[][], "v": f64[], "v_avg": f64}
  T6 = cluster{"X_UT (m)": i32, "Y_UT (m)": i32, "h_UT (m)": i32, "v": f64, "phi_v": f64, "theta_v": f64, "t": f64, "Omega_UT,alpha": f64, "Omega_UT,beta": f64, "Omega_UT,gamma": f64, "zeta_rx": f64, "N,rx": i32, "M,rx": i32, "N_g,rx": i32, "M_g,rx": i32, "u": i32, "Introduce Blockages?": bool, "Self-blocking Mode": bool, "X_UT_end": i32, "Y_UT_end": i32, "h_UT_end": i32, "step_std_X": f64, "step_std_Y": f64, "step_std_Z": f64, "t_total (s)": f64, "t_step (s)": f64, "UT_loc_curr": i32[], "Blockage Model": enum{"A", "B"}, "trj_UT": T5}
  T7 = cluster{"Blockage Grid Margin-X": i32, "Blockage Grid Margin-Y": i32, "Blockage Parameters (B)": "UP_blk_B.gtype"[]}
  "UP_sys.gtype" = cluster{"Scenario": enum{"UMi - Street Canyon"}, "f_C (Hz)": f64, "No. of UT": i32, "Align BS-UT?": bool, "Blockage Settings (A)": T3, "UP_BS": T4, "Introduce Blockages in System?": bool, "Blockage Model": enum{"A", "B"}, "UP_UT": T6[], "Blockage Settings (B)": T7}
  T8 = cluster{"Type": enum{"SB", "NSB"}, "Class (for NSB)": T1, "Location (X,Y,Z)": i32[], "Attenuation": f64, "Cl. No.": i32, "t": f64}
  T9 = cluster{"Blocker Info": T8[][], "No. of Blocked Cl. at time t": i32}
  "SSP.gtype" = cluster{"N": i32, "M": i32, "tau_n": f64[], "tau_n,i": f64[], "min(tau'_n)": f64, "P_n": f64[], "P_n,pre_blk": f64[], "P_n,m": f64[][], "phi_n_AOA": f64[], "phi_n,m,AOA": f64[][], "theta_n_ZOA": f64[], "theta_n,m,ZOA": f64[][], "phi_n_AOD": f64[], "phi_n,m,AOD": f64[][], "theta_n_ZOD": f64[], "theta_n,m,ZOD": f64[][], "phi_theta_n,m,cpl": f64[][][], "XPR": f64[][], "Phi_n,m,theta,theta": f64[][], "Phi_n,m,theta,phi": f64[][], "Phi_n,m,phi,theta": f64[][], "Phi_n,m,phi, phi": f64[][], "H_u,s,n,NLOS": c128[], "H_u,s,n,i,NLOS": c128[], "H_u,s,NLOS": c128, "H_u,s,1,LOS": c128, "H_u,s": c128, "H": c128[][], "H_u,s,n": c128[][][], "cl_sp_delay_map_LOS": f64[][][], "cl_sp_delay_map_NLOS": f64[][][], "cl_sp_shadowing_map_LOS": f64[][][], "cl_sp_shadowing_map_NLOS": f64[][][], "cl_sp_offset_AOD_map_LOS": f64[][][], "cl_sp_offset_AOD_map_NLOS": f64[][][], "cl_sp_offset_AOA_map_LOS": f64[][][], "cl_sp_offset_AOA_map_NLOS": f64[][][], "cl_sp_offset_ZOD_map_LOS": f64[][][], "cl_sp_offset_ZOD_map_NLOS": f64[][][], "cl_sp_offset_ZOA_map_LOS": f64[][][], "cl_sp_offset_ZOA_map_NLOS": f64[][][], "ray_XPR_map_LOS": f64[][][], "ray_XPR_map_NLOS": f64[][][], "ray_ini_phase_theta,phi_map_LOS": f64[][][], "ray_ini_phase_theta,theta_map_LOS": f64[][][], "pr_los_map": f64[][], "cl_sp_sign_AOD_map_LOS": i32[][][], "cl_sp_sign_AOD_map_NLOS": i32[][][], "cl_sp_sign_AOA_map_LOS": i32[][][], "cl_sp_sign_AOA_map_NLOS": i32[][][], "cl_sp_sign_ZOD_map_LOS": i32[][][], "cl_sp_sign_ZOD_map_NLOS": i32[][][], "cl_sp_sign_ZOA_map_LOS": i32[][][], "cl_sp_sign_ZOA_map_NLOS": i32[][][], "ray_ini_phase_phi,phi_map_LOS": f64[][][], "ray_ini_phase_phi,theta_map_LOS": f64[][][], "ray_ini_phase_theta,phi_map_NLOS": f64[][][], "ray_ini_phase_theta,theta_map_NLOS": f64[][][], "ray_ini_phase_phi,phi_map_NLOS": f64[][][], "ray_ini_phase_phi,theta_map_NLOS": f64[][][], "Xn_map": f64[][][], "H_sc": c128[][][], "tau_n_sc": f64[][], "P_n_sc": f64[][], "P_n_pre_blk_sc": f64[][], "blk_cnt_ang_map_LOS-NLOS": f64[][][], "Cluster Blockage Data (A)": T9}
uses:
  NI::Analysis::Generation::Ramp Pattern by Increment.gvi
  NI::Analysis::Probability::Riffle Array (I32).gvi
diagram:
  $SSP_out <- $SSP_in
  Property Node(instance in=$UP_sys_in) -> ("Blockage Settings (A):Blocker Parameters (A)"=w1, "UP_UT"=w2, "UP_BS:X_BS (m)"=w3, "UP_BS:Y_BS (m)"=w4, "No. of UT"=w5, "Blockage Settings (A):Blockage Grid Margin-X"=w6, "Blockage Settings (A):Blockage Grid Margin-Y"=w7, instance out=w8)
  for {
    w9 = each element of w2
    Property Node(instance in=w9) -> ("X_UT (m)"=w14, "Y_UT (m)"=w15, "X_UT_end"=w16, "Y_UT_end"=w17)
    Subtract(x=w14, y=w3) -> w18
    Subtract(x=w16, y=w3) -> w19
    # [1]
    Build Array(w18, w19) -> w20
    # w21: max_trj_span_X
    Array Max And Min(array=w20) -> (max value=w21)
    Subtract(x=w15, y=w4) -> w22
    Subtract(x=w17, y=w4) -> w23
    Build Array(w22, w23) -> w24
    # w25: max_trj_span_Y
    Array Max And Min(array=w24) -> (max value=w25)
    concatenate w20 onto w10
    append w21 to w11
    append w25 to w12
    concatenate w24 onto w13
  }
  Array Max And Min(array=w10) -> (max value=w26, min value=w27)
  Subtract(x=w26, y=w27) -> w28
  # [3]
  Array Index(array=w11) -> (out0[0]=w29)
  Is Equal(x=1, y=w5) -> w30
  Select(s=w30, t=w29, f=w28) -> w31
  Add(w31, w6) -> w32
  Array Max And Min(array=w13) -> (max value=w33, min value=w34)
  Subtract(x=w33, y=w34) -> w35
  Array Index(array=w12) -> (out0[0]=w36)
  Select(s=w30, t=w36, f=w35) -> w37
  Add(w37, w7) -> w38
  for {
    w39 = each element of w1
    # blocker class loop
    Property Node(instance in=w39) -> ("Count (K)"=w41, instance out=w42)
    call "Ramp Pattern by Increment.gvi"(increment=1, end=w32) -> (ramp pattern=w43)
    To Long Integer(number=w43) -> w44
    call "Riffle Array (I32).gvi"(input array=w44) -> (riffled array=w45)
    Array Subset(array=w45, length0=w41) -> w46
    call "Ramp Pattern by Increment.gvi"(increment=1, end=w38) -> (ramp pattern=w47)
    To Long Integer(number=w47) -> w48
    call "Riffle Array (I32).gvi"(input array=w48) -> (riffled array=w49)
    Array Subset(array=w49, length0=w41) -> w50
    Build Array(w46, w50, i32[] []) -> w51
    Transpose 2D Array(2D array=w51) -> (transposed array=w52)
    Property Node(instance in=w42, "Location (C)"=w52) -> (instance out=w53)
    append w53 to w40
  }
  Property Node(instance in=w8, "Blockage Settings (A):Blocker Parameters (A)"=w40) -> (instance out=w54)
  $UP_sys_out <- w54
  $error_out <- $error_in
