vi "gen_cl_sp_delay_map.gvi"   [LabVIEW Communications System Design Suite 2.0.1]
inputs:
  "UP_sys_in": "UP_sys.gtype"
  "SSP_in": "SSP.gtype"
  "error_in": error
outputs:
  "error_out": error
  "SSP_out": "SSP.gtype"
types:
  T1 = cluster{"X_BS (m)": i32, "Y_BS (m)": i32, "h_BS (m)": i32, "Omega_BS,alpha": f64, "Omega_BS,beta": f64, "Omega_BS,gamma": f64, "zeta_tx": f64, "M,tx": i32, "N,tx": i32, "M_g,tx": i32, "N_g,tx": i32, "s": i32}
  T2 = cluster{"X_UT (m)": f64, "Y_UT (m)": f64, "h_UT (m)": f64, "v": f64, "phi_v": f64, "theta_v": f64, "t": f64, "Omega_UT,alpha": f64, "Omega_UT,beta": f64, "Omega_UT,gamma": f64, "zeta_rx": f64, "N,rx": i32, "M,rx": i32, "N_g,rx": i32, "M_g,rx": i32, "u": i32, "Introduce Blockages?": bool, "Self-blocking Mode": bool, "X_UT_end": f64, "Y_UT_end": f64, "h_UT_end": f64, "step_std_X": f64, "step_std_Y": f64, "step_std_Z": f64, "t_total (s)": f64, "t_step (s)": f64, "trj": "trj.gtype"}
  T3 = enum{"Pedestrian", "Cyclist", "City Motorist", "Freeway Motorist", "Train"}
  "UP_blocker.gtype" = cluster{"Class": T3, "Velocity": f64, "Count (K)": f64, "Location (C)": f64[][]}
  "UP_sys.gtype" = cluster{"Scenario": enum{"UMi - Street Canyon"}, "f_C (Hz)": f64, "No. of UT": i32, "UP_BS": T1, "UP_UT": T2[], "Align BS-UT?": bool, "Blocker Data": "UP_blocker.gtype"[], "Blockage Grid Margin-X": f64, "Blockage Grid Margin-Y": f64}
  T4 = cluster{"Cl. No.": i32, "Attn. (dB)": f64, "SB": bool, "NSB": bool}
  "SSP.gtype" = cluster{"N": i32, "M": i32, "tau_n": f64[], "tau_n,i": f64[], "min(tau'_n)": f64, "P_n": f64[], "P_n,pre_blk": f64[], "P_n,m": f64[][], "phi_n_AOA": f64[], "phi_n,m,AOA": f64[][], "theta_n_ZOA": f64[], "theta_n,m,ZOA": f64[][], "phi_n_AOD": f64[], "phi_n,m,AOD": f64[][], "theta_n_ZOD": f64[], "theta_n,m,ZOD": f64[][], "phi_theta_n,m,cpl": f64[][][], "XPR": f64[][], "Phi_n,m,theta,theta": f64[][], "Phi_n,m,theta,phi": f64[][], "Phi_n,m,phi,theta": f64[][], "Phi_n,m,phi, phi": f64[][], "H_u,s,n,NLOS": c128[], "H_u,s,n,i,NLOS": c128[], "H_u,s,NLOS": c128, "H_u,s,1,LOS": c128, "H_u,s": c128, "H": c128[][], "H_u,s,n": c128[][][], "UT Blockage Status": T4[], "cl_sp_delay_map_LOS": f64[][][], "cl_sp_delay_map_NLOS": f64[][][], "cl_sp_shadowing_map_LOS": f64[][][], "cl_sp_shadowing_map_NLOS": f64[][][], "cl_sp_offset_AOD_map_LOS": f64[][][], "cl_sp_offset_AOD_map_NLOS": f64[][][], "cl_sp_offset_AOA_map_LOS": f64[][][], "cl_sp_offset_AOA_map_NLOS": f64[][][], "cl_sp_offset_ZOD_map_LOS": f64[][][], "cl_sp_offset_ZOD_map_NLOS": f64[][][], "cl_sp_offset_ZOA_map_LOS": f64[][][], "cl_sp_offset_ZOA_map_NLOS": f64[][][], "ray_XPR_map_LOS": f64[][][], "ray_XPR_map_NLOS": f64[][][], "ray_ini_phase_theta,phi_map_LOS": f64[][][], "ray_ini_phase_theta,theta_map_LOS": f64[][][], "pr_los_map": f64[][], "cl_sp_sign_AOD_map_LOS": i32[][][], "cl_sp_sign_AOD_map_NLOS": i32[][][], "cl_sp_sign_AOA_map_LOS": i32[][][], "cl_sp_sign_AOA_map_NLOS": i32[][][], "cl_sp_sign_ZOD_map_LOS": i32[][][], "cl_sp_sign_ZOD_map_NLOS": i32[][][], "cl_sp_sign_ZOA_map_LOS": i32[][][], "cl_sp_sign_ZOA_map_NLOS": i32[][][], "ray_ini_phase_phi,phi_map_LOS": f64[][][], "ray_ini_phase_phi,theta_map_LOS": f64[][][], "ray_ini_phase_theta,phi_map_NLOS": f64[][][], "ray_ini_phase_theta,theta_map_NLOS": f64[][][], "ray_ini_phase_phi,phi_map_NLOS": f64[][][], "ray_ini_phase_phi,theta_map_NLOS": f64[][][], "Xn_map": f64[][][], "H_sc": c128[][][], "tau_n_sc": f64[][], "P_n_sc": f64[][], "P_n_pre_blk_sc": f64[][], "blk_cnt_ang_map_LOS-NLOS": f64[][][]}
uses:
  NI::Analysis::SpecialFunc::Error Function.gvi
diagram:
  Property Node(instance in=$UP_sys_in) -> ("UP_UT"=w1, "UP_BS:X_BS (m)"=w2, "UP_BS:Y_BS (m)"=w3, "No. of UT"=w4)
  for {
    w5 = each element of w1
    Property Node(instance in=w5) -> ("X_UT (m)"=w8, "Y_UT (m)"=w9)
    # [1]
    Subtract(x=w8, y=w2) -> w10
    Subtract(x=w9, y=w3) -> w11
    append w10 to w6
    append w11 to w7
  }
  Array Max And Min(array=w6) -> (max value=w12, min value=w13)
  Subtract(x=w12, y=w13) -> w14
  # [3]
  Array Index(array=w6) -> (out0[0]=w15)
  Is Equal(x=1, y=w4) -> w16
  Select(s=w16, t=w15, f=w14) -> w17
  Array Max And Min(array=w7) -> (max value=w18, min value=w19)
  Subtract(x=w18, y=w19) -> w20
  Array Index(array=w7) -> (out0[0]=w21)
  Select(s=w16, t=w21, f=w20) -> w22
  # w23: LOS
  for (N = 12) {
    call "gen_wgn_grd.gvi"(X_span=w17, Y_span=w22) -> (grd=w24, n_r,grd=w25, n_c,grd=w26)
    call "spatial_filter.gvi"(white_grd=w24, n_r,ker=w25, delta_m=12, n_r,grd=w25, n_c,ker=w26, n_c,grd=w26) -> (fil_grd=w27)
    append w27 to w23
  }
  # convert N(0,1) to U(0,1)
  for {
    w28 = each element of w23
    for {
      w30 = each element of w28
      for {
        w32 = each element of w30
        Divide(x=w32, y=1.41421356237) -> w34
        call "Error Function.gvi"(error in=$error_in, x=w34) -> (error out=w35, erf(x)=w36)
        Increment(x=w36) -> w37
        Multiply(w37, 0.5) -> w38
        append w38 to w33
      }
      append w33 to w31
    }
    append w31 to w29
  }
  # w39: NLOS
  for (N = 19) {
    call "gen_wgn_grd.gvi"(X_span=w17, Y_span=w22) -> (grd=w40, n_r,grd=w41, n_c,grd=w42)
    call "spatial_filter.gvi"(white_grd=w40, n_r,ker=w41, delta_m=15, n_r,grd=w41, n_c,ker=w42, n_c,grd=w42) -> (fil_grd=w43)
    append w43 to w39
  }
  # NOTES:
  #
  # [1] shift the BS to the origin of the grid to be generated.
  # [2] kernel size has been set to the non-padded grid size.
  # [3] if only single UT, max-min diff. must be ignored.
  # [4] each page in the output 3D array is a spatially correlated grid which corresponds to a sample value that is used to generate a cluster delay,
  #       hence there are 12 pages for LOS and 19 for NLOS case.
  for {
    w44 = each element of w39
    for {
      w46 = each element of w44
      for {
        w48 = each element of w46
        Divide(x=w48, y=1.41421356237) -> w50
        call "Error Function.gvi"(error in=$error_in, x=w50) -> (error out=w51, erf(x)=w52)
        Increment(x=w52) -> w53
        Multiply(w53, 0.5) -> w54
        append w54 to w49
      }
      append w49 to w47
    }
    append w47 to w45
  }
  Property Node(instance in=$SSP_in, "cl_sp_delay_map_LOS"=w29, "cl_sp_delay_map_NLOS"=w45) -> (instance out=w55)
  $SSP_out <- w55
  Merge Errors(w35, w51) -> (error out=w56)
  $error_out <- w56
