vi "gen_cluster_delay.gvi"   [LabVIEW Communications System Design Suite 2.0.1]
inputs:
  "UP_lnk_in": "UP_lnk.gtype"
  "LSP_in": "LSP.gtype"
  "error_in": error
  "SSP_in": "SSP.gtype"
outputs:
  "SSP_out": "SSP.gtype"
  "LSP_out": "LSP.gtype"
  "UP_lnk_out": "UP_lnk.gtype"
  "error_out": error
types:
  T1 = cluster{"Cl. No.": i32, "Attn. (dB)": f64, "SB": bool, "NSB": bool}
  "SSP.gtype" = cluster{"N": i32, "M": i32, "tau_n": f64[], "tau_n,i": f64[], "P_n": f64[], "P_n,pre_blk": f64[], "P_n,m": f64[][], "phi_n_AOA": f64[], "phi_n,m,AOA": f64[][], "theta_n_ZOA": f64[], "theta_n,m,ZOA": f64[][], "phi_n_AOD": f64[], "phi_n,m,AOD": f64[][], "theta_n_ZOD": f64[], "theta_n,m,ZOD": f64[][], "phi_theta_n,m,cpl": f64[][][], "XPR": f64[][], "Phi_n,m,theta,theta": f64[][], "Phi_n,m,theta,phi": f64[][], "Phi_n,m,phi,theta": f64[][], "Phi_n,m,phi, phi": f64[][], "H_u,s,n,NLOS": c128[], "H_u,s,n,i,NLOS": c128[], "H_u,s,NLOS": c128, "H_u,s,1,LOS": c128, "H_u,s": c128, "H": c128[][], "H_u,s,n": c128[][][], "UT Blockage Status": T1[], "cl_sp_delay_map_LOS": f64[][][], "cl_sp_delay_map_NLOS": f64[][][], "cl_sp_shadowing_map_LOS": f64[][][], "cl_sp_shadowing_map_NLOS": f64[][][], "cl_sp_offset_AOD_map_LOS": f64[][][], "cl_sp_offset_AOD_map_NLOS": f64[][][], "cl_sp_offset_AOA_map_LOS": f64[][][], "cl_sp_offset_AOA_map_NLOS": f64[][][], "cl_sp_offset_ZOD_map_LOS": f64[][][], "cl_sp_offset_ZOD_map_NLOS": f64[][][], "cl_sp_offset_ZOA_map_LOS": f64[][][], "cl_sp_offset_ZOA_map_NLOS": f64[][][], "ray_XPR_map_LOS": f64[][][], "ray_XPR_map_NLOS": f64[][][], "ray_ini_phase_map_LOS": f64[][][], "ray_ini_phase_map_NLOS": f64[][][], "pr_los_map": f64[][], "min(tau'_n)": f64}
  T2 = cluster{"SF": f64, "K": f64, "DS": f64, "ASD": f64, "ASA": f64, "ZSD": f64, "ZSA": f64, "mu_XPR_dB": f64}
  T3 = cluster{"mu_SF_dB": f64, "sig_SF_dB": f64, "mu_K_dB": f64, "sig_K_dB": f64, "mu_lgDS": f64, "sig_lgDS": f64, "mu_lgASD": f64, "sig_lgASD": f64, "mu_lgASA": f64, "sig_lgASA": f64, "mu_lgZSD": f64, "sig_lgZSD": f64, "mu_lgZSA": f64, "sig_lgZSA": f64, "mu_XPR_dB": f64, "sig_XPR_dB": f64}
  "LSP.gtype" = cluster{"LSP": T2, "LSP_mu_sig": T3, "PL_dB": f64, "mu_PL_dB": f64, "LSP_map_LOS": f64[][][], "LSP_map_NLOS": f64[][][], "n_r,grd": i32, "n_c,grd": i32}
  T4 = enum{"UMi - Street Canyon (LOS)", "UMi - Street Canyon (NLOS)"}
  T5 = cluster{"X_BS (m)": f64, "Y_BS (m)": f64, "h_BS (m)": f64, "Omega_BS,alpha": f64, "Omega_BS,beta": f64, "Omega_BS,gamma": f64, "zeta_tx": f64, "M,tx": i32, "N,tx": i32, "M_g,tx": i32, "N_g,tx": i32, "s": i32}
  T6 = cluster{"h_UT (m)": f64, "v": f64, "phi_v": f64, "theta_v": f64, "t": f64, "Omega_UT,alpha": f64, "Omega_UT,beta": f64, "Omega_UT,gamma": f64, "zeta_rx": f64, "Y_UT (m)": f64, "X_UT (m)": f64, "N,rx": i32, "M,rx": i32, "N_g,rx": i32, "M_g,rx": i32, "u": i32, "Introduce Blockages?": bool, "Self-blocking Mode": bool, "X_UT_end": f64, "Y_UT_end": f64, "h_UT_end": f64, "step_std_X": f64, "step_std_Y": f64, "step_std_Z": f64, "t_total (s)": f64, "t_step (s)": f64}
  "UP_lnk.gtype" = cluster{"Scenario LOS-NLOS": T4, "d_2D (m)": f64, "d_3D (m)": f64, "f_C (Hz)": f64, "lambda_0": f64, "phi_LOS,AOA": f64, "phi_LOS,AOD": f64, "theta_LOS,ZOA": f64, "theta_LOS,ZOD": f64, "BS": T5, "d_V_tx": f64, "d_H,tx": f64, "d_V_rx": f64, "d_H,rx": f64, "d_g,V,tx": f64, "d_g,H,tx": f64, "d_g,V,rx": f64, "d_g,H,rx": f64, "d_rx,u": f64[3], "d_tx,s": f64[3], "UT": T6, "Align BS-UT?": bool}
uses:
  NI::Analysis::Generation::Uniform White Noise.gvi
diagram:
  Property Node(instance in=$UP_lnk_in) -> ("Scenario LOS-NLOS"=w1, instance out=w2)
  $UP_lnk_out <- w2
  Property Node(instance in=$LSP_in) -> ("LSP:DS"=w3, "LSP:K"=w4, instance out=w5)
  case (w1) {
    frame "UMi - Street Canyon (NLOS)" {
      w9 = 2.1  # r_tau
      Negate(x=w9) -> w10
      w11 = 19  # N
      # w12: U(-1,1)
      call "Uniform White Noise.gvi"(samples=w11, error in=$error_in) -> (uniform white noise=w12, error out=w7)
      Increment(x=w12) -> w13
      # w14: U(0,1)
      Multiply(w13, 0.5) -> w14
      Natural Logarithm(x=w14) -> w15
      Multiply(w15, w10, w3) -> w16
      Array Max And Min(array=w16) -> (min value=w8)
      # w16: tau'_n
      Subtract(x=w16, y=w8) -> w17
      # w6: tau_n
      Sort 1D Array(array=w17) -> (sorted array=w6)
    }
    frame "UMi - Street Canyon (LOS)", Default {
      Multiply(w4, -0.0433) -> w18
      Power Of X(x=w4, y=2) -> w19
      Multiply(w19, 0.0002) -> w20
      Power Of X(x=w4, y=3) -> w21
      Multiply(w21, 1.7e-05) -> w22
      Add(0.7705, w18, w20, w22) -> w23
      w24 = 3  # r_tau
      Negate(x=w24) -> w25
      w26 = 12  # N
      call "Uniform White Noise.gvi"(samples=w26, error in=$error_in) -> (uniform white noise=w27, error out=w7)
      # w27: U(-1,1)
      Increment(x=w27) -> w28
      # w29: U(0,1)
      Multiply(w28, 0.5) -> w29
      Natural Logarithm(x=w29) -> w30
      Multiply(w30, w25, w3) -> w31
      # w23: C_tau
      Array Max And Min(array=w31) -> (min value=w8)
      # w31: tau'_n
      Subtract(x=w31, y=w8) -> w32
      # w6: tau_LOS_n
      # w33: tau_n
      Sort 1D Array(array=w32) -> (sorted array=w33)
      Divide(x=w33, y=w23) -> w6
    }
  }
  Property Node(instance in=$SSP_in, "tau_n"=w6, "min(tau'_n)"=w8) -> (instance out=w34)
  $SSP_out <- w34
  $LSP_out <- w5
  $error_out <- w7
