vi "gen_cluster_delay_sc.gvi"   [LabVIEW Communications System Design Suite 2.0.1]
inputs:
  "UP_lnk_in": "UP_lnk.gtype"
  "LSP_in": "LSP.gtype"
  "error_in": error
  "SSP_in": "SSP.gtype"
outputs:
  "SSP_out": "SSP.gtype"
  "LSP_out": "LSP.gtype"
  "UP_lnk_out": "UP_lnk.gtype"
  "error_out": error
types:
  T1 = enum{"Pedestrian", "Cyclist", "City Motorist", "Freeway Motorist", "Train"}
  T2 = cluster{"Type": enum{"SB", "NSB"}, "Class (for NSB)": T1, "Location (X,Y,Z)": i32[], "Attenuation": f64, "Cl. No.": i32, "t": f64}
  T3 = cluster{"Blocker Info": T2[][], "No. of Blocked Cl. at time t": i32}
  T4 = cluster{"Cl. Attn. (ray aggr.)": f64, "No. of Blocked Rays": i32, "Ray Blocker Array": "blk_inf_ry_B.gtype"[], "Cl. No.": i32}
  "blk_inf_cl_B.gtype" = cluster{"Cluster Blocker Array": T4[], "No. of Blocked Cl. at time t": i32}
  "SSP.gtype" = cluster{"N": i32, "M": i32, "tau_n": f64[], "tau_n,i": f64[], "min(tau'_n)": f64, "P_n": f64[], "P_n,pre_blk": f64[], "P_n,m": f64[][], "phi_n_AOA": f64[], "phi_n,m,AOA": f64[][], "theta_n_ZOA": f64[], "theta_n,m,ZOA": f64[][], "phi_n_AOD": f64[], "phi_n,m,AOD": f64[][], "theta_n_ZOD": f64[], "theta_n,m,ZOD": f64[][], "phi_theta_n,m,cpl": f64[][][], "XPR": f64[][], "Phi_n,m,theta,theta": f64[][], "Phi_n,m,theta,phi": f64[][], "Phi_n,m,phi,theta": f64[][], "Phi_n,m,phi, phi": f64[][], "H_u,s,n,NLOS": c128[], "H_u,s,n,i,NLOS": c128[], "H_u,s,NLOS": c128, "H_u,s,1,LOS": c128, "H_u,s": c128, "H": c128[][], "H_u,s,n": c128[][][], "cl_sp_delay_map_LOS": f64[][][], "cl_sp_delay_map_NLOS": f64[][][], "cl_sp_shadowing_map_LOS": f64[][][], "cl_sp_shadowing_map_NLOS": f64[][][], "cl_sp_offset_AOD_map_LOS": f64[][][], "cl_sp_offset_AOD_map_NLOS": f64[][][], "cl_sp_offset_AOA_map_LOS": f64[][][], "cl_sp_offset_AOA_map_NLOS": f64[][][], "cl_sp_offset_ZOD_map_LOS": f64[][][], "cl_sp_offset_ZOD_map_NLOS": f64[][][], "cl_sp_offset_ZOA_map_LOS": f64[][][], "cl_sp_offset_ZOA_map_NLOS": f64[][][], "ray_XPR_map_LOS": f64[][][], "ray_XPR_map_NLOS": f64[][][], "ray_ini_phase_theta,phi_map_LOS": f64[][][], "ray_ini_phase_theta,theta_map_LOS": f64[][][], "pr_los_map": f64[][], "cl_sp_sign_AOD_map_LOS": i32[][][], "cl_sp_sign_AOD_map_NLOS": i32[][][], "cl_sp_sign_AOA_map_LOS": i32[][][], "cl_sp_sign_AOA_map_NLOS": i32[][][], "cl_sp_sign_ZOD_map_LOS": i32[][][], "cl_sp_sign_ZOD_map_NLOS": i32[][][], "cl_sp_sign_ZOA_map_LOS": i32[][][], "cl_sp_sign_ZOA_map_NLOS": i32[][][], "ray_ini_phase_phi,phi_map_LOS": f64[][][], "ray_ini_phase_phi,theta_map_LOS": f64[][][], "ray_ini_phase_theta,phi_map_NLOS": f64[][][], "ray_ini_phase_theta,theta_map_NLOS": f64[][][], "ray_ini_phase_phi,phi_map_NLOS": f64[][][], "ray_ini_phase_phi,theta_map_NLOS": f64[][][], "Xn_map": f64[][][], "H_sc": c128[][][], "tau_n_sc": f64[][], "P_n_sc": f64[][], "P_n_pre_blk_sc": f64[][], "blk_cnt_ang_map_LOS-NLOS": f64[][][], "Cluster Blockage Data (A)": T3, "Cluster Blockage Data (B)": "blk_inf_cl_B.gtype", "P_n,drv": f64[], "P_n,drv_sc": f64[][], "P_n,drv_pre_blk_sc": f64[][]}
  T5 = cluster{"SF": f64, "K": f64, "DS": f64, "ASD": f64, "ASA": f64, "ZSD": f64, "ZSA": f64, "mu_XPR_dB": f64}
  T6 = cluster{"mu_SF_dB": f64, "sig_SF_dB": f64, "mu_K_dB": f64, "sig_K_dB": f64, "mu_lgDS": f64, "sig_lgDS": f64, "mu_lgASD": f64, "sig_lgASD": f64, "mu_lgASA": f64, "sig_lgASA": f64, "mu_lgZSD": f64, "sig_lgZSD": f64, "mu_lgZSA": f64, "sig_lgZSA": f64, "mu_XPR_dB": f64, "sig_XPR_dB": f64}
  "LSP.gtype" = cluster{"LSP": T5, "LSP_mu_sig": T6, "PL_dB": f64, "mu_PL_dB": f64, "LSP_map_LOS": f64[][][], "LSP_map_NLOS": f64[][][], "n_r,grd": i32, "n_c,grd": i32}
  T7 = enum{"UMi - Street Canyon (LOS)", "UMi - Street Canyon (NLOS)"}
  "blk_inf_UT_B.gtype" = "blk_inf_cl_B.gtype"[]
  T8 = enum{"A - Generic", "B - Generic", "B - Gramercy Park"}
  T9 = cluster{"Blockage Grid Margin-X": i32, "Blockage Grid Margin-Y": i32, "Blockage Parameters (B)": "UP_blk_B.gtype"[], "t_total_blk (s)": f64, "t_stp_blk (s)": f64}
  T10 = cluster{"Class (NSB)": T1, "Velocity": f64, "Count (K)": i32, "Blocker Trajectories": "trj_blk_B.gtype"[]}
  T11 = cluster{"Blockage Grid Margin-X": i32, "Blockage Grid Margin-Y": i32, "t_max_grd": f64, "t_res_grd": f64, "Blockage Parameters (A)": T10[], "d_res_grd": f64}
  "UP_BS.gtype" = cluster{"X_BS (m)": f64, "Y_BS (m)": f64, "h_BS (m)": f64, "Omega_BS,alpha": f64, "Omega_BS,beta": f64, "Omega_BS,gamma": f64, "zeta_tx": f64, "M,tx": i32, "N,tx": i32, "M_g,tx": i32, "N_g,tx": i32, "s": i32, "BF Parameters": "UP_bf.gtype"}
  T12 = cluster{"t": f64[], "C": i32[][], "d_2D": f64[], "d_3D": f64[], "V": f64[][], "v": f64[], "v_avg": f64}
  T13 = cluster{"X_UT (m)": i32, "Y_UT (m)": i32, "h_UT (m)": i32, "v": f64, "phi_v": f64, "theta_v": f64, "t": f64, "Omega_UT,alpha": f64, "Omega_UT,beta": f64, "Omega_UT,gamma": f64, "zeta_rx": f64, "N,rx": i32, "M,rx": i32, "N_g,rx": i32, "M_g,rx": i32, "u": i32, "Introduce Blockages?": bool, "Self-blocking Mode": bool, "X_UT_end": i32, "Y_UT_end": i32, "h_UT_end": i32, "step_std_X": f64, "step_std_Y": f64, "step_std_Z": f64, "t_total (s)": f64, "t_step (s)": f64, "UT_loc_curr": i32[], "trj_UT": T12, "Blockage Model": T8, "BF Parameters": "UP_bf.gtype"}
  "UP_lnk.gtype" = cluster{"Scenario LOS-NLOS": T7, "d_2D (m)": f64, "d_3D (m)": f64, "f_C (Hz)": f64, "lambda_0": f64, "phi_LOS,AOA": f64, "phi_LOS,AOD": f64, "theta_LOS,ZOA": f64, "theta_LOS,ZOD": f64, "d_V_tx": f64, "d_H,tx": f64, "d_V_rx": f64, "d_H,rx": f64, "d_g,V,tx": f64, "d_g,H,tx": f64, "d_g,V,rx": f64, "d_g,H,rx": f64, "d_rx,u": f64[3], "d_tx,s": f64[3], "Align BS-UT?": bool, "Introduce Blockages in System?": bool, "UT Blockage Data (A)": T2[][][], "UT Blockage Data (B)": "blk_inf_UT_B.gtype", "Blockage Model": T8, "Blockage Settings (B)": T9, "Blockage Settings (A)": T11, "BS": "UP_BS.gtype", "UT": T13}
diagram:
  Property Node(instance in=$UP_lnk_in) -> ("UT:X_UT (m)"=w1, "BS:X_BS (m)"=w2, "UT:Y_UT (m)"=w3, "BS:Y_BS (m)"=w4, "Scenario LOS-NLOS"=w5, instance out=w6)
  $UP_lnk_out <- w6
  Property Node(instance in=$LSP_in) -> ("LSP:DS"=w7, "LSP:K"=w8, instance out=w9)
  Subtract(x=w1, y=w2) -> w10
  Subtract(x=w3, y=w4) -> w11
  Property Node(instance in=$SSP_in) -> ("cl_sp_delay_map_LOS"=w12, "cl_sp_delay_map_NLOS"=w13)
  Is Equal To 0(x=w5) -> w14
  Select(s=w14, t=w12, f=w13) -> w15
  Array Index(array=w15) -> (out0[_, w11, w10]=w16)
  case (w5) {
    frame "UMi - Street Canyon (NLOS)" {
      w20 = 2.1  # r_tau
      Negate(x=w20) -> w21
      # w16: U(0,1)
      Natural Logarithm(x=w16) -> w22
      Multiply(w22, w21, w7) -> w23
      Array Max And Min(array=w23) -> (min value=w19)
      # w23: tau'_n
      Subtract(x=w23, y=w19) -> w24
      # w17: tau_n
      Sort 1D Array(array=w24) -> (sorted array=w17)
      w18 = $error_in
    }
    frame "UMi - Street Canyon (LOS)", Default {
      Multiply(w8, -0.0433) -> w25
      Power Of X(x=w8, y=2) -> w26
      Multiply(w26, 0.0002) -> w27
      Power Of X(x=w8, y=3) -> w28
      Multiply(w28, 1.7e-05) -> w29
      Add(0.7705, w25, w27, w29) -> w30
      w31 = 3  # r_tau
      Negate(x=w31) -> w32
      # w16: U(0,1)
      Natural Logarithm(x=w16) -> w33
      Multiply(w33, w32, w7) -> w34
      # w30: C_tau
      Array Max And Min(array=w34) -> (min value=w19)
      # w34: tau'_n
      Subtract(x=w34, y=w19) -> w35
      # w17: tau_LOS_n
      # w36: tau_n
      Sort 1D Array(array=w35) -> (sorted array=w36)
      Divide(x=w36, y=w30) -> w17
      w18 = $error_in
    }
  }
  Property Node(instance in=$SSP_in, "tau_n"=w17, "min(tau'_n)"=w19) -> (instance out=w37)
  $SSP_out <- w37
  $LSP_out <- w9
  $error_out <- w18
