vi "gen_cluster_power.gvi"   [LabVIEW Communications System Design Suite 2.0.1]
inputs:
  "UP_lnk_in": "UP_lnk.gtype"
  "LSP_in": "LSP.gtype"
  "error_in": error
  "SSP_in": "SSP.gtype"
outputs:
  "SSP_out": "SSP.gtype"
  "UP_lnk_out": "UP_lnk.gtype"
  "LSP_out": "LSP.gtype"
  "error_out": error
panel indicators:
  "P_n_all": f64[]
types:
  T1 = cluster{"Cl. No.": i32, "Attn. (dB)": f64, "SB": bool, "NSB": bool}
  "SSP.gtype" = cluster{"N": i32, "M": i32, "tau_n": f64[], "tau_n,i": f64[], "P_n": f64[], "P_n,blk": f64[], "P_n,m": f64[][], "phi_n_AOA": f64[], "phi_n,m,AOA": f64[][], "theta_n_ZOA": f64[], "theta_n,m,ZOA": f64[][], "phi_n_AOD": f64[], "phi_n,m,AOD": f64[][], "theta_n_ZOD": f64[], "theta_n,m,ZOD": f64[][], "phi_theta_n,m,cpl": f64[][][], "XPR": f64[][], "Phi_n,m,theta,theta": f64[][], "Phi_n,m,theta,phi": f64[][], "Phi_n,m,phi,theta": f64[][], "Phi_n,m,phi, phi": f64[][], "H_u,s,n,NLOS": c128[], "H_u,s,n,i,NLOS": c128[], "H_u,s,NLOS": c128, "H_u,s,1,LOS": c128, "H_u,s": c128, "H": c128[][], "H_u,s,n": c128[][][], "UT Blockage Status": T1[], "cl_sp_delay_map_LOS": f64[][][], "cl_sp_delay_map_NLOS": f64[][][], "cl_sp_shadowing_map_LOS": f64[][][], "cl_sp_shadowing_map_NLOS": f64[][][], "cl_sp_offset_AOD_map_LOS": f64[][][], "cl_sp_offset_AOD_map_NLOS": f64[][][], "cl_sp_offset_AOA_map_LOS": f64[][][], "cl_sp_offset_AOA_map_NLOS": f64[][][], "cl_sp_offset_ZOD_map_LOS": f64[][][], "cl_sp_offset_ZOD_map_NLOS": f64[][][], "cl_sp_offset_ZOA_map_LOS": f64[][][], "cl_sp_offset_ZOA_map_NLOS": f64[][][], "ray_XPR_map_LOS": f64[][][], "ray_XPR_map_NLOS": f64[][][], "ray_ini_phase_map_LOS": f64[][][], "ray_ini_phase_map_NLOS": f64[][][], "pr_los_map": f64[][]}
  T2 = cluster{"SF": f64, "K": f64, "DS": f64, "ASD": f64, "ASA": f64, "ZSD": f64, "ZSA": f64, "mu_XPR_dB": f64}
  T3 = cluster{"mu_SF_dB": f64, "sig_SF_dB": f64, "mu_K_dB": f64, "sig_K_dB": f64, "mu_lgDS": f64, "sig_lgDS": f64, "mu_lgASD": f64, "sig_lgASD": f64, "mu_lgASA": f64, "sig_lgASA": f64, "mu_lgZSD": f64, "sig_lgZSD": f64, "mu_lgZSA": f64, "sig_lgZSA": f64, "mu_XPR_dB": f64, "sig_XPR_dB": f64}
  "LSP.gtype" = cluster{"LSP": T2, "LSP_mu_sig": T3, "PL_dB": f64, "mu_PL_dB": f64, "LSP_map_LOS": f64[][][], "LSP_map_NLOS": f64[][][], "n_r,grd": i32, "n_c,grd": i32}
  T4 = enum{"UMi - Street Canyon (LOS)", "UMi - Street Canyon (NLOS)"}
  T5 = cluster{"X_BS (m)": f64, "Y_BS (m)": f64, "h_BS (m)": f64, "Omega_BS,alpha": f64, "Omega_BS,beta": f64, "Omega_BS,gamma": f64, "zeta_tx": f64, "M,tx": i32, "N,tx": i32, "M_g,tx": i32, "N_g,tx": i32, "s": i32}
  T6 = cluster{"h_UT (m)": f64, "v": f64, "phi_v": f64, "theta_v": f64, "t": f64, "Omega_UT,alpha": f64, "Omega_UT,beta": f64, "Omega_UT,gamma": f64, "zeta_rx": f64, "Y_UT (m)": f64, "X_UT (m)": f64, "N,rx": i32, "M,rx": i32, "N_g,rx": i32, "M_g,rx": i32, "u": i32, "Introduce Blockages?": bool, "Self-blocking Mode": bool}
  "UP_lnk.gtype" = cluster{"Scenario LOS-NLOS": T4, "d_2D (m)": f64, "d_3D (m)": f64, "f_C (Hz)": f64, "lambda_0": f64, "phi_LOS,AOA": f64, "phi_LOS,AOD": f64, "theta_LOS,ZOA": f64, "theta_LOS,ZOD": f64, "BS": T5, "d_V_tx": f64, "d_H,tx": f64, "d_V_rx": f64, "d_H,rx": f64, "d_g,V,tx": f64, "d_g,H,tx": f64, "d_g,V,rx": f64, "d_g,H,rx": f64, "d_rx,u": f64[3], "d_tx,s": f64[3], "UT": T6, "Align BS-UT?": bool}
uses:
  NI::Analysis::Generation::Gaussian White Noise.gvi
diagram:
  Property Node(instance in=$SSP_in) -> ("tau_n"=w1)
  Property Node(instance in=$UP_lnk_in) -> ("Scenario LOS-NLOS"=w2, instance out=w3)
  Property Node(instance in=$LSP_in) -> ("LSP:DS"=w4, "LSP:K"=w5, instance out=w6)
  case (w2) {
    frame "UMi - Street Canyon (NLOS)" {
      Negate(x=w1) -> w10
      w11 = 2.1  # r_tau
      Decrement(x=w11) -> w12
      Multiply(w12, w4) -> w13
      Divide(x=w12, y=w13) -> w14
      Multiply(w10, w14) -> w15
      Exponential(x=w15) -> w16
      w17 = 19  # N
      call "Gaussian White Noise.gvi"(samples=w17, standard deviation=3, error in=$error_in) -> (Gaussian white noise=w18, error out=w9)
      Multiply(w18, -0.1) -> w19
      Power Of 10(x=w19) -> w20
      Multiply(w16, w20) -> w21
      # w21: P'_n
      Add Array Elements(numeric array=w21) -> (sum=w22)
      # w7: P_n
      Divide(x=w21, y=w22) -> w7
      w23 = 20  # M
      w8 = w23
    }
    frame "UMi - Street Canyon (LOS)", Default {
      Increment(x=w5) -> w24
      Reciprocal(x=w24) -> w25
      Multiply(w5, -0.0433) -> w26
      Power Of X(x=w5, y=2) -> w27
      Multiply(w27, 0.0002) -> w28
      Power Of X(x=w5, y=3) -> w29
      Multiply(w29, 1.7e-05) -> w30
      # w31: C_tau
      Add(0.7705, w26, w28, w30) -> w31
      Multiply(w31, w1) -> w32
      # scale by C_tau to retrieve tau_n_NLOS from previous cluster gen. VI, since tau_n_LOS should not be used to compute cluster powers.
      Negate(x=w32) -> w33
      w34 = 3  # r_tau
      Decrement(x=w34) -> w35
      Multiply(w35, w4) -> w36
      Divide(x=w35, y=w36) -> w37
      Multiply(w33, w37) -> w38
      Exponential(x=w38) -> w39
      w40 = 12  # N
      call "Gaussian White Noise.gvi"(samples=w40, standard deviation=3, error in=$error_in) -> (Gaussian white noise=w41, error out=w9)
      Multiply(w41, -0.1) -> w42
      Power Of 10(x=w42) -> w43
      Multiply(w39, w43) -> w44
      # w44: P'_n
      Add Array Elements(numeric array=w44) -> (sum=w45)
      # w46: P_n_NLOS
      Divide(x=w44, y=w45) -> w46
      Multiply(w46, w25) -> w47
      # w48: P_1,LOS
      Multiply(w5, w25) -> w48
      Array Index(array=w47) -> (out0[0]=w49)
      Add(w49, w48) -> w50
      Replace Array Subset(inArray=w47, index=0, new=w50) -> w7
      w51 = 20  # M
      w8 = w51
    }
  }
  Array Max And Min(array=w7) -> (max value=w52)
  Power Of 10(x=-2.5) -> w53
  Multiply(w52, w53) -> w54
  # w8: M
  s1 = f64[] []  # shift register
  for {
    w55 = each element of w7
    Is Greater Or Equal(x=w55, y=w54) -> w56
    case (w56) {
      frame False, Default {
        w57 = s1
      }
      frame True {
        Build Array[ConcatenateInputs=True](s1, w55) -> w57
      }
    }
    next s1 = w57
  }
  Array Size(array=s1) -> (size(s)=w58)
  # w58: N
  Initialize Array(element=0, size=w58, size=w8) -> w59
  Reciprocal(x=w8) -> w60
  s2 = w59  # shift register
  for (iteration -> i1) {
    w61 = each element of s1
    Multiply(w61, w60) -> w62
    Initialize Array(element=w62, size=w8) -> w63
    Replace Array Subset(inArray=s2, index=i1, index=_, new=w63) -> w64
    next s2 = w64
  }
  Property Node(instance in=$SSP_in, "N"=w58, "M"=w8, "P_n"=s1, "P_n,m"=s2) -> (instance out=w65)
  $SSP_out <- w65
  $UP_lnk_out <- w3
  # remove less than 25dB powers
  $P_n_all <- w7
  $LSP_out <- w6
  $error_out <- w9
