vi "gen_cluster_power_sc.gvi"   [LabVIEW Communications System Design Suite 2.0.1]
inputs:
  "UP_lnk_in": "UP_lnk.gtype"
  "LSP_in": "LSP.gtype"
  "error_in": error
  "SSP_in": "SSP.gtype"
outputs:
  "SSP_out": "SSP.gtype"
  "UP_lnk_out": "UP_lnk.gtype"
  "LSP_out": "LSP.gtype"
  "error_out": error
panel indicators:
  "tau_n": f64[]
  "Graph": cluster{"Element 1": f64[], "Element 2": f64[]}[]
  "P_n_all": f64[]
types:
  T1 = enum{"Pedestrian", "Cyclist", "City Motorist", "Freeway Motorist", "Train"}
  T2 = cluster{"Type": enum{"SB", "NSB"}, "Class (for NSB)": T1, "Location (X,Y,Z)": i32[], "Attenuation": f64, "Cl. No.": i32, "t": f64}
  T3 = cluster{"Blocker Info": T2[][], "No. of Blocked Cl. at time t": i32}
  T4 = cluster{"Cl. Attn. (ray aggr.)": f64, "No. of Blocked Rays": i32, "Ray Blocker Array": "blk_inf_ry_B.gtype"[], "Cl. No.": i32}
  "blk_inf_cl_B.gtype" = cluster{"Cluster Blocker Array": T4[], "No. of Blocked Cl. at time t": i32}
  "SSP.gtype" = cluster{"N": i32, "M": i32, "tau_n": f64[], "tau_n,i": f64[], "min(tau'_n)": f64, "P_n": f64[], "P_n,pre_blk": f64[], "P_n,m": f64[][], "phi_n_AOA": f64[], "phi_n,m,AOA": f64[][], "theta_n_ZOA": f64[], "theta_n,m,ZOA": f64[][], "phi_n_AOD": f64[], "phi_n,m,AOD": f64[][], "theta_n_ZOD": f64[], "theta_n,m,ZOD": f64[][], "phi_theta_n,m,cpl": f64[][][], "XPR": f64[][], "Phi_n,m,theta,theta": f64[][], "Phi_n,m,theta,phi": f64[][], "Phi_n,m,phi,theta": f64[][], "Phi_n,m,phi, phi": f64[][], "H_u,s,n,NLOS": c128[], "H_u,s,n,i,NLOS": c128[], "H_u,s,NLOS": c128, "H_u,s,1,LOS": c128, "H_u,s": c128, "H": c128[][], "H_u,s,n": c128[][][], "cl_sp_delay_map_LOS": f64[][][], "cl_sp_delay_map_NLOS": f64[][][], "cl_sp_shadowing_map_LOS": f64[][][], "cl_sp_shadowing_map_NLOS": f64[][][], "cl_sp_offset_AOD_map_LOS": f64[][][], "cl_sp_offset_AOD_map_NLOS": f64[][][], "cl_sp_offset_AOA_map_LOS": f64[][][], "cl_sp_offset_AOA_map_NLOS": f64[][][], "cl_sp_offset_ZOD_map_LOS": f64[][][], "cl_sp_offset_ZOD_map_NLOS": f64[][][], "cl_sp_offset_ZOA_map_LOS": f64[][][], "cl_sp_offset_ZOA_map_NLOS": f64[][][], "ray_XPR_map_LOS": f64[][][], "ray_XPR_map_NLOS": f64[][][], "ray_ini_phase_theta,phi_map_LOS": f64[][][], "ray_ini_phase_theta,theta_map_LOS": f64[][][], "pr_los_map": f64[][], "cl_sp_sign_AOD_map_LOS": i32[][][], "cl_sp_sign_AOD_map_NLOS": i32[][][], "cl_sp_sign_AOA_map_LOS": i32[][][], "cl_sp_sign_AOA_map_NLOS": i32[][][], "cl_sp_sign_ZOD_map_LOS": i32[][][], "cl_sp_sign_ZOD_map_NLOS": i32[][][], "cl_sp_sign_ZOA_map_LOS": i32[][][], "cl_sp_sign_ZOA_map_NLOS": i32[][][], "ray_ini_phase_phi,phi_map_LOS": f64[][][], "ray_ini_phase_phi,theta_map_LOS": f64[][][], "ray_ini_phase_theta,phi_map_NLOS": f64[][][], "ray_ini_phase_theta,theta_map_NLOS": f64[][][], "ray_ini_phase_phi,phi_map_NLOS": f64[][][], "ray_ini_phase_phi,theta_map_NLOS": f64[][][], "Xn_map": f64[][][], "H_sc": c128[][][], "tau_n_sc": f64[][], "P_n_sc": f64[][], "P_n_pre_blk_sc": f64[][], "blk_cnt_ang_map_LOS-NLOS": f64[][][], "Cluster Blockage Data (A)": T3, "Cluster Blockage Data (B)": "blk_inf_cl_B.gtype", "P_n,drv": f64[], "P_n,drv_sc": f64[][], "P_n,drv_pre_blk_sc": f64[][], "P_n,i": f64[]}
  T5 = cluster{"SF": f64, "K": f64, "DS": f64, "ASD": f64, "ASA": f64, "ZSD": f64, "ZSA": f64, "mu_XPR_dB": f64}
  T6 = cluster{"mu_SF_dB": f64, "sig_SF_dB": f64, "mu_K_dB": f64, "sig_K_dB": f64, "mu_lgDS": f64, "sig_lgDS": f64, "mu_lgASD": f64, "sig_lgASD": f64, "mu_lgASA": f64, "sig_lgASA": f64, "mu_lgZSD": f64, "sig_lgZSD": f64, "mu_lgZSA": f64, "sig_lgZSA": f64, "mu_XPR_dB": f64, "sig_XPR_dB": f64}
  "LSP.gtype" = cluster{"LSP": T5, "LSP_mu_sig": T6, "PL_dB": f64, "mu_PL_dB": f64, "LSP_map_LOS": f64[][][], "LSP_map_NLOS": f64[][][], "n_r,grd": i32, "n_c,grd": i32}
  T7 = enum{"UMi - Street Canyon (LOS)", "UMi - Street Canyon (NLOS)"}
  "blk_inf_UT_B.gtype" = "blk_inf_cl_B.gtype"[]
  T8 = enum{"A - Generic", "B - Generic", "B - Gramercy Park"}
  T9 = cluster{"Blockage Grid Margin-X": i32, "Blockage Grid Margin-Y": i32, "Blockage Parameters (B)": "UP_blk_B.gtype"[], "t_total_blk (s)": f64, "t_stp_blk (s)": f64}
  T10 = cluster{"Class (NSB)": T1, "Velocity": f64, "Count (K)": i32, "Blocker Trajectories": "trj_blk_B.gtype"[]}
  T11 = cluster{"Blockage Grid Margin-X": i32, "Blockage Grid Margin-Y": i32, "t_max_grd": f64, "t_res_grd": f64, "Blockage Parameters (A)": T10[], "d_res_grd": f64}
  "UP_BS.gtype" = cluster{"X_BS (m)": f64, "Y_BS (m)": f64, "h_BS (m)": f64, "Omega_BS,alpha": f64, "Omega_BS,beta": f64, "Omega_BS,gamma": f64, "zeta_tx": f64, "M,tx": i32, "N,tx": i32, "M_g,tx": i32, "N_g,tx": i32, "s": i32, "BF Parameters": "UP_bf.gtype"}
  T12 = cluster{"t": f64[], "C": i32[][], "d_2D": f64[], "d_3D": f64[], "V": f64[][], "v": f64[], "v_avg": f64}
  T13 = cluster{"X_UT (m)": i32, "Y_UT (m)": i32, "h_UT (m)": i32, "v": f64, "phi_v": f64, "theta_v": f64, "t": f64, "Omega_UT,alpha": f64, "Omega_UT,beta": f64, "Omega_UT,gamma": f64, "zeta_rx": f64, "N,rx": i32, "M,rx": i32, "N_g,rx": i32, "M_g,rx": i32, "u": i32, "Introduce Blockages?": bool, "Self-blocking Mode": bool, "X_UT_end": i32, "Y_UT_end": i32, "h_UT_end": i32, "step_std_X": f64, "step_std_Y": f64, "step_std_Z": f64, "t_total (s)": f64, "t_step (s)": f64, "UT_loc_curr": i32[], "trj_UT": T12, "Blockage Model": T8, "BF Parameters": "UP_bf.gtype"}
  "UP_lnk.gtype" = cluster{"Scenario LOS-NLOS": T7, "d_2D (m)": f64, "d_3D (m)": f64, "f_C (Hz)": f64, "lambda_0": f64, "phi_LOS,AOA": f64, "phi_LOS,AOD": f64, "theta_LOS,ZOA": f64, "theta_LOS,ZOD": f64, "d_V_tx": f64, "d_H,tx": f64, "d_V_rx": f64, "d_H,rx": f64, "d_g,V,tx": f64, "d_g,H,tx": f64, "d_g,V,rx": f64, "d_g,H,rx": f64, "d_rx,u": f64[3], "d_tx,s": f64[3], "Align BS-UT?": bool, "Introduce Blockages in System?": bool, "UT Blockage Data (A)": T2[][][], "UT Blockage Data (B)": "blk_inf_UT_B.gtype", "Blockage Model": T8, "Blockage Settings (B)": T9, "Blockage Settings (A)": T11, "BS": "UP_BS.gtype", "UT": T13}
diagram:
  Property Node(instance in=$LSP_in) -> ("LSP:DS"=w1, "LSP:K"=w2, instance out=w3)
  Property Node(instance in=$SSP_in) -> ("cl_sp_shadowing_map_LOS"=w4, "cl_sp_shadowing_map_NLOS"=w5, "tau_n"=w6)
  Property Node(instance in=$UP_lnk_in) -> ("UT:X_UT (m)"=w7, "BS:X_BS (m)"=w8, "UT:Y_UT (m)"=w9, "BS:Y_BS (m)"=w10, "Scenario LOS-NLOS"=w11, instance out=w12)
  Subtract(x=w7, y=w8) -> w13
  Subtract(x=w9, y=w10) -> w14
  Is Equal To 0(x=w11) -> w15
  Select(s=w15, t=w4, f=w5) -> w16
  Array Index(array=w16) -> (out0[_, w14, w13]=w17)
  case (w11) {
    frame "UMi - Street Canyon (NLOS)" {
      Negate(x=w6) -> w21
      w22 = 2.1  # r_tau
      Decrement(x=w22) -> w23
      Multiply(w23, w1) -> w24
      Divide(x=w23, y=w24) -> w25
      Multiply(w21, w25) -> w26
      Exponential(x=w26) -> w27
      # w17: N(0,1)
      Multiply(w17, 3) -> w28
      Multiply(w28, -0.1) -> w29
      Power Of 10(x=w29) -> w30
      Multiply(w27, w30) -> w31
      # w31: P'_n
      Add Array Elements(numeric array=w31) -> (sum=w32)
      # w18: P_n
      Divide(x=w31, y=w32) -> w18
      w33 = 20  # M
      w19 = w33
      w20 = $error_in
    }
    frame "UMi - Street Canyon (LOS)", Default {
      Increment(x=w2) -> w34
      Reciprocal(x=w34) -> w35
      Multiply(w2, -0.0433) -> w36
      Power Of X(x=w2, y=2) -> w37
      Multiply(w37, 0.0002) -> w38
      Power Of X(x=w2, y=3) -> w39
      Multiply(w39, 1.7e-05) -> w40
      # w41: C_tau
      Add(0.7705, w36, w38, w40) -> w41
      Multiply(w41, w6) -> w42
      # scale by C_tau to retrieve tau_n_NLOS from previous cluster gen. VI, since tau_n_LOS should not be used to compute cluster powers.
      Negate(x=w42) -> w43
      w44 = 3  # r_tau
      Decrement(x=w44) -> w45
      Multiply(w45, w1) -> w46
      Divide(x=w45, y=w46) -> w47
      Multiply(w43, w47) -> w48
      Exponential(x=w48) -> w49
      # w17: N(0,1)
      Multiply(w17, 3) -> w50
      Multiply(w50, -0.1) -> w51
      Power Of 10(x=w51) -> w52
      Multiply(w49, w52) -> w53
      # w53: P'_n
      Add Array Elements(numeric array=w53) -> (sum=w54)
      # w55: P_n_NLOS
      Divide(x=w53, y=w54) -> w55
      Multiply(w55, w35) -> w56
      # w57: P_1,LOS
      Multiply(w2, w35) -> w57
      Array Index(array=w56) -> (out0[0]=w58)
      Add(w58, w57) -> w59
      Replace Array Subset(inArray=w56, index=0, new=w59) -> w18
      w60 = 20  # M
      w19 = w60
      w20 = $error_in
    }
  }
  Multiply(1000000000, w6) -> w61
  Build Cluster(w61, w18) -> w62
  Sort 1D Array(array=w18) -> (sorted array=w63)
  Reverse 1D Array(array=w63) -> (reversed array=w64)
  Build Cluster(w61, w64) -> w65
  Build Array(w62, w65) -> w66
  $Graph <- w66
  $tau_n <- w61
  $UP_lnk_out <- w12
  Array Max And Min(array=w18) -> (max value=w67)
  Power Of 10(x=-2.5) -> w68
  Multiply(w67, w68) -> w69
  # w70: N (strong)
  s1 = f64[] []  # shift register
  for {
    w71 = each element of w18
    Is Greater Or Equal(x=w71, y=w69) -> w72
    case (w72) {
      frame False, Default {
        w73 = s1
      }
      frame True {
        Build Array[ConcatenateInputs=True](s1, w71) -> w73
      }
    }
    next s1 = w73
  }
  Array Size(array=s1) -> (size(s)=w70)
  Initialize Array(element=0, size=w70, size=w19) -> w74
  Reciprocal(x=w19) -> w75
  # w19: M
  s2 = w74  # shift register
  for (iteration -> i1) {
    w76 = each element of s1
    Multiply(w76, w75) -> w77
    Initialize Array(element=w77, size=w19) -> w78
    Replace Array Subset(inArray=s2, index=i1, index=_, new=w78) -> w79
    next s2 = w79
  }
  Property Node(instance in=$SSP_in, "N"=w70, "M"=w19, "P_n"=s1, "P_n,m"=s2) -> (instance out=w80)
  $SSP_out <- w80
  # remove less than 25dB powers
  $P_n_all <- w18
  $LSP_out <- w3
  $error_out <- w20
