vi "gen_coeff.gvi"   [LabVIEW Communications System Design Suite 2.0.1]
inputs:
  "UP_lnk_in": "UP_lnk.gtype"
  "LSP_in": "LSP.gtype"
  "SSP_in": "SSP.gtype"
  "error_in": error
outputs:
  "UP_lnk_out": "UP_lnk.gtype"
  "error out": error
  "SSP_out": "SSP.gtype"
  "LSP_out": "LSP.gtype"
types:
  T1 = cluster{"SF": f64, "K": f64, "DS": f64, "ASD": f64, "ASA": f64, "ZSD": f64, "ZSA": f64, "mu_XPR_dB": f64}
  T2 = cluster{"mu_SF_dB": f64, "sig_SF_dB": f64, "mu_K_dB": f64, "sig_K_dB": f64, "mu_lgDS": f64, "sig_lgDS": f64, "mu_lgASD": f64, "sig_lgASD": f64, "mu_lgASA": f64, "sig_lgASA": f64, "mu_lgZSD": f64, "sig_lgZSD": f64, "mu_lgZSA": f64, "sig_lgZSA": f64, "mu_XPR_dB": f64, "sig_XPR_dB": f64}
  "LSP.gtype" = cluster{"LSP": T1, "LSP_mu_sig": T2, "PL_dB": f64, "mu_PL_dB": f64, "LSP_map_LOS": f64[][][], "LSP_map_NLOS": f64[][][], "n_r,grd": i32, "n_c,grd": i32}
  T3 = enum{"Pedestrian", "Cyclist", "City Motorist", "Freeway Motorist", "Train"}
  T4 = cluster{"Type": enum{"SB", "NSB"}, "Class (for NSB)": T3, "Location (X,Y,Z)": i32[], "Attenuation": f64, "Cl. No.": i32, "t": f64}
  T5 = cluster{"Blocker Info": T4[][], "No. of Blocked Cl. at time t": i32}
  T6 = cluster{"Cl. Attn. (ray aggr.)": f64, "No. of Blocked Rays": i32, "Ray Blocker Array": "blk_inf_ry_B.gtype"[], "Cl. No.": i32}
  "blk_inf_cl_B.gtype" = cluster{"Cluster Blocker Array": T6[], "No. of Blocked Cl. at time t": i32}
  "SSP.gtype" = cluster{"N": i32, "M": i32, "tau_n": f64[], "tau_n,i": f64[], "min(tau'_n)": f64, "P_n": f64[], "P_n,pre_blk": f64[], "P_n,m": f64[][], "phi_n_AOA": f64[], "phi_n,m,AOA": f64[][], "theta_n_ZOA": f64[], "theta_n,m,ZOA": f64[][], "phi_n_AOD": f64[], "phi_n,m,AOD": f64[][], "theta_n_ZOD": f64[], "theta_n,m,ZOD": f64[][], "phi_theta_n,m,cpl": f64[][][], "XPR": f64[][], "Phi_n,m,theta,theta": f64[][], "Phi_n,m,theta,phi": f64[][], "Phi_n,m,phi,theta": f64[][], "Phi_n,m,phi, phi": f64[][], "H_u,s,n,NLOS": c128[], "H_u,s,n,i,NLOS": c128[], "H_u,s,NLOS": c128, "H_u,s,1,LOS": c128, "H_u,s": c128, "H": c128[][], "H_u,s,n": c128[][][], "cl_sp_delay_map_LOS": f64[][][], "cl_sp_delay_map_NLOS": f64[][][], "cl_sp_shadowing_map_LOS": f64[][][], "cl_sp_shadowing_map_NLOS": f64[][][], "cl_sp_offset_AOD_map_LOS": f64[][][], "cl_sp_offset_AOD_map_NLOS": f64[][][], "cl_sp_offset_AOA_map_LOS": f64[][][], "cl_sp_offset_AOA_map_NLOS": f64[][][], "cl_sp_offset_ZOD_map_LOS": f64[][][], "cl_sp_offset_ZOD_map_NLOS": f64[][][], "cl_sp_offset_ZOA_map_LOS": f64[][][], "cl_sp_offset_ZOA_map_NLOS": f64[][][], "ray_XPR_map_LOS": f64[][][], "ray_XPR_map_NLOS": f64[][][], "ray_ini_phase_theta,phi_map_LOS": f64[][][], "ray_ini_phase_theta,theta_map_LOS": f64[][][], "pr_los_map": f64[][], "cl_sp_sign_AOD_map_LOS": i32[][][], "cl_sp_sign_AOD_map_NLOS": i32[][][], "cl_sp_sign_AOA_map_LOS": i32[][][], "cl_sp_sign_AOA_map_NLOS": i32[][][], "cl_sp_sign_ZOD_map_LOS": i32[][][], "cl_sp_sign_ZOD_map_NLOS": i32[][][], "cl_sp_sign_ZOA_map_LOS": i32[][][], "cl_sp_sign_ZOA_map_NLOS": i32[][][], "ray_ini_phase_phi,phi_map_LOS": f64[][][], "ray_ini_phase_phi,theta_map_LOS": f64[][][], "ray_ini_phase_theta,phi_map_NLOS": f64[][][], "ray_ini_phase_theta,theta_map_NLOS": f64[][][], "ray_ini_phase_phi,phi_map_NLOS": f64[][][], "ray_ini_phase_phi,theta_map_NLOS": f64[][][], "Xn_map": f64[][][], "H_sc": c128[][][], "tau_n_sc": f64[][], "P_n_sc": f64[][], "P_n_pre_blk_sc": f64[][], "blk_cnt_ang_map_LOS-NLOS": f64[][][], "Cluster Blockage Data (A)": T5, "Cluster Blockage Data (B)": "blk_inf_cl_B.gtype"}
  T7 = enum{"UMi - Street Canyon (LOS)", "UMi - Street Canyon (NLOS)"}
  "blk_inf_UT_B.gtype" = "blk_inf_cl_B.gtype"[]
  T8 = enum{"A - Generic", "B - Generic", "B - Gramercy Park"}
  T9 = cluster{"Blockage Grid Margin-X": i32, "Blockage Grid Margin-Y": i32, "Blockage Parameters (B)": "UP_blk_B.gtype"[], "t_total_blk (s)": f64, "t_stp_blk (s)": f64}
  T10 = cluster{"Class (NSB)": T3, "Velocity": f64, "Count (K)": i32, "Blocker Trajectories": "trj_blk_B.gtype"[]}
  T11 = cluster{"Blockage Grid Margin-X": i32, "Blockage Grid Margin-Y": i32, "t_max_grd": f64, "t_res_grd": f64, "Blockage Parameters (A)": T10[], "d_res_grd": f64}
  "UP_BS.gtype" = cluster{"X_BS (m)": f64, "Y_BS (m)": f64, "h_BS (m)": f64, "Omega_BS,alpha": f64, "Omega_BS,beta": f64, "Omega_BS,gamma": f64, "zeta_tx": f64, "M,tx": i32, "N,tx": i32, "M_g,tx": i32, "N_g,tx": i32, "s": i32, "BF Parameters": "UP_bf.gtype"}
  T12 = cluster{"t": f64[], "C": i32[][], "d_2D": f64[], "d_3D": f64[], "V": f64[][], "v": f64[], "v_avg": f64}
  T13 = cluster{"X_UT (m)": i32, "Y_UT (m)": i32, "h_UT (m)": i32, "v": f64, "phi_v": f64, "theta_v": f64, "t": f64, "Omega_UT,alpha": f64, "Omega_UT,beta": f64, "Omega_UT,gamma": f64, "zeta_rx": f64, "N,rx": i32, "M,rx": i32, "N_g,rx": i32, "M_g,rx": i32, "u": i32, "Introduce Blockages?": bool, "Self-blocking Mode": bool, "X_UT_end": i32, "Y_UT_end": i32, "h_UT_end": i32, "step_std_X": f64, "step_std_Y": f64, "step_std_Z": f64, "t_total (s)": f64, "t_step (s)": f64, "UT_loc_curr": i32[], "trj_UT": T12, "Blockage Model": T8, "BF Parameters": "UP_bf.gtype"}
  "UP_lnk.gtype" = cluster{"Scenario LOS-NLOS": T7, "d_2D (m)": f64, "d_3D (m)": f64, "f_C (Hz)": f64, "lambda_0": f64, "phi_LOS,AOA": f64, "phi_LOS,AOD": f64, "theta_LOS,ZOA": f64, "theta_LOS,ZOD": f64, "d_V_tx": f64, "d_H,tx": f64, "d_V_rx": f64, "d_H,rx": f64, "d_g,V,tx": f64, "d_g,H,tx": f64, "d_g,V,rx": f64, "d_g,H,rx": f64, "d_rx,u": f64[3], "d_tx,s": f64[3], "Align BS-UT?": bool, "Introduce Blockages in System?": bool, "UT Blockage Data (A)": T4[][][], "UT Blockage Data (B)": "blk_inf_UT_B.gtype", "Blockage Model": T8, "Blockage Settings (B)": T9, "Blockage Settings (A)": T11, "BS": "UP_BS.gtype", "UT": T13}
diagram:
  Property Node(instance in=$UP_lnk_in) -> ("Scenario LOS-NLOS"=w1, "BS:M,tx"=w2, "BS:N,tx"=w3, "BS:M_g,tx"=w4, "BS:N_g,tx"=w5, "UT:M,rx"=w6, "UT:N,rx"=w7, "UT:M_g,rx"=w8, "UT:N_g,rx"=w9, instance out=w10)
  Multiply(w2, w3, w4, w5) -> w11
  Multiply(w6, w7, w8, w9) -> w12
  # NOTES:
  #
  # [1] final per antenna pair ce is either (7.5-27) in the NLOS case or (7.5-30) in the LOS case, hence the superscript LOS/NLOS has been dropped here.
  # [2] H_u,s,n,NLOS should be labeled as H_u,s,n in theory since, it can hold LOS or NLOS cluster values. however, to match the notation in the TR and the
  #      code here, we adopt the "NLOS" tag.
  # [3] 3D array, H_u,s,n is s x u x n
  for (N = w11) (iteration -> i1) {
    # BS antenna loop
    for (N = w12) (iteration -> i2) {
      Property Node(instance in=w10, "BS:s"=i1, "UT:u"=i2) -> (instance out=w17)
      call "calc_ant_elm_crd_upa.gvi"(UP_lnk_in=w17, error_in=$error_in) -> (UP_lnk_out=w18, error_out=w19)
      # UT antenna loop
      # [1]
      case (w1) {
        frame "UMi - Street Canyon (LOS)", Default {
          call "gen_coeff_nlos.gvi"(SSP_in=$SSP_in, error_in=w19, UP_lnk_in=w18, LSP_in=$LSP_in) -> (SSP_out=w24, error_out=w25, UP_lnk_out=w21, LSP_out=w22)
          Property Node(instance in=w24) -> ("H_u,s,NLOS"=w26, "H_u,s,n,NLOS"=w27, instance out=w28)
          call "gen_coeff_los.gvi"(UP_lnk_in=w18, LSP_in=$LSP_in, SSP_in=$SSP_in, error_in=w19) -> (error out=w29, SSP_out=w30)
          Property Node(instance in=w30) -> ("H_u,s,1,LOS"=w31)
          Property Node(instance in=$LSP_in) -> ("LSP:K"=w32)
          Increment(x=w32) -> w33
          Reciprocal(x=w33) -> w34
          Square Root(x=w34) -> w35
          Multiply(w26, w35) -> w36
          Multiply(w34, w32) -> w37
          Square Root(x=w37) -> w38
          Multiply(w31, w38) -> w39
          Add(w36, w39) -> w40
          Replace Array Subset(inArray=w27, index=0, new=w40) -> w41
          Property Node(instance in=w28, "H_u,s"=w40, "H_u,s,n,NLOS"=w41, "H_u,s,1,LOS"=w31) -> (instance out=w23)
          Merge Errors(w25, w29) -> (error out=w20)
        }
        frame "UMi - Street Canyon (NLOS)" {
          call "gen_coeff_nlos.gvi"(SSP_in=$SSP_in, error_in=w19, UP_lnk_in=w18, LSP_in=$LSP_in) -> (SSP_out=w23, error_out=w20, UP_lnk_out=w21, LSP_out=w22)
        }
      }
      Property Node(instance in=w23) -> ("H_u,s"=w42, "H_u,s,n,NLOS"=w43)
      append w42 to w15
      append w43 to w16
    }
    append w15 to w13
    append w16 to w14
  }
  $UP_lnk_out <- w21
  $LSP_out <- w22
  # [3]
  Property Node(instance in=w23, "H"=w13, "H_u,s,n"=w14) -> (instance out=w44)
  $SSP_out <- w44
  $"error out" <- w20
